# Grasshopper definition 1A-ExampleWithoutShapeDiverPlugin.ghx (Grasshopper 1.0.8)

# ----
# Parameters: All standard Grasshopper parameters can be used and will be converted automatically to parameters on the online platform.
# 
# The parameter names in Grasshopper will be used online so make sure to give each parameter a meaningful name.
number_slider = Slider(0.25, range=0..100)
# Example of a Grasshopper file compatible with ShapeDiver that does not use the ShapeDiver plugin.
# 
# The ShapeDiver plugin is not needed but will generate better materials and provides a lot of additional functionalities.
sizex = Slider(10, range=0..20)
sizey = Slider(10, range=0..20)
sizez = Slider(10, range=0..20)
box_color = ColourSwatch(SwatchColor=RGB(255, 255, 255))

# ----
# Grasshopper components: All the standard Grasshopper components can be used in your definitions.
# 
# Make sure to hide the preview for all components except for the final Display compononents.
material = CreateMaterial(
    Diffuse=box_color,
    Specular=RGB(255, 255, 255),
    Emission=RGB(0, 0, 0),
    Transparency=Slider(0.25, range=0..1),
    Shine=number_slider)
box = CenterBox(Base=PlaneXY(0, 0, 0), X=sizex, Y=sizey, Z=sizez)

# ----
# Meshing: Brep geometry is automatically converted to meshes when the model is uploaded to ShapeDiver. Therefore, achieve better performance and visual results by meshing all outputs manually whenever possible.
jagged = SettingsSpeed()
mesh = MeshBrep(Brep=box, Settings=jagged)

# ----
# Preview: You can use the Grasshopper 'Custom Preview' component along with the 'Create Material' component to display your geometry. However, we recommend using the display components from the ShapeDiver plugin (see next tutorial).
preview = CustomPreview(Geometry=mesh, Shader=material)
