# Grasshopper definition 1C-ExampleWithAppBuilder.ghx (Grasshopper 1.0.7)
# plug-ins: BitmapComponent, ShapeDiverForGrasshopper

# ----
# URL of a texture image: http://1.bp.blogspot.com/-QeZI4kfO-ts/UFwYngEHLQI/AAAAAAAACPQ/qTKLVMZjj-Y/s1600/Tileable+metal+eroded+scratch+texture+background+01.jpg
# Using images: Textures can be defined by connecting a string containing the URL of an image file, or by using the Bitmap primitive included in the ShapeDiver plugin. Add a GrasshopperBitmap element and Right-Click -> 'Set one GrasshopperBitmap'
#  to internalize a local image file.
# 
# The bitmap component can then be connected to texture inputs of the ShapeDiverMaterial component.
internalized_image = Bitmap(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)

# ----
# Parameters: All standard Grasshopper parameters can be used and will be converted automatically to parameters on the online platform.
# 
# The parameter names in Grasshopper will be used online so make sure to give each parameter a meaningful name.
# 
# In this example, inputs are ordered and grouped using App Builder components.
metalness = Slider(0.29, range=0..1)
roughness = Slider(0.5, range=0..1)
# Example of a Grasshopper file compatible with ShapeDiver that makes use the ShapeDiver plugin and the App Builder component.
# 
# The App Builder components are used to control the layout of the online App more precisely, and also open up many additional features.
sizex = Slider(10, range=0..20)
sizey = Slider(10, range=0..20)
sizez = Slider(10, range=0..20)
box_color = ColourSwatch(SwatchColor=RGBA(255, 255, 255, 207))

# ----
# Grasshopper components: All the standard Grasshopper components can be used in your definitions.
# 
# Make sure to hide the preview for all components except for the final preview compononents.
# ShapeDiver material components: Use Preset Material, Legacy Material or glTF 2.0 Material to define optimized materials for online rendering.
# 
# All PBR textures can be specified.
gltf2material = GlTF20Material(
    BaseColorFactor=box_color,
    BaseColorTexture=internalized_image,
    MetallicFactor=metalness,
    RoughnessFactor=roughness,
    EmissiveFactor=RGB(0, 0, 0),
    AlphaMode="BLEND",
    AlphaCutoff=0.5,
    DoubleSided=True)
box = CenterBox(Base=PlaneXY(0, 0, 0), X=sizex, Y=sizey, Z=sizez)

# ----
# Meshing: Brep geometry is automatically converted to meshes when the model is uploaded to ShapeDiver. Therefore, achieve better performance and visual results by meshing all outputs manually whenever possible.
# Legacy Display vs. glTF 2.0 Display: Read more about the differences between those two display approaches here:
# https://help.shapediver.com/doc/Display.1842479137.html
# 
# We recommend to use the glTF 2.0 workflow in general.
jagged = SettingsSpeed()
mesh = MeshBrep(Brep=box, Settings=jagged)

# ----
# Preview: You can use the Grasshopper 'Custom Preview' component along with the 'Create Material' component to display your geometry. However, we recommend using the display components from the ShapeDiver plugin.
# ShapeDiver display components: Use ShapeDiver Display or glTF 2.0 Display to create previews compatible with the ShapeDiver materials.
gltfdisplay = GlTF20Display(Geometry=mesh, Material=gltf2material)

# ----
# Build the App: In this example, we override the default layout by including some App Builder components.
# 
# The App contains one left container with two tabs. The first tab includes the size parameters of the box, while the second tab includes the material parameters.
panel = Panel("Box Color")
merge = Merge(Data1="SizeX", Data2="SizeY", Data3="SizeZ")
merge_2 = Merge(Data1=panel, Data2="Metalness", Data3="Roughness")
paramctrl = ParameterControl(Name=merge)
paramctrl_2 = ParameterControl(Name=merge_2)
controlswidget = ControlsWidget(Controls=paramctrl)
controlswidget_2 = ControlsWidget(Controls=paramctrl_2)
tab = Tab(Name="Size Parameters", AppBuilderWidgets=controlswidget)
tab_2 = Tab(Name="Material Parameters", AppBuilderWidgets=controlswidget_2)
merge_3 = Merge(Data1=tab, Data2=tab_2)
container = Container(Location="left", AppBuilderTabs=merge_3)
app = App(Containers=container)
