# Grasshopper definition 2A-DirectTextInput.ghx (Grasshopper 1.0.7)
# plug-ins: ShapeDiverForGrasshopper

# ----
# The Direct Text Input component will let users enter a text online and use it as a parameter of the model.
panel = Panel("Pi/6")
series = Series(Start=0, Step=panel, Count=12)
pln = Plane(PlaneYZ(0, 0, 0))
vec = VectorXYZ(XComponent=0, YComponent=10, ZComponent=0)  # -> Vector, Length
vec_2 = VectorXYZ(XComponent=0, YComponent=5, ZComponent=0)  # -> Vector, Length
move = Move(Geometry=pln, Motion=vec.Vector)  # -> Geometry, Transform
move_2 = Move(Geometry=pln, Motion=vec_2.Vector)  # -> Geometry, Transform
rotate = Rotate(Geometry=move.Geometry, Angle=series, Plane=pln)  # -> Geometry, Transform
rotate_2 = Rotate(Geometry=move_2.Geometry, Angle=series, Plane=pln)  # -> Geometry, Transform

# ----
# Text input: Right-click on the component to define a default text and the maximum length for the string typed by the user.
# 
# Rename the component to define the parameter name on ShapeDiver.
text_color = ColourSwatch(SwatchColor=RGB(36, 34, 186))
sdtextinput = ShapeDiverTextInput(maxlength=15, text="Try it!")

# ----
# Text tags: In addition to the 'Custom Preview' and the ShapeDiver Display components, ShapeDiver is also compatible with 2D and 3D text tags.
text_tag_3d = TextTag3D(Location=rotate.Geometry, Text=sdtextinput, Size=1, Colour=text_color, Justification=7)
text_tag = TextTag(Location=rotate_2.Geometry, Text=sdtextinput, Colour=text_color)
