# Grasshopper definition 2B-FileImports.ghx (Grasshopper 1.0.7)
# plug-ins: Human, ShapeDiverForGrasshopper, GrasshopperHyperGooComponents

# ----
# The ShapeDiver plugin contains three types of file input components: Import Text, Import Bitmap and Import Geometry.
# 
# The three components will generate an upload button in the ShapeDiver viewer which users can use to upload their own files.
# 
# User the context menu to define which file types should be allowed.
# 
# You can also input a URL string to define the default file if none was defined by the user.
# Import Text: For long texts, you can import a text file in Grasshopper instead of allowing users to manually enter text.
# 
# CSV files are accepted but you will need to parse them.
panel = Panel("https://shapediverdownloads.s3.amazonaws.com/staticassets/tryit.txt")

# ----
# Import Geometry: In Rhino 7, most geometry import file formats are supported. Double-click on the component to see the full list. Additionally, objects are imported with several of their file properties.
panel_2 = Panel("https://shapediverdownloads.s3.amazonaws.com/staticassets/bunny.obj")

# ----
# Import Bitmap: BMP, JPG, GIF, PNG and TIFF images are supported.
panel_3 = Panel("https://shapediverdownloads.s3.amazonaws.com/staticassets/fur.jpg")

# ----
# Import Stream: Import any file format as a memory stream. The stream along its detected format (content type) are output from the component.
panel_4 = Panel("https://shapediverdownloads.s3.amazonaws.com/DemoModels/240216_ExcelTest.xlsx")

# ----
# Naming: Give explicit names to the Import components. They will be used on the ShapeDiver platform as button labels.
importtxt = ImportText(
    URI=panel,
    maximum_file_size=52428800,
    selected_file_formats="application/json,application/xml,application/x-step,text/csv,text/plain")  # -> Text, Filename
importgeo = ImportGeometry(
    URI=panel_2,
    maximum_file_size=52428800,
    selected_file_formats="application/3dm,application/3ds,application/ai,application/amf,application/dgn,application/dwg,application/dxf,application/fbx,application/off,application/pdf,application/ply,application/postscript,application/skp,application/sla,application/slc,application/step,application/vda,application/wavefront-obj,image/svg+xml,model/3mf,model/iges,model/stl")  # -> Object, Material, Filename
importstream = ImportStream(
    URI=panel_4,
    maximum_file_size=52428800,
    selected_file_formats="application/3dm,application/3ds,application/ai,application/amf,application/dgn,application/dwg,application/dxf,application/fbx,application/gdf,application/json,application/msword,application/off,application/pdf,application/ply,application/postscript,application/rtf,application/skp,application/sla,application/slc,application/step,application/vda,application/vnd.openxmlformats-officedocument.spreadsheetml.sheet,application/vnd.openxmlformats-officedocument.wordprocessingml.document,application/wavefront-obj,application/xml,application/x-step,application/x-zip-compressed,application/zip,gltf+json,image/bmp,image/gif,image/jpeg,image/png,image/svg+xml,image/tif,image/vnd.radiance,model/3mf,model/gltf-binary,model/iges,model/stl,model/vnd.sdtf,model/vrml,text/csv,text/plain")  # -> Stream, ContentType, FileEnding, Filename
importbmp = ImportBitmap(URI=panel_3, maximum_file_size=52428800, selected_file_formats="image/bmp,image/gif,image/jpeg,image/png,image/tif")  # -> Bitmap, Width, Height, Filename

# ----
# Filename: All components expose the name of the imported file in the Filename output.
panel_5 = Panel(importgeo.Filename)
panel_6 = Panel(importbmp.Filename)
panel_7 = Panel(importtxt.Filename)

# ----
# Using Memory Streams: Memory Streams can be read and processed using Script components (C# and Python).
# 
# This is particularly useful in Rhino 8, where Script components can make use of external libraries and open up new worfklows (read Excel files, Zip archives, etc...)
data = Data(importstream.Stream)
panel_8 = Panel(data)

series = Series(Start=0, Step="Pi/6", Count=12)
pln = Plane(PlaneYZ(0, 0, 0))
vec = VectorXYZ(XComponent=0, YComponent=10, ZComponent=0)  # -> Vector, Length
vec_2 = VectorXYZ(XComponent=0, YComponent=5, ZComponent=0)  # -> Vector, Length
move = Move(Geometry=pln, Motion=vec.Vector)  # -> Geometry, Transform
move_2 = Move(Geometry=pln, Motion=vec_2.Vector)  # -> Geometry, Transform
rotate = Rotate(Geometry=move.Geometry, Angle=series, Plane=pln)  # -> Geometry, Transform
rotate_2 = Rotate(Geometry=move_2.Geometry, Angle=series, Plane=pln)  # -> Geometry, Transform

scaletextureobj = Slider(4.17, range=1..10)
sizeinputobj = Slider(20, range=10..30)
centerobject = CenterObject(C=importgeo.Object)
extractattr = ExtractAttributes(Object=importgeo.Object)

scale = Scale(Geometry=centerobject, Center=Point(0, 0, 0), Factor=sizeinputobj)  # -> Geometry, Transform
bbox = BoundingBox(Content=scale.Geometry, Plane=PlaneXY(0, 0, 0))  # -> Box, Box_2
boxmap = BoxMapping(Mesh=scale.Geometry, Box=bbox.Box)
scale_2 = Scale(Center=Point(0, 0, 0), Factor=scaletextureobj)  # -> Geometry, Transform
transformuv = TransformTextureUV(Mesh=boxmap, Transform=scale_2.Transform)

deconstructattr = DeconstructAttributes(Object=extractattr)  # -> Keys, Values
text_color = ColourSwatch(SwatchColor=RGB(36, 34, 186))

# ----
# Imported attributes: When they are supported in the input file format, several properties of the imported geometry are stored as attributes in te objects. Access them using the attribute components of the ShapeDiver plugin.
panel_9 = Panel(deconstructattr.Keys)
panel_10 = Panel(deconstructattr.Values)

# ----
# Text tags: In addition to the 'Custom Preview' and the 'ShapeDiverDisplayGeometry' components, ShapeDiver is also compatible with 2D and 3D text tags.
text_tag_3d = TextTag3D(Location=rotate.Geometry, Text=importtxt.Text, Size=1, Colour=text_color, Justification=7)
text_tag = TextTag(Location=rotate_2.Geometry, Text=importtxt.Text, Colour=text_color)

# ----
# Bitmap texture: Use the imported image file as a texture for the imported geometry.
gltf2material = GlTF20Material(
    BaseColorFactor=RGB(255, 255, 255),
    BaseColorTexture=importbmp.Bitmap,
    MetallicFactor=0,
    RoughnessFactor=1,
    EmissiveFactor=RGB(0, 0, 0),
    AlphaMode="OPAQUE",
    AlphaCutoff=0.5,
    DoubleSided=True)

gltfdisplay = GlTF20Display(Geometry=transformuv, Material=gltf2material)

# ==== cluster CenterObject
C = ClusterInput()
bbox = BoundingBox(Content=C, Plane=PlaneXY(0, 0, 0))  # -> Box, Box_2
debox = DeconstructBox(Box=bbox.Box)  # -> Plane, X, Y, Z
dedomain = DeconstructDomain(Domain=debox.X)  # -> Start, End
dedomain_2 = DeconstructDomain(Domain=debox.Y)  # -> Start, End
dedomain_3 = DeconstructDomain(Domain=debox.Z)  # -> Start, End
addition = Addition(A=dedomain.Start, B=dedomain.End)
addition_2 = Addition(A=dedomain_2.Start, B=dedomain_2.End)
addition_3 = Addition(A=dedomain_3.Start, B=dedomain_3.End)
division = Division(A=addition, B=2)
division_2 = Division(A=addition_2, B=2)
division_3 = Division(A=addition_3, B=2)
vec = VectorXYZ(XComponent=division, YComponent=division_2, ZComponent=division_3)  # -> Vector, Length
rev = Reverse(Vector=vec.Vector)
move = Move(Geometry=C, Motion=rev)  # -> Geometry, Transform
G = ClusterOutput(move.Geometry)
