# Grasshopper definition 2C-ImportWithAttributes.ghx (Grasshopper 1.0.7)
# plug-ins: ShapeDiverForGrasshopper, GrasshopperHyperGooComponents

# Imported CAD files come with ShapeDiver Attributes
# containing various document properties from the original file.
path = FilePath("C:\Users\mathi\Downloads\2C-ImportWithAttributes.3dm")
panel = Panel(path)
importgeo = ImportGeometry(
    URI=path,
    maximum_file_size=52428800,
    selected_file_formats="application/3dm,application/3ds,application/ai,application/amf,application/dgn,application/dwg,application/dxf,application/fbx,application/off,application/pdf,application/ply,application/postscript,application/skp,application/sla,application/slc,application/step,application/vda,application/wavefront-obj,image/svg+xml,model/3mf,model/iges,model/stl")  # -> Object, Material, Filename
mesh = Mesh(importgeo.Object)

# ----
# List all stored attributes: Use the Extract Attributes and Deconstruct Attributes components to list all stored attributes in the imported objects.
extractattr = ExtractAttributes(Object=mesh)
deconstructattr = DeconstructAttributes(Object=extractattr)  # -> Keys, Values
panel_2 = Panel(deconstructattr.Keys)
panel_3 = Panel(deconstructattr.Values)

# ----
# Custom Attributes: When importing CAD files, the data attached to objects with Rhino User Texts is mapped to custom ShapeDiver attributes.
# 
# In our example a User Text called "examplekey" is stored in the imported mesh, with the value "examplevalue".
# Stored User Text is contained
# in custom attributes
panel_4 = Panel("examplekey")
accesskey = AccessKey(Object=extractattr, Key=panel_4)
panel_5 = Panel(accesskey)

# ----
# Reserved Attributes: Reserved attributes include:
# * name
# * layer
# * nestedlayer
# * color
# * plotcolor
# * plotweight
# 
# These properties do not exist in all supported formats for importing. For example, there are no object names in OBJ. If they exist, they will always be included when importing.
# Document properties are
# contained in reserved attributes
panel_6 = Panel("name")
accesskey_2 = AccessKey(Object=extractattr, Key=panel_6)
panel_7 = Panel(accesskey_2)

# ----
# Display Attribute Values: In this model, we just use the Direct Data Output component to display and test the values of some attributes stored in the imported objects.
# 
# Learn more about the Direct Data Output component in tutorial 3E.
name = DirectDataOutput(Data=panel_7)
layer = DirectDataOutput(Data=panel_5)
