# Grasshopper definition 2D-SelectionInput_Basic.ghx (Grasshopper 1.0.7)
# plug-ins: ShapeDiverForGrasshopper, Pufferfish, GrasshopperHyperGooComponents

sddp = ShapeDiverDocumentPayload({AbsoluteTolerance=0, AngleTolerance=0, DistanceDisplayPrecision=0, GltfVersion="Gltf2", GrasshopperVersion="1.0.0007", InputGroups="{}", OutputGroups="{}", RelativeTolerance=0, RhinoVersion="7.38.24338.17001", UnitSystem=0, VersionCreated="1.20.0.0", VersionSaved="1.26.0.0"})
panel = Panel("Boxes.box_2")
selectbox = SelectionInput(
    Hover=True,
    MaxObjectsSelected=1,
    MinObjectsSelected=1,
    NameFilters_Branch0_Path="{0}",
    NameFilters_Branch0_Item0_null_string=False,
    NameFilters_Branch0_Item0_string="Boxes.*")

# ----
# Filter selectable objects: Use the Name filters option to specify which objects should be selectable.
# 
# In our example, we use a wildcard to filter all objects in the "Boxes" display component, regardless of their name:
# 
# "Boxes.*"
# Component output: Once online, the component returns the name of the selected object(s) in the viewer, if there are any.
# 
# Use the Local Test Data option to simulate selection in the online viewer.
# 
# In our example, we specify "Boxes.box_1" to simulate the selection of the corresponding object.
panel_2 = Panel(selectbox)

# ----
# In this example model, we use the Selection Input component to create several boxes that can be clicked on in the viewer.
# 
# When one of the boxes is clicked on, we draw a flat border around it.
mesh = Mesh(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)
mesh_2 = Mesh(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)
mesh_3 = Mesh(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)
merge = Merge(Data1=mesh, Data2=mesh_2, Data3=mesh_3)

# ----
# Give each object a name: Use the ShapeDiver Attribute system to store a name attribute in each object you want to make selectable.
# 
# The Selection Input then allows to specify which objects are selectable using their names.
series = Series(Start=1, Step=1, Count=3)
concat = Concatenate(FragmentA="box_", FragmentB=series)  # -> simplify(Result)
constructattr = ConstructAttributes(Keys="name", Values=graft(concat))  # -> flatten(Attributes)
injectattr = InjectAttributes(Object=merge, Attributes=constructattr)

# ----
# Use the selected object: Now that we have retrieved the selected object in the online viewer, we can use this information.
# 
# Here, we draw a flat border around the object that was selected.
panel_3 = Panel("_")
split = TextSplit(Text=panel_2, Separators=panel_3)
item = ListItem(List=split, Index=1, Wrap=True)
subtraction = Subtraction(A=item, B=1)
item_2 = ListItem(List=merge, Index=subtraction, Wrap=True)
brec = BoundingRectangle(Geometry=item_2, Plane=PlaneXY(0, 0, 0), Axis=0, Slide=0, Union=True)  # -> Bounding, DimensionX, DimensionY
len = Length(Curve=brec.Bounding)
division = Division(A=len, B=100)
addition = Addition(A=division, B=1)
offset = OffsetCurve(Curve=brec.Bounding, Distance=[division, addition], Corners=1)
loft = Loft(Curves=flatten(offset), Options={Adjust=False, Closed=False, LoftEnds=0, LoftSimp=0, LoftType=0, Rebuild=10, Refit=0.01})
border = GlTF20Display(Geometry=loft, Material=ColourSwatch(SwatchColor=RGB(0, 168, 50)))

# ----
# Use glTF 2.0 Display components: Selectable objects need to be part of a glTF 2.0 Display component.
# 
# The name of the component is also important, as there might be several such components in the definition! The Selection Input uses a dot-separated name for filtering objects: DISPLAY_COMPONENT_NAME.OBJECT_NAME
# Example: In our example, the name of the Display component is "Boxes", and the objects inside it are called "box_1", "box_2", etc...
boxes = GlTF20Display(Geometry=injectattr, Material=ColourSwatch(SwatchColor=RGB(255, 102, 102)))
