# Grasshopper definition 2E-SelectionInput_Advanced.ghx (Grasshopper 1.0.7)
# plug-ins: ShapeDiverForGrasshopper, Pufferfish, GrasshopperHyperGooComponents

sddp = ShapeDiverDocumentPayload({AbsoluteTolerance=0, AngleTolerance=0, DistanceDisplayPrecision=0, GltfVersion="Gltf2", GrasshopperVersion="1.0.0007", InputGroups="{}", OutputGroups="{}", RelativeTolerance=0, RhinoVersion="7.38.24338.17001", UnitSystem=0, VersionCreated="1.20.0.0", VersionSaved="1.26.0.0"})
# In this example model, we use the Selection Input component to create several boxes that can be clicked on in the viewer.
# 
# When one of the boxes is clicked on, we draw a flat border around it, and we show a color parameter corresponding to the selected box.
height1 = Slider(10, range=10..50)
height2 = Slider(40, range=10..50)
height3 = Slider(20, range=10..50)
panel = Panel("Boxes.box_2")
selectbox = SelectionInput(
    Hover=True,
    MaxObjectsSelected=1,
    MinObjectsSelected=1,
    NameFilters_Branch0_Path="{0}",
    NameFilters_Branch0_Item0_null_string=False,
    NameFilters_Branch0_Item0_string="Boxes.*")
color1 = ColourSwatch(SwatchColor=RGB(255, 0, 0))
color2 = ColourSwatch(SwatchColor=RGB(63, 235, 226))
color3 = ColourSwatch(SwatchColor=RGB(255, 112, 195))
mesh = Mesh(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)
mesh_2 = Mesh(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)
mesh_3 = Mesh(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)

# ----
# Filter selectable objects: Use the Name filters option to specify which objects should be selectable.
# 
# In our example, we use a wildcard to filter all objects in the "Boxes" display component, regardless of their name:
# 
# "Boxes.*"
# Component output: Once online, the component returns the name of the selected object(s) in the viewer, if there are any.
# 
# Use the Local Test Data option to simulate selection in the online viewer.
# 
# In our example, we specify "Boxes.box_1" to simulate the selection of the corresponding object.
panel_2 = Panel(selectbox)

merge = Merge(Data1=height1, Data2=height2, Data3=height3)
merge_2 = Merge(Data1=mesh, Data2=mesh_2, Data3=mesh_3)
merge_3 = Merge(Data1=color1, Data2=color2, Data3=color3)
gltf2material = GlTF20Material(
    BaseColorFactor=merge_3,
    MetallicFactor=0,
    RoughnessFactor=1,
    EmissiveFactor=RGB(0, 0, 0),
    AlphaMode="OPAQUE",
    AlphaCutoff=0.5,
    DoubleSided=True)  # -> simplify(graft(Material))
scale_nu = ScaleNU(Geometry=merge_2, Plane=PlaneXY(0, 0, 0), ScaleX=1, ScaleY=1, ScaleZ=merge)  # -> Geometry, Transform

# ----
# Give each object a name: Use the ShapeDiver Attribute system to store a name attribute in each object you want to make selectable.
# 
# The Selection Input then allows to specify which objects are selectable using their names.
panel_3 = Panel("material")
series = Series(Start=1, Step=1, Count=3)
merge_4 = Merge(Data1=panel_3, Data2="name")
concat = Concatenate(FragmentA="box_", FragmentB=series)  # -> simplify(graft(Result))
merge_5 = Merge(Data1=gltf2material, Data2=concat)
constructattr = ConstructAttributes(Keys=merge_4, Values=merge_5)  # -> flatten(Attributes)
injectattr = InjectAttributes(Object=scale_nu.Geometry, Attributes=constructattr)

# ----
# Use the selected object: Now that we have retrieved the selected object in the online viewer, we can use this information.
# 
# Here, we draw a flat border around the object that was selected.
geo = Geometry(scale_nu.Geometry)
split = TextSplit(Text=panel_2, Separators="_")
item = ListItem(List=split, Index=1, Wrap=True)
subtraction = Subtraction(A=item, B=1)
item_2 = ListItem(List=geo, Index=subtraction, Wrap=True)
brec = BoundingRectangle(Geometry=item_2, Plane=PlaneXY(0, 0, 0), Axis=0, Slide=0, Union=True)  # -> Bounding, DimensionX, DimensionY
len = Length(Curve=brec.Bounding)
division = Division(A=len, B=100)
addition = Addition(A=division, B=1)
offset = OffsetCurve(Curve=brec.Bounding, Distance=[division, addition], Corners=1)
loft = Loft(Curves=flatten(offset), Options={Adjust=False, Closed=False, LoftEnds=0, LoftSimp=0, LoftType=0, Rebuild=10, Refit=0.01})
border = GlTF20Display(Geometry=loft, Material=ColourSwatch(SwatchColor=RGB(0, 168, 50)))

num = Number(item)

# ----
# Use glTF 2.0 Display components: Selectable objects need to be part of a glTF 2.0 Display component.
# 
# The name of the component is also important, as there might be several such components in the definition! The Selection Input uses a dot-separated name for filtering objects: DISPLAY_COMPONENT_NAME.OBJECT_NAME
# Example: In our example, the name of the Display component is "Boxes", and the objects inside it are called "box_1", "box_2", etc...
boxes = GlTF20Display(Geometry=injectattr)

# ----
# Build the App: We build a simple App with just a single left container that contains:
# 
# * The Selection Input
# * The color parameter corresponding to the selected object, if it exists.
# * The height parameter corresponding to the selected object, if it exists.
num_2 = Number(num)
merge_6 = Merge(Data1="Color", Data2="Height")
null = NullItem(Item=num_2)  # -> NullFlags, InvalidFlags, Description
concat_2 = Concatenate(FragmentA=merge_6, FragmentB=num_2)
panel_4 = Panel(concat_2)
filter = StreamFilter(Gate=null.NullFlags, Stream0=panel_4)
merge_7 = Merge(Data1="SelectBox", Data2=filter)  # -> flatten(Result)

paramwidget = ParameterWidget(ParametersAndExports=merge_7, PreserveOrdering=True)

container = Container(Name="left", Widgets=paramwidget)
app = App(Containers=container)
