# Grasshopper definition 2G-GumballInput_Tutorial1.ghx (Grasshopper 1.0.7)
# plug-ins: ShapeDiverForGrasshopper, Pufferfish, GrasshopperHyperGooComponents

sddp = ShapeDiverDocumentPayload({AbsoluteTolerance=0, AngleTolerance=0, DistanceDisplayPrecision=0, GltfVersion="Gltf2", GrasshopperVersion="1.0.0007", InputGroups="{}", OutputGroups="{}", RelativeTolerance=0, RhinoVersion="7.38.24338.17001", UnitSystem=0, VersionCreated="1.20.0.0", VersionSaved="1.26.0.0"})

# ----
# Filter transformable objects: Use the Name filters option to specify which objects should be selectable.
# 
# In our example, we use a wildcard to filter all objects in the "Boxes" display component, regardless of their name:
# 
# "Boxes.*"
# Component output: Once online, the component returns the name of the transformed object(s) in the viewer, if there are any.
# 
# Use the Local Test Data option to test locally your definition.
# 
# In our example, we specify "Boxes.box_1 and Boxe.box_2" to simulate that both these objects were transformed in the viewer.
gumballinput = GumballInput(
    EnableTranslationAxes_X=True,
    EnableTranslationAxes_Y=True,
    EnableTranslationAxes_Z=True,
    EnableRotationAxes_X=True,
    EnableRotationAxes_Y=True,
    EnableRotationAxes_Z=True,
    EnableScalingAxes_X=True,
    EnableScalingAxes_Y=True,
    EnableScalingAxes_Z=True,
    NameFilters_Branch0_Path="{0}",
    NameFilters_Branch0_Item0_null_string=False,
    NameFilters_Branch0_Item0_string="Boxes.*",
    LocalTestData_Branch0_Path="{0}",
    LocalTestData_Branch0_Item0_null_string=False,
    LocalTestData_Branch0_Item0_string="Boxes.box_1",
    LocalTestData_Branch0_Item1_null_string=False,
    LocalTestData_Branch0_Item1_string="Boxes.box_2")  # -> Names, Transforms
panel = Panel(gumballinput.Transforms)
panel_2 = Panel(gumballinput.Names)
txt = Text(gumballinput.Names)
transform = Transform(gumballinput.Transforms)

# ----
# Test data =>
transform_2 = Transform([{TransformCount=1, Name="Translation", tx=0, ty=0, tz=15}, {TransformCount=1, Name="Translation", tx=0, ty=0, tz=20}])

# ----
# In this example model, we use the Gumball Input component to create an App where users can transform several boxes in the viewer.
# 
# When one of the boxes is transformed, we draw a flat border around it.
# Transformable objects
mesh = Mesh([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])

# ----
# Map transformations: Only the names and transformations of objects that were manipulated with the gumball are sent to the component. In this step, we map the transformations to the full array of transformable objects.
transform_3 = Transform(transform)
mesh_2 = Mesh(mesh)
txt_2 = Text(txt)
split = TextSplit(Text=txt_2, Separators="_")
lng = ListLength(List=mesh_2)
zerotran = ZeroedTransform()
item = ListItem(List=split, Index=1, Wrap=True)
repeat = RepeatData(Data=zerotran, Length=lng)
int = Integer(flatten(item))
replace = ReplaceItems(List=repeat, Item=transform_3, Indices=int, Wrap=False)
transform_4 = Transform(replace)

# ----
# Apply the transformations: In order to communicate with the App, the transformable objects should not be transformed directly in Grasshopper. Instead, one must attach the transformation as an attribute.
# IMPORTANT: Note that this method will not work if the objects themselves are further modified by the definition. See the second Gumball tutorial to handle this use case.
transform_5 = Transform(transform_4)
constructattr = ConstructAttributes(Keys="transform", Values=graft(transform_5))  # -> flatten(Attributes)

# ----
# Use the transformation data: Here we also use the transformation data to explicitely transform the objects and drive additional geometry in the definition.
mesh_3 = Mesh(mesh)
transform_6 = Transform(transform_4)
int_2 = Integer(int)
transform_7 = Transform(Geometry=mesh_3, Transform=transform_6)
item_2 = ListItem(List=transform_7, Index=int_2, Wrap=True)  # -> graft(Item)
brec = BoundingRectangle(Geometry=item_2, Plane=PlaneXY(0, 0, 0), Axis=0, Slide=0, Union=True)  # -> Bounding, DimensionX, DimensionY
len = Length(Curve=brec.Bounding)
division = Division(A=len, B=100)
addition = Addition(A=division, B=1)
offset = OffsetCurve(Curve=brec.Bounding, Distance=[division, addition], Corners=1)

trim = TrimTree(Tree=offset, Depth=1)

loft = Loft(Curves=trim, Options={Adjust=False, Closed=False, LoftEnds=0, LoftSimp=0, LoftType=0, Rebuild=10, Refit=0.01})
border = GlTF20Display(Geometry=loft, Material=ColourSwatch(SwatchColor=RGB(0, 168, 50)))

# ----
# Give each object a name: Use the ShapeDiver Attribute system to store a name attribute in each object you want to make selectable.
# 
# The Gumball Input then allows to specify which objects are transformable using their names.
series = Series(Start=0, Step=1, Count=3)
mesh_4 = Mesh(mesh)
concat = Concatenate(FragmentA="box_", FragmentB=series)  # -> simplify(Result)

addkvpair = AddModifyRemoveKeyValuePair(Object=constructattr, Key="name", Value=concat)

injectattr = InjectAttributes(Object=mesh_4, Attributes=addkvpair)

# ----
# Use glTF 2.0 Display components: Transformable objects need to be part of a glTF 2.0 Display component.
# 
# The name of the component is also important, as there might be several such components in the definition! The Gumball Input uses a dot-separated name for filtering objects: DISPLAY_COMPONENT_NAME.OBJECT_NAME
# Example: In our example, the name of the Display component is "Boxes", and the objects inside it are called "box_1", "box_2", etc...
boxes = GlTF20Display(Geometry=injectattr, Material=ColourSwatch(SwatchColor=RGB(255, 102, 102)))
