# Grasshopper definition 2H-Gumballinput_Tutorial2.ghx (Grasshopper 1.0.7)
# plug-ins: ShapeDiverForGrasshopper, Pufferfish, GrasshopperHyperGooComponents, Sasquatch

sddp = ShapeDiverDocumentPayload({AbsoluteTolerance=0, AngleTolerance=0, DistanceDisplayPrecision=0, GltfVersion="Gltf2", GrasshopperVersion="1.0.0007", InputGroups="{}", OutputGroups="{}", RelativeTolerance=0, RhinoVersion="7.38.24338.17001", UnitSystem=0, VersionCreated="1.20.0.0", VersionSaved="1.26.0.0"})

# ----
# In this example model, we use the Gumball Input component to create an App where users can transform several boxes in the viewer.
# 
# When the transformed boxes interact each other, we apply a solid difference to the first one.
# Filter transformable objects: Use the Name filters option to specify which objects should be selectable.
# 
# In our example, we use a wildcard to filter all objects in the "Boxes" display component, regardless of their name:
# 
# "Boxes.*"
# Component output: Once online, the component returns the name of the transformed object(s) in the viewer, if there are any.
# 
# Use the Local Test Data option to test locally your definition.
# 
# In our example, we specify "Boxes.box_0 and Boxe.box_1" to simulate that both these objects were transformed in the viewer.
gumballinput = GumballInput(
    EnableTranslationAxes_X=True,
    EnableTranslationAxes_Y=True,
    EnableTranslationAxes_Z=True,
    EnableRotationAxes_X=True,
    EnableRotationAxes_Y=True,
    EnableRotationAxes_Z=True,
    EnableScalingAxes_X=True,
    EnableScalingAxes_Y=True,
    EnableScalingAxes_Z=True,
    NameFilters_Branch0_Path="{0}",
    NameFilters_Branch0_Item0_null_string=False,
    NameFilters_Branch0_Item0_string="Boxes.*",
    LocalTestData_Branch0_Path="{0}",
    LocalTestData_Branch0_Item0_null_string=False,
    LocalTestData_Branch0_Item0_string="Boxes.box_0",
    LocalTestData_Branch0_Item1_null_string=False,
    LocalTestData_Branch0_Item1_string="Boxes.box_1",
    LocalTestTransforms_Branch0_Path="{0}",
    LocalTestTransforms_Branch0_Item0_Transform0_m00=1,
    LocalTestTransforms_Branch0_Item0_Transform0_m01=0,
    LocalTestTransforms_Branch0_Item0_Transform0_m02=0,
    LocalTestTransforms_Branch0_Item0_Transform0_m03=0,
    LocalTestTransforms_Branch0_Item0_Transform0_m10=0,
    LocalTestTransforms_Branch0_Item0_Transform0_m11=1,
    LocalTestTransforms_Branch0_Item0_Transform0_m12=0,
    LocalTestTransforms_Branch0_Item0_Transform0_m13=0,
    LocalTestTransforms_Branch0_Item0_Transform0_m20=0,
    LocalTestTransforms_Branch0_Item0_Transform0_m21=0,
    LocalTestTransforms_Branch0_Item0_Transform0_m22=1,
    LocalTestTransforms_Branch0_Item0_Transform0_m23=0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)  # -> Names, Transforms
panel = Panel(gumballinput.Names)
txt = Text(panel)
transform = Transform(gumballinput.Transforms)

# ----
# Test data =>
transform_2 = Transform([{TransformCount=1, Name="Translation", tx=15, ty=-5, tz=0}, {TransformCount=1, Name="Translation", tx=-20, ty=0, tz=5}])

# ----
# Transformable objects
brep = Brep([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])

# ----
# Map transformations: Only the names and transformations of objects that were manipulated with the gumball are sent to the component. In this step, we map the transformations to the full array of transformable objects.
transform_3 = Transform(transform)
txt_2 = Text(txt)
brep_2 = Brep(brep)
split = TextSplit(Text=txt_2, Separators="_")
lng = ListLength(List=brep_2)
zerotran = ZeroedTransform()
item = ListItem(List=split, Index=1, Wrap=True)
repeat = RepeatData(Data=zerotran, Length=lng)
int = Integer(flatten(item))

lng_2 = ListLength(List=txt_2)
larger = LargerThan(FirstNumber=lng_2, SecondNumber=0)  # -> LargerThan, OrEqualTo
filter = StreamFilter(Gate=larger.LargerThan, Stream1=int)

replace = ReplaceItems(List=repeat, Item=transform_3, Indices=filter, Wrap=False)
transform_4 = Transform(replace)

# ----
# Apply the transformations: In order to communicate with the App, the transformable objects should not be transformed directly in Grasshopper. Instead, one must attach the transformation as an attribute.
transform_5 = Transform(transform_4)
constructattr = ConstructAttributes(Keys="transform", Values=graft(transform_5))  # -> flatten(Attributes)

# ----
# Use the transformation data: Here we also use the transformation data to explicitely transform the objects and modify one of the boxes further.
# 
# Since we want the modifed box to still be associated with the gumball, we will need to apply the revers
brep_3 = Brep(brep)
transform_6 = Transform(transform_4)
int_2 = Integer(int)
transform_7 = Transform(Geometry=brep_3, Transform=transform_6)
item_2 = ListItem(List=transform_7, Index=0, Wrap=True)
item_3 = ListItem(List=transform_7, Index=1, Wrap=True)
sdiff = SolidDifference(BrepsA=item_3, BrepsB=item_2)
merge = Merge(Data1=item_2, Data2=sdiff)

offsetbrep = OffsetBrep(Brep=merge, OffsetDistance="-0.5", Solid=False, SharpEdges=True, Tolerance=0.01)
mesh = MeshBrep(
    Brep=offsetbrep,
    Settings={GridMaxCount=0, GridMinCount=16, JaggedSeams=False, MaxEdgeLength=0, MinEdgeLength=0.0001, MinTolerance=0, Refine=True, RefineAngle=0, RelativeTolerance=0.65, SimplePlanes=True, Tolerance=0})
mjoin = MeshJoin(Meshes=mesh)

mesh_2 = Mesh(flatten(mjoin))

# ----
# Apply the reverse transformation: Since we want the modifed box to still be associated with the gumball, we need to apply the reverse transformation to put the object back in its default position.
# 
# The stored transform attribute will again place it at the right location in the online viewer.
mesh_3 = Mesh(mesh_2)
transform_8 = Transform(transform_4)
inverse = InverseTransform(Transform=transform_8)
transform_9 = Transform(Geometry=mesh_3, Transform=inverse)
mesh_4 = Mesh(transform_9)

# ----
# Give each object a name: Use the ShapeDiver Attribute system to store a name attribute in each object you want to make selectable.
# 
# The Gumball Input then allows to specify which objects are transformable using their names.
series = Series(Start=0, Step=1, Count=2)
mesh_5 = Mesh(mesh_4)
concat = Concatenate(FragmentA="box_", FragmentB=series)  # -> simplify(Result)
addkvpair = AddModifyRemoveKeyValuePair(Object=constructattr, Key="name", Value=concat)
injectattr = InjectAttributes(Object=mesh_5, Attributes=addkvpair)

# ----
# Use glTF 2.0 Display components: Transformable objects need to be part of a glTF 2.0 Display component.
# 
# The name of the component is also important, as there might be several such components in the definition! The Gumball Input uses a dot-separated name for filtering objects: DISPLAY_COMPONENT_NAME.OBJECT_NAME
# Example: In our example, the name of the Display component is "Boxes", and the objects inside it are called "box_0" and "box_1".
boxes = GlTF20Display(Geometry=injectattr, Material=ColourSwatch(SwatchColor=RGB(255, 102, 102)))
