# Grasshopper definition 2I-PointsInputBasicTutorial.ghx (Grasshopper 1.0.7)
# plug-ins: ShapeDiverForGrasshopper, Pufferfish

# In this example model, we use a Points Input component
# which allows users of the ShapeDiver App to draw their own control polygon
# and create a Voronoi graph inside the boundary.
sddp = ShapeDiverDocumentPayload({AbsoluteTolerance=0, AngleTolerance=0, DistanceDisplayPrecision=0, GltfVersion="Gltf2", GrasshopperVersion="1.0.0007", InputGroups="{}", OutputGroups="{}", RelativeTolerance=0, RhinoVersion="7.38.24338.17001", UnitSystem=0, VersionCreated="1.21.0.0", VersionSaved="1.26.0.0"})
cells = Slider(140, range=50..300)
boundary = PointsInput(GridUnit=0, Mode="2", PlaneConstraint_plane=PlaneXY(0, 0, 0), DefaultValue_EdgeIndex=-1)
crv = Curve(boundary)

cp = ControlPoints(Curve=crv)  # -> Points, Weights, Knots
brec = BoundingRectangle(Geometry=crv, Plane=PlaneXY(0, 0, 0), Axis=0, Slide=0, Union=True)  # -> Bounding, DimensionX, DimensionY
lng = ListLength(List=cp.Points)
subtraction = Subtraction(A=lng, B=2)
pop2d = Populate2D(Region=brec.Bounding, Count=cells, Seed=1)
subset = SubList(List=cp.Points, Domain=subtraction, Wrap=True)  # -> List, Index
nurbs = NurbsCurve(Vertices=subset.List, Degree=3, Periodic=True)  # -> Curve, Length, Domain
extr = Extrude(Base=nurbs.Curve, Direction=Vector(0, 0, 1))
voronoi = Voronoi(Points=pop2d, Boundary=brec.Bounding, BruteForceOverride=False)
move = Move(Geometry=extr, Motion=Vector(0, 0, -0.5))  # -> Geometry, Transform
cap = CapHoles(Brep=move.Geometry)
trim = TrimWithBrep(Curve=voronoi, Brep=cap)  # -> Inside, Outside
crv_2 = Curve(trim.Inside)
clscrv = CloseCurve(Curve=crv_2, CloseType=0, Bulge=0.5, Tolerance=0)  # -> flatten(Closed), R

gltfdisplay = GlTF20Display(Geometry=clscrv.Closed)
