# Grasshopper definition 2J-PointsInputGeometryConstraints.ghx (Grasshopper 1.0.7)
# plug-ins: ShapeDiverForGrasshopper, GrasshopperHyperGooComponents

# In this example model, we set geometry constraints in a Points Input component
# to allow users of the online App to draw a polyline on a mesh.
sddp = ShapeDiverDocumentPayload({AbsoluteTolerance=0, AngleTolerance=0, DistanceDisplayPrecision=0, GltfVersion="Gltf2", GrasshopperVersion="1.0.0007", InputGroups="{}", OutputGroups="{}", RelativeTolerance=0, RhinoVersion="7.38.24338.17001", UnitSystem=0, VersionCreated="1.21.0.0", VersionSaved="1.26.0.0"})

# ----
# Use the name attribute: Set a name attribute in the object(s)
# that should be used for drawing
srf = Surface(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)
mesh = Mesh(srf)
constructattr = ConstructAttributes(Keys="name", Values="torus")
injectattr = InjectAttributes(Object=mesh, Attributes=constructattr)

# ----
# Define constraints in the Points Input
# Points Input: In the Points Input component, set the "Geometry Constraint" to: COMPONENT.NAME where:
# * COMPONENT is the name of a glTF 2.0 Display component.
# * NAME is the name attribute of an object contained in the component.
# 
# Several names can be specified (or the * wildcard) if one wants to allow drawing on several objects in the scene.
# Example: In our example, we have a component called "Meshes" with an object that has a name attribute set to "torus", so we specify "Meshes.torus".
pointsinput = PointsInput(
    GridUnit=0,
    Mode="1",
    PlaneConstraint=False,
    NameFilters_Branch0_Path="{0}",
    NameFilters_Branch0_Item0_null_string=False,
    NameFilters_Branch0_Item0_string="Meshes.torus",
    DefaultValue_EdgeIndex=-1)

# ----
# Example: We display a pipe where the polyline is drawn.
cp = ControlPoints(Curve=pointsinput)  # -> Points, Weights, Knots
srf_cp = SurfaceClosestPoint(Point=cp.Points, Surface=srf)  # -> Point, UVPoint, Distance
crvsrf = CurveOnSurface(Surface=srf, UVCoordinates=srf_cp.UVPoint, Closed=False)  # -> Curve, Length, Domain
thickness = Slider(0.2, range=0.1..1)
pipe = Pipe(Curve=crvsrf.Curve, Radius=thickness, Caps=0)
gltfdisplay = GlTF20Display(Geometry=pipe)

# ----
# Display component named "Meshes"
gltf2material = GlTF20Material(
    BaseColorFactor=ColourSwatch(SwatchColor=RGBA(255, 153, 153, 144)),
    MetallicFactor=0,
    RoughnessFactor=1,
    EmissiveFactor=RGB(0, 0, 0),
    AlphaMode="OPAQUE",
    AlphaCutoff=0.5,
    DoubleSided=True)
meshes = GlTF20Display(Geometry=injectattr, Material=gltf2material)
