# Grasshopper definition 3A-ExportComponentsBasicTutorial.ghx (Grasshopper 1.0.7)
# plug-ins: ShapeDiverForGrasshopper

# The ShapeDiver plugin includes two
# components for exporting to various file formats
# directly from the online viewer.
sizex = Slider(8, range=0..20)
sizey = Slider(18, range=0..20)
sizez = Slider(10, range=0..20)

box = CenterBox(Base=PlaneXY(0, 0, 0), X=sizex, Y=sizey, Z=sizez)
jagged = SettingsSpeed()
mesh = MeshBrep(Brep=box, Settings=jagged)

# ----
# Unroll the faces of the box
max = Maximum(A=sizex, B=sizey)
max_2 = Maximum(A=max, B=sizez)
demesh = DeconstructMesh(Mesh=mesh)  # -> Vertices, Faces, Colours, Normals
addition = Addition(A=max_2, B=0.5)
multiplication = Multiplication(A=addition, B=2)
conmesh = ConstructMesh(Vertices=demesh.Vertices, Faces=graft(demesh.Faces))  # -> flatten(Mesh)
series = Series(Start=0, Step=multiplication, Count=6)
vec = VectorXYZ(XComponent=series, YComponent=0, ZComponent=0)  # -> Vector, Length
facen = FaceNormals(Mesh=conmesh)  # -> Centers, Normals
medges = MeshEdges(Mesh=simplify(graft(conmesh)))  # -> simplify(NakedEdges), InteriorEdges, NonManifoldEdges
xy = XYPlane(Origin=Point(0, 0, 0))
pl = PlaneNormal(Origin=facen.Centers, ZAxis=facen.Normals)
move = Move(Geometry=xy, Motion=vec.Vector)  # -> Geometry, Transform
join = JoinCurves(Curves=medges.NakedEdges, Preserve=False)
orient = Orient(Geometry=simplify(join), Source=simplify(pl), Target=simplify(graft(move.Geometry)))  # -> flatten(Geometry), Transform

# ----
# Display: What is displayed in the ShapeDiver viewer is not necessarily what is being exported. For example, here we display an optimized mesh but we can still export a Brep object as well as 2D drawings.
# Display
gltf2material = GlTF20Material(
    BaseColorFactor=RGB(255, 255, 255),
    MetallicFactor=0,
    RoughnessFactor=1,
    EmissiveFactor=RGB(0, 0, 0),
    AlphaMode="OPAQUE",
    AlphaCutoff=0.5,
    DoubleSided=True)
gltfdisplay = GlTF20Display(Geometry=mesh, Material=gltf2material)

# ---- group: Download Export
# Export example 1: direct download
# Direct download example: In this case we use a Download Export component to export a Brep object in a 3dm file. This component will generate a download button in the online viewer and a download trigger function in the API.
# Export Options: There is one Export Options components for each supported export format. These components expose some relevant export options of Rhino.
brep = Brep(box)
export3dm = _3dmExportOptions(Version=7)
downloadexport = DownloadExport(Data=brep, Options=export3dm)

# ---- group: Email Export
# Export example 2: email export the unrolled faces
# Email export example: In this case we use an Email Export component to export a 2D drawing (set of curves) in a dwg file. This component will generate a button in the online viewer and a trigger in the API to send an email to the specified address.
# 
# With this component, the export file is never directly exposed to the user.
# Multiple email addresses: To, CC and BCC all accept an array of up to 5 email addresses
export_polycurves_as = ValueList({"Splines", "Lines", "Arcs", "Polylines", "Polybulges", "3Dpolylines"}, selected="Splines")
export_polylines_as = ValueList({"Polylines", "Lines", "3Dpolylines", "Splines"}, selected="Polylines")
export_curves_as = ValueList({"Splines", "Lines", "3Dpolylines", "Polylines"}, selected="Splines")
export_lines_as = ValueList({"Lines", "Polylines", "3Dpolylines", "Splines"}, selected="Lines")
export_arcs_as = ValueList({"Arcs", "Lines", "Polylines", "Polybulges", "3Dpolylines", "Splines"}, selected="Arcs")
save_surfaces_as = ValueList({"Curves", "Meshes", "Solids"}, selected="Curves")
save_meshes_as = ValueList({"Meshes", "3Dfaces"}, selected="Meshes")
arc_normals = ValueList({"Preserve", "Flip"}, selected="Preserve")
color_method = ValueList({"RGB", "ACI"}, selected="RGB")
format = ValueList({"dxf", "dwg"}, selected="dxf")
crv = Curve(orient.Geometry)
target_email = ShapeDiverTextInput(maxlength=100, text="youremail@shapediver.com")
exportdwgdxf = DrawingExportOptions(
    Format=format,
    SaveSurfacesAs=save_surfaces_as,
    SaveMeshesAs=save_meshes_as,
    Project=False,
    FullLayerPaths=False,
    ColorMethod=color_method,
    ArcNormals=arc_normals,
    LWPolylines=False,
    ExportLinesAs=export_lines_as,
    ExportArcsAs=export_arcs_as,
    ExportPolylinesAs=export_polylines_as,
    ExportCurvesAs=export_curves_as,
    ExportPolycurvesAs=export_polycurves_as,
    ExplodePolycurves=False,
    SplitAtKinks=False,
    N=False)
email_body = Panel("""Here you can include a pre-filled message in the email.

Include the macro __PARAMS__ to include the list of parameter values used for the export.""")
txt = Text(["email1@shapediver.com", "email2@shapediver.com"])
target_email_address = Panel(target_email)
cc_email_addresses = Panel(txt)
file_name = Panel("example_dwg_file")
email_subject = Panel("Export successful!")
attach_export = BooleanToggle(True)
attach_json = BooleanToggle(False)
emailexport = EmailExport(
    Data=crv,
    Options=exportdwgdxf,
    Name=file_name,
    To=target_email_address,
    CC=cc_email_addresses,
    ReplyTo=target_email_address,
    Subject=email_subject,
    Body=email_body,
    AttachExport=attach_export,
    AttachJSON=attach_json)
