# Grasshopper definition 3B-ExportWithAttributes.ghx (Grasshopper 1.0.7)
# plug-ins: ShapeDiverForGrasshopper, GrasshopperHyperGooComponents

# Use the ShapeDiver Attributes system to include metadata in exported objects.
# 
# The Export Attributes component allows to quickly set some standard attributes, when they are compatible with the chosen export format.
# 
# Custom attributes map to Rhino UserText key/value pairs.
sizex = Slider(8, range=0..20)
sizey = Slider(16, range=0..20)
sizez = Slider(4, range=0..20)

box = CenterBox(Base=PlaneXY(0, 0, 0), X=sizex, Y=sizey, Z=sizez)
jagged = SettingsSpeed()
mesh = MeshBrep(Brep=box, Settings=jagged)

demesh = DeconstructMesh(Mesh=mesh)  # -> Vertices, Faces, Colours, Normals
conmesh = ConstructMesh(Vertices=demesh.Vertices, Faces=graft(demesh.Faces))  # -> flatten(Mesh)

# ----
# Unroll the faces of the box
max = Maximum(A=sizex, B=sizey)
max_2 = Maximum(A=max, B=sizez)
addition = Addition(A=max_2, B=0.5)
multiplication = Multiplication(A=addition, B=2)
series = Series(Start=0, Step=multiplication, Count=6)
vec = VectorXYZ(XComponent=series, YComponent=0, ZComponent=0)  # -> Vector, Length
medges = MeshEdges(Mesh=simplify(graft(conmesh)))  # -> simplify(NakedEdges), InteriorEdges, NonManifoldEdges
facen = FaceNormals(Mesh=conmesh)  # -> Centers, Normals
xy = XYPlane(Origin=Point(0, 0, 0))
pl = PlaneNormal(Origin=facen.Centers, ZAxis=facen.Normals)
move = Move(Geometry=xy, Motion=vec.Vector)  # -> Geometry, Transform
join = JoinCurves(Curves=medges.NakedEdges, Preserve=False)
orient = Orient(Geometry=simplify(join), Source=simplify(pl), Target=simplify(graft(move.Geometry)))  # -> flatten(Geometry), Transform

# ----
# Display: What is displayed in the ShapeDiver viewer is not necessarily what is being exported. For example, here we display an optimized mesh but we can still export a Brep object as well as 2D drawings.
# Display
gltf2material = GlTF20Material(
    BaseColorFactor=RGB(255, 255, 255),
    MetallicFactor=0,
    RoughnessFactor=1,
    EmissiveFactor=RGB(0, 0, 0),
    AlphaMode="OPAQUE",
    AlphaCutoff=0.5,
    DoubleSided=True)

gltfdisplay = GlTF20Display(Geometry=mesh, Material=gltf2material)

# ----
# Define export attributes (reserved keys)
# Reserved attributes: In this example, we assign a different Name and Color to each curve, but all assign them to the same layer.
crv = Curve(orient.Geometry)
lng = ListLength(List=crv)
series_2 = Series(Start=1, Step=1, Count=lng)
division = Division(A=series_2, B=lng)
gradient = Gradient(LowerLimit=0, UpperLimit=1, Parameter=division, stops=[0: RGB(0, 128, 0), 0.5: RGB(255, 255, 0), 1: RGB(255, 0, 0)])
name_of_the_layer = Panel("Unrolled Curves")
concat = Concatenate(FragmentA="Curve_", FragmentB=series_2)
exportattr = ExportAttributes(Name=concat, Layer=name_of_the_layer, Color=gradient)

crv_2 = Curve(orient.Geometry)

# ----
# Define custom attributes
# Custom attributes: On top of the reserved attributes, which map to standard properties of the export formats, we define one custom attribute called area for each curve. This maps to UserText in Rhino.
area = Area(Geometry=crv_2)  # -> Area, Centroid
addkvpair = AddModifyRemoveKeyValuePair(Object=exportattr, Key="area", Value=area.Centroid)
injectattr = InjectAttributes(Object=crv_2, Attributes=addkvpair)

# ----
# Check the stored attribute values
extractattr = ExtractAttributes(Object=injectattr)
deconstructattr = DeconstructAttributes(Object=extractattr)  # -> Keys, Values
panel = Panel(deconstructattr.Values)
panel_2 = Panel(deconstructattr.Keys)

# ----
# Export with properties
# File format restrictions: Only the properties compatible with the chosen file format will be included in the exported files.
file_name = Panel("example_3dm_file")
export3dm = _3dmExportOptions(Version=7)

downloadexport = DownloadExport(Data=injectattr, Options=export3dm, Name=file_name)
