# Grasshopper definition 3E-DataOutputTypes.ghx (Grasshopper 1.0.7)
# plug-ins: ShapeDiverForGrasshopper

# Line
line = Line(Line((-11.14330457, 45.73879514, 0), (9.483333993, 24.10320857, 0)))
# NURBS Curve
# Color
swatch = ColourSwatch(SwatchColor=RGB(0, 34, 255))
# Box
# Transformation
box = Box({Plane=PlaneXY(1, 2, 3), X=Domain(0, 3), Y=Domain(0, 3), Z=Domain(0, 2)})
# Several types of Grasshopper types can be automatically converted
# and sent to the API using ShapeDiverDataOutput.
# See the list below.
# Points
pt = Point(Point(7.262389848, 5.778105791, 0))
# Plane
# NURBS Surface
pln = Plane(PlaneYZ(0, 0, 0))
# String
panel = Panel("Greetings from ShapeDiver")
# Number
num = Number(45)
# Domain
dom = ConstructDomain(DomainStart=1, DomainEnd=3)
crv = Curve(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)
rot3d = Rotate3D(Angle=1, Center=Point(0, 0, 0), Axis=Vector(1, 2, 3))  # -> Geometry, Transform
srf = Surface(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)
pointoutput = ShapeDiverDataOutput(Data=pt)
numberoutput = ShapeDiverDataOutput(Data=num)
stringoutput = ShapeDiverDataOutput(Data=panel)
lineoutput = ShapeDiverDataOutput(Data=line)
domainoutput = ShapeDiverDataOutput(Data=dom)
planeoutput = ShapeDiverDataOutput(Data=pln)
surfaceoutput = ShapeDiverDataOutput(Data=srf)
curveoutput = ShapeDiverDataOutput(Data=crv)
coloroutput = ShapeDiverDataOutput(Data=swatch)
boxoutput = ShapeDiverDataOutput(Data=box)
transformationoutput = ShapeDiverDataOutput(Data=rot3d.Transform)
