# Grasshopper definition 3H-ExportZipArchive.ghx (Grasshopper 1.0.7)
# plug-ins: ShapeDiverForGrasshopper, BitmapComponent

sddp = ShapeDiverDocumentPayload({AbsoluteTolerance=0, AngleTolerance=0, DistanceDisplayPrecision=0, GltfVersion="Gltf2", GrasshopperVersion="1.0.0007", InputGroups="{}", OutputGroups="{}", RelativeTolerance=0, RhinoVersion="7.38.24338.17001", UnitSystem=0, VersionCreated="1.20.0.0", VersionSaved="1.26.0.0"})
mesh = Mesh(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)
bmp = Bitmap(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)

# ----
# Create individual streams
# Create Stream: The Create Stream component works similarly to the standard ShapeDiver Export components. Feed data (D) and export options (O) for the embedded file format you want to create a memory stream for.
rhinoversion = ValueList({"7", "8"}, selected="7")
format = ValueList({"jpg", "png", "tiff", "bmp", "gif"}, selected="jpg")
exportimg = ImageExportOptions(Format=format, QualityLevel=100, N=False)
export3dm = _3dmExportOptions(Version=rhinoversion)
createstream = CreateStream(Data=bmp, Options=exportimg)
createstream_2 = CreateStream(Data=mesh, Options=export3dm)

# ----
# Display
mesh_2 = Mesh(mesh)
bmp_2 = Bitmap(bmp)
gltf2material = GlTF20Material(
    BaseColorFactor=RGB(255, 255, 255),
    BaseColorTexture=bmp_2,
    MetallicFactor=0,
    RoughnessFactor=1,
    EmissiveFactor=RGB(0, 0, 0),
    AlphaMode="OPAQUE",
    AlphaCutoff=0.5,
    DoubleSided=True)
gltfdisplay = GlTF20Display(Geometry=mesh_2, Material=gltf2material)

# ----
# Merge streams in
# a single one
# Zip Streams: Merge several streams and specify a file name (including the extension) for each of the streams.
# 
# The components outputs a new stream representing a zip archive that contains all specified files.
panel = Panel("mesh.3dm")
merge = Merge(Data1=createstream_2, Data2=createstream)
merge_2 = Merge(Data1=panel, Data2="image.jpg")
zipstreams = ZipStreams(Streams=merge, Filenames=merge_2)

# ----
# Export the merged stream
# as a zip archive
# Export the archive: Finally, the archive can be exported using the standard ShapeDiver components.
# 
# Use the stream export options and specify the zip file type in the ContentType input (C).
panel_2 = Panel("zip,application/zip")
exportstream = StreamExportOptions(ContentType=panel_2, N=False)
downloadexport = DownloadExport(Data=zipstreams, Options=exportstream, Name="example_archive")
