# Grasshopper definition 4A-DisplayBasicTutorial.ghx (Grasshopper 1.0.7)
# plug-ins: BitmapComponent, ShapeDiverForGrasshopper

display_method = ValueList({"Component Preview": 0, "Grashopper Custom Preview": 1, "ShapeDiver Legacy Display": 2, "ShapeDiver glTF 2.0 Display": 3}, selected="Component Preview")
# In this model, explore the different options you
# have to display geometry in the ShapeDiver viewer.
# 
# While it is possible to display geometry with native Grasshopper components,
# the display components of ShapeDiver are recommended for advanced control over material properties.
sddp = ShapeDiverDocumentPayload({AbsoluteTolerance=0, AngleTolerance=0, DistanceDisplayPrecision=0, GltfVersion="Gltf2", GrasshopperVersion="1.0.0007", InputGroups="{}", OutputGroups="{}", RelativeTolerance=0, RhinoVersion="7.38.24338.17001", UnitSystem=0, VersionCreated="1.26.0.0", VersionSaved="1.26.0.0"})
roughness = Slider(0, range=0..1)
metalness = Slider(0.5, range=0..1)
opacity = Slider(0.5, range=0..1)

# ----
# Switch between display methods: Use this value list to switch between the four ways to display geometry on ShapeDiver
# Display methods
mesh = Mesh(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)
gate = StreamGate(Stream=mesh, Gate=display_method)  # -> Target0, Target1, Target2, Target3
mesh_2 = Mesh(gate.Target0)
mesh_3 = Mesh(gate.Target1)
mesh_4 = Mesh(gate.Target2)
mesh_5 = Mesh(gate.Target3)

# ----
# Display options
# Display options: The various display methods include similar options, although they sometimes differ slightly between methods.
bmp = Bitmap(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)
col = Colour(ColourSwatch(SwatchColor=RGBA(0, 132, 255, 135)))
num = Number(opacity)
num_2 = Number(metalness)
num_3 = Number(roughness)

# ----
# glTF 2.0 Opacity: glTF 2.0 material include opacity directly in the alpa channel of the color factor, instead of exposing a separate input.
# ShapeDiver glTF 2.0 Display
# Metalness and Roughness: Unlike in the legacy material definition, glTF 2.0 Materials include a single texture input for MetalnessRoughness, using the blue channel for metalness and the green channel for roughness.
# ShapeDiver glTF 2.0 Display: The ShapeDiver glTF 2.0 Display component is the recommended one for most applications. It includes the most advanced material properties, including material naming (needed for various applications) and supports storing transformations in geometry.
col_2 = Colour(col)
bmp_2 = Bitmap(bmp)
num_4 = Number(num_3)
gltf2material = GlTF20Material(
    Name="MyMaterial",
    BaseColorFactor=col_2,
    BaseColorTexture=bmp_2,
    MetallicFactor=0,
    RoughnessFactor=num_4,
    EmissiveFactor=RGB(0, 0, 0),
    AlphaMode="OPAQUE",
    AlphaCutoff=0.5,
    DoubleSided=True)
mesh_6 = Mesh(mesh_5)
# << Recommended!
gltfdisplay = GlTF20Display(Geometry=mesh_6, Material=gltf2material)

# ----
# Custom Preview component
# Custom Preview: The Custom Preview component in Grasshopper allows to customize how geometry is displayed in Grasshopper. It is supported on ShapeDiver, but only provides limited options compared to the ShapeDiver components, which support glTF materials with textures.
panel = Panel("1")
num_5 = Number(opacity)
num_6 = Number(num_2)
col_3 = Colour(col)
subtraction = Subtraction(A=panel, B=num_5)
multiplication = Multiplication(A=num_6, B="100")
material = CreateMaterial(Diffuse=col_3, Specular=RGB(255, 255, 255), Emission=RGB(0, 0, 0), Transparency=subtraction, Shine=multiplication)
mesh_7 = Mesh(gate.Target1)

# ----
# ShapeDiver Legacy Display
# ShapeDiver Legacy Display: The ShapeDiver Legacy Display component creates PBR materials in the online viewer and allows to define various texture maps (color, metalness, roughness, normal, opacity). In most use cases, it is superseded by the more recent glTF 2.0 Display and Material components, but is still supported for backwards compatibility and because of slight differences and texture and geometry handling which might be relevant in some cases.
col_4 = Colour(col)
bmp_3 = Bitmap(bmp)
num_7 = Number(num_2)
num_8 = Number(num_3)
num_9 = Number(num)
sdmaterial = LegacyMaterial(Color=col_4, ColorMap=bmp_3, Metalness=num_7, Roughness=num_8, Opacity=num_9, FlatShading=False)
mesh_8 = Mesh(mesh_4)
sddisplay = LegacyDisplay(Geometry=mesh_8, ShapeDiverMaterial=sdmaterial)

# ----
# Component preview: Any component with the preview turned on will be displayed in the ShapeDiver viewer with a default material (i.e without any control over its material). Make sure to disable preview for all components except the ones that are meant to be displayed in the viewer.
# Component preview
mesh_9 = Mesh(mesh_2)
mesh_10 = Mesh(mesh_9)

preview = CustomPreview(Geometry=mesh_7, Material=material)
