# Grasshopper definition 4B-MaterialPresets.ghx (Grasshopper 1.0.7)
# plug-ins: ShapeDiverForGrasshopper

secondary_material = ValueList({"Default (0100)": 100, "Default Plastic (0200)": 200, "Default Metal (0300)": 300, "Used Metal (0301)": 301, "Metal Variation 1 (0302)": 302, "Metal Variation 2 (0303)": 303, "Gold (0310)": 310, "Used Gold (0311)": 311, "Default Glass (0400)": 400, "Default Wood (0500)": 500, "Wood Floor (0501)": 501, "Natural Oak (0510)": 510, "Premium Oak (0511)": 511, "Default Leather (0600)": 600, "Dark Brown Leather (0601)": 601, "Black Leather (0602)": 602, "Worn Leather (0610)": 610, "Default Fabric (0700)": 700, "Grey Fabric (0701)": 701}, selected="Default Wood (0500)")
# The Preset Material component contains a list of presets that are optimized for online use.
# 
# The presets are organized in families (default, metal, glass, wood, leather, fabric...).
# Some of them contain prefedined textures.
primary_material = ValueList({"Default (0100)": 100, "Default Plastic (0200)": 200, "Default Metal (0300)": 300, "Used Metal (0301)": 301, "Metal Variation 1 (0302)": 302, "Metal Variation 2 (0303)": 303, "Gold (0310)": 310, "Used Gold (0311)": 311, "Default Glass (0400)": 400, "Default Wood (0500)": 500, "Wood Floor (0501)": 501, "Natural Oak (0510)": 510, "Premium Oak (0511)": 511, "Default Leather (0600)": 600, "Dark Brown Leather (0601)": 601, "Black Leather (0602)": 602, "Worn Leather (0610)": 610, "Default Fabric (0700)": 700, "Grey Fabric (0701)": 701}, selected="Used Metal (0301)")
secondary_color = ColourSwatch(SwatchColor=RGB(255, 255, 255))
# Color input: The color inputs allow to modulate the appearance of the preset materials. If textures are present, the color modulates the one coming from the texture.
primary_color = ColourSwatch(SwatchColor=RGB(210, 212, 93))

presetmaterial = PresetMaterial(Color=primary_color, MaterialIndex=primary_material)
# Preview: The preset materials can include textures and other PBR properties and therefore cannot be previewed in Grasshopper. Upload the files and see how they look in the online viewer.
primary = Mesh([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])
gltfdisplay = GlTF20Display(Geometry=primary, Material=presetmaterial)

presetmaterial_2 = PresetMaterial(Color=secondary_color, MaterialIndex=secondary_material)
secondary = Mesh([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])
gltfdisplay_2 = GlTF20Display(Geometry=secondary, Material=presetmaterial_2)
