# Grasshopper definition 4C-RenderingGuide.ghx (Grasshopper 1.0.8)
# plug-ins: MeshEdit Components, treesloth01, Pufferfish, Human, GrasshopperHyperGooComponents, ShapeDiverForGrasshopper

# ---- group: Examples
# https://upload.wikimedia.org/wikipedia/commons/2/21/Physically_Based_Rendering_Sample_2.png
panel = Panel("https://i.ibb.co/LXZDXLrG/Wood-Polyhaven-Oak-Veneer01-Normal-256.jpg")

# ---- group: Door interior preset
door_interior_starting_point = ValueList({"Simple": 0, "Vertical": 1, "Rattan": 2}, selected="Vertical")

# ---- group: Door interior - vertical
door_interior_alpha_mode = ValueList({"OPAQUE", "BLEND", "MASK"}, selected="BLEND")
door_interior_base_texture = DirectTextInput(maxlength=10000)
door_interior_metalic_roughness_texture = DirectTextInput(maxlength=10000)
door_interior_normal_texture = DirectTextInput(
    maxlength=10000,
    text="https://project-textures.s3.us-east-1.amazonaws.com/bookshelf-assets-to-host/texture/glass/Glass_Normal.jpg")
door_interior_base_colour = ColourSwatch(SwatchColor=RGBA(87, 87, 87, 42))
door_interior_metalic_factor = Slider(0, range=0..1)
door_interior_roughness_factor = Slider(0, range=0..1)
gltf2material = GlTF20Material(
    BaseColorFactor=door_interior_base_colour,
    BaseColorTexture=door_interior_base_texture,
    MetallicFactor=door_interior_metalic_factor,
    RoughnessFactor=door_interior_roughness_factor,
    MetallicRoughnessTexture=door_interior_metalic_roughness_texture,
    NormalTexture=door_interior_normal_texture,
    EmissiveFactor=RGB(0, 0, 0),
    AlphaMode=door_interior_alpha_mode,
    AlphaCutoff=0.5,
    DoubleSided=True)

# ---- group: Door interior - rattan
door_interior_alpha_mode_2 = ValueList({"OPAQUE", "BLEND", "MASK"}, selected="MASK")
door_interior_base_texture_2 = DirectTextInput(
    maxlength=10000,
    text="https://project-textures.s3.us-east-1.amazonaws.com/bookshelf-assets-to-host/texture/rattanBase.png")
door_interior_metalic_roughness_texture_2 = DirectTextInput(maxlength=10000)
door_interior_normal_texture_2 = DirectTextInput(maxlength=10000)
door_interior_base_colour_2 = ColourSwatch(SwatchColor=RGB(186, 186, 186))
door_interior_metalic_factor_2 = Slider(0, range=0..1)
door_interior_roughness_factor_2 = Slider(1, range=0..1)
door_interior_alpha_cutout = Slider(0.85, range=0..1)
gltf2material_2 = GlTF20Material(
    BaseColorFactor=door_interior_base_colour_2,
    BaseColorTexture=door_interior_base_texture_2,
    MetallicFactor=door_interior_metalic_factor_2,
    RoughnessFactor=door_interior_roughness_factor_2,
    MetallicRoughnessTexture=door_interior_metalic_roughness_texture_2,
    NormalTexture=door_interior_normal_texture_2,
    EmissiveFactor=RGB(0, 0, 0),
    AlphaMode=door_interior_alpha_mode_2,
    AlphaCutoff=door_interior_alpha_cutout,
    DoubleSided=True)

# ---- group: Preset materials
door_interior_preset = ValueList({"Used Gold (0311)": 0311, "Default (0100)": 0100, "Default Plastic (0200)": 0200, "Default Metal (0300)": 0300, "Used Metal (0301)": 0301, "Metal Variation 1 (0302)": 0302, "Metal Variation 2 (0303)": 0303, "Gold (0310)": 0310, "Used Gold (0311)": 0311, "Default Glass (0400)": 0400, "Default Wood (0500)": 0500, "Wood Floor (0501)": 0501, "Natural Oak (0510)": 0510, "Premium Oak (0511)": 0511, "Default Leather (0600)": 0600, "Dark Brown Leather (0601)": 0601, "Black Leather (0602)": 0602, "Worn Leather (0610)": 0610, "Default Fabric (0700)": 0700, "Grey Fabric (0701)": 0701}, selected="Used Gold (0311)")
accent_preset = ValueList({"Used Gold (0311)": 0311, "Default (0100)": 0100, "Default Plastic (0200)": 0200, "Default Metal (0300)": 0300, "Used Metal (0301)": 0301, "Metal Variation 1 (0302)": 0302, "Metal Variation 2 (0303)": 0303, "Gold (0310)": 0310, "Used Gold (0311)": 0311, "Default Glass (0400)": 0400, "Default Wood (0500)": 0500, "Wood Floor (0501)": 0501, "Natural Oak (0510)": 0510, "Premium Oak (0511)": 0511, "Default Leather (0600)": 0600, "Dark Brown Leather (0601)": 0601, "Black Leather (0602)": 0602, "Worn Leather (0610)": 0610, "Default Fabric (0700)": 0700, "Grey Fabric (0701)": 0701}, selected="Used Gold (0311)")
body_preset = ValueList({"Used Gold (0311)": 0311, "Default (0100)": 0100, "Default Plastic (0200)": 0200, "Default Metal (0300)": 0300, "Used Metal (0301)": 0301, "Metal Variation 1 (0302)": 0302, "Metal Variation 2 (0303)": 0303, "Gold (0310)": 0310, "Used Gold (0311)": 0311, "Default Glass (0400)": 0400, "Default Wood (0500)": 0500, "Wood Floor (0501)": 0501, "Natural Oak (0510)": 0510, "Premium Oak (0511)": 0511, "Default Leather (0600)": 0600, "Dark Brown Leather (0601)": 0601, "Black Leather (0602)": 0602, "Worn Leather (0610)": 0610, "Default Fabric (0700)": 0700, "Grey Fabric (0701)": 0701}, selected="Used Gold (0311)")
body_base_colour = ColourSwatch(SwatchColor=RGB(255, 255, 255))
accent_colour = ColourSwatch(SwatchColor=RGB(255, 144, 0))
door_interior_colour = ColourSwatch(SwatchColor=RGB(255, 0, 212))
presetmaterial = PresetMaterial(Color=door_interior_colour, MaterialIndex=door_interior_preset)
presetmaterial_2 = PresetMaterial(Color=body_base_colour, MaterialIndex=body_preset)
presetmaterial_3 = PresetMaterial(Color=accent_colour, MaterialIndex=accent_preset)

# ---- group: Legs
legs_style = ValueList({"Straight": 0, "Cylinders": 1}, selected="Cylinders")
offset_from_floor = Slider(150, range=5..300)
leg_bar = Slider(20, range=10..50)
legoffset = Slider(30, range=0..50)
leg_metal = Slider(0.4, range=0.1..0.9)
leg_narrowing = Slider(0.38, range=0.3..1)

# ---- group: Drawers and doors
handle_style = ValueList({"Bar": 0, "Button": 1, "Rectangle": 2}, selected="Button")
drawers_heights_divided_with = ShapeDiverTextInput(maxlength=10000, text="100,100,100")
door_frame_thickness = Slider(15, range=0..50)
doors_corner_radius = Slider(2, range=0..10)
door = BooleanToggle(True)
shelf_drawers_gap = BooleanToggle(True)

# ---- group: Basic
doors_drawers_thickness = Panel("15")
walls_offset = Panel("0")

wardrobe_depth = Slider(346, range=300..500)
wardrobe_width = Slider(859, range=600..1200)
wardrobe_height = Slider(1654, range=1500..2000)
elongated_corners = Slider(30, range=0..40)
distance_between_shelves = Slider(320, range=200..400)
frame_thickness = Slider(15, range=5..25)

# ---- group: General visualisation
tolerance_distance = Panel("2")
weld_angle = Panel("1.5")
tolerance_angle = Panel("0.8")

textures_size = Slider(400, range=0..1000)

# ---- group: Body Custom Material
body_base_texture = DirectTextInput(
    maxlength=10000,
    text="https://project-textures.s3.us-east-1.amazonaws.com/bookshelf-assets-to-host/texture/wood_table_worn_1k/wood_table_worn_diff_1k.jpg")
body_metalic_roughness_texture = DirectTextInput(
    maxlength=10000,
    text="https://project-textures.s3.us-east-1.amazonaws.com/bookshelf-assets-to-host/texture/wood_table_worn_1k/wood_table_worn_rough_1k.jpg")
body_normal_texture = DirectTextInput(
    maxlength=10000,
    text="https://project-textures.s3.us-east-1.amazonaws.com/bookshelf-assets-to-host/texture/wood_table_worn_1k/wood_table_worn_nor_dx_1k.jpg")
body_base_colour_2 = ColourSwatch(SwatchColor=RGB(255, 255, 255))
body_metalic_factor = Slider(0, range=0..1)
body_roughness_factor = Slider(0.48, range=0..1)
gltf2material_3 = GlTF20Material(
    BaseColorFactor=body_base_colour_2,
    BaseColorTexture=body_base_texture,
    MetallicFactor=body_metalic_factor,
    RoughnessFactor=body_roughness_factor,
    MetallicRoughnessTexture=body_metalic_roughness_texture,
    NormalTexture=body_normal_texture,
    EmissiveFactor=RGB(0, 0, 0),
    AlphaMode="OPAQUE",
    AlphaCutoff=0.5,
    DoubleSided=True)
body = Material(gltf2material_3)

# ---- group: Accent Custom Material
accent_base_texture = DirectTextInput(
    maxlength=10000,
    text="https://project-textures.s3.us-east-1.amazonaws.com/bookshelf-assets-to-host/texture/metal/Metal_Color.jpg")
accent_metalic_roughness_texture = DirectTextInput(maxlength=10000)
accent_normal_texture = DirectTextInput(
    maxlength=10000,
    text="https://project-textures.s3.us-east-1.amazonaws.com/bookshelf-assets-to-host/texture/metal/Metal_Normal.jpg")
accent_base_colour = ColourSwatch(SwatchColor=RGB(176, 145, 134))
accent_metalic_factor = Slider(1, range=0..1)
accent_roughness_factor = Slider(0, range=0..1)
gltf2material_4 = GlTF20Material(
    BaseColorFactor=accent_base_colour,
    BaseColorTexture=accent_base_texture,
    MetallicFactor=accent_metalic_factor,
    RoughnessFactor=accent_roughness_factor,
    MetallicRoughnessTexture=accent_metalic_roughness_texture,
    NormalTexture=accent_normal_texture,
    EmissiveFactor=RGB(0, 0, 0),
    AlphaMode="OPAQUE",
    AlphaCutoff=0.5,
    DoubleSided=True)
accent = Material(gltf2material_4)

# ---- group: Door interior - simple
door_interior_base_colour_3 = ColourSwatch(SwatchColor=RGBA(0, 0, 0, 46))
gltf2material_5 = GlTF20Material(
    BaseColorFactor=door_interior_base_colour_3,
    MetallicFactor=0,
    RoughnessFactor=0,
    EmissiveFactor=RGB(0, 0, 0),
    AlphaMode="BLEND",
    AlphaCutoff=0.5,
    DoubleSided=True)

# ---- group: Checker texture
textinput = DirectTextInput(maxlength=10000, text="https://us.v-cdn.net/5021068/uploads/editor/ha/7frj09nru4zu.png")  # disabled
swatch = ColourSwatch(SwatchColor=RGB(255, 255, 255))  # disabled
gltf2material_6 = GlTF20Material(
    BaseColorFactor=swatch,
    BaseColorTexture=textinput,
    MetallicFactor=0,
    RoughnessFactor=1,
    EmissiveFactor=RGB(0, 0, 0),
    AlphaMode="OPAQUE",
    AlphaCutoff=0.5,
    DoubleSided=True)  # disabled
checker = Material(gltf2material_6)  # disabled

# ----
tolerance = ToleranceSettings(AbsoluteTolerance=0.001, RelativeTolerance=1, AngleTolerance=1, UnitSystem=3)
box = DomainBox(Base=PlaneXY(0, 0, 0), X=textures_size, Y=textures_size, Z=textures_size)
material_mode = ValueList({"Presets": 0, "Custom": 1}, selected="Custom")

# ---- group: Ground
ground_texture = DirectTextInput(
    maxlength=10000,
    text="https://project-textures.s3.us-east-1.amazonaws.com/bookshelf-assets-to-host/texture/ground/GroundTextureOnlyGlitter.png")
ground = BooleanToggle(True)
ground_scale = Slider(1.3, range=0.5..10)
ground_colour = ColourSwatch(SwatchColor=RGB(255, 255, 255))

# ----
wallsthick = Number(frame_thickness)
legthick = Number(frame_thickness)
shelfthick = Number(frame_thickness)
top_basethick = Number(frame_thickness)
texturemap = Box(box)

# ---- group: symmetry planes
wardrobeheight = Number(wardrobe_height)
offsetfloor = Number(offset_from_floor)
wardrobewidth = Number(wardrobe_width)
wallsoffset = Number(walls_offset)
addition = Addition(A=wardrobeheight, B=offsetfloor)
subtraction = Subtraction(A=wardrobewidth, B=wallsoffset)
division = Division(A=subtraction, B=2)
division_2 = Division(A=addition, B=2)
Z = UnitZ(Factor=division_2)
X = UnitX(Factor=division)
xy = XYPlane(Origin=Z)
yz = YZPlane(Origin=X)
xy_body_symmetry = Plane(xy)
yz_symmetry = Plane(yz)

# ----
filter = StreamFilter(Gate=door_interior_starting_point, Stream0=gltf2material_5, Stream1=gltf2material, Stream2=gltf2material_2)

# ---- group: Ground
tolerance_distance_2 = Number(tolerance_distance)
wardrobewidth_2 = Number(wardrobe_width)
wardrobedepth = Number(wardrobe_depth)
division_3 = Division(A=wardrobewidth_2, B=2)
division_4 = Division(A=wardrobedepth, B=2)
neg = Negative(Value=wardrobewidth_2)
neg_2 = Negative(Value=wardrobedepth)
pt = ConstructPoint(XCoordinate=division_3, YCoordinate=division_4, ZCoordinate=tolerance_distance_2)
dom = ConstructDomain(DomainStart=neg, DomainEnd=wardrobewidth_2)
dom_2 = ConstructDomain(DomainStart=neg_2, DomainEnd=wardrobedepth)
rectangle = Rectangle(Plane=pt, XSize=dom, YSize=dom_2, Radius=0)  # -> Rectangle, Length
scale = Scale(Geometry=rectangle.Rectangle, Center=pt, Factor=ground_scale)  # -> Geometry, Transform
gltf2material_7 = GlTF20Material(
    BaseColorFactor=ground_colour,
    BaseColorTexture=ground_texture,
    MetallicFactor=0,
    RoughnessFactor=1,
    EmissiveFactor=RGB(0, 0, 0),
    AlphaMode="BLEND",
    AlphaCutoff=0.5,
    DoubleSided=True)
mplane = MeshPlane(Boundary=scale.Geometry, WidthCount=1, HeightCount=1)  # -> Mesh, Area
filter_2 = StreamFilter(Gate=ground, Stream1=mplane.Mesh)

# ----
door_interior = Material(filter)
or = GateOr(A=door, B=shelf_drawers_gap)

merge = Merge(Data1=body, Data2=accent, Data3=door_interior)
merge_2 = Merge(Data1=presetmaterial_2, Data2=presetmaterial_3, Data3=presetmaterial)
filter_3 = StreamFilter(Gate=material_mode, Stream0=merge_2, Stream1=merge)
item = ListItem(List=filter_3, Index=0, Wrap=False)  # -> Item, Item1, Item2
body_2 = Material(item.Item)
accent_2 = Material(item.Item1)
door_frame = Material(item.Item1)
door_interior_2 = Material(item.Item2)

bool = Boolean(invert(or))
or_2 = GateOr(A=bool, B=shelf_drawers_gap)

# ---- group: Drawers and doors
wardrobeheight_2 = Number(wardrobe_height)
offsetfloor_2 = Number(offset_from_floor)
shelf_gap = Panel("0")
subtraction_2 = Subtraction(A=wardrobeheight_2, B=offsetfloor_2)
split = TextSplit(Text=drawers_heights_divided_with, Separators=",")
division_5 = Division(A=subtraction_2, B=2)
max = Maximum(A=shelf_gap, B=split)
min = Minimum(A=division_5, B=max)
shelf_drawers_gap_2 = Boolean(or_2)
drawerheights = Number(min)

# ----
door_2 = Boolean(door)
legstyle = Integer(legs_style)
wardrobewidth_3 = Number(wardrobe_width)
wardrobedepth_2 = Number(wardrobe_depth)
gltfdisplay = GlTF20Display(Geometry=filter_2, Material=gltf2material_7)
panel_2 = Panel("100")
rotate = Rotate(Angle=1.570796327, Plane=PlaneXY(0, 0, 0))  # -> Geometry, Transform

drawerheights_2 = Number(drawerheights)
null = NullItem(Item=drawerheights_2)  # -> NullFlags, InvalidFlags, Description
item_2 = ListItem(List=null.NullFlags, Index=0, Wrap=True)
drawers_remove = Boolean(item_2)

tolerance_distance_3 = Number(tolerance_distance)
textures_size_2 = Number(textures_size)
distance_between_shelves_2 = Number(distance_between_shelves)

# ---- group: External display
external_display_model_size = Slider(0.001, range=0.0001..1000)

# ---- group: External Display - Plant
plant_position_x = Slider(0.41, range=0.1..0.9)
plant_position_y = Panel("0.5")
plant_width = Slider(0.7, range=0.4..1)
plant_height = Slider(1, range=0.4..1)
plant_shelf = Slider(2, range=0..10)
plant = DirectTextInput(
    maxlength=10000,
    text="s3://shapediverexternalgeometry/bookshelf-assets-to-host/external_display/potted_plant_02_1k_scaled.glb")

# ---- group: External Display - Vase
vase_position_x = Slider(0.22, range=0.1..0.9)
vase_position_y = Panel("0.5")
vase_height = Slider(0.8, range=0.4..1)
vase_width = Slider(0.7, range=0.4..1)
vase_shelf = Slider(1, range=0..10)
vase = DirectTextInput(
    maxlength=10000,
    text="s3://shapediverexternalgeometry/bookshelf-assets-to-host/external_display/ceramic_vase_02_1k-scaled.glb")

# ---- group: External Display - Bust
bust_position_y = Panel("0.5")
bust_position_x = Slider(0.8, range=0.1..0.9)
bust_width = Slider(0.7, range=0.4..1)
bust_height = Slider(0.9, range=0.4..1)
bust_shelf = Slider(0, range=0..10)
bust = DirectTextInput(
    maxlength=10000,
    text="s3://shapediverexternalgeometry/bookshelf-assets-to-host/external_display/marble_bust_01_1k-scaled.glb")

# ----
presetmaterial_4 = PresetMaterial(Color=RGB(255, 255, 255), MaterialIndex=1)
panel_3 = Panel("""{1}
{1;*}""")
texturemap_2 = Box(texturemap)
mat = Material(door_interior_2)

# ---- group: Body
wardrobewidth_4 = Number(wardrobe_width)
wallsthick_2 = Number(wallsthick)
wardrobeheight_3 = Number(wardrobe_height)
wallsthick_3 = Number(wallsthick)
elongate_corner = Number(elongated_corners)
wardrobedepth_3 = Number(wardrobe_depth)
xy_body_symmetry_2 = Plane(xy_body_symmetry)
yz_symmetry_2 = Plane(yz_symmetry)
textures_size_3 = Number(textures_size)
texturemap_3 = Box(texturemap)
offsetfloor_3 = Number(offset_from_floor)
top_basethick_2 = Number(top_basethick)
wallsoffset_2 = Number(walls_offset)
subtraction_3 = Subtraction(A=wardrobedepth_3, B=wallsoffset_2)
addition_2 = Addition(A=offsetfloor_3, B=top_basethick_2)
subtraction_4 = Subtraction(A=addition_2, B=wallsthick_3)
addition_3 = Addition(A=wardrobedepth_3, B=wallsthick_2)
subtraction_5 = Subtraction(A=wallsoffset_2, B=elongate_corner)
dom_3 = ConstructDomain(DomainStart=0, DomainEnd=wardrobewidth_4)
dom_4 = ConstructDomain(DomainStart=wardrobedepth_3, DomainEnd=addition_3)
dom_5 = ConstructDomain(DomainStart=subtraction_4, DomainEnd=wardrobeheight_3)
merge_3 = Merge(Data1=subtraction_4, Data2=subtraction_4, Data3=addition_2, Data4=addition_2)
merge_4 = Merge(Data1=wallsoffset_2, Data2=wallsoffset_2, Data3=wallsthick_3, Data4=wallsthick_3)
merge_5 = Merge(Data1=subtraction_5, Data2=subtraction_3, Data3=subtraction_3, Data4=wallsoffset_2)
pt_2 = ConstructPoint(XCoordinate=merge_4, YCoordinate=merge_5, ZCoordinate=merge_3)
box_2 = DomainBox(Base=PlaneXY(0, 0, 0), X=dom_3, Y=dom_4, Z=dom_5)
pline = PolyLine(Vertices=pt_2, Closed=True)
mirror = Mirror(Geometry=pline, Plane=xy_body_symmetry_2)  # -> Geometry, Transform
mirror_2 = Mirror(Geometry=pline, Plane=yz_symmetry_2)  # -> Geometry, Transform
merge_6 = Merge(Data1=pline, Data2=mirror.Geometry)
merge_7 = Merge(Data1=mirror_2.Geometry, Data2=pline)
meshpatch = MeshPatch(OuterBoundary=graft(merge_6), AngleTolerance=0.1, Trimback=False, Divisions=1)
meshpatch_2 = MeshPatch(OuterBoundary=graft(merge_7), AngleTolerance=0.1, Trimback=False, Divisions=1)
loftmesh = LoftMesh(Polylines=merge_6, ComputeUV=True, IsometricUV=True, UVSize=textures_size_3)
loftmesh_2 = LoftMesh(Polylines=merge_7, ComputeUV=True, IsometricUV=True, UVSize=textures_size_3)
merge_8 = Merge(Data1=meshpatch, Data2=loftmesh)  # -> flatten(Result)
merge_9 = Merge(Data1=meshpatch_2, Data2=loftmesh_2)  # -> flatten(Result)
transform = Transform(Geometry=merge_8, Transform=mirror_2.Transform)
transform_2 = Transform(Geometry=merge_9, Transform=mirror.Transform)

# ----
mbox = MeshBox(Base=box_2, XCount=1, YCount=1, ZCount=1)

# ---- group: Straight legs with frame
wardrobewidth_5 = Number(wardrobe_width)
wardrobedepth_4 = Number(wardrobe_depth)
legthick_2 = Number(legthick)
wardrobeheight_4 = Number(wardrobe_height)
legthick_3 = Number(legthick)
subtraction_6 = Subtraction(A=wardrobewidth_5, B=legthick_2)
subtraction_7 = Subtraction(A=wardrobedepth_4, B=legthick_2)
merge_10 = Merge(Data1=0, Data2=0, Data3=subtraction_6, Data4=subtraction_6)
merge_11 = Merge(Data1=0, Data2=subtraction_7, Data3=subtraction_7, Data4=0)
pt_3 = ConstructPoint(XCoordinate=merge_10, YCoordinate=merge_11, ZCoordinate=0)

# ----
filter_4 = StreamFilter(Gate=legstyle, Stream0=legthick_3)

# ---- group: Straight legs with frame (continued)
box_3 = DomainBox(Base=pt_3, X=filter_4, Y=filter_4, Z=wardrobeheight_4)
mbox_2 = MeshBox(Base=box_3, XCount=1, YCount=1, ZCount=1)
mjoin = MeshJoin(Meshes=mbox_2)
legs = Mesh(mjoin)

# ---- group: Point Legs
offsetfloor_4 = Number(offset_from_floor)
leg_metal_2 = Number(leg_metal)
legthick_4 = Number(legthick)
leg_narrowing_2 = Number(leg_narrowing)
legstyle_2 = Integer(legs_style)
tolerance_angle_2 = Number(tolerance_angle)
textures_size_4 = Number(textures_size)
filter_5 = StreamFilter(Gate=legstyle_2, Stream1=legthick_4)
multiplication = Multiplication(A=offsetfloor_4, B=leg_metal_2)
multiplication_2 = Multiplication(A=filter_5, B=leg_narrowing_2)
division_6 = Division(A=filter_5, B=tolerance_angle_2)
twn2nums = TweenTwoNumbers(NumberA=multiplication_2, NumberB=filter_5, Factor=leg_metal_2)
Z_2 = UnitZ(Factor=multiplication)
Z_3 = UnitZ(Factor=offsetfloor_4)
polygon = Polygon(Plane=PlaneXY(0, 0, 0), Radius=multiplication_2, Segments=division_6, FilletRadius=0)  # -> Polygon, Length
polygon_2 = Polygon(Plane=PlaneXY(0, 0, 0), Radius=twn2nums, Segments=division_6, FilletRadius=0)  # -> Polygon, Length
polygon_3 = Polygon(Plane=PlaneXY(0, 0, 0), Radius=filter_5, Segments=division_6, FilletRadius=0)  # -> Polygon, Length
move = Move(Geometry=polygon_2.Polygon, Motion=Z_2)  # -> Geometry, Transform
move_2 = Move(Geometry=polygon_3.Polygon, Motion=Z_3)  # -> Geometry, Transform
merge_12 = Merge(Data1=move_2.Geometry, Data2=move.Geometry)
merge_13 = Merge(Data1=move.Geometry, Data2=polygon.Polygon)
loftmesh_3 = LoftMesh(Polylines=merge_12, ComputeUV=True, IsometricUV=True, UVSize=textures_size_4)

# ----
loftmesh_4 = LoftMesh(Polylines=merge_13, ComputeUV=True, IsometricUV=True, UVSize=textures_size_4)
cir = Circle(Plane=PlaneXY(0, 0, 0), Radius=textures_size_4)

# ---- group: Shelves
tolerance_angle_3 = Number(tolerance_angle)
wallsoffset_3 = Number(walls_offset)
wallsthick_4 = Number(wallsthick)
shelfthick_2 = Number(expr("-x", shelfthick))
door_drawerthick = Number(doors_drawers_thickness)
textures_size_5 = Number(textures_size)
addition_4 = Addition(A=wallsoffset_3, B=wallsthick_4)
subtraction_8 = Subtraction(A=wardrobewidth_3, B=addition_4)
addition_5 = Addition(A=door_drawerthick, B=wallsoffset_3)
subtraction_9 = Subtraction(A=wardrobedepth_2, B=addition_4)
dom_6 = ConstructDomain(DomainStart=addition_4, DomainEnd=subtraction_8)
dom_7 = ConstructDomain(DomainStart=addition_5, DomainEnd=subtraction_9)
rectangle_2 = Rectangle(Plane=PlaneXY(0, 0, 0), XSize=dom_6, YSize=dom_7, Radius=0)  # -> Rectangle, Length
topoly = CurveToPolyline(Curve=rectangle_2.Rectangle, ToleranceDistance=0, ToleranceAngle=tolerance_angle_3)  # -> Polyline, Segments
Z_4 = UnitZ(Factor=shelfthick_2)
move_3 = Move(Geometry=topoly.Polyline, Motion=Z_4)  # -> Geometry, Transform
merge_14 = Merge(Data1=topoly.Polyline, Data2=move_3.Geometry)
shelf = Rectangle(topoly.Polyline)

# ----
meshpatch_3 = MeshPatch(OuterBoundary=topoly.Polyline, AngleTolerance=0.1, Trimback=False, Divisions=1)
move_4 = Move(Geometry=meshpatch_3, Motion=Z_4)  # -> Geometry, Transform
loftmesh_5 = LoftMesh(Polylines=merge_14, ComputeUV=True, IsometricUV=True, UVSize=textures_size_5)

# ---- group: Drawers shelf
shelf_drawers_gap_3 = Boolean(shelf_drawers_gap_2)
wardrobewidth_6 = Number(wardrobe_width)
wardrobedepth_5 = Number(wardrobe_depth)
wallsthick_5 = Number(wallsthick)
elongate_corner_2 = Number(elongated_corners)
textures_size_6 = Number(textures_size)
division_7 = Division(A=elongate_corner_2, B=2)
filter_6 = StreamFilter(Gate=shelf_drawers_gap_3, Stream1=wardrobewidth_6)
neg_3 = Negative(Value=wallsthick_5)
neg_4 = Negative(Value=division_7)
Z_5 = UnitZ(Factor=neg_3)
division_8 = Division(A=neg_3, B=2)
dom_8 = ConstructDomain(DomainStart=0.5, DomainEnd=expr("x-2", filter_6))
Z_6 = UnitZ(Factor=division_8)
dom_9 = ConstructDomain(DomainStart=neg_4, DomainEnd=expr("x-2", wardrobedepth_5))
rectangle_3 = Rectangle(Plane=PlaneXY(0, 0, 0), XSize=dom_8, YSize=dom_9, Radius=0)  # -> Rectangle, Length
move_5 = Move(Geometry=rectangle_3.Rectangle, Motion=Z_6)  # -> Geometry, Transform

# ----
neg_5 = Negative(Value=division_7)
offset_l = OffsetCurveLoose(Curve=rectangle_3.Rectangle, Distance=neg_5)
topoly_2 = CurveToPolyline(Curve=offset_l, ToleranceDistance=0, ToleranceAngle=0)  # -> Polyline, Segments

# ---- group: Drawers shelf (continued)
move_6 = Move(Geometry=topoly_2.Polyline, Motion=Z_5)  # -> Geometry, Transform
merge_15 = Merge(Data1=topoly_2.Polyline, Data2=move_6.Geometry)
merge_16 = Merge(Data1=offset_l, Data2=move_5.Geometry, Data3=move_6.Geometry)

# ----
meshpatch_4 = MeshPatch(OuterBoundary=merge_15, AngleTolerance=0.1, Trimback=False, Divisions=1)
loftmesh_6 = LoftMesh(Polylines=merge_16, ComputeUV=True, IsometricUV=True, UVSize=textures_size_6)

# ---- group: Drawers shelf (continued)
merge_17 = Merge(Data1=meshpatch_4, Data2=loftmesh_6)  # -> flatten(Result)
drawers_shelf = Geometry(merge_17)

# ---- group: Body (continued)
boxmap = BoxMapping(Mesh=mbox, Box=texturemap_3)
merge_18 = Merge(Data1=merge_8, Data2=transform, Data3=boxmap, Data4=merge_9, Data5=transform_2)  # -> flatten(Result)

# ----
transformuv = TransformTextureUV(Mesh=merge_18, Transform=rotate.Transform)
unweld = UnweldMesh(Mesh=transformuv, Angle=0)

# ---- group: Body (continued)
body_3 = Data(unweld)

# ----
sides = Geometry(body_3)

# ---- group: Point Legs (continued)
merge_19 = Merge(Data1=loftmesh_3, Data2=loftmesh_4)

# ----
weld = WeldMesh(Mesh=merge_19, Angle=3.141592654)
cylindermap = CylinderMapping(Mesh=weld, BaseCircle=cir, Height=textures_size_4)  # -> MappedMesh, MappingCylinder

# ---- group: Point Legs (continued)
leg = Geometry(cylindermap.MappedMesh)

# ---- group: Legs frame
leg_2 = Mesh(leg)
textures_size_7 = Number(textures_size)
offsetfloor_5 = Number(offset_from_floor)
leg_bar_2 = Number(leg_bar)
wallsthick_6 = Number(wallsthick)
legthick_5 = Number(legthick)
legoffset_2 = Number(legoffset)
wardrobewidth_7 = Number(wardrobe_width)
wardrobedepth_6 = Number(wardrobe_depth)
legstyle_3 = Integer(legs_style)
filter_7 = StreamFilter(Gate=legstyle_3, Stream1=offsetfloor_5)
addition_6 = Addition(A=legthick_5, B=legoffset_2)
pt_4 = ConstructPoint(XCoordinate=addition_6, YCoordinate=addition_6, ZCoordinate=0)
addition_7 = Addition(A=addition_6, B=addition_6)
larger = LargerThan(FirstNumber=filter_7, SecondNumber=leg_bar_2)  # -> LargerThan, OrEqualTo
subtraction_10 = Subtraction(A=filter_7, B=leg_bar_2)
Z_7 = UnitZ(Factor=leg_bar_2)
subtraction_11 = Subtraction(A=wardrobewidth_7, B=addition_7)
subtraction_12 = Subtraction(A=wardrobedepth_6, B=addition_7)
filter_8 = StreamFilter(Gate=larger.LargerThan, Stream1=subtraction_10)
rectangle_4 = Rectangle(Plane=pt_4, XSize=subtraction_11, YSize=subtraction_12, Radius=0)  # -> Rectangle, Length
Z_8 = UnitZ(Factor=filter_8)
explode = Explode(Curve=rectangle_4.Rectangle, Recursive=True)  # -> Segments, Vertices
move_7 = Move(Geometry=rectangle_4.Rectangle, Motion=Z_8)  # -> Geometry, Transform
neg_6 = Negative(Value=wallsthick_6)
cull_i = CullIndex(List=explode.Vertices, Indices=4, Wrap=False)  # -> graft(List)
offset_l_2 = OffsetCurveLoose(Curve=move_7.Geometry, Distance=neg_6)
meshpatch_5 = MeshPatch(OuterBoundary=move_7.Geometry, AngleTolerance=0.1, HoleBoundaries=offset_l_2, Trimback=False, Divisions=1)
attachtransform = AttachTransformations(Geometry=leg_2, Transform=cull_i)
merge_20 = Merge(Data1=offset_l_2, Data2=move_7.Geometry)
move_8 = Move(Geometry=merge_20, Motion=Z_7)  # -> Geometry, Transform
merge_21 = Merge(Data1=graft(move_8.Geometry), Data2=graft(merge_20))
loftmesh_7 = LoftMesh(Polylines=merge_21, ComputeUV=True, IsometricUV=True, UVSize=textures_size_7)
merge_22 = Merge(Data1=flatten(loftmesh_7), Data2=meshpatch_5)
mjoin_2 = MeshJoin(Meshes=merge_22)
leg_bar_3 = Mesh(mjoin_2)
legs_in_place = Mesh(attachtransform)

# ---- group: Legs and body
straight_legs = Mesh(legs)
leg_bar_4 = Mesh(leg_bar_3)
point_legs_in_place = Mesh(legs_in_place)
mat_2 = Material(body_2)
mat_3 = Material(accent_2)
item_3 = ListItem(List=point_legs_in_place, Index=0, Wrap=False)  # -> flatten(Item), flatten(Item1)
merge_23 = Merge(Data1=sides, Data2=straight_legs, Data3=leg_bar_4, Data4=item_3.Item)
legsbottom = GlTF20Display(Geometry=item_3.Item1, Material=mat_3)

# ----
body_4 = GlTF20Display(Geometry=merge_23, Material=mat_2)

# ---- group: Shelves (continued)
merge_24 = Merge(Data1=meshpatch_3, Data2=loftmesh_5, Data3=move_4.Geometry)

# ----
mjoin_3 = MeshJoin(Meshes=merge_24)

# ---- group: Shelves (continued)
shelfbasemesh = Geometry(mjoin_3)

# ---- group: Handles
drawers_remove_2 = Boolean(drawers_remove)
handlestyle = Integer(handle_style)
base_length = Panel("20")
weld_angle_2 = Number(weld_angle)
wardrobewidth_8 = Number(wardrobe_width)
door_3 = Boolean(door_2)
barhandlemesh = Mesh(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)
radius = Panel("30")
legthick_6 = Number(expr("x*2", legthick))
rechandlemeshdoors = Mesh(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)
rechandlemeshdrawers = Mesh(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)
subtraction_13 = Subtraction(A=wardrobewidth_8, B=legthick_6)
rotate_2 = Rotate(Geometry=barhandlemesh, Angle=1.570796327, Plane=PlaneXZ(0, 0, 0))  # -> Geometry, Transform
merge_25 = Merge(Data1=0, Data2=base_length)
num = Number(expr("x/2", subtraction_13))
num_2 = Number(expr("x/5", subtraction_13))
Y = UnitY(Factor=expr("-x", merge_25))
subtraction_14 = Subtraction(A=num, B=num_2)
xz = XZPlane(Origin=Y)
neg_7 = Negative(Value=subtraction_14)
polygon_4 = Polygon(Plane=xz, Radius=expr("x/3", radius), Segments=10, FilletRadius=0)  # -> Polygon, Length
X_2 = UnitX(Factor=[neg_7, subtraction_14])
move_9 = Move(Geometry=rechandlemeshdrawers, Motion=X_2)  # -> Geometry, Transform
mjoin_4 = MeshJoin(Meshes=move_9.Geometry)

# ----
topoly_3 = CurveToPolyline(Curve=polygon_4.Polygon, ToleranceDistance=0, ToleranceAngle=0)  # -> Polyline, Segments
meshpatch_6 = MeshPatch(OuterBoundary=topoly_3.Polyline, AngleTolerance=0.1, Trimback=False, Divisions=1)
loftmesh_8 = LoftMesh(Polylines=polygon_4.Polygon, ComputeUV=True, IsometricUV=True, UVSize=textures_size_2)
handle_radius = Number(radius)

# ---- group: Prepare shelf sizes
wardrobewidth_9 = Number(wardrobe_width)
legthick_7 = Number(legthick)
shelfthick_3 = Number(shelfthick)
shelf_gap_2 = Number(shelf_gap)
shelf_drawers_gap_4 = Boolean(shelf_drawers_gap_2)
wallsthick_7 = Number(wallsthick)
drawers_shelf_2 = Mesh(drawers_shelf)
top_basethick_3 = Number(top_basethick)
offsetfloor_6 = Number(offset_from_floor)
drawerheights_3 = Number(drawerheights)
drawers_remove_3 = Boolean(drawers_remove)
min_2 = Minimum(A=shelfthick_3, B=shelf_gap_2)
addition_8 = Addition(A=top_basethick_3, B=offsetfloor_6)
subtraction_15 = Subtraction(A=wardrobewidth_9, B=legthick_7)
filter_9 = StreamFilter(Gate=shelf_drawers_gap_4, Stream0=min_2, Stream1=wallsthick_7)
addition_9 = Addition(A=min_2, B=drawerheights_3)
filter_10 = StreamFilter(Gate=drawers_remove_3, Stream0=subtraction_15)
filter_11 = StreamFilter(Gate=drawers_remove_3, Stream0=addition_9)
ma = MassAddition(Input=filter_11)  # -> Result, PartialResults
addition_10 = Addition(A=addition_8, B=ma.PartialResults)
subtraction_16 = Subtraction(A=addition_10, B=min_2)
filter_12 = StreamFilter(Gate=shelf_drawers_gap_4, Stream0="0", Stream1="1")
merge_26 = Merge(Data1=flatten(addition_8), Data2=flatten(addition_10))
split_2 = SplitList(List=reverse(subtraction_16), Index=filter_12)  # -> ListA, ListB
split_3 = SplitList(List=reverse(addition_10), Index=filter_12)  # -> ListA, ListB
lng = ListLength(List=merge_26)  # -> expr("x-1", Length)
Z_9 = UnitZ(Factor=split_3.ListA)
rev = ReverseList(List=split_3.ListB)
split_4 = SplitList(List=merge_26, Index=lng)  # -> ListA, ListB
rev_2 = ReverseList(List=split_2.ListB)
subtraction_17 = Subtraction(A=rev_2, B=shelfthick_3)
subtraction_18 = Subtraction(A=split_2.ListA, B=filter_9)
move_10 = Move(Geometry=drawers_shelf_2, Motion=Z_9)  # -> Geometry, Transform
filter_13 = StreamFilter(Gate=shelf_drawers_gap_4, Stream1=subtraction_18)
merge_27 = Merge(Data1=filter_13, Data2=split_2.ListB)  # -> reverse(Result)
drawers_shelves_height_top = Number(subtraction_17)
drawers_height_bottom = Number(merge_27)
drawers_shelf_3 = Mesh(move_10.Geometry)
drawers_shelves_height_bottom = Number(rev)
drawers_doors_heights = Number(split_4.ListA)
drawers_doors_heights_2 = Number(split_4.ListB)

# ----
division_9 = Division(A=wardrobewidth_9, B=2)
subtraction_19 = Subtraction(A=division_9, B=tolerance_distance_3)

# ---- group: Prepare shelf sizes (continued)
merge_28 = Merge(Data1=filter_10, Data2=subtraction_19)
dom_10 = ConstructDomain(DomainStart=expr("x+1", legthick_7), DomainEnd=expr("x-1", graft(merge_28)))  # -> simplify(Domain)
drawers_door_width = Domain(dom_10)

# ---- group: Handles (continued)
merge_29 = Merge(Data1=loftmesh_8, Data2=flatten(meshpatch_6))
mjoin_5 = MeshJoin(Meshes=merge_29)

# ----
weld_2 = WeldMesh(Mesh=mjoin_5, Angle=weld_angle_2)

# ---- group: Handles (continued)
move_11 = Move(Geometry=weld_2, Motion=X_2)  # -> Geometry, Transform
mjoin_6 = MeshJoin(Meshes=move_11.Geometry)
filter_14 = StreamFilter(Gate=handlestyle, Stream0=barhandlemesh, Stream1=mjoin_6, Stream2=mjoin_4)
filter_15 = StreamFilter(Gate=handlestyle, Stream0=rotate_2.Geometry, Stream1=weld_2, Stream2=rechandlemeshdoors)

# ----
filter_16 = StreamFilter(Gate=drawers_remove_2, Stream0=filter_14)
filter_17 = StreamFilter(Gate=door_3, Stream1=filter_15)

# ---- group: Handles (continued)
drawerhandlemesh = Mesh(filter_16)
doorhandlemesh = Mesh(filter_17)

# ---- group: Drawer Shelves
drawers_exist = Boolean(invert(drawers_remove))
drawers_shelves_height_top_2 = Number(drawers_shelves_height_top)
drawers_shelves_height_bottom_2 = Number(drawers_shelves_height_bottom)
wallsoffset_4 = Number(walls_offset)
wardrobedepth_7 = Number(wardrobe_depth)
drawers_shelf_4 = Mesh(drawers_shelf_3)
wardrobewidth_10 = Number(wardrobe_width)
wallsthick_8 = Number(wallsthick)
door_drawerthick_2 = Number(doors_drawers_thickness)
dom_11 = ConstructDomain(DomainStart=drawers_shelves_height_top_2, DomainEnd=drawers_shelves_height_bottom_2)
addition_11 = Addition(A=wallsoffset_4, B=wallsthick_8)
filter_18 = StreamFilter(Gate=drawers_exist, Stream0=dom_11)
subtraction_20 = Subtraction(A=wardrobewidth_10, B=addition_11)
subtraction_21 = Subtraction(A=wardrobedepth_7, B=addition_11)
dom_12 = ConstructDomain(DomainStart=addition_11, DomainEnd=subtraction_20)
dom_13 = ConstructDomain(DomainStart=door_drawerthick_2, DomainEnd=subtraction_21)
box_4 = DomainBox(Base=PlaneXY(0, 0, 0), X=dom_12, Y=dom_13, Z=filter_18)
mbox_3 = MeshBox(Base=box_4, XCount=1, YCount=1, ZCount=1)
mjoin_7 = MeshJoin(Meshes=mbox_3)

# ----
filter_19 = StreamFilter(Gate=drawers_exist, Stream1=drawers_shelf_4)

# ---- group: Drawer Shelves (continued)
merge_30 = Merge(Data1=filter_19, Data2=mjoin_7)
drawershelvesmesh = Mesh(merge_30)

# ----
door_drawerthick_top = Number(subtraction_21)

# ---- group: Drawers door outline
cornerradius = Number(doors_corner_radius)
drawers_doors_heights_3 = Number(drawers_doors_heights)
drawers_doors_heights_4 = Number(drawers_doors_heights_2)
drawers_height_bottom_2 = Number(drawers_height_bottom)
wardrobeheight_5 = Number(expr("x-1", wardrobe_height))
top_basethick_4 = Number(top_basethick)
drawers_door_width_2 = Domain(drawers_door_width)
door_drawerthick_3 = Number(doors_drawers_thickness)
drawers_doors_heights_5 = Number(drawers_doors_heights)
framethickness = Number(door_frame_thickness)
drawerhandlemesh_2 = Mesh(drawerhandlemesh)
drawers_height_bottom_3 = Number(drawers_height_bottom)
drawerheights_4 = Number(drawerheights)
tolerance_distance_4 = Number(tolerance_distance)
door_drawerthick_top_2 = Number(door_drawerthick_top)
drawers_doors_heights_6 = Number(drawers_doors_heights_2)
wardrobewidth_11 = Number(wardrobe_width)
doorhandlemesh_2 = Mesh(doorhandlemesh)
num_3 = Number(expr("x/2", wardrobewidth_11))
num_4 = Number(expr("x/2.5", drawerheights_4))
subtraction_22 = Subtraction(A=wardrobeheight_5, B=top_basethick_4)
dom_14 = ConstructDomain(DomainStart=door_drawerthick_3, DomainEnd=door_drawerthick_top_2)
subtraction_23 = Subtraction(A=drawers_height_bottom_3, B=num_4)
entwine = Entwine(Branch00=drawers_doors_heights_3, Branch01=drawers_doors_heights_4, FlattenInputs=True)
entwine_2 = Entwine(Branch00=drawers_height_bottom_2, Branch01=subtraction_22, FlattenInputs=True)
subtraction_24 = Subtraction(A=subtraction_22, B=drawers_doors_heights_6)
num_5 = Number(expr("(x-1)/2", subtraction_24))
addition_12 = Addition(A=num_5, B=drawers_doors_heights_6)
pt_5 = ConstructPoint(XCoordinate=num_3, YCoordinate=0, ZCoordinate=subtraction_23)  # -> graft(Point)
move_12 = Move(Geometry=drawerhandlemesh_2, Motion=pt_5)  # -> Geometry, Transform
finaldrawerhandlesmesh = Mesh(move_12.Geometry)

# ----
max_2 = Maximum(A=handle_radius, B=framethickness)
addition_13 = Addition(A=drawers_doors_heights_5, B=tolerance_distance_4)
addition_14 = Addition(A=entwine, B=tolerance_distance_4)
subtraction_25 = Subtraction(A=entwine_2, B=tolerance_distance_4)

# ---- group: Drawers door outline (continued)
num_6 = Number(expr("x/2", max_2))
neg_8 = Negative(Value=num_6)
dom_15 = ConstructDomain(DomainStart=addition_13, DomainEnd=expr("x-30", drawers_height_bottom_2))
addition_15 = Addition(A=num_3, B=[neg_8, num_6])
dom_16 = ConstructDomain(DomainStart=addition_14, DomainEnd=subtraction_25)  # -> simplify(Domain)
pt_6 = ConstructPoint(XCoordinate=addition_15, YCoordinate=0, ZCoordinate=expr("x-100", addition_12))  # -> graft(Point)
move_13 = Move(Geometry=doorhandlemesh_2, Motion=pt_6)  # -> Geometry, Transform
finaldoorhandlesmesh = Mesh(move_13.Geometry)

# ---- group: Drawers door outline / Door/Drawers Front Curves
rectangle_5 = Rectangle(Plane=PlaneXZ(0, 0, 0), XSize=drawers_door_width_2, YSize=dom_16, Radius=0)  # -> Rectangle, Length
fillet = FilletDistance(Curve=rectangle_5.Rectangle, Distance=expr("x*2", cornerradius))
explode_2 = Explode(Curve=fillet, Recursive=True)  # -> Segments, Vertices
pline_2 = PolyLine(Vertices=explode_2.Vertices, Closed=True)
basedoordrawercrv = Curve(pline_2)

# ----
subtraction_26 = Subtraction(A=subtraction_24, B=distance_between_shelves_2)

# ---- group: Handles
finaldoorhandlesmesh_2 = Mesh(finaldoorhandlesmesh)
finaldrawerhandlesmesh_2 = Mesh(finaldrawerhandlesmesh)
mat_4 = Material(accent_2)
merge_31 = Merge(Data1=finaldoorhandlesmesh_2, Data2=finaldrawerhandlesmesh_2)  # -> flatten(Result)
handles = GlTF20Display(Geometry=merge_31, Material=mat_4)

# ---- group: Drawers door outline / Drawers Interior
branch = TreeBranch(Tree=drawers_door_width_2, Path="{0}", MaintainPaths=True)
box_5 = DomainBox(Base=PlaneXY(0, 0, 0), X=branch, Y=dom_14, Z=dom_15)
mbox_4 = MeshBox(Base=box_5, XCount=1, YCount=1, ZCount=1)
explode_3 = MeshExplode(Mesh=mbox_4, Interpolate=False)
replace = ReplaceItems(List=explode_3, Indices=5, Wrap=False)
mjoin_8 = MeshJoin(Meshes=replace)
offmsh = OffsetMesh(Mesh=mjoin_8, Distance=-10, BothSides=0, CreateSolid=True)

# ----
shift = ShiftPaths(Data=offmsh, Offset=3)

# ---- group: Drawers door outline / Drawers Interior (continued)
trim = TrimTree(Tree=shift, Depth=1)
intdrawermesh = Mesh(trim)

# ---- group: Drawers door outline / Shelf Transformations
division_10 = Division(A=subtraction_24, B=distance_between_shelves_2)
round = Round(Number=division_10)  # -> expr("x-1", Nearest), Floor, Ceiling

# ----
division_11 = Division(A=subtraction_26, B=round.Nearest)

# ---- group: Drawers door outline / Shelf Transformations (continued)
addition_16 = Addition(A=division_11, B=drawers_doors_heights_6)
series = Series(Start=addition_16, Step=division_11, Count=round.Nearest)
Z_10 = UnitZ(Factor=series)
move_14 = Move(Motion=Z_10)  # -> Geometry, Transform
shelvesxform = Transform(move_14.Transform)

# ----
shelvesheight = Number(Z_10)
actual_distance_between_shelves = Number(division_11)
actual_distance_between_shelves_2 = Number(actual_distance_between_shelves)

external_display_model_size_2 = Number(external_display_model_size)
shelfthick_4 = Number(shelfthick)
tolerance_distance_5 = Number(tolerance_distance)
subtraction_27 = Subtraction(A=actual_distance_between_shelves_2, B=shelfthick_4, C=tolerance_distance_5)
division_12 = Division(A=external_display_model_size_2, B=2)
dom_17 = ConstructDomain(DomainStart=0, DomainEnd=external_display_model_size_2)
_2waydom = TwoWayDomain(Extent=division_12, Direction=True)
box_6 = DomainBox(Base=PlaneXY(0, 0, 0), X=_2waydom, Y=_2waydom, Z=dom_17)
max_height = Number(subtraction_27)
xy_size = Domain(_2waydom)
z_size = Domain(dom_17)
preview_external_display = Box(box_6)

position_object = PositionObject(
    url=bust,
    shelf=shelf,
    position_x=bust_position_x,
    position_y=bust_position_y,
    shelf_heights=shelvesheight,
    shelf_index=bust_shelf,
    C=tolerance_distance,
    B=external_display_model_size,
    object_width=bust_width,
    max_height=max_height,
    object_height=bust_height)
position_object_2 = PositionObject(
    url=plant,
    shelf=shelf,
    position_x=plant_position_x,
    position_y=plant_position_y,
    shelf_heights=shelvesheight,
    shelf_index=plant_shelf,
    C=tolerance_distance,
    B=external_display_model_size,
    object_width=plant_width,
    max_height=max_height,
    object_height=plant_height)
position_object_3 = PositionObject(
    url=vase,
    shelf=shelf,
    position_x=vase_position_x,
    position_y=vase_position_y,
    shelf_heights=shelvesheight,
    shelf_index=vase_shelf,
    C=tolerance_distance,
    B=external_display_model_size,
    object_width=vase_width,
    max_height=max_height,
    object_height=vase_height)
preview_external_display_2 = Box(preview_external_display)
displayext_plant = ExternalDisplay(URL=position_object_2, Geometry=preview_external_display_2, ShapeDiverMaterial=presetmaterial_4)
displayext_bust = ExternalDisplay(URL=position_object, Geometry=preview_external_display_2, ShapeDiverMaterial=presetmaterial_4)
displayext_vase = ExternalDisplay(URL=position_object_3, Geometry=preview_external_display_2, ShapeDiverMaterial=presetmaterial_4)
shelvesxform_2 = Transform(shelvesxform)

# ---- group: door offset
framethickness_2 = Number(door_frame_thickness)
drawerheights_5 = Number(drawerheights)
cornerradius_2 = Number(doors_corner_radius)
door_drawerthick_4 = Number(doors_drawers_thickness)
basedoordrawercrv_2 = Curve(basedoordrawercrv)
subtraction_28 = Subtraction(A=door_drawerthick_4, B=cornerradius_2)
num_7 = Number(expr("x*2", cornerradius_2))
merge_32 = Merge(
    Data1=0,
    Data2=0,
    Data3=cornerradius_2,
    Data4=subtraction_28,
    Data5=door_drawerthick_4,
    Data6=door_drawerthick_4,
    Data7=0)
merge_33 = Merge(Data1=framethickness_2, Data2=num_7, Data3=0, Data4=0, Data5=num_7, Data6=framethickness_2, Data7=framethickness_2)
lng_2 = ListLength(List=merge_32)  # -> expr("x-3", Length)
dom_18 = ConstructDomain(DomainStart=1, DomainEnd=lng_2)
subset = SubList(List=merge_33, Domain=dom_18, Wrap=True)  # -> List, Index
subset_2 = SubList(List=merge_32, Domain=dom_18, Wrap=True)  # -> List, Index
lng_3 = ListLength(List=drawerheights_5)
dup = DuplicateData(Data=subset.List, Number=lng_3, Order=True)
dup_2 = DuplicateData(Data=subset_2.List, Number=lng_3, Order=True)
lng_4 = ListLength(List=subset_2.List)
partition = PartitionList(List=dup, Size=lng_4)  # -> simplify(Chunks)
partition_2 = PartitionList(List=dup_2, Size=lng_4)  # -> simplify(Chunks)
corners = Number(merge_32)

# ----
shift_2 = ShiftPaths(Data=partition, Offset=0)
shift_3 = ShiftPaths(Data=partition_2, Offset=0)

# ---- group: door offset (continued)
entwine_3 = Entwine(Branch0X=shift_2, Branch1X=merge_33, FlattenInputs=False)
entwine_4 = Entwine(Branch0X=shift_3, Branch1X=merge_32, FlattenInputs=False)
Y_2 = UnitY(Factor=entwine_4)
move_15 = Move(Geometry=basedoordrawercrv_2, Motion=Y_2)  # -> Geometry, Transform
clean = CleanTree(RemoveNulls=True, RemoveInvalid=True, RemoveEmpty=True, Tree=move_15.Geometry)
explode_4 = Explode(Curve=clean, Recursive=True)  # -> Segments, Vertices

# ----
neg_9 = Negative(Value=entwine_3)

# ---- group: door offset (continued)
offset = OffsetCurve(Curve=graft(clean), Distance=graft(neg_9), Corners=1)
trim_2 = TrimTree(Tree=offset, Depth=1)
crv_cp = CurveClosestPoint(Point=explode_4.Vertices, Curve=trim_2)  # -> Point, Parameter, Distance
door_outline_offset = Point(crv_cp.Point)

# ----
door_outline_offset_2 = Point(door_outline_offset)
pline_3 = PolyLine(Vertices=door_outline_offset_2, Closed=False)

# ---- group: Doors mesh
door_4 = Boolean(door_2)
drawers_remove_4 = Boolean(drawers_remove)
corners_2 = Number(corners)
textures_size_8 = Number(textures_size)
lng_5 = ListLength(List=corners_2)  # -> expr("x-2", Length)
trim_3 = TrimTree(Tree=pline_3, Depth=1)
merge_34 = Merge(Data1=0, Data2=lng_5)
pcol = PolylineCollapse(Polyline=trim_3, Tolerance=1)  # -> Polyline, Count
split_5 = SplitTree(Data=door_outline_offset_2, Masks=flatten(panel_3))  # -> Positive, Negative
split_6 = SplitTree(Data=pcol.Polyline, Masks=flatten(panel_3))  # -> Positive, Negative
item_4 = ListItem(List=split_6.Positive, Index=merge_34, Wrap=True)
lng_6 = ListLength(List=split_6.Negative)  # -> expr("x-1", Length)
move_16 = Move(Geometry=item_4, Motion=[Vector(0, 3.5, 0), Vector(0, -3.5, 0)])  # -> Geometry, Transform
ins = InsertItems(List=lng_6, Item=0, Indices=0, Wrap=True)

# ----
filter_20 = StreamFilter(Gate=drawers_remove_4, Stream0=trim_3, Stream1=flatten(pline_3))
pt_7 = Point(split_5.Positive)
suirify = Suirify(ins)
pline_4 = PolyLine(Vertices=split_5.Negative, Closed=False)
trim_4 = TrimTree(Tree=pline_4, Depth=1)  # -> simplify(Tree)

# ---- group: Doors mesh (continued)
lng_7 = ListLength(List=pt_7)  # -> expr("x-1", Length)
split_7 = SplitList(List=pt_7, Index=lng_7)  # -> ListA, ListB
flip = FlipMatrix(Data=split_7.ListA)
pline_5 = PolyLine(Vertices=flip, Closed=False)  # -> flatten(Polyline)
item_5 = ListItem(List=split_6.Negative, Index=suirify, Wrap=True)
shift_4 = ShiftList(List=pline_5, Shift=1, Wrap=True)
partition_3 = PartitionList(List=pline_5, Size=2)  # -> simplify(Chunks)
merge_35 = Merge(Data1=move_16.Geometry, Data2=item_5)
partition_4 = PartitionList(List=shift_4, Size=2)  # -> simplify(Chunks)
explode_5 = Explode(Curve=partition_3, Recursive=True)  # -> Segments, graft(Vertices)
path_mapper = PathMapper(explode_5.Vertices, source="{A;B;C}", target="{A;C}")
ma_2 = MassAddition(Input=path_mapper)  # -> Result, PartialResults
division_13 = Division(A=ma_2.Result, B=2)
trim_5 = TrimTree(Tree=division_13, Depth=1)
pline_6 = PolyLine(Vertices=trim_5, Closed=False)
repeat = RepeatData(Data=pline_6, Length=2)  # -> flatten(Data)
shift_5 = ShiftList(List=repeat, Shift=1, Wrap=True)
partition_5 = PartitionList(List=shift_5, Size=2)  # -> simplify(Chunks)
ins_2 = InsertItems(List=partition_4, Item=partition_5, Indices=[0, 2], Wrap=True)  # -> simplify(List)
entwine_5 = Entwine(Branch0X=trim_4, Branch1X=ins_2, FlattenInputs=False)
loftmesh_9 = LoftMesh(Polylines=entwine_5, ComputeUV=True, IsometricUV=True, UVSize=textures_size_8)

# ----
meshpatch_7 = MeshPatch(OuterBoundary=merge_35, AngleTolerance=0.1, Trimback=False, Divisions=1)

# ---- group: Doors mesh (continued)
mjoin_9 = MeshJoin(Meshes=meshpatch_7)  # -> graft(Mesh)

# ----
trim_6 = TrimTree(Tree=mjoin_9, Depth=1)

# ---- group: Doors mesh (continued)
merge_36 = Merge(Data1=trim_6, Data2=loftmesh_9)
split_8 = SplitTree(Data=merge_36, Masks=flatten("{1;?}"))  # -> Positive, simplify(Negative)
gate = StreamGate(Stream=split_8.Negative, Gate=drawers_remove_4)  # -> Target0, Target1
mjoin_10 = MeshJoin(Meshes=gate.Target0)

# ----
gate_2 = StreamGate(Stream=split_8.Positive, Gate=door_4)  # -> Target0, Target1
rebmsh = RebuildMesh(
    Mesh=flatten(gate_2.Target1),
    RebuildNormals=False,
    CullUnused=True,
    UnifyNormals=False,
    FlipNormals=False,
    IdenticalCombine=False,
    WeldVertices=0)
shift_6 = ShiftPaths(Data=mjoin_10, Offset=0)

# ---- group: Doors mesh (continued)
frontdrawersmesh = Mesh(shift_6)
doorsmesh = Mesh(rebmsh)

# ---- group: drawerstransform and map
frontdrawersmesh_2 = Mesh(frontdrawersmesh)
intdrawermesh_2 = Mesh(intdrawermesh)
texturemap_4 = Box(texturemap)
merge_37 = Merge(Data1=frontdrawersmesh_2, Data2=intdrawermesh_2)
boxmap_2 = BoxMapping(Mesh=merge_37, Box=texturemap_4)

# ----
mat_5 = Material(body_2)
drawers = GlTF20Display(Geometry=flatten(boxmap_2), Material=mat_5)

# ---- group: doors transform and map
doorsmesh_2 = Mesh(doorsmesh)
yz_symmetry_3 = Plane(yz_symmetry)

# ----
boxmap_3 = BoxMapping(Mesh=doorsmesh_2, Box=texturemap_2)

# ---- group: doors transform and map (continued)
split_9 = SplitList(List=boxmap_3, Index=1)  # -> ListA, ListB
mirror_3 = Mirror(Geometry=split_9.ListA, Plane=yz_symmetry_3)  # -> Geometry, Transform
mirror_4 = Mirror(Geometry=split_9.ListB, Plane=yz_symmetry_3)  # -> Geometry, Transform
merge_38 = Merge(Data1=split_9.ListA, Data2=mirror_3.Geometry)
merge_39 = Merge(Data1=split_9.ListB, Data2=mirror_4.Geometry)
mjoin_11 = MeshJoin(Meshes=merge_39)

# ----
mat_6 = Material(door_frame)
doorsinternal = GlTF20Display(Geometry=merge_38, Material=mat)  # disabled
doorframe = GlTF20Display(Geometry=mjoin_11, Material=mat_6)

shelves = Mesh(shelfbasemesh)
drawershelvesmesh_2 = Mesh(drawershelvesmesh)
mat_7 = Material(body_2)

transform_3 = Transform(Geometry=shelves, Transform=shelvesxform_2)

shelves_2 = GlTF20Display(Geometry=flatten([transform_3, drawershelvesmesh_2]), Material=mat_7)

# ==== cluster PositionObject
url = ClusterInput()
shelf = ClusterInput()
position_x = ClusterInput()
position_y = ClusterInput()
shelf_heights = ClusterInput()
shelf_index = ClusterInput()
C = ClusterInput()
B = ClusterInput()
object_width = ClusterInput()
max_height = ClusterInput()
object_height = ClusterInput()
pt = ConstructPoint(XCoordinate=position_x, YCoordinate=position_y, ZCoordinate=0)
item = ListItem(List=flatten(shelf_heights), Index=shelf_index, Wrap=True)
evalsrf = EvaluateSurface(Surface=reparameterize(shelf), Point=pt)  # -> Point, Normal, UDirection, VDirection, Frame
multiplication = Multiplication(A=max_height, B=object_height)
pull = PullPoint(Point=evalsrf.Point, Geometry=shelf, ClosestOnly=True)  # -> ClosestPoint, Distance, Index
pdecon = Deconstruct(Point=evalsrf.Point)  # -> XComponent, YComponent, ZComponent
division = Division(A=multiplication, B=B)
subtraction = Subtraction(A=pull.Distance, B=C)
division_2 = Division(A=B, B=2)
division_3 = Division(A=subtraction, B=division_2)
vec = VectorXYZ(XComponent=pdecon.XComponent, YComponent=pdecon.YComponent, ZComponent=item)  # -> Vector, Length
multiplication_2 = Multiplication(A=division_3, B=object_width)
move = Move(Motion=vec.Vector)  # -> Geometry, Transform
scale_nu = ScaleNU(Plane=PlaneXY(0, 0, 0), ScaleX=multiplication_2, ScaleY=multiplication_2, ScaleZ=division)  # -> Geometry, Transform
merge = Merge(Data1=flatten(scale_nu.Transform), Data2=flatten(move.Transform))
comp = Compound(Transforms=merge)
attachtransform = AttachTransformations(Geometry=url, Transform=comp)
url_2 = ClusterOutput(attachtransform)
