# Grasshopper definition 4C-start.ghx (Grasshopper 1.0.8)
# plug-ins: MeshEdit Components, treesloth01, Pufferfish, GrasshopperHyperGooComponents, ShapeDiverForGrasshopper, CurveOffsetTools

tolerance = ToleranceSettings(AbsoluteTolerance=0.001, RelativeTolerance=1, AngleTolerance=1, UnitSystem=3)

# ---- group: Basic
doors_drawers_thickness = Panel("15")
walls_offset = Panel("0")

wardrobe_depth = Slider(350, range=300..500)
distance_between_shelves = Slider(317, range=200..400)
frame_thickness = Slider(15, range=5..25)
wardrobe_width = Slider(750, range=600..1200)
wardrobe_height = Slider(1800, range=1500..2000)
elongated_corners = Slider(30, range=0..40)

# ---- group: Legs
leg_bar = Slider(20, range=10..50)
legoffset = Slider(30, range=0..50)
leg_metal = Slider(0.4, range=0.1..0.9)
leg_narrowing = Slider(0.38, range=0.3..1)
offset_from_floor = Slider(150, range=5..300)
legs_style = ValueList({"Straight": 0, "Cylinders": 1}, selected="Cylinders")

# ---- group: Drawers and doors
drawers_heights_divided_with = ShapeDiverTextInput(maxlength=10000, text="100,100,100")
door_frame_thickness = Slider(15, range=0..50)
handle_style = ValueList({"Bar": 0, "Button": 1, "Rectangle": 2}, selected="Button")
doors_corner_radius = Slider(2, range=0..10)
door = BooleanToggle(True)
shelf_drawers_gap = BooleanToggle(True)

# ---- group: General visualisation
tolerance_distance = Panel("0")
weld_angle = Panel("1.5")
tolerance_angle = Panel("0.8")

textures_size = Slider(630, range=0..1000)

# ----
col = Colour(ColourSwatch(SwatchColor=RGB(189, 189, 189)))

box = DomainBox(Base=PlaneXY(0, 0, 0), X=textures_size, Y=textures_size, Z=textures_size)
wallsthick = Number(frame_thickness)
legthick = Number(frame_thickness)
shelfthick = Number(frame_thickness)
top_basethick = Number(frame_thickness)
texturemap = Box(box)

# ---- group: symmetry planes
wardrobeheight = Number(wardrobe_height)
offsetfloor = Number(offset_from_floor)
wardrobewidth = Number(wardrobe_width)
wallsoffset = Number(walls_offset)
addition = Addition(A=wardrobeheight, B=offsetfloor)
subtraction = Subtraction(A=wardrobewidth, B=wallsoffset)
division = Division(A=subtraction, B=2)
division_2 = Division(A=addition, B=2)
Z = UnitZ(Factor=division_2)
X = UnitX(Factor=division)
xy = XYPlane(Origin=Z)
yz = YZPlane(Origin=X)
xy_body_symmetry = Plane(xy)
yz_symmetry = Plane(yz)

# ----
or = GateOr(A=door, B=shelf_drawers_gap)
bool = Boolean(invert(or))
or_2 = GateOr(A=bool, B=shelf_drawers_gap)

# ---- group: Drawers and doors
wardrobeheight_2 = Number(wardrobe_height)
offsetfloor_2 = Number(offset_from_floor)
shelf_gap = Panel("0")
subtraction_2 = Subtraction(A=wardrobeheight_2, B=offsetfloor_2)
split = TextSplit(Text=drawers_heights_divided_with, Separators=",")
division_3 = Division(A=subtraction_2, B=2)
max = Maximum(A=shelf_gap, B=split)
min = Minimum(A=division_3, B=max)
shelf_drawers_gap_2 = Boolean(or_2)
drawerheights = Number(min)

# ----
door_2 = Boolean(door)

# ---- group: Body
wardrobewidth_2 = Number(wardrobe_width)
wallsthick_2 = Number(wallsthick)
wardrobeheight_3 = Number(wardrobe_height)
wallsthick_3 = Number(wallsthick)
elongate_corner = Number(elongated_corners)
wardrobedepth = Number(wardrobe_depth)
xy_body_symmetry_2 = Plane(xy_body_symmetry)
yz_symmetry_2 = Plane(yz_symmetry)
offsetfloor_3 = Number(offset_from_floor)
top_basethick_2 = Number(top_basethick)
wallsoffset_2 = Number(walls_offset)
subtraction_3 = Subtraction(A=wardrobedepth, B=wallsoffset_2)
addition_2 = Addition(A=offsetfloor_3, B=top_basethick_2)
subtraction_4 = Subtraction(A=addition_2, B=wallsthick_3)
subtraction_5 = Subtraction(A=wallsoffset_2, B=elongate_corner)
dom = ConstructDomain(DomainStart=0, DomainEnd=wardrobewidth_2)
dom_2 = ConstructDomain(DomainStart=wardrobedepth, DomainEnd=wardrobedepth)
dom_3 = ConstructDomain(DomainStart=subtraction_4, DomainEnd=wardrobeheight_3)
merge = Merge(Data1=subtraction_4, Data2=subtraction_4, Data3=addition_2, Data4=addition_2)
merge_2 = Merge(Data1=wallsoffset_2, Data2=wallsoffset_2, Data3=wallsthick_3, Data4=wallsthick_3)
merge_3 = Merge(Data1=subtraction_5, Data2=subtraction_3, Data3=subtraction_3, Data4=wallsoffset_2)
pt = ConstructPoint(XCoordinate=merge_2, YCoordinate=merge_3, ZCoordinate=merge)
box_2 = DomainBox(Base=PlaneXY(0, 0, 0), X=dom, Y=dom_2, Z=dom_3)
pline = PolyLine(Vertices=pt, Closed=True)
mirror = Mirror(Geometry=pline, Plane=xy_body_symmetry_2)  # -> Geometry, Transform
mirror_2 = Mirror(Geometry=pline, Plane=yz_symmetry_2)  # -> Geometry, Transform
merge_4 = Merge(Data1=pline, Data2=mirror.Geometry)
merge_5 = Merge(Data1=mirror_2.Geometry, Data2=pline)
loft = Loft(Curves=merge_5, Options={Adjust=False, Closed=False, LoftEnds=0, LoftSimp=0, LoftType=0, Rebuild=10, Refit=0.01})
patch = Patch(Curves=graft(merge_5), Spans=20, Flexibility=1, Trim=True)
patch_2 = Patch(Curves=graft(merge_4), Spans=20, Flexibility=1, Trim=True)
loft_2 = Loft(Curves=merge_4, Options={Adjust=False, Closed=False, LoftEnds=0, LoftSimp=0, LoftType=0, Rebuild=10, Refit=0.01})
merge_6 = Merge(Data1=patch, Data2=loft)  # -> flatten(Result)
merge_7 = Merge(Data1=patch_2, Data2=loft_2)  # -> flatten(Result)
transform = Transform(Geometry=merge_7, Transform=mirror_2.Transform)
transform_2 = Transform(Geometry=merge_6, Transform=mirror.Transform)
merge_8 = Merge(Data1=merge_7, Data2=transform, Data3=box_2, Data4=merge_6, Data5=transform_2)  # -> flatten(Result)
body = Data(merge_8)

# ----
legstyle = Integer(legs_style)
wardrobewidth_3 = Number(wardrobe_width)
wardrobedepth_2 = Number(wardrobe_depth)

drawerheights_2 = Number(drawerheights)
null = NullItem(Item=drawerheights_2)  # -> NullFlags, InvalidFlags, Description
item = ListItem(List=null.NullFlags, Index=0, Wrap=True)
drawers_remove = Boolean(item)

sides = Geometry(body)
distance_between_shelves_2 = Number(distance_between_shelves)

# ---- group: Straight legs with frame
wardrobewidth_4 = Number(wardrobe_width)
wardrobedepth_3 = Number(wardrobe_depth)
legthick_2 = Number(legthick)
wardrobeheight_4 = Number(wardrobe_height)
legthick_3 = Number(legthick)
subtraction_6 = Subtraction(A=wardrobewidth_4, B=legthick_2)
subtraction_7 = Subtraction(A=wardrobedepth_3, B=legthick_2)
merge_9 = Merge(Data1=0, Data2=0, Data3=subtraction_6, Data4=subtraction_6)
merge_10 = Merge(Data1=0, Data2=subtraction_7, Data3=subtraction_7, Data4=0)
pt_2 = ConstructPoint(XCoordinate=merge_9, YCoordinate=merge_10, ZCoordinate=0)

# ----
filter = StreamFilter(Gate=legstyle, Stream0=legthick_3)

# ---- group: Straight legs with frame (continued)
box_3 = DomainBox(Base=pt_2, X=filter, Y=filter, Z=wardrobeheight_4)
mbox = MeshBox(Base=box_3, XCount=1, YCount=1, ZCount=1)
mjoin = MeshJoin(Meshes=mbox)
legs = Mesh(mjoin)

# ---- group: Point Legs
offsetfloor_4 = Number(offset_from_floor)
leg_metal_2 = Number(leg_metal)
legthick_4 = Number(legthick)
leg_narrowing_2 = Number(leg_narrowing)
legstyle_2 = Integer(legs_style)
tolerance_angle_2 = Number(tolerance_angle)
filter_2 = StreamFilter(Gate=legstyle_2, Stream1=legthick_4)
multiplication = Multiplication(A=offsetfloor_4, B=leg_metal_2)
multiplication_2 = Multiplication(A=filter_2, B=leg_narrowing_2)
division_4 = Division(A=filter_2, B=tolerance_angle_2)
twn2nums = TweenTwoNumbers(NumberA=multiplication_2, NumberB=filter_2, Factor=leg_metal_2)
Z_2 = UnitZ(Factor=multiplication)
Z_3 = UnitZ(Factor=offsetfloor_4)
polygon = Polygon(Plane=PlaneXY(0, 0, 0), Radius=multiplication_2, Segments=division_4, FilletRadius=0)  # -> Polygon, Length
polygon_2 = Polygon(Plane=PlaneXY(0, 0, 0), Radius=twn2nums, Segments=division_4, FilletRadius=0)  # -> Polygon, Length
polygon_3 = Polygon(Plane=PlaneXY(0, 0, 0), Radius=filter_2, Segments=division_4, FilletRadius=0)  # -> Polygon, Length
move = Move(Geometry=polygon_2.Polygon, Motion=Z_2)  # -> Geometry, Transform
move_2 = Move(Geometry=polygon_3.Polygon, Motion=Z_3)  # -> Geometry, Transform
merge_11 = Merge(Data1=move_2.Geometry, Data2=move.Geometry)
merge_12 = Merge(Data1=move.Geometry, Data2=polygon.Polygon)

# ----
loftmesh = LoftMesh(Polylines=merge_11, ComputeUV=False, IsometricUV=False, UVSize=1)
loftmesh_2 = LoftMesh(Polylines=merge_12, ComputeUV=False, IsometricUV=False, UVSize=1)

# ---- group: Point Legs (continued)
merge_13 = Merge(Data1=loftmesh, Data2=loftmesh_2)
leg = Geometry(merge_13)

# ---- group: Legs frame
leg_2 = Mesh(leg)
offsetfloor_5 = Number(offset_from_floor)
leg_bar_2 = Number(leg_bar)
wallsthick_4 = Number(wallsthick)
legthick_5 = Number(legthick)
legoffset_2 = Number(legoffset)
wardrobewidth_5 = Number(wardrobe_width)
wardrobedepth_4 = Number(wardrobe_depth)
legstyle_3 = Integer(legs_style)
filter_3 = StreamFilter(Gate=legstyle_3, Stream1=offsetfloor_5)
addition_3 = Addition(A=legthick_5, B=legoffset_2)
pt_3 = ConstructPoint(XCoordinate=addition_3, YCoordinate=addition_3, ZCoordinate=0)
addition_4 = Addition(A=addition_3, B=addition_3)
larger = LargerThan(FirstNumber=filter_3, SecondNumber=leg_bar_2)  # -> LargerThan, OrEqualTo
subtraction_8 = Subtraction(A=filter_3, B=leg_bar_2)
Z_4 = UnitZ(Factor=leg_bar_2)
subtraction_9 = Subtraction(A=wardrobewidth_5, B=addition_4)
subtraction_10 = Subtraction(A=wardrobedepth_4, B=addition_4)
filter_4 = StreamFilter(Gate=larger.LargerThan, Stream1=subtraction_8)
rectangle = Rectangle(Plane=pt_3, XSize=subtraction_9, YSize=subtraction_10, Radius=0)  # -> Rectangle, Length
Z_5 = UnitZ(Factor=filter_4)
explode = Explode(Curve=rectangle.Rectangle, Recursive=True)  # -> Segments, Vertices
move_3 = Move(Geometry=rectangle.Rectangle, Motion=Z_5)  # -> Geometry, Transform
neg = Negative(Value=wallsthick_4)
cull_i = CullIndex(List=explode.Vertices, Indices=4, Wrap=False)  # -> graft(List)
offset_l = OffsetCurveLoose(Curve=move_3.Geometry, Distance=neg)
attachtransform = AttachTransformations(Geometry=leg_2, Transform=cull_i)
merge_14 = Merge(Data1=offset_l, Data2=move_3.Geometry)
meshpatch = MeshPatch(OuterBoundary=move_3.Geometry, AngleTolerance=0.1, HoleBoundaries=offset_l, Trimback=False, Divisions=1)
move_4 = Move(Geometry=merge_14, Motion=Z_4)  # -> Geometry, Transform
merge_15 = Merge(Data1=graft(move_4.Geometry), Data2=graft(merge_14))
loftmesh_3 = LoftMesh(Polylines=merge_15, ComputeUV=False, IsometricUV=False, UVSize=1)
merge_16 = Merge(Data1=flatten(loftmesh_3), Data2=meshpatch)
mjoin_2 = MeshJoin(Meshes=merge_16)
leg_bar_3 = Mesh(mjoin_2)
legs_in_place = Mesh(attachtransform)

# ---- group: Legs and body
straight_legs = Mesh(legs)
leg_bar_4 = Mesh(leg_bar_3)
point_legs_in_place = Mesh(legs_in_place)
col_2 = Colour(col)
item_2 = ListItem(List=point_legs_in_place, Index=0, Wrap=False)  # -> flatten(Item), flatten(Item1)
merge_17 = Merge(Data1=sides, Data2=straight_legs, Data3=leg_bar_4, Data4=item_2.Item)
preview = CustomPreview(Geometry=merge_17, Material=col_2)
preview_2 = CustomPreview(Geometry=item_2.Item1, Material=col_2)

# ---- group: Shelves
tolerance_angle_3 = Number(tolerance_angle)
wallsoffset_3 = Number(walls_offset)
wallsthick_5 = Number(wallsthick)
shelfthick_2 = Number(expr("-x", shelfthick))
door_drawerthick = Number(doors_drawers_thickness)
addition_5 = Addition(A=wallsoffset_3, B=wallsthick_5)
addition_6 = Addition(A=door_drawerthick, B=wallsoffset_3)
subtraction_11 = Subtraction(A=wardrobedepth_2, B=addition_5)
dom_4 = ConstructDomain(DomainStart=addition_5, DomainEnd=wardrobewidth_3)
dom_5 = ConstructDomain(DomainStart=addition_6, DomainEnd=subtraction_11)
rectangle_2 = Rectangle(Plane=PlaneXY(0, 0, 0), XSize=dom_4, YSize=dom_5, Radius=0)  # -> Rectangle, Length
topoly = CurveToPolyline(Curve=rectangle_2.Rectangle, ToleranceDistance=0, ToleranceAngle=tolerance_angle_3)  # -> Polyline, Segments
Z_6 = UnitZ(Factor=shelfthick_2)
move_5 = Move(Geometry=topoly.Polyline, Motion=Z_6)  # -> Geometry, Transform
merge_18 = Merge(Data1=topoly.Polyline, Data2=move_5.Geometry)
shelf = Rectangle(topoly.Polyline)

# ----
meshpatch_2 = MeshPatch(OuterBoundary=topoly.Polyline, AngleTolerance=0.1, Trimback=False, Divisions=1)
move_6 = Move(Geometry=meshpatch_2, Motion=Z_6)  # -> Geometry, Transform
loftmesh_4 = LoftMesh(Polylines=merge_18, ComputeUV=False, IsometricUV=False, UVSize=1)

# ---- group: Drawers shelf
shelf_drawers_gap_3 = Boolean(shelf_drawers_gap_2)
wardrobewidth_6 = Number(wardrobe_width)
wardrobedepth_5 = Number(wardrobe_depth)
wallsthick_6 = Number(wallsthick)
elongate_corner_2 = Number(elongated_corners)
division_5 = Division(A=elongate_corner_2, B=2)
filter_5 = StreamFilter(Gate=shelf_drawers_gap_3, Stream1=wardrobewidth_6)
neg_2 = Negative(Value=wallsthick_6)
neg_3 = Negative(Value=division_5)
Z_7 = UnitZ(Factor=neg_2)
division_6 = Division(A=neg_2, B=2)
dom_6 = ConstructDomain(DomainStart=0.5, DomainEnd=expr("x-2", filter_5))
merge_19 = Merge(Data1=division_5, Data2=division_5, Data3="0", Data4=division_5)
Z_8 = UnitZ(Factor=division_6)
dom_7 = ConstructDomain(DomainStart=neg_3, DomainEnd=expr("x-2", wardrobedepth_5))
rectangle_3 = Rectangle(Plane=PlaneXY(0, 0, 0), XSize=dom_6, YSize=dom_7, Radius=0)  # -> Rectangle, Length
polylineoffset = PolylineOffset(
    Polyline=rectangle_3.Rectangle,
    Distance=merge_19,
    AbsoluteTolerance=0,
    AngleTolerance=0,
    KeepDuplicates=False,
    AvoidSelfIntersections=False)  # -> OffsettedPolyline, OffsettedPolylineReverse
move_7 = Move(Geometry=rectangle_3.Rectangle, Motion=Z_8)  # -> Geometry, Transform
move_8 = Move(Geometry=polylineoffset.OffsettedPolyline, Motion=Z_7)  # -> Geometry, Transform
merge_20 = Merge(Data1=polylineoffset.OffsettedPolyline, Data2=move_8.Geometry)
merge_21 = Merge(Data1=polylineoffset.OffsettedPolyline, Data2=move_7.Geometry, Data3=move_8.Geometry)

# ----
loftmesh_5 = LoftMesh(Polylines=merge_21, ComputeUV=False, IsometricUV=False, UVSize=1)
meshpatch_3 = MeshPatch(OuterBoundary=merge_20, AngleTolerance=0.1, Trimback=False, Divisions=1)

# ---- group: Drawers shelf (continued)
merge_22 = Merge(Data1=meshpatch_3, Data2=loftmesh_5)  # -> flatten(Result)
drawers_shelf = Geometry(merge_22)

# ---- group: Prepare shelf sizes
wardrobewidth_7 = Number(wardrobe_width)
legthick_6 = Number(legthick)
shelfthick_3 = Number(shelfthick)
shelf_gap_2 = Number(shelf_gap)
shelf_drawers_gap_4 = Boolean(shelf_drawers_gap_2)
wallsthick_7 = Number(wallsthick)
drawers_shelf_2 = Mesh(drawers_shelf)
top_basethick_3 = Number(top_basethick)
offsetfloor_6 = Number(offset_from_floor)
drawerheights_3 = Number(drawerheights)
drawers_remove_2 = Boolean(drawers_remove)
min_2 = Minimum(A=shelfthick_3, B=shelf_gap_2)
addition_7 = Addition(A=top_basethick_3, B=offsetfloor_6)
subtraction_12 = Subtraction(A=wardrobewidth_7, B=legthick_6)
filter_6 = StreamFilter(Gate=shelf_drawers_gap_4, Stream0=min_2, Stream1=wallsthick_7)
addition_8 = Addition(A=min_2, B=drawerheights_3)
filter_7 = StreamFilter(Gate=drawers_remove_2, Stream0=subtraction_12)
filter_8 = StreamFilter(Gate=drawers_remove_2, Stream0=addition_8)
ma = MassAddition(Input=filter_8)  # -> Result, PartialResults
merge_23 = Merge(Data1=filter_7, Data2=wardrobewidth_7)
addition_9 = Addition(A=addition_7, B=ma.PartialResults)
dom_8 = ConstructDomain(DomainStart=expr("x+1", legthick_6), DomainEnd=expr("x-1", graft(merge_23)))  # -> simplify(Domain)
subtraction_13 = Subtraction(A=addition_9, B=min_2)
filter_9 = StreamFilter(Gate=shelf_drawers_gap_4, Stream0="0", Stream1="1")
merge_24 = Merge(Data1=flatten(addition_7), Data2=flatten(addition_9))
split_2 = SplitList(List=reverse(subtraction_13), Index=filter_9)  # -> ListA, ListB
split_3 = SplitList(List=reverse(addition_9), Index=filter_9)  # -> ListA, ListB
lng = ListLength(List=merge_24)  # -> expr("x-1", Length)
Z_9 = UnitZ(Factor=split_3.ListA)
rev = ReverseList(List=split_3.ListB)
split_4 = SplitList(List=merge_24, Index=lng)  # -> ListA, ListB
rev_2 = ReverseList(List=split_2.ListB)
subtraction_14 = Subtraction(A=rev_2, B=shelfthick_3)
subtraction_15 = Subtraction(A=split_2.ListA, B=filter_6)
move_9 = Move(Geometry=drawers_shelf_2, Motion=Z_9)  # -> Geometry, Transform
filter_10 = StreamFilter(Gate=shelf_drawers_gap_4, Stream1=subtraction_15)
merge_25 = Merge(Data1=filter_10, Data2=split_2.ListB)  # -> reverse(Result)
drawers_door_width = Domain(dom_8)
drawers_shelves_height_top = Number(subtraction_14)
drawers_height_bottom = Number(merge_25)
drawers_shelf_3 = Mesh(move_9.Geometry)
drawers_shelves_height_bottom = Number(rev)
drawers_doors_heights = Number(split_4.ListA)
drawers_doors_heights_2 = Number(split_4.ListB)

# ---- group: Drawer Shelves
drawers_exist = Boolean(invert(drawers_remove))
drawers_shelves_height_top_2 = Number(drawers_shelves_height_top)
drawers_shelves_height_bottom_2 = Number(drawers_shelves_height_bottom)
wallsoffset_4 = Number(walls_offset)
wardrobedepth_6 = Number(wardrobe_depth)
drawers_shelf_4 = Mesh(drawers_shelf_3)
wardrobewidth_8 = Number(wardrobe_width)
wallsthick_8 = Number(wallsthick)
door_drawerthick_2 = Number(doors_drawers_thickness)
dom_9 = ConstructDomain(DomainStart=drawers_shelves_height_top_2, DomainEnd=drawers_shelves_height_bottom_2)
addition_10 = Addition(A=wallsoffset_4, B=wallsthick_8)
filter_11 = StreamFilter(Gate=drawers_exist, Stream0=dom_9)
subtraction_16 = Subtraction(A=wardrobewidth_8, B=addition_10)
subtraction_17 = Subtraction(A=wardrobedepth_6, B=addition_10)
dom_10 = ConstructDomain(DomainStart=addition_10, DomainEnd=subtraction_16)
dom_11 = ConstructDomain(DomainStart=door_drawerthick_2, DomainEnd=subtraction_17)
box_4 = DomainBox(Base=PlaneXY(0, 0, 0), X=dom_10, Y=dom_11, Z=filter_11)
mbox_2 = MeshBox(Base=box_4, XCount=1, YCount=1, ZCount=1)
mjoin_3 = MeshJoin(Meshes=mbox_2)
merge_26 = Merge(Data1=drawers_shelf_4, Data2=mjoin_3)
drawershelvesmesh = Mesh(merge_26)

# ----
door_drawerthick_top = Number(subtraction_17)

# ---- group: Shelves (continued)
merge_27 = Merge(Data1=meshpatch_2, Data2=loftmesh_4, Data3=move_6.Geometry)

# ----
mjoin_4 = MeshJoin(Meshes=merge_27)

# ---- group: Shelves (continued)
shelfbasemesh = Geometry(mjoin_4)

# ---- group: Handles
drawers_remove_3 = Boolean(drawers_remove)
handlestyle = Integer(handle_style)
base_length = Panel("20")
weld_angle_2 = Number(weld_angle)
wardrobewidth_9 = Number(wardrobe_width)
door_3 = Boolean(door_2)
barhandlemesh = Mesh(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)
radius = Panel("30")
legthick_7 = Number(expr("x*2", legthick))
rechandlemeshdoors = Mesh(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)
rechandlemeshdrawers = Mesh(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)
subtraction_18 = Subtraction(A=wardrobewidth_9, B=legthick_7)
rotate = Rotate(Geometry=barhandlemesh, Angle=1.570796327, Plane=PlaneXZ(0, 0, 0))  # -> Geometry, Transform
merge_28 = Merge(Data1=0, Data2=base_length)
num = Number(expr("x/2", subtraction_18))
num_2 = Number(expr("x/5", subtraction_18))
Y = UnitY(Factor=expr("-x", merge_28))
subtraction_19 = Subtraction(A=num, B=num_2)
xz = XZPlane(Origin=Y)
neg_4 = Negative(Value=subtraction_19)
polygon_4 = Polygon(Plane=xz, Radius=expr("x/3", radius), Segments=10, FilletRadius=0)  # -> Polygon, Length
X_2 = UnitX(Factor=[neg_4, subtraction_19])
move_10 = Move(Geometry=rechandlemeshdrawers, Motion=X_2)  # -> Geometry, Transform
mjoin_5 = MeshJoin(Meshes=move_10.Geometry)

# ----
topoly_2 = CurveToPolyline(Curve=polygon_4.Polygon, ToleranceDistance=0, ToleranceAngle=0)  # -> Polyline, Segments
loftmesh_6 = LoftMesh(Polylines=polygon_4.Polygon, ComputeUV=False, IsometricUV=False, UVSize=1)
meshpatch_4 = MeshPatch(OuterBoundary=topoly_2.Polyline, AngleTolerance=0.1, Trimback=False, Divisions=1)
handle_radius = Number(radius)

# ---- group: Handles (continued)
merge_29 = Merge(Data1=loftmesh_6, Data2=flatten(meshpatch_4))
mjoin_6 = MeshJoin(Meshes=merge_29)

# ----
weld = WeldMesh(Mesh=mjoin_6, Angle=weld_angle_2)

# ---- group: Handles (continued)
move_11 = Move(Geometry=weld, Motion=X_2)  # -> Geometry, Transform
mjoin_7 = MeshJoin(Meshes=move_11.Geometry)
filter_12 = StreamFilter(Gate=handlestyle, Stream0=barhandlemesh, Stream1=mjoin_7, Stream2=mjoin_5)
filter_13 = StreamFilter(Gate=handlestyle, Stream0=rotate.Geometry, Stream1=weld, Stream2=rechandlemeshdoors)

# ----
filter_14 = StreamFilter(Gate=drawers_remove_3, Stream0=filter_12)
filter_15 = StreamFilter(Gate=door_3, Stream1=filter_13)

# ---- group: Handles (continued)
drawerhandlemesh = Mesh(filter_14)
doorhandlemesh = Mesh(filter_15)

# ---- group: Drawers door outline
cornerradius = Number(doors_corner_radius)
drawers_doors_heights_3 = Number(drawers_doors_heights)
drawers_doors_heights_4 = Number(drawers_doors_heights_2)
drawers_height_bottom_2 = Number(drawers_height_bottom)
wardrobeheight_5 = Number(expr("x-1", wardrobe_height))
top_basethick_4 = Number(top_basethick)
drawers_door_width_2 = Domain(drawers_door_width)
door_drawerthick_3 = Number(doors_drawers_thickness)
drawers_doors_heights_5 = Number(drawers_doors_heights)
framethickness = Number(door_frame_thickness)
drawerhandlemesh_2 = Mesh(drawerhandlemesh)
drawers_height_bottom_3 = Number(drawers_height_bottom)
drawerheights_4 = Number(drawerheights)
tolerance_distance_2 = Number(tolerance_distance)
door_drawerthick_top_2 = Number(door_drawerthick_top)
drawers_doors_heights_6 = Number(drawers_doors_heights_2)
wardrobewidth_10 = Number(wardrobe_width)
doorhandlemesh_2 = Mesh(doorhandlemesh)
num_3 = Number(expr("x/2", wardrobewidth_10))
num_4 = Number(expr("x/2.5", drawerheights_4))
subtraction_20 = Subtraction(A=wardrobeheight_5, B=top_basethick_4)
dom_12 = ConstructDomain(DomainStart=door_drawerthick_3, DomainEnd=door_drawerthick_top_2)
subtraction_21 = Subtraction(A=drawers_height_bottom_3, B=num_4)
entwine = Entwine(Branch00=drawers_doors_heights_3, Branch01=drawers_doors_heights_4, FlattenInputs=True)
entwine_2 = Entwine(Branch00=drawers_height_bottom_2, Branch01=subtraction_20, FlattenInputs=True)
subtraction_22 = Subtraction(A=subtraction_20, B=drawers_doors_heights_6)
num_5 = Number(expr("(x-1)/2", subtraction_22))
addition_11 = Addition(A=num_5, B=drawers_doors_heights_6)
pt_4 = ConstructPoint(XCoordinate=num_3, YCoordinate=0, ZCoordinate=subtraction_21)  # -> graft(Point)
move_12 = Move(Geometry=drawerhandlemesh_2, Motion=pt_4)  # -> Geometry, Transform
finaldrawerhandlesmesh = Mesh(move_12.Geometry)

# ----
max_2 = Maximum(A=handle_radius, B=framethickness)
addition_12 = Addition(A=drawers_doors_heights_5, B=tolerance_distance_2)
addition_13 = Addition(A=entwine, B=tolerance_distance_2)
subtraction_23 = Subtraction(A=entwine_2, B=tolerance_distance_2)

# ---- group: Drawers door outline (continued)
num_6 = Number(expr("x/2", max_2))
neg_5 = Negative(Value=num_6)
dom_13 = ConstructDomain(DomainStart=addition_12, DomainEnd=expr("x-30", drawers_height_bottom_2))
addition_14 = Addition(A=num_3, B=[neg_5, num_6])
dom_14 = ConstructDomain(DomainStart=addition_13, DomainEnd=subtraction_23)  # -> simplify(Domain)
pt_5 = ConstructPoint(XCoordinate=addition_14, YCoordinate=0, ZCoordinate=expr("x-100", addition_11))  # -> graft(Point)
move_13 = Move(Geometry=doorhandlemesh_2, Motion=pt_5)  # -> Geometry, Transform
finaldoorhandlesmesh = Mesh(move_13.Geometry)

# ---- group: Drawers door outline / Door/Drawers Front Curves
rectangle_4 = Rectangle(Plane=PlaneXZ(0, 0, 0), XSize=drawers_door_width_2, YSize=dom_14, Radius=0)  # -> Rectangle, Length
fillet = FilletDistance(Curve=rectangle_4.Rectangle, Distance=expr("x*2", cornerradius))
explode_2 = Explode(Curve=fillet, Recursive=True)  # -> Segments, Vertices
pline_2 = PolyLine(Vertices=explode_2.Vertices, Closed=True)
basedoordrawercrv = Curve(pline_2)

# ---- group: Drawers door outline / Shelf Transformations
division_7 = Division(A=subtraction_22, B=distance_between_shelves_2)
addition_15 = Addition(A=distance_between_shelves_2, B=drawers_doors_heights_6)
round = Round(Number=division_7)  # -> expr("x-1", Nearest), Floor, Ceiling
series = Series(Start=addition_15, Step=distance_between_shelves_2, Count=round.Nearest)
Z_10 = UnitZ(Factor=series)
move_14 = Move(Motion=Z_10)  # -> Geometry, Transform
shelvesxform = Transform(move_14.Transform)

# ----
shelvesheight = Number(Z_10)

# ---- group: Handles
col_3 = Colour(col)
finaldoorhandlesmesh_2 = Mesh(finaldoorhandlesmesh)
finaldrawerhandlesmesh_2 = Mesh(finaldrawerhandlesmesh)
merge_30 = Merge(Data1=finaldoorhandlesmesh_2, Data2=finaldrawerhandlesmesh_2)  # -> flatten(Result)
handles = GlTF20Display(Geometry=merge_30, Material=col_3)

# ----
shelvesxform_2 = Transform(shelvesxform)

# ---- group: Drawers door outline / Drawers Interior
branch = TreeBranch(Tree=drawers_door_width_2, Path="{0}", MaintainPaths=True)
box_5 = DomainBox(Base=PlaneXY(0, 0, 0), X=branch, Y=dom_12, Z=dom_13)
mbox_3 = MeshBox(Base=box_5, XCount=1, YCount=1, ZCount=1)
explode_3 = MeshExplode(Mesh=mbox_3, Interpolate=False)
replace = ReplaceItems(List=explode_3, Indices=5, Wrap=False)
mjoin_8 = MeshJoin(Meshes=replace)
offmsh = OffsetMesh(Mesh=mjoin_8, Distance=-10, BothSides=0, CreateSolid=True)

# ----
shift = ShiftPaths(Data=offmsh, Offset=3)

# ---- group: Drawers door outline / Drawers Interior (continued)
trim = TrimTree(Tree=shift, Depth=1)
intdrawermesh = Mesh(trim)

# ---- group: door offset
framethickness_2 = Number(door_frame_thickness)
drawerheights_5 = Number(drawerheights)
cornerradius_2 = Number(doors_corner_radius)
door_drawerthick_4 = Number(doors_drawers_thickness)
basedoordrawercrv_2 = Curve(basedoordrawercrv)
subtraction_24 = Subtraction(A=door_drawerthick_4, B=cornerradius_2)
num_7 = Number(expr("x*2", cornerradius_2))
merge_31 = Merge(
    Data1=0,
    Data2=0,
    Data3=cornerradius_2,
    Data4=subtraction_24,
    Data5=door_drawerthick_4,
    Data6=door_drawerthick_4,
    Data7=0)
merge_32 = Merge(Data1=framethickness_2, Data2=num_7, Data3=0, Data4=0, Data5=num_7, Data6=framethickness_2, Data7=framethickness_2)
lng_2 = ListLength(List=merge_31)  # -> expr("x-3", Length)
dom_15 = ConstructDomain(DomainStart=1, DomainEnd=lng_2)
subset = SubList(List=merge_32, Domain=dom_15, Wrap=True)  # -> List, Index
subset_2 = SubList(List=merge_31, Domain=dom_15, Wrap=True)  # -> List, Index
lng_3 = ListLength(List=drawerheights_5)
dup = DuplicateData(Data=subset.List, Number=lng_3, Order=True)
dup_2 = DuplicateData(Data=subset_2.List, Number=lng_3, Order=True)
lng_4 = ListLength(List=subset_2.List)
partition = PartitionList(List=dup, Size=lng_4)  # -> simplify(Chunks)
partition_2 = PartitionList(List=dup_2, Size=lng_4)  # -> simplify(Chunks)
corners = Number(merge_31)

# ----
shift_2 = ShiftPaths(Data=partition, Offset=0)
shift_3 = ShiftPaths(Data=partition_2, Offset=0)

# ---- group: door offset (continued)
entwine_3 = Entwine(Branch0X=shift_2, Branch1X=merge_32, FlattenInputs=False)
entwine_4 = Entwine(Branch0X=shift_3, Branch1X=merge_31, FlattenInputs=False)
Y_2 = UnitY(Factor=entwine_4)
move_15 = Move(Geometry=basedoordrawercrv_2, Motion=Y_2)  # -> Geometry, Transform
clean = CleanTree(RemoveNulls=True, RemoveInvalid=True, RemoveEmpty=True, Tree=move_15.Geometry)
polylineoffset_2 = PolylineOffset(
    Polyline=graft(clean),
    Distance=graft(entwine_3),
    AbsoluteTolerance=0,
    AngleTolerance=0,
    KeepDuplicates=True,
    AvoidSelfIntersections=False)  # -> simplify(OffsettedPolyline), OffsettedPolylineReverse
door_outline_offset = Curve(polylineoffset_2.OffsettedPolyline)

# ---- group: Doors mesh
door_4 = Boolean(door_2)
drawers_remove_4 = Boolean(drawers_remove)
corners_2 = Number(corners)
door_outline_offset_2 = Curve(door_outline_offset)
lng_5 = ListLength(List=corners_2)  # -> expr("x-2", Length)
trim_2 = TrimTree(Tree=door_outline_offset_2, Depth=1)
merge_33 = Merge(Data1=0, Data2=lng_5)
filter_16 = StreamFilter(Gate=drawers_remove_4, Stream0=trim_2, Stream1=flatten(door_outline_offset_2))
filter_17 = StreamFilter(Gate=drawers_remove_4, Stream0=["{1}", "{1;?}"], Stream1="{0}")
pcol = PolylineCollapse(Polyline=filter_16, Tolerance=1)  # -> Polyline, Count
split_5 = SplitTree(Data=filter_16, Masks=flatten(filter_17))  # -> Positive, simplify(Negative)
split_6 = SplitTree(Data=pcol.Polyline, Masks=flatten(filter_17))  # -> Positive, Negative
explode_4 = Explode(Curve=split_5.Positive, Recursive=True)  # -> Segments, simplify(Vertices)
item_3 = ListItem(List=split_6.Positive, Index=merge_33, Wrap=True)
lng_6 = ListLength(List=explode_4.Vertices)  # -> expr("x-1", Length)
lng_7 = ListLength(List=split_6.Negative)  # -> expr("x-1", Length)
move_16 = Move(Geometry=item_3, Motion=[Vector(0, 3.5, 0), Vector(0, -3.5, 0)])  # -> Geometry, Transform
ins = InsertItems(List=lng_7, Item=0, Indices=0, Wrap=True)  # -> simplify(List)
split_7 = SplitList(List=explode_4.Vertices, Index=lng_6)  # -> ListA, ListB
flip = FlipMatrix(Data=split_7.ListA)
item_4 = ListItem(List=split_6.Negative, Index=ins, Wrap=True)
pline_3 = PolyLine(Vertices=flip, Closed=False)  # -> flatten(Polyline)
shift_4 = ShiftList(List=pline_3, Shift=1, Wrap=True)
partition_3 = PartitionList(List=pline_3, Size=2)  # -> simplify(Chunks)
merge_34 = Merge(Data1=move_16.Geometry, Data2=item_4)
partition_4 = PartitionList(List=shift_4, Size=2)  # -> simplify(Chunks)
explode_5 = Explode(Curve=partition_3, Recursive=True)  # -> Segments, graft(Vertices)
path_mapper = PathMapper(explode_5.Vertices, source="{A;B;C}", target="{A;C}")
bool_2 = Boolean(invert(drawers_remove_4))
ma_2 = MassAddition(Input=path_mapper)  # -> Result, PartialResults
division_8 = Division(A=ma_2.Result, B=2)
trim_3 = TrimTree(Tree=division_8, Depth=1)
pline_4 = PolyLine(Vertices=trim_3, Closed=False)
repeat = RepeatData(Data=pline_4, Length=2)  # -> flatten(Data)
shift_5 = ShiftList(List=repeat, Shift=1, Wrap=True)
partition_5 = PartitionList(List=shift_5, Size=2)  # -> simplify(Chunks)
ins_2 = InsertItems(List=partition_4, Item=partition_5, Indices=[0, 2], Wrap=True)  # -> simplify(List)
entwine_5 = Entwine(Branch0X=split_5.Negative, Branch1X=ins_2, FlattenInputs=False)
loftmesh_7 = LoftMesh(Polylines=entwine_5, ComputeUV=True, IsometricUV=False, UVSize=1)

# ----
meshpatch_5 = MeshPatch(OuterBoundary=merge_34, AngleTolerance=0.1, Trimback=False, Divisions=1)

# ---- group: Doors mesh (continued)
mjoin_9 = MeshJoin(Meshes=meshpatch_5)  # -> graft(Mesh)

# ----
trim_4 = TrimTree(Tree=mjoin_9, Depth=bool_2)

# ---- group: Doors mesh (continued)
merge_35 = Merge(Data1=trim_4, Data2=loftmesh_7)
split_8 = SplitTree(Data=merge_35, Masks=flatten("{1;?}"))  # -> Positive, simplify(Negative)
gate = StreamGate(Stream=split_8.Negative, Gate=drawers_remove_4)  # -> Target0, Target1
mjoin_10 = MeshJoin(Meshes=gate.Target0)

# ----
gate_2 = StreamGate(Stream=split_8.Positive, Gate=door_4)  # -> Target0, Target1
rebmsh = RebuildMesh(
    Mesh=flatten(gate_2.Target1),
    RebuildNormals=False,
    CullUnused=True,
    UnifyNormals=False,
    FlipNormals=False,
    IdenticalCombine=False,
    WeldVertices=0)
shift_6 = ShiftPaths(Data=mjoin_10, Offset=0)

# ---- group: Doors mesh (continued)
frontdrawersmesh = Mesh(shift_6)
doorsmesh = Mesh(rebmsh)

# ---- group: drawerstransform and map
frontdrawersmesh_2 = Mesh(frontdrawersmesh)
intdrawermesh_2 = Mesh(intdrawermesh)
merge_36 = Merge(Data1=frontdrawersmesh_2, Data2=intdrawermesh_2)

# ---- group: doors transform and map
doorsmesh_2 = Mesh(doorsmesh)
yz_symmetry_3 = Plane(yz_symmetry)
split_9 = SplitList(List=doorsmesh_2, Index=1)  # -> ListA, ListB
mirror_3 = Mirror(Geometry=split_9.ListA, Plane=yz_symmetry_3)  # -> Geometry, Transform
mirror_4 = Mirror(Geometry=split_9.ListB, Plane=yz_symmetry_3)  # -> Geometry, Transform
merge_37 = Merge(Data1=split_9.ListA, Data2=mirror_3.Geometry)
merge_38 = Merge(Data1=split_9.ListB, Data2=mirror_4.Geometry)
mjoin_11 = MeshJoin(Meshes=merge_38)

# ----
col_4 = Colour(col)
drawers = GlTF20Display(Geometry=flatten(merge_36), Material=col_4)

col_5 = Colour(col)
doorsinternal = GlTF20Display(Geometry=merge_37, Material=col_5)
doorframe = GlTF20Display(Geometry=mjoin_11, Material=col_5)

shelves = Mesh(shelfbasemesh)
drawershelvesmesh_2 = Mesh(drawershelvesmesh)
col_6 = Colour(col)

transform_3 = Transform(Geometry=shelves, Transform=shelvesxform_2)

shelves_2 = GlTF20Display(Geometry=flatten([transform_3, drawershelvesmesh_2]), Material=col_6)
