# Grasshopper definition 5A-GrasshopperBitmap.ghx (Grasshopper 1.0.7)
# plug-ins: BitmapComponent, ShapeDiverForGrasshopper

# ----
# The Grasshopper Bitmap type is a Bitmap format that is native to Grasshopper.
# 
# It can be used along the ShapeDiver Image components (Image Sampler and Image to Mesh) and the plugin Squid (ShapeDiver version).
# 
# Grasshopper Bitmaps can also be used as textures for the geometry displayed in the online viewer.
# How to create Grasshopper Bitmaps?
# Method 1: Internalize Images
# Internalize an image: Right-Click and choose 'Set one GrasshopperBitmap' to open a file selection window and select an image from your local computer.
# 
# The image is automatically internalized in your definition.
# New primitive type: Find the Bitmap primitive along with the other native Grasshopper primitives in the Params > Primitive tab.
# Method 3: Create Images with Squid
# Squid drawings: With the Squid (ShapeDiver edition) plugin, you can draw images directly in Grasshopper and manipulate them as Grasshopper Bitmaps.
# 
# Resulting bitmaps are compatible with all ShapeDiver Image components.
# 
# See model 5D for Squid tutorials.
bmp = Bitmap(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)

panel = Panel("https://i0.wp.com/archeyes.com/wp-content/uploads/2016/04/San-Cataldo-Cemetery-Aldo-Rossi-20.jpg?ssl=1")

# ----
# Method 2: Import Images
# Internalize an image: Use the ShapeDiver Image Input to import images from URLs. User the URL as a string input to the component.
# 
# The Image Input component will also generate a button in the online viewer so that users can upload their own images. In that case, the input URL is used as a default image until the user has picked another one.
# 
# Don't forget to right-click and check all image formats that should be allowed.
importbmp = ImportBitmap(URI=panel, maximum_file_size=52428800, selected_file_formats="image/bmp,image/gif,image/jpeg,image/png,image/tif")  # -> Bitmap, Width, Height, Filename

# ----
# Simple application: texturing
# Using ShapeDiverMaterial: Grasshopper Bitmaps can be used instead of URLs for all texture parameters of ShapeDiver Materials.
rectangle = Rectangle(Plane=PlaneXY(0, 0, 0), XSize=importbmp.Width, YSize=importbmp.Height, Radius=0)  # -> Rectangle, Length
mplane = MeshPlane(Boundary=rectangle.Rectangle, WidthCount=1, HeightCount=1)  # -> Mesh, Area
gltf2material = GlTF20Material(
    BaseColorFactor=RGB(255, 255, 255),
    BaseColorTexture=importbmp.Bitmap,
    MetallicFactor=0,
    RoughnessFactor=1,
    EmissiveFactor=RGB(0, 0, 0),
    AlphaMode="OPAQUE",
    AlphaCutoff=0.5,
    DoubleSided=True)
gltfdisplay = GlTF20Display(Geometry=mplane.Mesh, Material=gltf2material)
