# Grasshopper definition 5B-ShapeDiverImageSampler.ghx (Grasshopper 1.0.7)
# plug-ins: BitmapComponent, ShapeDiverForGrasshopper

# The ShapeDiver Image Sampler component replaces the
# Grasshopper Image Sampler for online applications.
# 
# Instead of referencing local files, it works with the Grasshopper Bitmap type.
bmp = Bitmap(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)

# ----
# ShapeDiver Image Sampler
# Domain: The default domain uses the image pixel dimensions (equivalent to the 'Use pixel image dimensions' button in the Grasshopper Image Sampler.
# 
# Any other domain can be specified. In this case, we specify a unit [0,1]x[0,1] domain.
# Internalized bitmap: See model 5A for learning how to create a Grasshopper Bitmap.
# Coordinates: Send the coordinates in a 2D point.
number_slider = Slider(0.27, range=0..1)
number_slider_2 = Slider(0.63, range=0..1)
pt = ConstructPoint(XCoordinate=number_slider, YCoordinate=number_slider_2, ZCoordinate=0)
dom² = ConstructDomain²(DomainU=Domain(0, 1), DomainV=Domain(0, 1))
bmpprop = BitmapProperties(Bitmap=bmp)  # -> Width, Height
sdimagesampler = ShapeDiverImageSampler(Bitmap=bmp, Coordinates=pt, Domain=dom²)
col = Colour(sdimagesampler)

# ----
# Display
# Show the image and extract the color of the selected pixel
num = Number(bmpprop.Width)
num_2 = Number(bmpprop.Height)
min = Minimum(A=num, B=num_2)
rectangle = Rectangle(Plane=PlaneXY(0, 0, 0), XSize=num, YSize=num_2, Radius=0)  # -> Rectangle, Length
panel = Panel(col)
multiplication = Multiplication(A=number_slider, B=num)
multiplication_2 = Multiplication(A=number_slider_2, B=num_2)
division = Division(A=min, B=2)
mplane = MeshPlane(Boundary=rectangle.Rectangle, WidthCount=1, HeightCount=10)  # -> Mesh, Area
pt_2 = ConstructPoint(XCoordinate=multiplication, YCoordinate=multiplication_2, ZCoordinate=0)
Z = UnitZ(Factor=division)
gltf2material = GlTF20Material(
    BaseColorFactor=RGB(255, 255, 255),
    BaseColorTexture=bmp,
    MetallicFactor=0,
    RoughnessFactor=1,
    EmissiveFactor=RGB(0, 0, 0),
    AlphaMode="OPAQUE",
    AlphaCutoff=0.5,
    DoubleSided=True)
move = Move(Geometry=pt_2, Motion=Z)  # -> Geometry, Transform
ln = Line(StartPoint=pt_2, EndPoint=move.Geometry)
gltf2material_2 = GlTF20Material(
    BaseColorFactor=col,
    MetallicFactor=0,
    RoughnessFactor=1,
    EmissiveFactor=RGB(0, 0, 0),
    AlphaMode="OPAQUE",
    AlphaCutoff=0.5,
    DoubleSided=True)
col_2 = Colour(RGB(0, 0, 0))
gltf2material_3 = GlTF20Material(
    BaseColorFactor=col_2,
    MetallicFactor=0,
    RoughnessFactor=1,
    EmissiveFactor=RGB(0, 0, 0),
    AlphaMode="OPAQUE",
    AlphaCutoff=0.5,
    DoubleSided=True)
gltfdisplay = GlTF20Display(Geometry=mplane.Mesh, Material=gltf2material)
gltfdisplay_2 = GlTF20Display(Geometry=ln, Material=gltf2material_3)

box = CenterBox(Base=move.Geometry, X=10, Y=10, Z=10)
mbox = MeshBox(Base=box, XCount=10, YCount=10, ZCount=10)

gltfdisplay_3 = GlTF20Display(Geometry=mbox, Material=gltf2material_2)
