# Grasshopper definition 5C-ShapeDiverImageToMesh.ghx (Grasshopper 1.0.7)
# plug-ins: BitmapComponent, ShapeDiverForGrasshopper

# Filter domain: Filter each channel of the image in a normalized unit [0,1] domain.
number_slider = Slider(0.387, range=0..1)
# The ShapeDiver ImageToMesh component replaces the Import Image component.
# 
# Instead of referencing local files, it works with the Grasshopper Bitmap type.
# 
# It also adds sampling options for more control on the resulting mesh.
bmp = Bitmap(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)
dom = ConstructDomain(DomainStart=Slider(0, range=0..1), DomainEnd=number_slider)

# ----
# Example 1: filter brightness
# Internalized bitmap: See model 5A for learning how to create a Grasshopper Bitmap.
# Domain: The default domain uses the image pixel dimensions (equivalent to the 'Use pixel image dimensions' button in the Grasshopper Image Sampler.
# 
# Any other domain can be specified. In this case, we specify a unit [0,1]x[0,1] domain.
img2mesh = ImageToMesh(Bitmap=bmp, BrightnessFilter=dom)
gltfdisplay = GlTF20Display(Geometry=img2mesh)
