# Grasshopper definition 5Dbis-SquidShapeDiverEditionPDF.ghx (Grasshopper 1.0.7)
# plug-ins: Squid (ShapeDiver Edition), ShapeDiverForGrasshopper, SdGhPdfComponents

number_of_circles = Slider(100, range=0..100)

# ----
# Outline: There are 2 components that can create an outline.
# (Drawing palette panel)
# 
# Outline
# Creates a simple outline defined by thickness and color.
# 
# OutlineEX
# Enables you to specify all the fancy properties. Dashes, end caps, dash caps, line join etc.
swatch = ColourSwatch(SwatchColor=RGB(68, 36, 227))
outline = Outline(Color=swatch, Width=Slider(5, range=0..10))

# ----
# Fill: There are 5 different fill types :
# Solid
# Linear gradient
# Radial gradient
# Path gradient
# Texture fill
# 
# You can find them all in the Drawing palette panel.
# 
# Here we create a simple linear gradient.
range = Range(Domain=Domain(0, 1), Steps=10)
gradient = Gradient(LowerLimit=0, UpperLimit=1, Parameter=range, stops=[0.15: RGB(255, 130, 160), 0.85: RGB(220, 0, 40)])
filll = FillLinear(Line=Line((206, 106, 0), (286, 200, 0)), Params=range, Colors=gradient)  # -> Fill, Points

# ----
# Step 3: Create a random color to fill each circle.
random = Random(Range=Domain(0, 1), Number=number_of_circles, Seed=2)
gradient_2 = Gradient(
    LowerLimit=0,
    UpperLimit=1,
    Parameter=random,
    stops=[0: RGB(243, 57, 0), 0.1: RGB(236, 27, 60), 0.2: RGB(210, 0, 118), 0.3: RGB(103, 0, 120), 0.4: RGB(39, 72, 161), 0.5: RGB(1, 192, 229), 0.6: RGB(18, 178, 90), 0.7: RGB(79, 186, 8), 0.8: RGB(220, 237, 32), 0.9: RGB(247, 159, 20), 1: RGB(243, 57, 0)])

# ----
# Bitmap rectangle: Bitmap rectangle has to lie on the WorldXY plane.
# 
# It's dimensions transfer directly to the bitmap dimensions (300x300 Rhino units = 300x300 px bitmap).
# 
# Rectangle can't be rotated (ortho only).
# PPU: PPU = pixels per Rhino unit.
# 
# Let's say you want to draw a very complex drawing, consisting of thousands of instructions. You set the bitmap rectangle to 2000x2000 pixels. It takes ages (few seconds) to draw it, not really convienient if you want to make some adjustments.
# 
# Solution is to lower the PPU. If you lower it to 0.1, Squid will rescale the bitmap to 200x200 pixels. It will also TRY to rescale all the fills, line widths, dash patterns etc., thus preserving the overall appearance as much as possible.
# 
# It will draw the bitmap much, much faster. After you're done with your adjustments, you can set the PPU back to 1... or even increase it.
# Double click to open
# the Squid window
# Instructions: Squid draws a bitmap with a list of instructions.
# 
# If your instructions are collected in a data tree, the data tree gets flattened internally.
# It means that one Squid component can draw one bitmap at a time, using only one rectangle.
# If you input more than one bitmap rectangle, Squid will use the first one.
# 
# Instructions are listed in the Instructions panel.
# Bitmap rectangle >
# Instructions >
# PPU >
# AntiAliasing >
# AntiAliasing: Affects the way Squid draws curves (doesn't affect images and fills).
squid = Squid(BitmapR={Plane=PlaneXY(0, 0, 0), Size=Domain2(u=0..500, v=0..300)}, PPU=1, AA=True, autohide=False)
polygon = Polygon(Plane=PlaneXY(243, 156, 0), Radius=Slider(50, range=0..100), Segments=6, FilletRadius=0)  # -> Polygon, Length

# ----
# Draw instruction: Draw instruction is arguably the most common one to use.
# 
# There are four inputs :
# C - curve to draw (either opened or close)
# 
# A - accuracy (due to drawing limitations, we can only draw polylines, this parameter steers the Curve to Polyline conversion accuracy)
# 
# O - outline
# 
# F - fill
# SQUID
draw = Draw(Curve=polygon.Polygon, Accuracy=-1, Outline=outline, Fill=filll.Fill)  # -> SquidInstr, Curve

# ----
# Step 5: Before drawing the circles, let's set the background color to white (Clear Instruction).
clear = Clear(Color=RGB(255, 255, 255))

# ----
# Export from the viewer
# Use the ShapeDiver export component with one of the image formats to let users download the resulting bitmap from the online viewer.
image_format = ValueList({"jpg", "png", "tiff", "bmp", "gif"}, selected="jpg")
exportpdf = PdfExportOptions()
exportimg = ImageExportOptions(Format=image_format, QualityLevel=100, N=False)

# ----
# Let's draw something
# ...colors are automatically
# converted into solid fills...
pagesize = PageSize(PageSizeName="A4")  # -> Rectangle, Width, Height

# ----
# Step 1: Create a bitmap rectangle, 300x300 pixels.
rec = Rectangle(pagesize.Rectangle)

# ----
# Step 2: Let's draw some random circles in it.
panel = Panel("20 to 80")
random_2 = Random(Range=panel, Number=number_of_circles, Seed=2)
pop2d = Populate2D(Region=rec, Count=number_of_circles, Seed=1)
cir = Circle(Plane=pop2d, Radius=random_2)

# ----
# Step 4: Create a Draw Instruction.
draw_2 = Draw(Curve=cir, Accuracy=-1, Fill=gradient_2)  # -> SquidInstr, Curve

# ----
# The Clear instruction is not supported for PDF drawing
merge = Merge(Data1=clear, Data2=flatten(draw_2.SquidInstr))

squidpdf = SquidPdf(PageSize=pagesize.Rectangle, SquidInstr=draw_2.SquidInstr, AA=True)
squid_2 = Squid(BitmapR=rec, SquidInstr=merge, PPU=1, AA=True, autohide=False)

# ----
# Display in ShapeDiver viewer
# Apply the resulting bitmap as a texture on a mesh to display in the ShapeDiver viewer.
mplane = MeshPlane(Boundary=rec, WidthCount=10, HeightCount=10)  # -> Mesh, Area

gltf2material = GlTF20Material(
    BaseColorFactor=RGB(255, 255, 255),
    BaseColorTexture=squid_2,
    MetallicFactor=0,
    RoughnessFactor=1,
    EmissiveFactor=RGB(0, 0, 0),
    AlphaMode="OPAQUE",
    AlphaCutoff=0.5,
    DoubleSided=True)
gltfdisplay = GlTF20Display(Geometry=mplane.Mesh, Material=gltf2material)
export_pdf = DownloadExport(Data=squidpdf, Options=exportpdf, Name="pdf_export")
export_bitmap = DownloadExport(Data=squid_2, Options=exportimg, Name="bitmap_export")
