# Grasshopper definition 6A-JSONTutorial.ghx (Grasshopper 1.0.7)
# plug-ins: ShapeDiverForGrasshopper

# ----
# String
panel = Panel("some_string")
# Build, parse and manipulate JSON objects
# using the JSON components of the ShapeDiver plugin.
panel_2 = Panel("Greetings from ShapeDiver")
sdjsonconstruct = ShapeDiverJSONConstruct(Data=panel_2, AddressString=panel)

# ----
# Number
panel_3 = Panel("some_numbers")
num = Number([45, 63, 101])
sdjsonconstruct_2 = ShapeDiverJSONConstruct(Object=sdjsonconstruct, Data=num, AddressString=panel_3)

# ----
# Points
panel_4 = Panel("some_points")
pt = Point([Point(-11.60922173, 0.9011724629, 0), Point(-6.944328979, 8.428613035, 0), Point(3.657699996, -1.113213042, 0), Point(8.055004923, 5.778105791, 0)])
constructjson = ConstructJSON(Object=sdjsonconstruct_2, Data=pt, AddressString=panel_4)

# ----
# Add a key-value pair to an object: Simply send any supported type and specify at which address in the JSON object it should be included.
panel_5 = Panel(sdjsonconstruct)

# ----
# Line
panel_6 = Panel("some_line")
line = Line(Line((-11.14330457, 45.73879514, 0), (9.483333993, 24.10320857, 0)))

# ----
# Interval
panel_7 = Panel("some_interval")
dom = ConstructDomain(DomainStart=1, DomainEnd=3)

# ----
# Plane
panel_8 = Panel("some_plane")
pln = Plane(PlaneYZ(0, 0, 0))

# ----
# Create arrays in JSON objects: Send a list of objects at a single address to automatically create an array for this JSON property
panel_9 = Panel(sdjsonconstruct_2)

# ----
# Use trees for multiple addresses: A list of addresses can be filled simultaneously by sending a tree of values of the Data input.
# 
# Each branch of the tree (in order) will be assigned to each address in the list.
entwine = Entwine(Branch00=line, Branch01=dom, Branch02=pln, FlattenInputs=True)
merge = Merge(Data1=panel_6, Data2=panel_7, Data3=panel_8)
constructjson_2 = ConstructJSON(Object=constructjson, Data=entwine, AddressString=merge)
# Construct JSON Objects: With the Construct JSON component,
# many Grasshopper types are automatically
# converted to JSON objects.
panel_10 = Panel(constructjson_2)

# ----
# NURBS Surface
panel_11 = Panel("nurbs.some_surface")
srf = Surface(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)
sdjsonconstruct_3 = ShapeDiverJSONConstruct(Object=constructjson_2, Data=srf, AddressString=panel_11)

# ----
# NURBS Curve
panel_12 = Panel("nurbs.some_curve")
crv = Curve(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)
sdjsonconstruct_4 = ShapeDiverJSONConstruct(Object=sdjsonconstruct_3, Data=crv, AddressString=panel_12)

# ----
# Color
panel_13 = Panel("some_color")
sdjsonconstruct_5 = ShapeDiverJSONConstruct(Object=sdjsonconstruct_4, Data=ColourSwatch(SwatchColor=RGB(0, 34, 255)), AddressString=panel_13)

# ----
# Nested objects: The Construct JSON components accepts dot-separated names for addresses in order to build directly nested objects.
# 
# In this example, an property "nurbs" is created, containing itself two more properties ("some_surface" and "some_curve") as nested objects.
panel_14 = Panel(sdjsonconstruct_4)

# ----
# Box
panel_15 = Panel("some_box")
box = Box({Plane=PlaneXY(1, 2, 3), X=Domain(0, 3), Y=Domain(0, 3), Z=Domain(0, 2)})
sdjsonconstruct_6 = ShapeDiverJSONConstruct(Object=sdjsonconstruct_5, Data=box, AddressString=panel_15)

# ----
# Transformation
panel_16 = Panel("some_xform")
rot3d = Rotate3D(Angle=1, Center=Point(0, 0, 0), Axis=Vector(1, 2, 3))  # -> Geometry, Transform
sdjsonconstruct_7 = ShapeDiverJSONConstruct(Object=sdjsonconstruct_6, Data=rot3d.Transform, AddressString=panel_16)

txt = Text(sdjsonconstruct_7)

# ----
# The resulting JSON: The resulting JSON
# represented by a string.
panel_17 = Panel(txt)

# ----
# The resulting JSON: With the Parse JSON component,
# we parse the string again to extract back
# the JSON object and be able to access its properties easily.
parsejson = ParseJSON(JSON=panel_17)

# ----
# Color
panel_18 = Panel("some_color")
json_data = Data(parsejson)
accessjson = AccessJSON(Object=json_data, AddressString=panel_18)
convertjson = ConvertJSON(Object=accessjson)
# Access JSON properties: The Access JSON component can read
# the properties of a parsed
# JSON object.
col = Colour(convertjson)

# ----
# Box
panel_19 = Panel("some_box")
json_data_2 = Data(parsejson)
accessjson_2 = AccessJSON(Object=json_data_2, AddressString=panel_19)
convertjson_2 = ConvertJSON(Object=accessjson_2)
box_2 = Box(convertjson_2)

# ----
# NURBS Surface
json_data_3 = Data(parsejson)
accessjson_3 = AccessJSON(Object=json_data_3, AddressString="nurbs.some_surface")
convertjson_3 = ConvertJSON(Object=accessjson_3)
srf_2 = Surface(convertjson_3)

# ----
# NURBS Curve
panel_20 = Panel("nurbs.some_curve")
json_data_4 = Data(parsejson)
accessjson_4 = AccessJSON(Object=json_data_4, AddressString=panel_20)
convertjson_4 = ConvertJSON(Object=accessjson_4)
crv_2 = Curve(convertjson_4)

# ----
# Transformation
panel_21 = Panel("some_xform")
json_data_5 = Data(parsejson)
accessjson_5 = AccessJSON(Object=json_data_5, AddressString=panel_21)
convertjson_5 = ConvertJSON(Object=accessjson_5)
transform = Transform(convertjson_5)
# Convert extracted data: The Convert JSON component automatically
# converts JSON properties
# to known geometry types.
matrix = TransformMatrix(transform, Digits=3)
