# Grasshopper definition 7A-AttributeVisualization.ghx (Grasshopper 1.0.7)
# plug-ins: ShapeDiverForGrasshopper, GrasshopperHyperGooComponents

number_of_spheres = Slider(100, range=1..100)
randomize = Slider(1, range=1..100)

# ----
# In this example, we create set of random spheres.
# For each sphere, we store as attributes its radius and distance to origin.
# We use the ShapeDiver Output component to create geometry
# that is compatible with the attributes visualization feature of the viewer.
mbox = MeshBox(Base={Plane=PlaneXY(0, 0, 0), X=Domain(-10, 10), Y=Domain(-10, 10), Z=Domain(-10, 10)}, XCount=10, YCount=10, ZCount=10)
random = Random(Range=Domain(0, 1), Number=number_of_spheres, Seed=randomize)
pop3d = Populate3D(Region=mbox, Count=number_of_spheres, Seed=randomize)
msphere = MeshSphere(Base=pop3d, Radius=random, UCount=10, VCount=20)

# ----
# Construct and inject attributes: Each sphere gets two attributes: a "radius" and a "distance" to the origin.
vlen = VectorLength(Vector=pop3d)
merge = Merge(Data1="radius", Data2="distance")  # -> graft(Result)
merge_2 = Merge(Data1=graft(random), Data2=graft(vlen))
constructattr = ConstructAttributes(Keys=flatten(merge), Values=merge_2)  # -> flatten(Attributes)
injectattr = InjectAttributes(Object=msphere, Attributes=constructattr)

# ----
# Typing output data: Output data (geometry and other primitives) must pass through a floating parameter of a specific type (Mesh, Surface, Number, Color...) before it is included in a ShapeDiver Output component.
spheres = Mesh(injectattr)

# ----
# Use the ShapeDiver Output component: Like the Display components, the ShapeDiver Output component can be used to define output geometry which can be visualized in the online viewer.
# However, it is the online component able to store and transfer custom attributes for each geometry asset in the scene.
# It needs to be used every time attribute visualization is required.
sdoutput = ShapeDiverOutput(
    Spheres=spheres,
    ParameterSchemas="""={
  "675ec376-6913-43bf-9f7b-7ebe0448d950": {
    "UniversalProperties": {
      "Structure": "item",
      "Guid": "78e26a3b-14d1-4aca-8aeb-e3ea3116172c",
      "ParamUiIndex": 536,
      "ParamGroupGuid": "ab23e0cd-2f8a-4f81-bc85-6c8becdd6583",
      "Name": "Spheres",
      "Description": "",
      "TypeCode": 211
    },
    "ImplementationType": "unknown",
    "ImplementationProperties": {}
  }
}""")
