# Grasshopper definition 8A-SpecklePublish.ghx (Grasshopper 1.0.8)
# plug-ins: GrasshopperHyperGooComponents, ShapeDiverForGrasshopper, Speckle.Connector.Grasshopper

# Use the synchronous Load and Publish components from the Dev category!
# This model requires a personal access token for your Speckle account.
# How to create one: https://speckle.guide/dev/tokens.html
# 
# The folllowing scopes are required:
# "profile:read", "streams:read", "streams:write"
# 
# WARNING: Storing your token in a Grasshopper file, or importing it
# using a ShapeDiver Text input, is not good practice for security.
# 
# We recommend to store API keys and passwords in your ShapeDiver account
# and using the ShapeDiver Secret input to retrieve them in your definitions.
speckle_model_url = DirectTextInput(maxlength=10000)
secretinput = SecretInput(SecretName="speckle-token")
speckle_token = DirectTextInput(maxlength=10000)
path_local_testing = FilePath("C:\Users\mathi\Downloads\241126_SpeckleImporterExampleSmall.3dm")
import_from_url = DirectTextInput(maxlength=10000)
import_from_file = ImportGeometry(
    URI=import_from_url,
    maximum_file_size=52428800,
    selected_file_formats="application/3dm,application/3ds,application/ai,application/amf,application/dgn,application/dwg,application/dxf,application/fbx,application/off,application/pdf,application/ply,application/postscript,application/skp,application/sla,application/slc,application/step,application/vda,application/wavefront-obj,image/svg+xml,model/3mf,model/iges,model/stl")  # -> Object, Material, Filename

# ---- group: Speckle
# Speckle stream
# Speckle personal access token.
# Use a ShapeDiver Secret input
# for better security
txt = Text(speckle_token)
txt_2 = Text(speckle_model_url)

# ---- group: File
# File import
geo = Geometry(import_from_file.Object)
txt_3 = Text(import_from_file.Filename)

# ----
# Convert attributes
geo_2 = Geometry(geo)
extractattr = ExtractAttributes(Object=geo_2)
accesskey = AccessKey(Object=extractattr, Key="layer")
accesskey_2 = AccessKey(Object=extractattr, Key="material")
geo_3 = Geometry(geo)
col = Colour(accesskey_2)
cp = CreateProperties(Layer=accesskey, AlwaysInheritNames=False, CreateEmptyProperties=False)
material = CreateMaterial(Diffuse=col, Specular=RGB(255, 255, 255), Emission=RGB(0, 0, 0), Transparency=0, Shine=0)
sg = SpeckleGeometry(SpeckleGeometry=geo_3, Properties=cp, Material=material)  # -> SpeckleGeometry, Geometry, Name, Properties, Color, Material, Path
cc = CreateCollection(SubCollection1=sg.SpeckleGeometry, AlwaysInheritNames=False)

# ----
# Get Speckle Model URL
# with authentication token
txt_4 = Text(txt_2)
txt_5 = Text(txt)
url = SpeckleModelURL(SpeckleUrl=txt_4, SpeckleToken=txt_5)

# ----
# Display imported geometry
panel = Panel("Filename: ")
geo_4 = Geometry(geo)
concat = Concatenate(FragmentA=panel, FragmentB=txt_3)
gltfdisplay = GlTF20Display(Geometry=geo_4)

publish = BooleanToggle(False)

# ----
# Synchronous! Publish
sp = SyncPublish(SpeckleModel=url, Collection=cc, Run=publish)

panel_2 = Panel(sp)
specklemodelresult = DirectDataOutput(Data=sp)
