# Grasshopper definition 8B-SpeckleLoad.ghx (Grasshopper 1.0.7)
# plug-ins: ShapeDiverForGrasshopper, Speckle.Connector.Grasshopper

secretinput = SecretInput(SecretName="speckle-token")  # disabled
speckle_token = DirectTextInput(maxlength=10000)
# Use the synchronous Load and Publish components from the Dev category!
# This model requires a personal access token for your Speckle account.
# How to create one: https://speckle.guide/dev/tokens.html
# 
# The folllowing scopes are required:
# "profile:read", "streams:read", "streams:write"
# 
# WARNING: Storing your token in a Grasshopper file, or importing it
# using a ShapeDiver Text input, is not good practice for security.
# 
# We recommend to store API keys and passwords in your ShapeDiver account
# and using the ShapeDiver Secret input to retrieve them in your definitions.
speckle_model_url = DirectTextInput(maxlength=10000)

# ---- group: Speckle
# Speckle stream
# Speckle personal access token.
# Use a ShapeDiver Secret input
# for better security
txt = Text(speckle_token)
txt_2 = Text(speckle_model_url)

# ----
# Get Speckle Model URL
# with authentication token
txt_3 = Text(txt_2)
txt_4 = Text(txt)
url = SpeckleModelURL(SpeckleUrl=txt_3, SpeckleToken=txt_4)

load = BooleanToggle(True)

# ----
# Synchronous! Load the data
# from the Speckle model
sl = SyncLoad(SpeckleModel=url, Run=load)  # -> Collection, Properties
qo = QuerySpeckleObjects(Collection=sl.Collection)

# ----
# Display imported geometry
so = SpeckleObject(qo)
so_2 = SpeckleObject(SpeckleObject=so, HasApplicationIdParam=False)  # -> SpeckleObject, Geometries, Name, Properties, Path
geo = Geometry(graft(so))
sg = SpeckleGeometry(SpeckleGeometry=so_2.Geometries, HasApplicationIdParam=False)  # -> SpeckleGeometry, Geometry, Color, Material, Path
material = Material(SpeckleParam=sg.Material)  # -> Name, Opacity, Metalness, Roughness, Diffuse, Emissive, DiffuseColor, EmissiveColor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
col = Colour(flatten(material.Diffuse))
gltfdisplay = GlTF20Display(Geometry=geo, Material=col)

# ---- group: 3dm export
version = ValueList({"Rhino 6": 6, "Rhino 7": 7, "Rhino 8": 8}, selected="Rhino 7")
export3dm = _3dmExportOptions(Version=version)
downloadexport = DownloadExport(Data=qo, Options=export3dm, Name="SpeckleExport")
