# Grasshopper definition 11A-AppBuilder_Tutorial1.ghx (Grasshopper 1.0.7)
# Copyright: Mohammad Yazdi
# plug-ins: ShapeDiverForGrasshopper

rotation_angle = Slider(45, range=0..180)
roof_thickness = Slider(2.75, range=0..10)
floor_height = Slider(7.14, range=0..10)
floor_count = Slider(15, range=0..100)
roof_offset = Slider(4.47, range=0..10)

# ----
# Build a text widget
# Text widget: Plain text can be used or markdown for some formatting options
panel = Panel("""# Heading level 1
## :span[Heading level 2]{color="lightgreen"}
### Heading level 3

:span[This shows]{color="blue"} **:span[bold text]{color="#ff00ff"}** mixed with *:span[italic]{color="gray"}* and normal text.

Italicized text is the *cat's meow*.

*:span[This is italic text.]{color="green"}*

The text widget uses  [github-flavored markdown](https://docs.github.com/en/get-started/writing-on-github/getting-started-with-writing-and-formatting-on-github/basic-writing-and-formatting-syntax), with a an extension for colored text.

* :span[Bullet in an unordered list]{color="blue"}.
* Bullet in an unordered list.""")
txt = Text(panel)
buildtextwidget = BuildTextWidget(Text=txt)

rigid = BooleanToggle(False)
# Inputs
curve = Curve(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)
# App Builder Tutorial 1:
# Basic App Builder setup with two containers, parameter and text widgets.
panel_2 = Panel(" floors")
concat = Concatenate(FragmentA="Download ", FragmentB=floor_count, FragmentC=panel_2)
# Main Algorithm
rotating_tower = RotatingTower(
    plan_curve=curve,
    rotation_angle=rotation_angle,
    rigid=rigid,
    floor_height=floor_height,
    floor_count=floor_count,
    roof_thickness=roof_thickness,
    roof_offset=roof_offset)  # -> roof, roof_solid, floor, facade
# Display
gltf2material = GlTF20Material(
    BaseColorFactor=ColourSwatch(SwatchColor=RGB(138, 138, 138)),
    MetallicFactor=0,
    RoughnessFactor=1,
    EmissiveFactor=RGB(0, 0, 0),
    AlphaMode="OPAQUE",
    AlphaCutoff=0.5,
    DoubleSided=True)
gltf2material_2 = GlTF20Material(
    BaseColorFactor=ColourSwatch(SwatchColor=RGB(97, 194, 194)),
    MetallicFactor=0,
    RoughnessFactor=1,
    EmissiveFactor=RGB(0, 0, 0),
    AlphaMode="OPAQUE",
    AlphaCutoff=0.5,
    DoubleSided=True)
# Parameter Widget: ...or directly connect the parameter name
panel_3 = Panel("Twist this tower!")

# ----
# Build parameter widgets
# from inputs of the definition
# Parameter Widget: Use the Parameter Reference component in order to override some parameter properties...
# Parameter Widget: The names of sliders, value lists, toggles, ShapeDiver Import components, etc... can be used to build the parameter widget.
panel_4 = Panel("Rotation Angle")
merge = Merge(Data1="Floor Height", Data2="Floor Count", Data3="Rigid")

roof = GlTF20Display(Geometry=rotating_tower.roof_solid, Material=gltf2material)
facade = GlTF20Display(Geometry=rotating_tower.facade, Material=gltf2material_2)
paramctrl = ParameterControl(Name=panel_4, DisplayName="Rotation Angle (degrees)", Tooltip=panel_3)
paramctrl_2 = ParameterControl(Name=merge)
rhino_version = ValueList({"Rhino 6": 6, "Rhino 7": 7}, selected="Rhino 7")
controlswidget = ControlsWidget(Controls=paramctrl_2)
controlswidget_2 = ControlsWidget(Controls=paramctrl)
accordionitem = AccordionItem(Label="Floor inputs", Widgets=controlswidget)
# Exports
export3dm = _3dmExportOptions(Version=rhino_version)
merge_2 = Merge(Data1=controlswidget_2, Data2=accordionitem)
export_3dm = DownloadExport(Data=[rotating_tower.roof_solid, rotating_tower.facade], Options=export3dm, Name="example_3dm")

# ----
# Build parameter widgets
# from exports of the definition
# (download buttons)
# Widgets: More widgets are coming: charts, legends, saved states, etc...
panel_5 = Panel("Rhino Version")
exportctrl = ExportControl(Name="Export 3DM")

paramctrl_3 = ParameterControl(Name=panel_5)
merge_3 = Merge(Data1=paramctrl_3, Data2=exportctrl)

controlswidget_3 = ControlsWidget(Controls=merge_3)

# ----
# Build tabs from widgets
# Tabs: The name and icon will be displayed in the app (default template).
# 
# The list of available icons is available here: https://help.shapediver.com/doc/build-tab
panel_6 = Panel(concat)
tab = Tab(Name="Exports", Icon="arrow-down", Tooltip=panel_6, Widgets=controlswidget_3)

tab_2 = Tab(Name="Details", Icon="settings", Tooltip="Example tooltip 1", Widgets=buildtextwidget)

# ----
# Build containers from tabs and/or widgets
# Containers: In the default template, four container names can be used: top, left, right and bottom.
# 
# Use widgets directly if your container does not need to be split into tabs.
merge_4 = Merge(Data1=tab_2, Data2=tab)
buildcontainer = BuildContainer(Name="left", Widgets=merge_2)
buildcontainer_2 = BuildContainer(Name="right", Tabs=merge_4)

# ----
# Build an app from containers
merge_5 = Merge(Data1=buildcontainer, Data2=buildcontainer_2)
app = App(Containers=merge_5)

# ==== cluster RotatingTower: Generates a Rotating Tower
rotation_angle = ClusterInput()
plan_curve = ClusterInput()

# ---- group: Rotation Angle
rigid = ClusterInput()

# ----
floor_height = ClusterInput()
floor_count = ClusterInput()
roof_thickness = ClusterInput()
roof_offset = ClusterInput()
curve = Curve(plan_curve)
polygon_center = PolygonCenter(Polyline=curve)  # -> CenterV, CenterE, CenterA
surface = Surface(curve)
unit_z = UnitZ(Factor=floor_height)
extrude = Extrude(Base=surface, Direction=unit_z)
multiplication = Multiplication(A=floor_height, B=floor_count)
addition = Addition(A=floor_height, B=roof_thickness)
unit_z_2 = UnitZ(Factor=addition)
line_sdl = LineSDL(Start=polygon_center.CenterV, Direction=Vector(0, 0, 1), Length=multiplication)
linear_array = LinearArray(Geometry=extrude, Direction=unit_z_2, Count=floor_count)  # -> Geometry, Transform
explode = Explode(Curve=curve, Recursive=True)  # -> Segments, Vertices
twist = Twist(Geometry=linear_array.Geometry, Axis=line_sdl, Angle=degrees(rotation_angle), Infinite=False, Rigid=rigid)
list_length = ListLength(List=explode.Segments)  # -> expr("x+1", Length)
deconstruct_brep = DeconstructBrep(Brep=twist)  # -> Faces, Edges, Vertices
panel = Panel(["0", list_length])
list_item = ListItem(List=deconstruct_brep.Faces, Index=0, Wrap=True)  # -> Item1, Item
cull_index = CullIndex(List=deconstruct_brep.Faces, Indices=flatten(panel), Wrap=True)
surface_2 = Surface(list_item.Item1)
curve_2 = Curve(surface_2)
curve_3 = Curve(list_item.Item)
unit_z_3 = UnitZ(Factor=roof_thickness)
offset_curve = OffsetCurve(Curve=surface_2, Distance=roof_offset, Corners=1)
surface_3 = Surface(offset_curve)
surface_4 = Surface(cull_index)
extrude_2 = Extrude(Base=surface_3, Direction=unit_z_3)
roof_solid = ClusterOutput(extrude_2)
roof = ClusterOutput(curve_2)
floor = ClusterOutput(curve_3)
facade = ClusterOutput(surface_4)
