# Grasshopper definition 11A_AppBuilder_Tutorial1.ghx (Grasshopper 1.0.8)
# Copyright: Mohammad Yazdi
# plug-ins: ShapeDiverForGrasshopper

sddb = ShapeDiverDatabase({AbsoluteTolerance=0, AngleTolerance=0, AppDescription="", AppName="rotating-tower-3", DistanceDisplayPrecision=0, DocumentName="rotating-tower-3*", GltfVersion="Gltf1", GrasshopperVersion="1.0.0008", InputGroups="{}", OutputGroups="{}", RelativeTolerance=0, RhinoVersion="8.17.25066.7001"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})
rotation_angle = Slider(45, range=0..180)
roof_thickness = Slider(2.75, range=0..10)
floor_height = Slider(7.14, range=0..10)
floor_count = Slider(15, range=0..100)
roof_offset = Slider(4.47, range=0..10)

# ----
# Build a text widget
# Plain text can be used or markdown for some formatting options
# More widgets are coming: charts, legends, saved states, etc...
panel = Panel("""# Heading level 1
## :span[Heading level 2]{color="lightgreen"}
### Heading level 3

:span[This shows]{color="blue"} **:span[bold text]{color="#ff00ff"}** mixed with *:span[italic]{color="gray"}* and normal text.

Italicized text is the *cat's meow*.

*:span[This is italic text.]{color="green"}*

The text widget uses  [github-flavored markdown](https://docs.github.com/en/get-started/writing-on-github/getting-started-with-writing-and-formatting-on-github/basic-writing-and-formatting-syntax), with a an extension for colored text.

* :span[Bullet in an unordered list]{color="blue"}.
* Bullet in an unordered list.""")
txt = Text(panel)
buildtextwidget = BuildTextWidget(Text=txt)

rigid = BooleanToggle(False)
# Inputs
curve = Curve(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)
# App Builder Tutorial 1:
# Basic App Builder setup with two containers, parameter and text widgets.
panel_2 = Panel(" floors")
concat = Concatenate(FragmentA="Download ", FragmentB=floor_count, FragmentC=panel_2)
# Main Algorithm
gumballinput = GumballInput(
    EnableTranslationAxes_X=True,
    EnableTranslationAxes_Y=True,
    EnableTranslationAxes_Z=True,
    EnableRotationAxes_X=True,
    EnableRotationAxes_Y=True,
    EnableRotationAxes_Z=True,
    EnableScalingAxes_X=False,
    EnableScalingAxes_Y=False,
    EnableScalingAxes_Z=False)  # -> Names, Transforms
rotating_tower = RotatingTower(
    plan_curve=curve,
    rotation_angle=rotation_angle,
    rigid=rigid,
    floor_height=floor_height,
    floor_count=floor_count,
    roof_thickness=roof_thickness,
    roof_offset=roof_offset)  # -> roof, roof_solid, floor, facade
# Display
gltf2material = GlTF20Material(
    BaseColorFactor=ColourSwatch(SwatchColor=RGB(138, 138, 138)),
    MetallicFactor=0,
    RoughnessFactor=1,
    EmissiveFactor=RGB(0, 0, 0),
    AlphaMode="OPAQUE",
    AlphaCutoff=0.5,
    DoubleSided=True)
gltf2material_2 = GlTF20Material(
    BaseColorFactor=ColourSwatch(SwatchColor=RGB(97, 194, 194)),
    MetallicFactor=0,
    RoughnessFactor=1,
    EmissiveFactor=RGB(0, 0, 0),
    AlphaMode="OPAQUE",
    AlphaCutoff=0.5,
    DoubleSided=True)
# ...or directly connect the parameter name
panel_3 = Panel("Twist this tower!")
roof = GlTF20Display(Geometry=rotating_tower.roof_solid, Material=gltf2material)
facade = GlTF20Display(Geometry=rotating_tower.facade, Material=gltf2material_2)
rhino_version = ValueList({"Rhino 6": 6, "Rhino 7": 7}, selected="Rhino 7")
# Exports
export3dm = _3dmExportOptions(Version=rhino_version)
export_3dm = DownloadExport(Data=[rotating_tower.roof_solid, rotating_tower.facade], Options=export3dm, Name="example_3dm")

# ----
# Build parameter widgets
# from exports of the definition
# (download buttons)
panel_4 = Panel("Rhino Version")
exportref = ExportReference(Name="Export 3DM")

merge = Merge(Data1=panel_4, Data2=exportref)

paramwidget = ParameterWidget(ParametersAndExports=merge, PreserveOrdering=True)

# ----
# Build tabs from widgets
# The name and icon will be displayed in the app (default template).
# The list of available icons is available here: https://help.shapediver.com/doc/build-tab
panel_5 = Panel(concat)
tab = Tab(Name="Exports", Icon="arrow-down", Tooltip=panel_5, Widgets=paramwidget)

tab_2 = Tab(Name="Details", Icon="settings", Tooltip="Example tooltip 1", Widgets=buildtextwidget)

# ----
# Build parameter widgets
# from inputs of the definition
# The names of sliders, value lists, toggles, ShapeDiver Import components, etc... can be used to build the parameter widget.
panel_6 = Panel("Rotation Angle")

# ----
# Use the Parameter Reference component in order to override some parameter properties...
paramref = ParameterReference(Name=panel_6, DisplayName="Rotation Angle (degrees)", Tooltip=panel_3, Validation=False)

merge_2 = Merge(Data1=paramref, Data2="Floor Height", Data3="Floor Count", Data4="Rigid")
paramwidget_2 = ParameterWidget(ParametersAndExports=merge_2, PreserveOrdering=True)

# ----
# Build containers from tabs and/or widgets
# In the default template, four container names can be used: top, left, right and bottom
# Use widgets directly if your container does not need to be split into tabs
merge_3 = Merge(Data1=tab_2, Data2=tab)
buildcontainer = BuildContainer(Name="right", Tabs=merge_3)
buildcontainer_2 = BuildContainer(Name="left", Widgets=paramwidget_2)

# ----
# Build an app from containers
merge_4 = Merge(Data1=buildcontainer_2, Data2=buildcontainer)
app = App(Containers=merge_4)

# ==== cluster RotatingTower: Generates a Rotating Tower
rotation_angle = ClusterInput()
plan_curve = ClusterInput()

# ---- group: Rotation Angle
rigid = ClusterInput()

# ----
floor_height = ClusterInput()
floor_count = ClusterInput()
roof_thickness = ClusterInput()
roof_offset = ClusterInput()
curve = Curve(plan_curve)
polygon_center = PolygonCenter(Polyline=curve)  # -> CenterV, CenterE, CenterA
surface = Surface(curve)
unit_z = UnitZ(Factor=floor_height)
extrude = Extrude(Base=surface, Direction=unit_z)
multiplication = Multiplication(A=floor_height, B=floor_count)
addition = Addition(A=floor_height, B=roof_thickness)
unit_z_2 = UnitZ(Factor=addition)
line_sdl = LineSDL(Start=polygon_center.CenterV, Direction=Vector(0, 0, 1), Length=multiplication)
linear_array = LinearArray(Geometry=extrude, Direction=unit_z_2, Count=floor_count)  # -> Geometry, Transform
explode = Explode(Curve=curve, Recursive=True)  # -> Segments, Vertices
twist = Twist(Geometry=linear_array.Geometry, Axis=line_sdl, Angle=degrees(rotation_angle), Infinite=False, Rigid=rigid)
list_length = ListLength(List=explode.Segments)  # -> expr("x+1", Length)
deconstruct_brep = DeconstructBrep(Brep=twist)  # -> Faces, Edges, Vertices
panel = Panel(["0", list_length])
list_item = ListItem(List=deconstruct_brep.Faces, Index=0, Wrap=True)  # -> Item1, Item
cull_index = CullIndex(List=deconstruct_brep.Faces, Indices=flatten(panel), Wrap=True)
surface_2 = Surface(list_item.Item1)
curve_2 = Curve(surface_2)
curve_3 = Curve(list_item.Item)
unit_z_3 = UnitZ(Factor=roof_thickness)
offset_curve = OffsetCurve(Curve=surface_2, Distance=roof_offset, Corners=1)
surface_3 = Surface(offset_curve)
surface_4 = Surface(cull_index)
extrude_2 = Extrude(Base=surface_3, Direction=unit_z_3)
roof_solid = ClusterOutput(extrude_2)
roof = ClusterOutput(curve_2)
floor = ClusterOutput(curve_3)
facade = ClusterOutput(surface_4)
