# Grasshopper definition 11B-AppBuilder_Tutorial2.ghx (Grasshopper 1.0.7)
# Copyright: Mohammad Yazdi
# plug-ins: ShapeDiverForGrasshopper

sddb = ShapeDiverDatabase({AbsoluteTolerance=0, AngleTolerance=0, AppDescription="", AppName="rotating-tower-3", DistanceDisplayPrecision=0, DocumentName="rotating-tower-3*", GltfVersion="Gltf1", GrasshopperVersion="1.0.0007", InputGroups="{}", OutputGroups="{}", RelativeTolerance=0, RhinoVersion="7.38.24338.17001"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})
rotation_angle = Slider(45, range=0..180)
roof_thickness = Slider(2.75, range=0..10)
floor_height = Slider(7.14, range=0..10)
floor_count = Slider(15, range=0..100)
# App Builder Tutorial 2:
roof_offset = Slider(4.47, range=0..10)
tolerance = ToleranceSettings(AbsoluteTolerance=0.01, RelativeTolerance=1, AngleTolerance=1, UnitSystem=9)
rigid = BooleanToggle(False)
# Inputs
floor_plan = ImportGeometry(
    maximum_file_size=52428800,
    selected_file_formats="application/3dm,application/3ds,application/ai,application/amf,application/dgn,application/dwg,application/dxf,application/fbx,application/off,application/pdf,application/ply,application/postscript,application/skp,application/sla,application/slc,application/step,application/vda,application/wavefront-obj,image/svg+xml,model/3mf,model/iges,model/stl")  # -> Object, Material, Filename

# ----
# Contextual parameters: Those parameters are only shown after a file is uploaded.
panel = Panel("Rotation Angle")
merge = Merge(Data1=panel, Data2="Floor Height", Data3="Floor Count", Data4="Rigid")

# ----
# Define parametric logic for the user interface.
# 
# In this app, users are able to upload a file containing a curve defining the tower's floor plan.
# 
# The file upload parameter is always shown in the interface, but we test if a curve exists before showing the other App parameters.
panel_2 = Panel("Floor Plan")
crv = Curve(floor_plan.Object)
null = NullItem(Item=crv)  # -> NullFlags, InvalidFlags, Description
# Main Algorithm
rotating_tower = RotatingTower(
    plan_curve=floor_plan.Object,
    rotation_angle=rotation_angle,
    rigid=rigid,
    floor_height=floor_height,
    floor_count=floor_count,
    roof_thickness=roof_thickness,
    roof_offset=roof_offset)  # -> roof, roof_solid, floor, facade
filter = StreamFilter(Gate=null.NullFlags, Stream0=merge)

# ----
# Display instructions
# Contextual text: The text widget is only displayed in case no file has been uploaded yet.
panel_3 = Panel("Import a file containing your floor plan to create a twisted tower.")
textwidget = TextWidget(Text=panel_3)

# ----
# Display
gltf2material = GlTF20Material(
    BaseColorFactor=ColourSwatch(SwatchColor=RGB(138, 138, 138)),
    MetallicFactor=0,
    RoughnessFactor=1,
    EmissiveFactor=RGB(0, 0, 0),
    AlphaMode="OPAQUE",
    AlphaCutoff=0.5,
    DoubleSided=True)
gltf2material_2 = GlTF20Material(
    BaseColorFactor=ColourSwatch(SwatchColor=RGB(97, 194, 194)),
    MetallicFactor=0,
    RoughnessFactor=1,
    EmissiveFactor=RGB(0, 0, 0),
    AlphaMode="OPAQUE",
    AlphaCutoff=0.5,
    DoubleSided=True)

# ----
# Build parameter widgets
# from inputs of the definition
# Parameter widget: The names of sliders, value lists, toggles, ShapeDiver Import components, etc... can be used to build the parameter widget.
merge_2 = Merge(Data1=panel_2, Data2=filter)
paramctrl = ParameterControl(Name=merge_2)
controlswidget = ControlsWidget(Controls=paramctrl)
merge_3 = Merge(Data1=controlswidget, Data2=textwidget)
filter_2 = StreamFilter(Gate=null.NullFlags, Stream0=controlswidget, Stream1=merge_3)

roof = GlTF20Display(Geometry=rotating_tower.roof_solid, Material=gltf2material)
facade = GlTF20Display(Geometry=rotating_tower.facade, Material=gltf2material_2)
rhino_version = ValueList({"Rhino 6": 6, "Rhino 7": 7}, selected="Rhino 7")
# Exports
export3dm = _3dmExportOptions(Version=rhino_version)
export_3dm = DownloadExport(Data=[rotating_tower.roof_solid, rotating_tower.facade], Options=export3dm, Name="example_3dm")

# ----
# Build containers from tabs and/or widgets
# Containers: In the default template, four container names can be used: top, left, right and bottom.
# 
# Use widgets directly if your container does not need to be split into tabs.
panel_4 = Panel("left")
buildcontainer = BuildContainer(Name=panel_4, Widgets=filter_2)

# ----
# Build an app from containers
app = App(Containers=buildcontainer)

# ==== cluster RotatingTower: Generates a Rotating Tower
rotation_angle = ClusterInput()
plan_curve = ClusterInput()

# ---- group: Rotation Angle
rigid = ClusterInput()

# ----
floor_height = ClusterInput()
floor_count = ClusterInput()
roof_thickness = ClusterInput()
roof_offset = ClusterInput()
curve = Curve(plan_curve)
polygon_center = PolygonCenter(Polyline=curve)  # -> CenterV, CenterE, CenterA
surface = Surface(curve)
unit_z = UnitZ(Factor=floor_height)
extrude = Extrude(Base=surface, Direction=unit_z)
multiplication = Multiplication(A=floor_height, B=floor_count)
addition = Addition(A=floor_height, B=roof_thickness)
unit_z_2 = UnitZ(Factor=addition)
line_sdl = LineSDL(Start=polygon_center.CenterV, Direction=Vector(0, 0, 1), Length=multiplication)
linear_array = LinearArray(Geometry=extrude, Direction=unit_z_2, Count=floor_count)  # -> Geometry, Transform
explode = Explode(Curve=curve, Recursive=True)  # -> Segments, Vertices
twist = Twist(Geometry=linear_array.Geometry, Axis=line_sdl, Angle=degrees(rotation_angle), Infinite=False, Rigid=rigid)
list_length = ListLength(List=explode.Segments)  # -> expr("x+1", Length)
deconstruct_brep = DeconstructBrep(Brep=twist)  # -> Faces, Edges, Vertices
panel = Panel(["0", list_length])
list_item = ListItem(List=deconstruct_brep.Faces, Index=0, Wrap=True)  # -> Item1, Item
cull_index = CullIndex(List=deconstruct_brep.Faces, Indices=flatten(panel), Wrap=True)
surface_2 = Surface(list_item.Item1)
curve_2 = Curve(surface_2)
curve_3 = Curve(list_item.Item)
unit_z_3 = UnitZ(Factor=roof_thickness)
offset_curve = OffsetCurve(Curve=surface_2, Distance=roof_offset, Corners=1)
surface_3 = Surface(offset_curve)
surface_4 = Surface(cull_index)
extrude_2 = Extrude(Base=surface_3, Direction=unit_z_3)
roof_solid = ClusterOutput(extrude_2)
roof = ClusterOutput(curve_2)
floor = ClusterOutput(curve_3)
facade = ClusterOutput(surface_4)
