# Grasshopper definition 11H-FloatingContainer2d.ghx (Grasshopper 1.0.7)
# plug-ins: ShapeDiverForGrasshopper

# ----
# Widgets: Widgets displayed inside the floating container.
panel = Panel("https://images.dog.ceo/breeds/samoyed/n02111889_1984.jpg")
textwidget = TextWidget(Text="An example 2d anchor container.")
imagewidget = ImageWidget(URI=panel)
textwidget_2 = TextWidget(textwidget)
imagewidget_2 = ImageWidget(imagewidget)

# ----
# Add floating containers attached to a 2D location on the 3D viewer canvas.
# Geometry: Dummy geometry for reference.
mbox = MeshBox(Base={Plane=PlaneXY(0, 0, 0), X=Domain(-10, 10), Y=Domain(-10, 10), Z=Domain(-10, 10)}, XCount=10, YCount=10, ZCount=10)

# ----
# Testing parameters: ShapeDiver parameters of the 2D anchored container. Location X/Y and width are CSS values. Cull Pattern only passes the icon name when previewIcon is on.
width = DirectTextInput(maxlength=10000, text="20rem")
locationx = DirectTextInput(maxlength=10000, text="calc(100%-1rem)")
locationy = DirectTextInput(maxlength=10000, text="1rem")
draggable = BooleanToggle(False)
usecontainer = BooleanToggle(False)
allowpointerevents = BooleanToggle(True)
previewicon = BooleanToggle(False)
cull = CullPattern(List="dog", CullPattern=previewicon)
width_2 = Width(width)
locationx_2 = LocationX(locationx)
locationy_2 = LocationY(locationy)
draggable_2 = Draggable(draggable)
usecontainer_2 = UseContainer(usecontainer)
allowpointerevents_2 = AllowPointerEvents(allowpointerevents)
previewicon_2 = PreviewIcon(cull)

# ----
# Testing container: Left container with controls to test various 2D floating container settings.
panel_2 = Panel("width")
merge = Merge(
    Data1=panel_2,
    Data2="locationX",
    Data3="locationY",
    Data4="draggable",
    Data5="useContainer",
    Data6="previewIcon",
    Data7="allowPointerEvents")
paramctrl = ParameterControl(Name=merge)
controlswidget = ControlsWidget(Controls=paramctrl)
container = Container(Location="left", AppBuilderWidgets=controlswidget)

# ----
# Floating Container: Screen Point defines the 2D anchor (CSS X/Y). Container Properties sets id, width, preview icon and useContainer. draggable and allowPointerEvents have no dedicated input and are passed as Custom Properties (Construct JSON). Floating Container combines location, properties and widgets.
usecontainer_3 = UseContainer(usecontainer_2)
previewicon_3 = PreviewIcon(previewicon_2)
allowpointerevents_3 = AllowPointerEvents(allowpointerevents_2)
locationx_3 = LocationX(locationx_2)
locationy_3 = LocationY(locationy_2)
address = Panel("""draggable
allowPointerEvents""")
textwidget_3 = TextWidget(textwidget_2)
imagewidget_3 = ImageWidget(imagewidget_2)
draggable_3 = Draggable(draggable_2)
width_3 = Width(width_2)
sp = ScreenPoint(XPosition=locationx_3, YPosition=locationy_3)  # -> AppBuilderScreenPoint, XPosition, YPosition

merge_2 = Merge(Data1=draggable_3, Data2=allowpointerevents_3)
merge_3 = Merge(Data1=textwidget_3, Data2=imagewidget_3)

constructjson = ConstructJSON(Data=graft(merge_2), AddressString=address)
customproperties = Text(constructjson)
cp = ContainerProperties(
    ID="anchor2d_0",
    Width=width_3,
    Justification="top_right",
    PreviewIcon=previewicon_3,
    UseContainer=usecontainer_3,
    CustomProperties=flatten(customproperties))
fcontainer = FloatingContainer(Location=sp.AppBuilderScreenPoint, AppBuilderContainerProperties=cp, AppBuilderWidgets=merge_3)

# ----
# Build the App: Add the static testing container and the floating container to the App.
merge_4 = Merge(Data1=fcontainer, Data2=container)
app = App(AppBuilderContainer=merge_4)
