# Grasshopper definition 11I-FloatingContainer3d.ghx (Grasshopper 1.0.7)
# plug-ins: ShapeDiverForGrasshopper

# ----
# Testing parameters: ShapeDiver parameters of the 3D anchored container. Location is a point given as x,y,z, width and height are CSS values. Clean Tree removes the justification when none is selected, Cull Pattern only passes the preview icon when Add Preview Icon is on.
justification = ValueList({"none": null, "TL", "TC", "TR", "ML", "MC", "MR", "BL", "BC", "BR"}, selected="none")
allow_pointer_events = BooleanToggle(True)
preview_icon = DirectTextInput(maxlength=10000, text="world")
add_preview_icon = BooleanToggle(True)
width = DirectTextInput(maxlength=10000, text="20rem")
height = DirectTextInput(maxlength=10000, text="20rem")
location = DirectTextInput(maxlength=10000, text="0,0,0")
use_container = BooleanToggle(True)
hideable = BooleanToggle(False)
clean = CleanTree(Tree=justification, CleanInvalid=True, CleanEmpty=False)
cull = CullPattern(List=preview_icon, CullPattern=add_preview_icon)
use_container_2 = UseContainer(use_container)
height_2 = Height(height)
preview_icon_2 = PreviewIcon(cull)
location_2 = Location(location)
hideable_2 = Hideable(hideable)
allow_pointer_events_2 = AllowPointerEvents(allow_pointer_events)
width_2 = Width(width)
justification_2 = Justification(clean)

# ----
# Add floating containers attached to a 3D point in the scene.
# Geometry: Box geometry for reference, displayed with a glTF 2.0 Display component.
sizex = Slider(8, range=1..10)
sizey = Slider(2, range=1..10)
box = CenterBox(Base=PlaneXY(0, 0, 0), X=sizex, Y=sizey, Z=1)
gltfdisplay = GlTF20Display(Geometry=box)

# ----
# Floating Container: The location text is converted to a 3D point. Container Properties sets id, width, height, justification, preview icon and useContainer. allowPointerEvents and hideable have no dedicated input and are passed as Custom Properties (Construct JSON). Floating Container combines location, properties and widgets.
location_3 = Location(location_2)
height_3 = Height(height_2)
justification_3 = Justification(justification_2)
hideable_3 = Hideable(hideable_2)
width_3 = Width(width_2)
preview_icon_3 = PreviewIcon(preview_icon_2)
use_container_3 = UseContainer(use_container_2)
allow_pointer_events_3 = AllowPointerEvents(allow_pointer_events_2)
address = Panel("""allowPointerEvents
hideable""")
merge = Merge(Data1=allow_pointer_events_3, Data2=hideable_3)
merge_2 = Merge(Data1="SizeX", Data2="SizeY")
constructjson = ConstructJSON(Data=graft(merge), AddressString=address)
paramctrl = ParameterControl(Name=merge_2)
customproperties = CustomProperties(constructjson)
controlswidget = ControlsWidget(Controls=paramctrl)
cp = ContainerProperties(
    ID="anchor_3d_0",
    Width=width_3,
    Height=height_3,
    Justification=justification_3,
    PreviewIcon=preview_icon_3,
    UseContainer=use_container_3,
    CustomProperties=flatten(customproperties))
locationpoint = LocationPoint(location_3)
fcontainer = FloatingContainer(Location=locationpoint, AppBuilderContainerProperties=cp, AppBuilderWidgets=controlswidget)

# ----
# Testing container: Right container with controls to test various 3D floating container settings.
panel = Panel("Justification")
merge_3 = Merge(
    Data1=panel,
    Data2="Allow Pointer Events",
    Data3="Add Preview Icon",
    Data4="Preview Icon",
    Data5="Width",
    Data6="Height",
    Data7="Location",
    Data8="Use Container")
paramctrl_2 = ParameterControl(Name=merge_3)
controlswidget_2 = ControlsWidget(Controls=paramctrl_2)
container = Container(Location="right", AppBuilderWidgets=controlswidget_2)

# ----
# Build the App: Add the static testing container and the floating container to the App.
merge_4 = Merge(Data1=fcontainer, Data2=container)
app = App(AppBuilderContainer=merge_4)
