# Grasshopper definition 11J-ParameterValueSources.ghx (Grasshopper 1.0.7)
# plug-ins: ShapeDiverForGrasshopper

# ----
# Main algorithm
# Main algorithm: This simple definition creates a box with a parametric width. A glTF 2.0 Display component is used to show the box in the online App.
# 
# An Email Export component sends an email containing the image of the "MyScreenshot" Import Bitmap input (exported with the Image Export Options).
# 
# The body of the email is built with a Format component from the "MyModelState" Direct Text Input. The placeholder __PARAMS__ adds the parameter names and values used for the export.
# 
# In the App, both MyScreenshot and MyModelState are filled automatically using parameter value sources (see below).
mymodelstate = DirectTextInput(maxlength=10000)
# Loop data from the App to the definition using Parameter Sources.
# 
# In this example, we show how to get a screenshot and a model state from the App and include them in a file export.
boxwidth = Slider(0.27, range=0..1)
myscreenshot = ImportBitmap(maximum_file_size=52428800, selected_file_formats="image/bmp,image/gif,image/jpeg,image/png,image/tif")  # -> Bitmap, Width, Height, Filename
format = ValueList({"jpg", "png", "tiff", "bmp", "gif"}, selected="jpg")
panel = Panel("""A model state of your configuration was created with this export.
Model state ID: {0}""")
box = CenterBox(Base=PlaneXY(0, 0, 0), X=boxwidth, Y=1, Z=1)
exportimg = ImageExportOptions(Format=format, QualityLevel=100, N=False)
emailbody = Format(Format=panel, Culture=127, Data0=mymodelstate)
exportwithscreenshot = EmailExport(
    Data=myscreenshot.Bitmap,
    Options=exportimg,
    Name="test_export",
    To="mathieu@shapediver.com",
    Body=emailbody,
    AttachExport=False,
    AttachJSON=False)
gltfdisplay = GlTF20Display(Geometry=box)

# ----
# Parameter Controls: The App contains controls for the "BoxWidth" slider and for the "ScreenshotWidth" and "ScreenshotHeight" sliders, which define the resolution of the screenshot.
# 
# The "MyScreenshot" and "MyModelState" inputs are not included: their values are set automatically by the export.
panel_2 = Panel("ScreenshotHeight")
merge = Merge(Data1="BoxWidth", Data2="ScreenshotWidth", Data3=panel_2)
paramctrl = ParameterControl(Name=merge)

# ----
# Parameter value sources: Instead of a fixed value, a Parameter Value can get its value from a source, evaluated in the App when the export is triggered:
# 
# - Screenshot Source: captures a screenshot of the viewer (top camera, resolution from the ScreenshotWidth and ScreenshotHeight sliders) and uses it as the value of the "MyScreenshot" image input.
# 
# - Model state source: there is no component for it, a JSON object {"type": "modelState", "props": {...}} is used. A model state of the current configuration is created and used as the value of the "MyModelState" text input, which is included in the body of the email.
panel_3 = Panel("1280")
panel_4 = Panel("""{
  "type": "modelState",
  "props": {}
}""")
screenshotsource = ScreenshotSource(Camera="{\"name\":\"Top\",\"type\":\"orthographic\",\"direction\":\"top\"}", Width=panel_3, Height="720")
parametervalue = ParameterValue(Name="MyScreenshot", Source=screenshotsource)
parametervalue_2 = ParameterValue(Name="MyModelState", Source=panel_4)
merge_2 = Merge(Data1=parametervalue, Data2=parametervalue_2)

# ----
# App Builder logic
panel_5 = Panel("ExportWithScreenshot")
exportctrl = ExportControl(Name=panel_5, ParameterValues=merge_2)
merge_3 = Merge(Data1=paramctrl, Data2=exportctrl)
controlswidget = ControlsWidget(Controls=merge_3)
container = Container(Location="right", AppBuilderWidgets=controlswidget)
app = App(AppBuilderContainer=container)
