# Grasshopper definition 11K-CameraAction.ghx (Grasshopper 1.0.7)
# plug-ins: ShapeDiverForGrasshopper

# ----
# In this tutorial, we show various ways to control the camera through the Camera Action.
width = Slider(4, range=1..10)
depth = Slider(3, range=1..10)
height = Slider(6, range=1..10)
height_2 = Height(height)
width_2 = Width(width)
depth_2 = Depth(depth)

depth_3 = Depth(depth_2)
height_3 = Height(height_2)
width_3 = Width(width_2)
halfheight = Division(A=height_3, B="2")
boxcenterpt = ConstructPoint(XCoordinate=0, YCoordinate=0, ZCoordinate=halfheight)
box = CenterBox(Base=boxcenterpt, X=width_3, Y=depth_3, Z=halfheight)
boxcenter = BoxCenter(boxcenterpt)
box_2 = GlTF20Display(Geometry=box)

# ----
# Camera helpers
# Reusable helper definitions, shared by several buttons.
# 
# CAMERA SETTINGS define how the user can navigate once a camera is active: field of view, pan / rotation / zoom on or off, auto adjust, auto rotation speed, position restriction, zoom distance and polar / azimuth rotation limits.
# - TopSettings: rotation disabled, so the top view stays a plan view.
# Note: in the current viewer, cameras with settings are switched to instantly, so settings are best used with assign actions (button 1), not with moves or animations.
# 
# CAMERA MOTION defines how the camera travels to its new state: duration (seconds), easing and interpolation (used for paths through several cameras).
# - SmoothMotion: 2 s, Cubic.InOut.
# - OrbitMotion: 8 s, Linear.None for a constant speed, CatmullRom interpolation (the default value, so it doesn't appear in the JSON).
panel = Panel("Cubic.InOut")
topsettings = CameraSettings(EnableRotation="False")
smoothmotion = CameraMotion(Duration="1", Easing=panel, Interpolation="CatmullRom")
orbitmotion = CameraMotion(Duration="5", Easing="Linear.None", Interpolation="CatmullRom")
topsettings_2 = TopSettings(topsettings)
orbitmotion_2 = OrbitMotion(orbitmotion)
smoothmotion_2 = SmoothMotion(smoothmotion)

# ---- group: 6 ORBIT
# Camera path
# Button 3 - Animate the camera along a path.
# 
# 13 points on a circle (radius 20 m, 8 m above the ground; the first point is repeated at the end to close the loop) are used as camera positions, all looking at the box centre.
# 
# When the Camera Action receives several cameras, it creates an "animate" action that moves through all of them with the Camera Motion.
# 
# The Type of an animation is taken from the FIRST camera only. We therefore split the first point off, make it a Perspective camera, and merge it back in front of the other cameras.
orbitmotion_3 = OrbitMotion(orbitmotion_2)
boxcenter_2 = BoxCenter(boxcenter)
orbitparams = Range(Domain=Domain(0, 1), Steps="12")
orbitcentre = ConstructPoint(XCoordinate=0, YCoordinate=0, ZCoordinate="8")
orbitcircle = Circle(Plane=orbitcentre, Radius="20")
orbitpoints = EvaluateCurve(Curve=reparameterize(orbitcircle), Parameter=orbitparams)  # -> Point, Tangent, Angle
splitfirst = SplitList(List=orbitpoints.Point, Index="1")  # -> ListA, ListB
firstcamera = Camera(Type="Perspective", Position=splitfirst.ListA, Target=boxcenter_2)
pathcameras = Camera(Position=splitfirst.ListB, Target=boxcenter_2)
orbitpath = Merge(Data1=firstcamera, Data2=pathcameras)
orbitaction = CameraAction(Cameras=orbitpath, CameraMotion=orbitmotion_3)
orbitctrl = ActionControl(Label="Orbit", Action=orbitaction)
orbitcontrol = OrbitControl(orbitctrl)

# ---- group: 5 CUSTOM
# Set camera position and target
# Button 2 - Move the camera to a custom position and target.
# 
# The Camera component receives a Type (Perspective), a Position and a Target. With a single camera, the Camera Action creates a "set" action: the viewer switches back to the perspective camera (e.g. after the top view) and moves it to the new position with the Camera Motion (SmoothMotion: 2 s, Cubic.InOut).
# 
# No Camera Settings are given here: with settings, the move would not be animated in the current viewer.
boxcenter_3 = BoxCenter(boxcenter)
smoothmotion_3 = SmoothMotion(smoothmotion_2)
customcamera = Camera(Type="Perspective", Position="{14, -16, 9}", Target=boxcenter_3)
customaction = CameraAction(Cameras=customcamera, CameraMotion=smoothmotion_3)
customctrl = ActionControl(Label="Custom view", Action=customaction)
customcontrol = CustomControl(customctrl)

# ---- group: 4 PRESET
# Switch camera
# Button 1 - Assign a preset camera.
# 
# The Camera input of the Camera component receives the name of a predefined camera: Perspective, Top, Bottom, Left, Right, Front or Back (also available in the right-click menu > ShapeDiver Helpers).
# 
# With a camera name and no position / target, the Camera Action creates an "assign" action: the viewer switches to this camera. The Camera Settings travel with the camera (here: no rotation).
# Assign actions don't use a Camera Motion.
panel_2 = Panel("Top")
topsettings_3 = TopSettings(topsettings_2)
topcamera = Camera(Camera=panel_2, CameraSettings=topsettings_3)
presetaction = CameraAction(Cameras=topcamera)
presetctrl = ActionControl(Label="Top view", Action=presetaction)
presetcontrol = PresetControl(presetctrl)

# ---- group: 7 ZOOM
# Zoom to node
# Action 4 - Zoom to a node.
# 
# When the Camera Action receives Node Names and no camera, it creates a "zoomTo" action: the active camera zooms to fit the matching nodes, using the Camera Motion.
# 
# The node name is the nickname of the glTF 2.0 Display component ("Box"). Objects named with the ShapeDiver "name" attribute are addressed as <nickname>.<name>, e.g. Box.top.
smoothmotion_4 = SmoothMotion(smoothmotion_2)
zoomaction = CameraAction(NodeNames="Box", CameraMotion=smoothmotion_4)
zoomctrl = ActionControl(Label="Zoom to box", Action=zoomaction)
zoomcontrol = ZoomControl(zoomctrl)

# ---- group: 8 APP
# App
presetcontrol_2 = PresetControl(presetcontrol)
customcontrol_2 = CustomControl(customcontrol)
orbitcontrol_2 = OrbitControl(orbitcontrol)
zoomcontrol_2 = ZoomControl(zoomcontrol)
panel_3 = Panel("""Width
Depth
Height""")
controls = Merge(
    Data1=flatten(presetcontrol_2),
    Data2=flatten(customcontrol_2),
    Data3=flatten(orbitcontrol_2),
    Data4=flatten(zoomcontrol_2))
sliderctrl = ParameterControl(Name=panel_3)
boxsliders = ControlsWidget(Controls=sliderctrl)
camerabuttons = ControlsWidget(Controls=controls)
rightpanel = Container(Location="right", AppBuilderWidgets=camerabuttons)
leftpanel = Container(Location="left", AppBuilderWidgets=boxsliders)
containers = Merge(Data1=leftpanel, Data2=rightpanel)
app = App(AppBuilderContainer=containers)
