# Grasshopper definition BETA-AgentSetup.ghx (Grasshopper 1.0.7)
# plug-ins: ShapeDiverForGrasshopper, jSwan

# ----
# Create a specific tool
# Custom tools for the agent: In this section, we create a custom tool for the agent called "custom_action_sequence". Each custom tool can be associated with one action.
# 
# In this example we connect the tool to the "executeActions" Action, which allows to execute several other actions in parallel or in sequence.
# Chaining two actions: We chain a zoomTo action (beta, zooms to the extents of the scene in the viewer), and a standard "Set Parameter Values" action.
panel = Panel("""{
  "type": "zoomTo",
  "props": {}
}""")
int = Integer("2")
parametervalue = ParameterValue(Name="SizeZ", Value=int)
parsejson = ParseJSON(JSON=panel)
setparametervalues = SetParameterValuesAction(ParameterValues=parametervalue)
rejson = SerializeJson(Type="camera", Props=parsejson, IncludeNullAndEmptyProperties=False)
parsejson_2 = ParseJSON(JSON=setparametervalues)
merge = Merge(Data1=rejson, Data2=parsejson_2)
rejson_2 = SerializeJson(Mode="sequential", Actions=merge, IncludeNullAndEmptyProperties=False)
rejson_3 = SerializeJson(Type="executeActions", Props=rejson_2, IncludeNullAndEmptyProperties=False)
panel_2 = Panel("A test tool with an empty input schema just to test if the agent can successfully trigger it.")
parsejson_3 = ParseJSON(JSON="{}")
rejson_4 = SerializeJson(
    Name="custom_action_sequence",
    Description=panel_2,
    InputSchema=parsejson_3,
    Action=rejson_3,
    IncludeNullAndEmptyProperties=False)

# ----
# list_parameter_definition settings: In this example (inactive), we ask the agent to ignore the parameters that are "invisible" to the App (present in the definition but not included in the App through parameter controls).
panel_3 = Panel("list_parameter_definitions")
rejson_5 = SerializeJson(Invisible="exclude", IncludeNullAndEmptyProperties=False)
rejson_6 = SerializeJson(Name=panel_3, Filter=rejson_5, IncludeNullAndEmptyProperties=False)

# ----
# App Builder
panel_4 = Panel("Center")
merge_2 = Merge(Data1="SizeX", Data2="SizeY", Data3="SizeZ", Data4="Color", Data5=panel_4)
paramctrl = ParameterControl(Name=merge_2)
controlswidget = ControlsWidget(Controls=paramctrl)
container = Container(Location="left", AppBuilderWidgets=controlswidget)
panel_5 = Panel("This App controls a hollow box-shaped structure with piped edges. Only the general size of the box can be controlled. The pipe radius is not exposed, although some size parameters influence its value.")
bool = Boolean(True)
parse_json = ParseJSON(JSON=container)  # -> flatten(Object)

# ----
# Customize a generic tool
# list_parameter_definition settings: We reference parameters by their name and give them a "description" property. Descriptions are added to the context available to the agent.
panel_6 = Panel("Size in the Z axis. This input also controls the thickness of the mesh output. The thickness is equal to the tenth of the value of this parameter.")
item = ListItem(List=merge_2, Index=[0, 1, 2, 3], Wrap=True)
merge_3 = Merge(Data1="Size in the X axis.", Data2="Size in the Y axis.", Data3=panel_6, Data4="The color of the mesh output.")
# System Prompt: The message prompt can be used to define a system prompt for the agent.
panel_7 = Panel("list_parameter_definitions")
rejson_7 = SerializeJson(Name=item, Description=merge_3, IncludeNullAndEmptyProperties=False)
rejson_8 = SerializeJson(Name=panel_7, Parameters=rejson_7, IncludeNullAndEmptyProperties=False)

# ----
# Main algorithm
sizex = Slider(5, range=1..10)
sizey = Slider(5, range=1..10)
sizez = Slider(5, range=1..10)
center = PointsInput(
    GridUnit=0,
    Mode="0",
    ShowDistanceLabels=True,
    ShowPointLabels=False,
    PlaneConstraint_plane=PlaneXY(0, 0, 0),
    DefaultValue_EdgeIndex=-1)
box = CenterBox(Base=center, X=sizex, Y=sizey, Z=sizez)
edges = BrepEdges(Brep=box)  # -> Naked, Interior, NonManifold
color = ColourSwatch(SwatchColor=RGB(83, 56, 255))

pipe = Pipe(Curve=edges.Interior, Radius=expr("x/10", sizez), Caps=2)  # -> flatten(Pipe)
mesh = MeshBrep(
    Brep=pipe,
    Settings={GridMaxCount=0, GridMinCount=16, JaggedSeams=False, MaxEdgeLength=0, MinEdgeLength=1, MinTolerance=0, Refine=False, RefineAngle=0, RelativeTolerance=0.65, SimplePlanes=True, Tolerance=0})
mjoin = MeshJoin(Meshes=mesh)

meshoutput = GlTF20Display(Geometry=mjoin, Material=color)

rejson_9 = SerializeJson(
    Id="my-agent",
    Name="My Agent",
    Message=panel_5,
    UseGenericToolDefaults=bool,
    GenericTools=rejson_8,
    SpecificTools=rejson_4,
    IncludeNullAndEmptyProperties=False)

rejson_10 = SerializeJson(Version="1.0", Containers=parse_json, Agents=rejson_9, IncludeNullAndEmptyProperties=False)
txt = Text(rejson_10)

appbuilder = DirectDataOutput(Data=txt)
