# Grasshopper definition BETA-Anchor2dTutorial.ghx (Grasshopper 1.0.7)
# plug-ins: ShapeDiverForGrasshopper, jSwan

mbox = MeshBox(Base={Plane=PlaneXY(0, 0, 0), X=Domain(-10, 10), Y=Domain(-10, 10), Z=Domain(-10, 10)}, XCount=10, YCount=10, ZCount=10)
previewicon = BooleanToggle(False)
locationx = DirectTextInput(maxlength=10000, text="calc(100%-1rem)")
locationy = DirectTextInput(maxlength=10000, text="1rem")
allowpointerevents = BooleanToggle(True)
usecontainer = BooleanToggle(False)
draggable = BooleanToggle(False)
imagewidget = ImageWidget(URI="https://images.dog.ceo/breeds/samoyed/n02111889_1984.jpg")
textwidget = TextWidget(Text="An example 2d anchor container.")
filter = StreamFilter(Gate=previewicon, Stream1="dog")
merge = Merge(Data1=locationx, Data2=locationy)
width = DirectTextInput(maxlength=10000, text="20rem")
parsejson = ParseJSON(JSON=textwidget)
parsejson_2 = ParseJSON(JSON=imagewidget)
rejson = SerializeJson(
    Id="anchor2d_0",
    Width=width,
    Location=merge,
    Draggable=draggable,
    UseContainer=usecontainer,
    PreviewIcon=filter,
    AllowPointerEvents=allowpointerevents,
    IncludeNullAndEmptyProperties=False)
merge_2 = Merge(Data1=parsejson, Data2=parsejson_2)
rejson_2 = SerializeJson(Name="anchor2d", Props=rejson, Widgets=merge_2, IncludeNullAndEmptyProperties=False)
merge_3 = Merge(
    Data1="width",
    Data2="locationX",
    Data3="locationY",
    Data4="draggable",
    Data5="useContainer",
    Data6="previewIcon",
    Data7="allowPointerEvents")
paramctrl = ParameterControl(Name=merge_3)
controlswidget = ControlsWidget(Controls=paramctrl)
container = Container(Name="left", Widgets=controlswidget)
merge_4 = Merge(Data1=rejson_2, Data2=container)
app = App(Containers=merge_4)
