# Grasshopper definition BETA-Anchor3dSimple.ghx (Grasshopper 1.0.7)
# plug-ins: ShapeDiverForGrasshopper

sizex = Slider(5, range=1..10)
sizey = Slider(5, range=1..10)
box = CenterBox(Base=PlaneXY(0, 0, 0), X=sizex, Y=sizey, Z=1)
gltfdisplay = GlTF20Display(Geometry=box)

merge = Merge(
    Data1="Justification",
    Data2="Allow Pointer Events",
    Data3="Add Preview Icon",
    Data4="Preview Icon",
    Data5="Width",
    Data6="Height",
    Data7="Location",
    Data8="Use Container")
paramctrl = ParameterControl(Name=merge)
controlswidget = ControlsWidget(Controls=paramctrl)
container = Container(Name="right", Widgets=controlswidget)

# ---- group: anchor 3d parameters
# Anchor 3d - Options as Parameters
justification = ValueList({"none": null, "TL", "TC", "TR", "ML", "MC", "MR", "BL", "BC", "BR"}, selected="none")
allow_pointer_events = BooleanToggle(True)
add_preview_icon = BooleanToggle(True)
preview_icon = DirectTextInput(maxlength=10000, text="world")
width = DirectTextInput(maxlength=10000, text="20rem")
height = DirectTextInput(maxlength=10000, text="20rem")
location = DirectTextInput(maxlength=10000, text="0,0,0")
use_container = BooleanToggle(True)
hideable = BooleanToggle(False)
stream_filter = StreamFilter(Gate=add_preview_icon, Stream1=preview_icon)
null_item = NullItem(Item=justification)  # -> NullFlags, InvalidFlags, Description
stream_filter_2 = StreamFilter(Gate=null_item.NullFlags, Stream0=justification)
text_split = TextSplit(Text=location, Separators=",")
number = Number(text_split)
merge_2 = Merge(Data1="SizeX", Data2="SizeY")
paramctrl_2 = ParameterControl(Name=merge_2)
entwine = Entwine(
    Branch00="anchor_3d_0",
    Branch01=stream_filter_2,
    Branch02=allow_pointer_events,
    Branch03=stream_filter,
    Branch04=width,
    Branch05=height,
    Branch06=number,
    Branch07=use_container,
    Branch08=hideable,
    FlattenInputs=True)
merge_3 = Merge(
    Data1="id",
    Data2="justification",
    Data3="allowPointerEvents",
    Data4="previewIcon",
    Data5="width",
    Data6="height",
    Data7="location",
    Data8="useContainer",
    Data9="hideable")
controlswidget_2 = ControlsWidget(Controls=paramctrl_2)
construct_json = ConstructJSON(Data=entwine, AddressString=merge_3)
merge_4 = Merge(Data1="name", Data2="props", Data3="widgets[0]")

# ----
parse_json = ParseJSON(JSON=controlswidget_2)

# ---- group: anchor 3d parameters (continued)
entwine_2 = Entwine(Branch00="anchor3d", Branch01=construct_json, Branch02=parse_json, FlattenInputs=True)
construct_json_2 = ConstructJSON(Data=entwine_2, AddressString=merge_4)

# ----
panel = Panel(construct_json_2)
merge_5 = Merge(Data1=flatten(construct_json_2), Data2=flatten(container))
app = App(Containers=merge_5)
