# Grasshopper definition BETA-CameraAction.ghx (Grasshopper 1.0.7)
# plug-ins: ShapeDiverForGrasshopper, jSwan, Pufferfish, GrasshopperHyperGooComponents

sqgrid = Square(Plane=PlaneXY(0, 0, 0), Size=10, ExtentX=3, ExtentY=5)  # -> Cells, Points
pshift = ShiftPaths(Data=sqgrid.Cells, Offset=2)
paramptinrec = ParameterPointInRectangle(Rectangle=pshift, ParameterX=0.5, ParameterY=0.5)  # -> Point, Normal
mesh = Mesh(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)
viewer = ParamViewer(paramptinrec.Point)
move = Move(Geometry=mesh, Motion=paramptinrec.Point)  # -> Geometry, Transform
listdexs = ListIndices(List=viewer)
listdexs_2 = ListIndices(List=move.Geometry)
oddevenums = OddEvenNumbers(Numbers=listdexs, Placeholders=False)  # -> Odd, Even

# ---- group: New Camera Settings
orthographic_camera_direction = ValueList({"back", "front", "left", "right", "top", "bottom", "custom"}, selected="custom")
camera_type = ValueList({"orthographic", "perspective"}, selected="perspective")
auto_rotation_speed = Slider(0, range=-10..10)
auto_adjust = BooleanToggle(False)
panel = Panel("new camera")
default_position = DirectTextInput(maxlength=10000, text="{15, 15, 15}")
default_target = DirectTextInput(maxlength=10000, text="{0, 0, 0}")

# ----
existing_camera_name = ValueList({"perspective": "Perspective", "front": "Front", "left": "Left", "right": "Right", "top": "Top", "bottom": "Bottom"}, selected="perspective")
concat = Concatenate(FragmentA=graft(listdexs), FragmentB=listdexs_2, JoinSeparator=".")  # -> graft(Result)
path = DataPath(oddevenums.Odd)
camera_action_type = ValueList({"assign", "set", "zoomTo", "animate"}, selected="animate")
camera_settings = ValueList({"None": 0, "Existing": 1, "New": 2}, selected="None")
split = SplitTree(Data=paramptinrec.Point, Masks=path)  # -> reverse(Positive), Negative
constructattr = ConstructAttributes(Keys="name", Values=concat)

# ---- group: Camera Action Settings
duration = Slider(2500, range=0..10000)
name_filter = DirectTextInput(maxlength=10000, text="Box")
initial_position = DirectTextInput(maxlength=10000, text="{0, 15, 0}")
initial_target = DirectTextInput(maxlength=10000, text="{0, 0, 0}")
position = DirectTextInput(maxlength=10000, text="{-15, 15, 15}")
target = DirectTextInput(maxlength=10000, text="{0, 0, 0}")

# ----
merge = Merge(Data1=split.Positive, Data2=split.Negative)  # -> graft(Result)
injectattr = InjectAttributes(Object=graft(move.Geometry), Attributes=constructattr)  # -> flatten(Object)
pt2num = PointsToNumbers(Points=default_position, Mask=4)
pt2num_2 = PointsToNumbers(Points=default_target, Mask=4)
move_2 = Move(Geometry=merge, Motion=Vector(0, 0, 10))  # -> Geometry, Transform
box = GlTF20Display(Geometry=injectattr)
bool = Boolean(auto_rotation_speed)
pt2num_3 = PointsToNumbers(Points=move_2.Geometry, Mask=4)
pt2num_4 = PointsToNumbers(Points=merge, Mask=4)
rejson = SerializeJson(
    Name=panel,
    Type=camera_type,
    Direction=orthographic_camera_direction,
    DefaultPosition=pt2num,
    DefaultTarget=pt2num_2,
    Position=pt2num,
    Target=pt2num_2,
    AutoRotationSpeed=auto_rotation_speed,
    EnableAutoRotation=bool,
    AutoAdjust=auto_adjust,
    IncludeNullAndEmptyProperties=False)
rejson_2 = SerializeJson(Position=pt2num_3, Target=pt2num_4, IncludeNullAndEmptyProperties=False)  # -> flatten(JSON)
rejson_3 = SerializeJson(Duration=duration, IncludeNullAndEmptyProperties=False)
rejson_4 = SerializeJson(Name=existing_camera_name, IncludeNullAndEmptyProperties=False)
pt2num_5 = PointsToNumbers(Points=initial_position, Mask=4)
pt2num_6 = PointsToNumbers(Points=initial_target, Mask=4)
pt2num_7 = PointsToNumbers(Points=position, Mask=4)
pt2num_8 = PointsToNumbers(Points=target, Mask=4)
filter = StreamFilter(Gate=camera_settings, Stream1=rejson_4, Stream2=rejson)

# ---- group: Create Camera Action
rejson_5 = SerializeJson(
    Camera=filter,
    InitialPosition=pt2num_5,
    InitialTarget=pt2num_6,
    Position=pt2num_7,
    Target=pt2num_8,
    Options=rejson_3,
    NameFilter=name_filter,
    Path=rejson_2,
    IncludeNullAndEmptyProperties=False)
trim = TrimTree(Tree=rejson_5, Depth=1)
rejson_6 = SerializeJson(Type=camera_action_type, Props=trim, IncludeNullAndEmptyProperties=False)
rejson_7 = SerializeJson(Type="camera", Props=rejson_6, IncludeNullAndEmptyProperties=False)
actionctrl = ActionControl(Label="Set Camera", Action=rejson_7)

# ---- group: UI
panel_2 = Panel("""assign
set
zoomTo
animate""")
mindex = MemberIndex(Set=panel_2, Member=camera_action_type)  # -> Index, Count
panel_3 = Panel("""camera type
orthographic camera direction
default position
default target
auto rotation speed
auto adjust""")
panel_4 = Panel("""position
target""")
panel_5 = Panel("""initial position
initial target
name filter""")
panel_6 = Panel("""camera settings
camera action type""")
filter_2 = StreamFilter(Gate=mindex.Index, Stream1=panel_4, Stream2=panel_5)
filter_3 = StreamFilter(Gate=camera_settings, Stream1="existing camera name", Stream2=panel_3)
merge_2 = Merge(Data1=panel_6, Data2=filter_3, Data3=filter_2, Data4="duration")
paramctrl = ParameterControl(Name=merge_2)

# ----
merge_3 = Merge(Data1=paramctrl, Data2=actionctrl)
controlswidget = ControlsWidget(Controls=merge_3)
container = Container(Name="right", Widgets=controlswidget)
app = App(Containers=container)
