# Grasshopper definition BETA-CameraActions.ghx (Grasshopper 1.0.7)
# plug-ins: ShapeDiverForGrasshopper, jSwan, GrasshopperHyperGooComponents

# ----
# Common camera options
duration_ms = Slider(2500, range=0..2500)
rejson = SerializeJson(Duration=duration_ms, IncludeNullAndEmptyProperties=False)
data = Data(rejson)

# ----
# set Camera Action
position_set = DirectTextInput(maxlength=10000, text="10,10,10")
target_set = DirectTextInput(maxlength=10000, text="0,0,0")
data_2 = Data(data)
split = TextSplit(Text=position_set, Separators=",")
split_2 = TextSplit(Text=target_set, Separators=",")
num = Number(split)
num_2 = Number(split_2)
rejson_2 = SerializeJson(Position=num, Target=num_2, Options=data_2, IncludeNullAndEmptyProperties=False)
rejson_3 = SerializeJson(Type="set", Props=rejson_2, IncludeNullAndEmptyProperties=False)
merge = Merge(Data1="position_set", Data2="target_set")
rejson_4 = SerializeJson(Type="camera", Props=rejson_3, IncludeNullAndEmptyProperties=False)
paramctrl = ParameterControl(Name=merge)
actionctrl = ActionControl(Label="set", Action=rejson_4)
merge_2 = Merge(Data1=paramctrl, Data2=actionctrl)  # -> flatten(Result)
controlswidget = ControlsWidget(Controls=merge_2)
singleaccordion = SingleAccordionWidget(Label="set Camera Action", AppBuilderWidgets=controlswidget)

# ----
# zoomTo Camera Action
name_filter = ValueList({"Objects.sphere", "Objects.box", "Objects.torus"}, selected="Objects.sphere")
data_3 = Data(data)
rejson_5 = SerializeJson(Options=data_3, NameFilter=name_filter, IncludeNullAndEmptyProperties=False)
rejson_6 = SerializeJson(Type="zoomTo", Props=rejson_5, IncludeNullAndEmptyProperties=False)
rejson_7 = SerializeJson(Type="camera", Props=rejson_6, IncludeNullAndEmptyProperties=False)
paramctrl_2 = ParameterControl(Name="name_filter")
actionctrl_2 = ActionControl(Label="zoomTo", Action=rejson_7)
merge_3 = Merge(Data1=paramctrl_2, Data2=actionctrl_2)
controlswidget_2 = ControlsWidget(Controls=merge_3)
singleaccordion_2 = SingleAccordionWidget(Label="zoomTo Camera Action", AppBuilderWidgets=controlswidget_2)

mesh = Mesh(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)
mesh_2 = Mesh(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)
mesh_3 = Mesh(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)
constructattr = ConstructAttributes(Keys="name", Values="sphere")
constructattr_2 = ConstructAttributes(Keys="name", Values="box")
constructattr_3 = ConstructAttributes(Keys="name", Values="torus")
injectattr = InjectAttributes(Object=mesh, Attributes=constructattr)
injectattr_2 = InjectAttributes(Object=mesh_2, Attributes=constructattr_2)
injectattr_3 = InjectAttributes(Object=mesh_3, Attributes=constructattr_3)
objects = GlTF20Display(Geometry=[injectattr, injectattr_2, injectattr_3], Material=ColourSwatch(SwatchColor=RGB(255, 0, 255)))

paramctrl_3 = ParameterControl(Name="duration_ms")
controlswidget_3 = ControlsWidget(Controls=paramctrl_3)

merge_4 = Merge(Data1=singleaccordion_2, Data2=singleaccordion)
multipleaccordion = MultipleAccordionWidget(Widgets=merge_4)
merge_5 = Merge(Data1=controlswidget_3, Data2=multipleaccordion)
container = Container(Location="right", AppBuilderWidgets=merge_5)
app = App(Containers=container)
