# Grasshopper definition BETA-DynamicPointsInput.ghx (Grasshopper 1.0.7)
# plug-ins: ShapeDiverForGrasshopper, GrasshopperHyperGooComponents

mesh = Mesh(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)
constructattr = ConstructAttributes(Keys="name", Values="planarmesh")
injectattr = InjectAttributes(Object=mesh, Attributes=constructattr)
gltf2material = GlTF20Material(
    BaseColorFactor=RGBA(255, 125, 125, 119),
    MetallicFactor=0,
    RoughnessFactor=1,
    EmissiveFactor=RGB(0, 0, 0),
    AlphaMode="BLEND",
    AlphaCutoff=0.5,
    DoubleSided=True)
display = GlTF20Display(Geometry=injectattr, Material=gltf2material)

# ----
# Add the dynamic points input to the App
panel = Panel("default_appbuilder")
paramctrl = ParameterControl(Name="polydraw", SessionId=panel)
controlswidget = ControlsWidget(Controls=paramctrl)
container = Container(Location="left", AppBuilderWidgets=controlswidget)

panel_2 = Panel("{\"points\":[]}")

# ----
# Example default  value for the points
pt = Point([Point(-10.8, 12, -5.512880845), Point(-10.8, -12, -5.512880845), Point(0, -16, -0.2822021129), Point(14.4, -8, 6.692036197), Point(14.4, 12, 6.692036197), Point(-10.8, 12, -5.512880845)])
pdecon = Deconstruct(Point=pt)  # -> XComponent, YComponent, ZComponent
concat = Concatenate(
    FragmentA="[",
    FragmentB=pdecon.XComponent,
    FragmentC=",",
    FragmentD=pdecon.YComponent,
    FragmentE=",",
    FragmentF=pdecon.ZComponent,
    FragmentG="]")

join = TextJoin(Text=concat, Join=",")

concat_2 = Concatenate(FragmentA="{\"points\":[", FragmentB=join, FragmentC="]}")

# ----
# Define the dynamic Points Input
panel_3 = Panel("""{
  "name":"polydraw",
  "id":"polydraw",
  "type": "Drawing",
  "hidden": false,
  "showDistanceLabels": false,
  "settings": {
    "geometry": {"autoClose": true, "close": true, "minPoints": 3, "maxPoints": 10, "mode": "lines"},
    "restrictions": [{type: "geometry", "nameFilter": ['Display.planarmesh']}],
    "display": {"wireframe": false, "wireframeColor": "#ff0000" },
  },
}""")
panel_4 = Panel(concat_2)
parsejson = ParseJSON(JSON=panel_3)
constructjson = ConstructJSON(Object=parsejson, Data=panel_4, AddressString="defval")

# ----
# Loop the updated value in the App
appbuilder = DirectTextInput(maxlength=10000)
parsejson_2 = ParseJSON(JSON=appbuilder)
appbuilderdebug = DirectDataOutput(Data=appbuilder)
accessjson = AccessJSON(Object=parsejson_2, AddressString="polydraw")
txt = Text(accessjson)

nullrep = ReplaceNulls(Items=txt, Replacements=panel_4)  # -> Items, Count

# ----
# Use the value to drive geometry
parsejson_3 = ParseJSON(JSON=nullrep.Items)
accessjson_2 = AccessJSON(Object=parsejson_3, AddressString="points")
convertjson = ConvertJSON(Object=accessjson_2)
pt_2 = Point(flatten(convertjson))
pline = PolyLine(Vertices=pt_2, Closed=True)

constructjson_2 = ConstructJSON(Object=constructjson, Data=nullrep.Items, AddressString="value")

app = App(Containers=container, Parameters=constructjson_2)
panel_5 = Panel(constructjson_2)
