# Grasshopper definition BETA-DynamicSlidersTutorial.ghx (Grasshopper 1.0.7)
# plug-ins: jSwan, ShapeDiverForGrasshopper

spherecount = Slider(5, range=1..10)
default_radius = Panel("10")

# ----
# Get the dynamic parameter values: Add a Direct Text Input component called AppBuilder. This component will send the list of values defined in the App for custom dynamic parameters. This list is sent as a JSON object.
# Example parameter: In this example, we send values for five dynamic parameters controlling the radius of five spheres.
panel = Panel("""{"DynamicSlider_0": 45,
"DynamicSlider_1": 15,
"DynamicSlider_2": 25,
"DynamicSlider_3": 35,
"DynamicSlider_4": 50}""")
appbuilder = DirectTextInput(maxlength=10000, text="Default")

num = Number(default_radius)
# In this example model, we instantiate a variable number of spheres
# and generate in the online App a dynamic slider for each sphere created in the scene.
num_2 = Number(spherecount)

# ----
# Parsing the input: Here we parse the JSON object to get the value of the parameters we are interested in.
# By default, our scene includes five spheres so we check if we find five sliders corresponding to them.
# 
# In case we find null values, we replace them with a default radius value for the corresponding sphere.
# Dropdown example: The example in this definition concerns sliders. Here is another example JSON object that allows to define a dynamic value list in the App.
# Checklist example: Here is an example for a checklist with three options, where the first (0) and third (2) options are checked by default, and for the current value all three options are checked.
num_3 = Number(num)
num_4 = Number(num_2)
series = Series(Start=0, Step=1, Count=num_4)
parsejson = ParseJSON(JSON=appbuilder)
concat = Concatenate(FragmentA="DynamicSlider_", FragmentB=series)
accessjson = AccessJSON(Object=parsejson, AddressString=concat)  # -> flatten(Property)
# {
#   "name":"Example Value List",
#   "id": "examplevaluelist",
#   "type": "StringList",
#   "choices": [
#     "Option 1",
#     "Option 2",
#     "Option 3"
#   ],
#   "defval":"0",
#   "value": "0",
#   "hidden": false
# }
# {
# "name":"Example Checklist",
# "id": "examplechecklist",
# "type": "StringList",
# "visualization": "checklist",
# "choices": [
#     "Option 1",
#     "Option 2",
#     "Option 3"
#   ],
# "defval": "0,2",
# "value": "0,1,2",
# "hidden": false
# }
nullrep = ReplaceNulls(Items=accessjson, Replacements=num_3)  # -> Items, Count
txt = Text(concat)
num_5 = Number(nullrep.Items)

# ----
# Use the dynamic slider value: We input here the values for each slider retrieved from the AppBuilder input, which represents the values picked by users of the online App.
panel_2 = Panel("100")
box = CenterBox(Base=PlaneXY(0, 0, 0), X=panel_2, Y=panel_2, Z=panel_2)
num_6 = Number(num_2)
num_7 = Number(num_5)
pop3d = Populate3D(Region=box, Count=num_6, Seed=1)
msphere = MeshSphere(Base=pop3d, Radius=num_7, UCount=10, VCount=20)

# ----
# Add the dynamic parameter to the App: We add the dynamic parameters to the list of parameters of the App here.
# 
# First we define the parameters as JSON objects (in the future, there will be dedicated components to do this for all types of parameters).
# 
# In our case, we define a list of sliders with identical properties (type, min and max values, precision...).
# 
# Then we set the value of each slider from the value imported in the AppBuilder Direct Text Input.
panel_3 = Panel("Float")
txt_2 = Text(txt)
num_8 = Number(num_5)
num_9 = Number(num)
rejson = SerializeJson(
    Name=txt_2,
    Id=txt_2,
    Type=panel_3,
    Min="10",
    Max="50",
    Value=num_8,
    Decimalplaces="0",
    Defval=num_9,
    IncludeNullAndEmptyProperties=False)
txt_3 = Text(rejson)

# ----
# Don't forget the Session ID: This feature is experimental! At the moment, one must make sure to set the sessionID property to "default_appbuilder".
panel_4 = Panel("default_appbuilder")
txt_4 = Text(txt)

paramctrl = ParameterControl(Name=txt_4, SessionId=panel_4)
paramctrl_2 = ParameterControl(Name="SphereCount")

# ----
# Build the App: We build an App with a single left container, containing the standard "SphereCount" slider, as well as dynamic sliders controlling the radius of each sphere added to the scene.
merge = Merge(Data1=paramctrl_2, Data2=flatten(paramctrl))  # -> flatten(Result)
controlswidget = ControlsWidget(Controls=merge)
container = Container(Location="left", AppBuilderWidgets=controlswidget)

app = App(Containers=container, Parameters=txt_3)
