# Grasshopper definition BETA-ExportWithScreenshot.ghx (Grasshopper 1.0.7)
# plug-ins: ShapeDiverForGrasshopper

myscreenshot = ImportBitmap(maximum_file_size=52428800, selected_file_formats="image/bmp,image/gif,image/jpeg,image/png,image/tif")  # -> Bitmap, Width, Height, Filename
width = Slider(0.27, range=0..1)
format = ValueList({"jpg", "png", "tiff", "bmp", "gif"}, selected="jpg")
box = CenterBox(Base=PlaneXY(0, 0, 0), X=width, Y=1, Z=1)
exportimg = ImageExportOptions(Format=format, QualityLevel=100, N=False)
concat = Concatenate(FragmentA="Download the screenshot at the following link:")
exportwithscreenshot = EmailExport(
    Data=myscreenshot.Bitmap,
    Options=exportimg,
    Name="test_box",
    To="mathieu@shapediver.com",
    Subject="Export with screenshot",
    Body=concat,
    AttachExport=False,
    AttachJSON=False)

panel = Panel("""{
 "type": "screenshot",
 "props": {
 }
}""")
parametervalue = ParameterValue(Name="MyScreenshot", Source=panel)
paramctrl = ParameterControl(Name="Width")
exportctrl = ExportControl(Name="ExportWithScreenshot", ParameterValues=parametervalue)
merge = Merge(Data1=paramctrl, Data2=exportctrl)
controlswidget = ControlsWidget(Controls=merge)
container = Container(Name="right", Widgets=controlswidget)
app = App(Containers=container)
