# Grasshopper definition BETA-ExportWithState.ghx (Grasshopper 1.0.7)
# plug-ins: ShapeDiverForGrasshopper

panel = Panel("""{
 "type": "modelState",
 "props": {
 }
}""")
parametervalue = ParameterValue(Name="MyState", Source=panel)
paramctrl = ParameterControl(Name="Width")
exportctrl = ExportControl(Name="ExportWithState", ParameterValues=parametervalue)
merge = Merge(Data1=paramctrl, Data2=exportctrl)
controlswidget = ControlsWidget(Controls=merge)
container = Container(Name="right", Widgets=controlswidget)
app = App(Containers=container)

width = Slider(0.27, range=0..1)
mystate = DirectTextInput(maxlength=10000, text="Default")
box = CenterBox(Base=PlaneXY(0, 0, 0), X=width, Y=1, Z=1)
export3dm = _3dmExportOptions(Version=8)
concat = Concatenate(FragmentA="This export is associated with the following state:", FragmentB=mystate)
exportwithstate = EmailExport(
    Data=box,
    Options=export3dm,
    Name="test_box",
    To="mathieu@shapediver.com",
    Subject="Export with state",
    Body=concat,
    AttachExport=False,
    AttachJSON=False)
