# Grasshopper definition BETA-FormWidget.ghx (Grasshopper 1.0.7)
# plug-ins: ShapeDiverForGrasshopper, jSwan

height = Slider(5, range=1..10)

rejson = SerializeJson(
    Validationrule="^[a-zA-Z0-9._%+-]+@[a-zA-Z0-9.-]+\.[a-zA-Z]{2,}$",
    Validationerror="Invalid email",
    IncludeNullAndEmptyProperties=False)
rejson_2 = SerializeJson(Settings=rejson, IncludeNullAndEmptyProperties=False)
rejson_3 = SerializeJson(Name="EmailExport", IncludeNullAndEmptyProperties=False)
merge = Merge(Data1="RhinoVersion", Data2="AttachExport")
rejson_4 = SerializeJson(Name="EnterEmail", Overrides=rejson_2, IncludeNullAndEmptyProperties=False)
rejson_5 = SerializeJson(Name=merge, IncludeNullAndEmptyProperties=False)
merge_2 = Merge(Data1=rejson_5, Data2=rejson_4)
rejson_6 = SerializeJson(Parameters=merge_2, Export=rejson_3, Submit="reset", IncludeNullAndEmptyProperties=False)
rejson_7 = SerializeJson(Type="form", Props=rejson_6, IncludeNullAndEmptyProperties=False)

rhinoversion = ValueList({"6", "7"}, selected="7")
attachexport = BooleanToggle(False)
enteremail = DirectTextInput(maxlength=10000)
box = CenterBox(Base=PlaneXY(0, 0, 0), X=1, Y=1, Z=height)
mbox = MeshBox(Base=box, XCount=10, YCount=10, ZCount=10)
export3dm = _3dmExportOptions(Version=rhinoversion)
emailexport = EmailExport(Data=mbox, Options=export3dm, To=enteremail, AttachExport=attachexport, AttachJSON=False)
gltfdisplay = GlTF20Display(Geometry=mbox)

paramctrl = ParameterControl(Name="Height")
controlswidget = ControlsWidget(Controls=paramctrl)
container = Container(Name="left", Widgets=controlswidget)
container_2 = Container(Name="right", Widgets=rejson_7)
merge_3 = Merge(Data1=container, Data2=container_2)
app = App(Containers=merge_3)

panel = Panel(rejson_7)
