# Grasshopper definition BETA-MultilineTextInput.ghx (Grasshopper 1.0.7)
# plug-ins: ShapeDiverForGrasshopper

int = Integer(3)
constructjson = ConstructJSON(Data=int, AddressString="lines")
paramref = ParameterReference(Name="MultilineText", Settings=constructjson)
paramwidget = ParameterWidget(ParametersAndExports=paramref, PreserveOrdering=True)
container = Container(Name="right", Widgets=paramwidget)
app = App(Containers=container)

multilinetext = DirectTextInput(maxlength=10000, text="Default")
pt = Point(Point(0, 0, 0))
tag = TextTag3D(Location=pt, Text=multilinetext, Size=1, Justification=7)
