# Grasshopper definition BETA-NumberInputWithStep.ghx (Grasshopper 1.0.7)
# plug-ins: ShapeDiverForGrasshopper

panel = Panel("{\"DynamicFloatWithStep\": 1.004}")
appbuilder = DirectTextInput(maxlength=10000, text="Default")
parsejson = ParseJSON(JSON=appbuilder)
accessjson = AccessJSON(Object=parsejson, AddressString="DynamicFloatWithStep")
null = NullItem(Item=accessjson)  # -> NullFlags, InvalidFlags, Description
panel_2 = Panel("""{
  "name": "DynamicFloatWithStep",
  "id": "DynamicFloatWithStep",
  "type": "Float",
  "min": "1",
  "max": "10",
  "step": "0.004",
  "decimalplaces": "3",
  "defval": 1.004
}""")
filter = StreamFilter(Gate=null.NullFlags, Stream0=accessjson, Stream1="1.004")
msphere = MeshSphere(Base=PlaneXY(0, 0, 0), Radius=filter, UCount=10, VCount=20)
parsejson_2 = ParseJSON(JSON=panel_2)
constructjson = ConstructJSON(Object=parsejson_2, Data=accessjson, AddressString="value")
paramref = ParameterReference(Name="DynamicFloatWithStep", SessionId="default_appbuilder")
paramwidget = ParameterWidget(ParametersAndExports=paramref, PreserveOrdering=True)
container = Container(Name="right", Widgets=paramwidget)
app = App(Containers=container, Parameters=constructjson)
