# Grasshopper definition BETA-ParametricBoxInstance.ghx (Grasshopper 1.0.7)
# plug-ins: ShapeDiverForGrasshopper

width = Slider(2, range=1..10)
height = Slider(5, range=1..10)
color = ColourSwatch(SwatchColor=RGB(255, 0, 0))
box = CenterBox(Base=PlaneXY(0, 0, 0), X=1, Y=width, Z=height)
gltfdisplay = GlTF20Display(Geometry=box, Material=color)
