# Grasshopper definition BETA-SavedStatesWidget.ghx (Grasshopper 1.0.7)
# plug-ins: ShapeDiverForGrasshopper

panel = Panel("""{
  "type": "savedStates",
}""")

width = Slider(1, range=1..10)
height = Slider(6, range=1..10)
color = ColourSwatch(SwatchColor=RGB(255, 0, 0))
box = DomainBox(Base=PlaneXY(0, 0, 0), X=Domain(0, 1), Y=width, Z=height)
volume = Volume(Geometry=box)  # -> Volume, Centroid
gltfdisplay = GlTF20Display(Geometry=box, Material=color)
volume_2 = DirectDataOutput(Data=volume.Volume)

type = ValueList({"dropdown", "buttonflex", "buttongroup", "carousel", "chipgroup", "color", "fullwidthcards", "grid", "imagedropdown"}, selected="imagedropdown")
parsejson = ParseJSON(JSON=panel)
merge = Merge(Data1="Width", Data2="Height")
constructjson = ConstructJSON(Object=parsejson, Data=type, AddressString=".props.visualization")
paramctrl = ParameterControl(Name=merge)
controlswidget = ControlsWidget(Controls=paramctrl)
merge_2 = Merge(Data1=controlswidget, Data2=constructjson)
container = Container(Name="right", Widgets=merge_2)
app = App(Containers=container)
