# Grasshopper definition BETA-SlidersWithMarksAndLabels.ghx (Grasshopper 1.0.7)
# plug-ins: ShapeDiverForGrasshopper, jSwan

restricttomarks = BooleanToggle(False)
marks = DirectTextInput(maxlength=10000, text="1.5,4.5,7.5")
postfix = DirectTextInput(maxlength=10000, text="cm")
split = TextSplit(Text=marks, Separators=",")
num = Number(split)
txt = Text(num)
concat = Concatenate(FragmentA=txt, FragmentB=postfix)
rejson = SerializeJson(Value=num, Label=concat, IncludeNullAndEmptyProperties=False)
sliderwithmarks = Slider(1, range=1..10)
rejson_2 = SerializeJson(RestrictToMarks=restricttomarks, Marks=rejson, IncludeNullAndEmptyProperties=False)
merge = Merge(Data1="restrictToMarks", Data2="marks", Data3="postfix")
paramctrl = ParameterControl(Name=merge)
paramctrl_2 = ParameterControl(Name="SliderWithMarks", Settings=rejson_2)
msphere = MeshSphere(Base=PlaneXY(0, 0, 0), Radius=sliderwithmarks, UCount=10, VCount=20)
controlswidget = ControlsWidget(Controls=paramctrl)
controlswidget_2 = ControlsWidget(Controls=paramctrl_2)
container = Container(Name="right", Widgets=controlswidget_2)
container_2 = Container(Name="left", Widgets=controlswidget)
merge_2 = Merge(Data1=container_2, Data2=container)
app = App(Containers=merge_2)
