# Grasshopper definition BETA-SoundAction.ghx (Grasshopper 1.0.7)
# plug-ins: ShapeDiverForGrasshopper

sound_widget_props = DirectTextInput(
    maxlength=10000,
    text="{\"href\": \"https://shapediverdownloads.s3.us-east-1.amazonaws.com/sample1.m4a\", \"autoplay\": true, \"loop\": false}")
parsejson = ParseJSON(JSON=sound_widget_props)
constructjson = ConstructJSON(Data="sound", AddressString="type")
constructjson_2 = ConstructJSON(Object=constructjson, Data=parsejson, AddressString="props")
textinput = DirectTextInput(maxlength=10000)
paramctrl = ParameterControl(Name="Sound widget props", Settings="{\"lines\": 10}")
actionctrl = ActionControl(Label="Play sound", Action=constructjson_2)
merge = Merge(Data1=actionctrl, Data2=paramctrl)
sph = Sphere(Base=PlaneXY(0, 0, 0), Radius=1)
textwidget = TextWidget(Text=textinput)
controlswidget = ControlsWidget(Controls=merge)
merge_2 = Merge(Data1=controlswidget, Data2=textwidget)
container = Container(Name="right", Widgets=merge_2)
app = App(Containers=container)
