# Grasshopper definition BETA-StackWidget.ghx (Grasshopper 1.0.7)
# plug-ins: ShapeDiverForGrasshopper

radius = Slider(1, range=0..1)
color = ColourSwatch(SwatchColor=RGB(255, 0, 0))
msphere = MeshSphere(Base=PlaneXY(0, 0, 0), Radius=radius, UCount=10, VCount=20)
gltfdisplay = GlTF20Display(Geometry=msphere, Material=color)

merge = Merge(Data1="Radius", Data2="Color")
paramctrl = ParameterControl(Name=merge)
controlswidget = ControlsWidget(Controls=paramctrl)
singleaccordion = SingleAccordionWidget(Label="Accordion", Widgets=controlswidget)

parsejson = ParseJSON(JSON=controlswidget)
constructjson = ConstructJSON(Data=parsejson, AddressString=".props.widgets[0]")
constructjson_2 = ConstructJSON(Object=constructjson, Data="stackUi", AddressString="type")
constructjson_3 = ConstructJSON(Object=constructjson_2, Data="Parameters", AddressString=".props.name")

merge_2 = Merge(Data1=singleaccordion, Data2=constructjson_3)
container = Container(Name="right", Widgets=merge_2)
app = App(Containers=container)
