# Grasshopper definition BETA-ValueListWithImages.ghx (Grasshopper 1.0.7)
# plug-ins: jSwan, ShapeDiverForGrasshopper

type = ValueList({"fullwidthcards", "carousel", "grid", "imagedropdown"}, selected="fullwidthcards")

# ----
# Types of image list visualization
txt = Text(type)

appbuilder = DirectTextInput(maxlength=10000, text="Default")

txt_2 = Text(txt)
panel = Panel("{\"fullwidthcards\": 2}")
parsejson = ParseJSON(JSON=appbuilder)
accessjson = AccessJSON(Object=parsejson, AddressString=txt_2)
txt_3 = Text(accessjson)

txt_4 = Text(["Apples", "Bananas", "Broccoli", "Carrots", "Chocolate"])
panel_2 = Panel(txt_4)

panel_3 = Panel("https://shapediverdownloads.s3.us-east-1.amazonaws.com/chocolate.png")
txt_5 = Text(txt)
panel_4 = Panel("https://shapediverdownloads.s3.us-east-1.amazonaws.com/broccoli.png")
panel_5 = Panel("https://shapediverdownloads.s3.us-east-1.amazonaws.com/carrot.png")
panel_6 = Panel("https://shapediverdownloads.s3.us-east-1.amazonaws.com/banana.png")
panel_7 = Panel("https://shapediverdownloads.s3.us-east-1.amazonaws.com/apple.png")
rejson = SerializeJson(
    ImageUrl=panel_7,
    Description="Crisp and refreshing fruit",
    Tooltip="An example tooltip",
    IncludeNullAndEmptyProperties=False)
rejson_2 = SerializeJson(
    ImageUrl=panel_6,
    Description="Naturally sweet and potassium-rich fruit",
    Displayname="Bananen",
    IncludeNullAndEmptyProperties=False)
rejson_3 = SerializeJson(ImageUrl=panel_4, Description="Nutrient-packed green vegetable", IncludeNullAndEmptyProperties=False)
rejson_4 = SerializeJson(ImageUrl=panel_5, Description="Crunchy and vitamin-rich root vegetable", IncludeNullAndEmptyProperties=False)
rejson_5 = SerializeJson(ImageUrl=panel_3, Description="Indulgent and decadent treat", IncludeNullAndEmptyProperties=False)
rejson_6 = SerializeJson(
    Apples=rejson,
    Bananas=rejson_2,
    Broccoli=rejson_3,
    Carrots=rejson_4,
    Chocolate=rejson_5,
    IncludeNullAndEmptyProperties=False)
rejson_7 = SerializeJson(Type=txt_5, ItemData=rejson_6, IncludeNullAndEmptyProperties=False)
default_value = Panel("0")
rejson_8 = SerializeJson(
    Name=txt_5,
    Id=txt_5,
    Type="StringList",
    Defval=default_value,
    Visualization="dropdown",
    Settings=rejson_7,
    Choices=panel_2,
    IncludeNullAndEmptyProperties=False)
txt_6 = Text(rejson_8)

txt_7 = Text(txt_6)
txt_8 = Text(txt_3)
rejson_9 = SerializeJson(Data1=txt_8, IncludeNullAndEmptyProperties=False)
jmerge = MergeJson(SourceJson=txt_7, OverrideJson=rejson_9)
txt_9 = Text(jmerge)

txt_10 = Text(panel_2)
num = Number(default_value)

txt_11 = Text(txt_9)
txt_12 = Text(txt)
paramref = ParameterReference(Name=txt_12, SessionId="default_appbuilder")
merge = Merge(Data1="Type", Data2=paramref)  # -> flatten(Result)
paramwidget = ParameterWidget(ParametersAndExports=merge, PreserveOrdering=True)
container = Container(Name="right", Widgets=paramwidget)
app = App(Containers=container, Parameters=txt_11)

panel_8 = Panel(txt_6)

txt_13 = Text(txt_3)
txt_14 = Text(txt_10)
num_2 = Number(num)
null = NullItem(Item=txt_13)  # -> NullFlags, InvalidFlags, Description
filter = StreamFilter(Gate=null.NullFlags, Stream0=txt_13, Stream1=num_2)
item = ListItem(List=txt_14, Index=filter, Wrap=True)
join = TextJoin(Text=item, Join=",")
tag = TextTag3D(Location=PlaneXY(0, 0, 0), Text=join, Size=1, Justification=7)
