# Grasshopper definition 2503A-Webinar_SpecklePavillion.ghx (Grasshopper 1.0.8)
# plug-ins: Pufferfish, GrasshopperHyperGooComponents, ShapeDiverForGrasshopper, Mesh Pipe, Speckle.Connector.Grasshopper

planaritystrength = Slider(1, range=1..100)
max_curvature = Slider(0.05, range=0.01..0.1)
lengthfactor = Slider(1, range=0..1)
segments = Slider(8, range=4..10)
optimize = BooleanToggle(True)
render = BooleanToggle(True)
boundaryend = PointsInput(
    GridUnit=5,
    Mode="1",
    ShowDistanceLabels=True,
    ShowPointLabels=False,
    PlaneConstraint_plane=Plane(origin=(395, 90, 0), x=(0, 0, 1), y=(1, 0, 0)),
    DefaultValue_EdgeIndex=-1,
    DefaultValue_ON_Version=5)
boundarystart = PointsInput(
    GridUnit=5,
    Mode="1",
    ShowDistanceLabels=True,
    ShowPointLabels=False,
    PlaneConstraint_plane=Plane(origin=(395, 25, 0), x=(0, 0, 1), y=(1, 0, 0)),
    DefaultValue_EdgeIndex=-1,
    DefaultValue_ON_Version=5)
num = Number(max_curvature)
crv = Curve(boundarystart)
crv_2 = Curve(boundaryend)
int = Integer(segments)
num_2 = Number(lengthfactor)
bool = Boolean(optimize)
bool_2 = Boolean(render)
int_2 = Integer(planaritystrength)

crv_3 = Curve(crv)
crv_4 = Curve(crv_2)
int_3 = Integer(int)
cp = ControlPoints(Curve=crv_4)  # -> Points, Weights, Knots
cp_2 = ControlPoints(Curve=crv_3)  # -> Points, Weights, Knots
nurbs = NurbsCurve(Vertices=cp_2.Points, Degree=2, Periodic=False)  # -> Curve, Length, Domain
nurbs_2 = NurbsCurve(Vertices=cp.Points, Degree=2, Periodic=False)  # -> Curve, Length, Domain
multiplication = Multiplication(A=int_3, B=2)
reb = RebuildCurve(Curve=nurbs.Curve, Degree=1, Count=multiplication, Tangents=False)
reb_2 = RebuildCurve(Curve=nurbs_2.Curve, Degree=1, Count=multiplication, Tangents=False)
cp_3 = ControlPoints(Curve=reb_2)  # -> Points, Weights, Knots
cp_4 = ControlPoints(Curve=reb)  # -> Points, Weights, Knots
entwine = Entwine(Branch00=cp_4.Points, Branch01=cp_3.Points, FlattenInputs=True)
flip = FlipMatrix(Data=entwine)
item = ListItem(List=flip, Index=0, Wrap=True)
item_2 = ListItem(List=flip, Index=1, Wrap=True)
ln = Line(StartPoint=item, EndPoint=item_2)  # -> flatten(Line)
reb_3 = RebuildCurve(Curve=ln, Count=int_3, Tangents=False)
loftmesh = LoftMesh(Polylines=reb_3, ComputeUV=False, IsometricUV=False, UVSize=1)
mesh = Mesh(loftmesh)

mesh_2 = Mesh(mesh)
nv = NakedVertices(Mesh=mesh_2)  # -> ClothedIndex, NakedIndex, ClothedPts, NakedPts
devec = DeconstructVector(Vector=nv.NakedPts)  # -> XComponent, YComponent, ZComponent
devec_2 = DeconstructVector(Vector=nv.NakedPts)  # -> XComponent, YComponent, ZComponent
devec_3 = DeconstructVector(Vector=nv.NakedPts)  # -> XComponent, YComponent, ZComponent
equalst = EqualityWithinTolerance(FirstNumber=devec_3.ZComponent, SecondNumber="0", Tolerance=0.001)  # -> Equality, Inequality
equalst_2 = EqualityWithinTolerance(FirstNumber=devec_2.YComponent, SecondNumber="25", Tolerance=0.001)  # -> Equality, Inequality
equalst_3 = EqualityWithinTolerance(FirstNumber=devec.YComponent, SecondNumber="90", Tolerance=0.001)  # -> Equality, Inequality
p_n_c = PickNChoose(Pattern=equalst.Equality, Stream1=nv.NakedPts)
p_n_c_2 = PickNChoose(Pattern=equalst_2.Equality, Stream1=nv.NakedPts)
p_n_c_3 = PickNChoose(Pattern=equalst_3.Equality, Stream1=nv.NakedPts)
merge = Merge(Data1=p_n_c_2, Data2=p_n_c_3)
pt = Point(p_n_c)
pt_2 = Point(merge)

mesh_3 = Mesh(mesh)
pt_3 = Point(pt_2)
num_3 = Number(num_2)
int_4 = Integer(int_2)
pt_4 = Point(pt)
bool_3 = Boolean(bool)
edgelengths = EdgeLengths(Mesh=mesh_3, LengthFactor=num_3, Strength=1)
anchor = Anchor(Point=pt_3, Strength=10000)
planarize = Planarize(M=mesh_3, Strength=int_4)
onplane = OnPlane(Points=pt_4, Plane=PlaneXY(0, 0, 0), Strength=10000)
show = Show(G=mesh_3)
filter = StreamFilter(Gate=bool_3, Stream0="1", Stream1="50000")
merge_2 = Merge(Data1=show, Data2=planarize, Data3=anchor, Data4=edgelengths, Data5=onplane)
zombiesolver = ZombieSolver(GoalObjects=flatten(merge_2), Threshold=1e-10, Tolerance=0.0001, MaxIterations=filter)  # -> I, V, O
split = SplitList(List=zombiesolver.O, Index=1)  # -> ListA, ListB
lng = ListLength(List=planarize)
split_2 = SplitList(List=split.ListB, Index=lng)  # -> ListA, ListB
mesh_4 = Mesh(split.ListA)
num_4 = Number(split_2.ListA)

send = BooleanToggle(False)
speckle_stream = DirectTextInput(maxlength=10000)
secretinput = SecretInput(SecretName="speckle-token")  # disabled
speckle_token = DirectTextInput(maxlength=10000)
num_5 = Number(num)

mesh_5 = Mesh(mesh_4)
num_6 = Number(num_4)
demesh = DeconstructMesh(Mesh=mesh_5)  # -> Vertices, Faces, Colours, Normals
medges = MeshEdges(Mesh=mesh_5)  # -> NakedEdges, InteriorEdges, NonManifoldEdges
gradient = Gradient(LowerLimit=0, UpperLimit=num_5, Parameter=num_6, stops=[0: RGB(0, 128, 0), 0.5: RGB(255, 255, 0), 1: RGB(255, 0, 0)])
deface = DeconstructFace(Face=graft(demesh.Faces))  # -> CornerA, CornerB, CornerC, CornerD
mpipe = MeshPipe(
    Curve=[medges.NakedEdges, medges.InteriorEdges, medges.NonManifoldEdges],
    Radius=0.5,
    Accuracy=0.2,
    Rotation=0,
    Segments=10,
    Caps=2)
item_3 = ListItem(List=demesh.Vertices, Index=simplify([deface.CornerA, deface.CornerB, deface.CornerC, deface.CornerD]), Wrap=True)
mjoin = MeshJoin(Meshes=mpipe)
col = Colour(simplify(graft(gradient)))
dup = DuplicateData(Data=col, Number=4, Order=True)  # -> simplify(Data)
conmesh = ConstructMesh(Vertices=item_3, Faces={A=0, B=1, C=2, D=3}, Colours=dup)  # -> flatten(Mesh)
mesh_6 = Mesh(mjoin)
mesh_7 = Mesh(conmesh)

createmodelstate = CreateModelStateAction()
actionctrl = ActionControl(Action=createmodelstate)
buildings = ColourSwatch(SwatchColor=RGB(243, 191, 255))
roads = ColourSwatch(SwatchColor=RGB(255, 251, 133))
controlswidget = ControlsWidget(Controls=actionctrl)

gltf2material = GlTF20Material(
    BaseColorFactor=buildings,
    MetallicFactor=0,
    RoughnessFactor=1,
    EmissiveFactor=RGB(0, 0, 0),
    AlphaMode="OPAQUE",
    AlphaCutoff=0.5,
    DoubleSided=True)
gltf2material_2 = GlTF20Material(
    BaseColorFactor=roads,
    MetallicFactor=0,
    RoughnessFactor=1,
    EmissiveFactor=RGB(0, 0, 0),
    AlphaMode="OPAQUE",
    AlphaCutoff=0.5,
    DoubleSided=True)
constructattr = ConstructAttributes(Keys="material", Values=gltf2material)
constructattr_2 = ConstructAttributes(Keys="material", Values=gltf2material_2)
mesh_8 = Mesh([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])
mesh_9 = Mesh([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])
injectattr = InjectAttributes(Object=mesh_9, Attributes=constructattr_2)
injectattr_2 = InjectAttributes(Object=mesh_8, Attributes=constructattr)
merge_3 = Merge(Data1=injectattr_2, Data2=injectattr)

num_7 = Number(num_4)
int_5 = Integer(int)
num_8 = Number(num)
py3 = Python3Script(pts=num_7, n=int_5, maxc=num_8)  # -> out, a; inputs pts: list of Double, n: Int32, maxc: Double
# ---------- py3: Python ----------
# r: matplotlib
# r: numpy


import numpy as np
import matplotlib.pyplot as plt
import io

# --- 1. DATA SAFETY CHECK ---
# Ensure these variables exist from your previous logic
# n = ...
# pts = ...
# maxc = ...

try:
    # Build the array
    array_2d = np.array(pts).reshape(2*n-1, n-1)
except NameError as e:
    print(f"Error: Make sure 'pts' and 'n' are defined! {e}")
    array_2d = None

# --- 2. PLOTTING (Only if data exists) ---
if array_2d is not None:
    # Set up the figure (Size matches your 250x320 ratio roughly)
    fig, ax = plt.subplots(figsize=(2.5, 3.2))

    # Create heatmap (origin='lower' or 'upper' to match your data orientation)
    im = ax.imshow(
        array_2d, 
        cmap='RdYlGn_r', 
        vmin=0, 
        vmax=maxc,
        aspect='equal',
        origin='upper' 
    )

    # Simulate Plotly's xgap/ygap with a white grid
    ax.set_xticks(np.arange(-.5, array_2d.shape[1], 1), minor=True)
    ax.set_yticks(np.arange(-.5, array_2d.shape[0], 1), minor=True)
    ax.grid(which="minor", color="white", linestyle='-', linewidth=1.5)
    
    # Clean up the UI
    ax.axis('off')
    
    # Add Colorbar (moves it close like colorbar_x=0.6)
    cbar = fig.colorbar(im, ax=ax, fraction=0.046, pad=0.1)
    cbar.outline.set_visible(False)

    # --- 3. EXPORT TO STRING ---
    f = io.StringIO()
    plt.savefig(f, format="svg", bbox_inches='tight', transparent=True)
    svg_string = f.getvalue()
    
    # Cleanup memory
    plt.close(fig)
    
    # Final Output
    a = svg_string
    print("SVG String generated successfully.")
# ---------- end py3 ----------
exportstream = StreamExportOptions(ContentType="svg,image/svg+xml", N=False)

# ---- group: Display
metal = ColourSwatch(SwatchColor=RGB(130, 130, 130))
bool_4 = Boolean(bool_2)
mesh_10 = Mesh(mesh_7)
mesh_11 = Mesh(mesh_4)
mesh_12 = Mesh(mesh_6)
presetmaterial = PresetMaterial(Color=RGB(255, 255, 255), MaterialIndex="400")
presetmaterial_2 = PresetMaterial(Color=metal, MaterialIndex="300")
filter_2 = StreamFilter(Gate=bool_4, Stream0=mesh_10)
filter_3 = StreamFilter(Gate=bool_4, Stream1=mesh_11)
filter_4 = StreamFilter(Gate=bool_4, Stream1=mesh_12)

# ----
gltfdisplay = GlTF20Display(Geometry=merge_3)
mesh_13 = Mesh(filter_2)
heatmap = DownloadExport(Data=py3.a, Options=exportstream, Name="test")
gltfdisplay_2 = GlTF20Display(Geometry=filter_3, Material=presetmaterial)
gltfdisplay_3 = GlTF20Display(Geometry=filter_4, Material=presetmaterial_2)

# ----
# Send geometry to Speckle Stream
mesh_14 = Mesh(mesh_12)
# Speckle personal access token.
# Use a ShapeDiver Secret input
# for better security
len = TextLength(Text=speckle_stream)
larger = LargerThan(FirstNumber=len, SecondNumber=0)  # -> LargerThan, OrEqualTo
bool_5 = Boolean(larger.LargerThan)
filter_5 = StreamFilter(Gate=larger.LargerThan, Stream1=speckle_stream)
sg = SpeckleGeometry(Geometry=mesh_14, HasApplicationIdParam=False)  # -> SpeckleGeometry, Geometry, Color, Material, Path
cc = CreateCollection(SubCollection1=sg.SpeckleGeometry, AlwaysInheritNames=False)
panel = Panel(""":span[**Successful export!**]{color="green"}

> Find it at the following """)
concat = Concatenate(FragmentA="**[url](", FragmentB=filter_5, FragmentC=")**.")
concat_2 = Concatenate(FragmentA=panel, FragmentB=concat)
filter_6 = StreamFilter(Gate=send, Stream0="Data not sent", Stream1=concat_2)
txt = Text(filter_6)
result = DirectDataOutput(Data=txt)

bool_6 = Boolean(bool_5)
url = SpeckleModelURLWithToken(SpeckleUrl=filter_5, SpeckleToken=speckle_token)

filter_7 = StreamFilter(Gate=send, Stream1=url)

sp = SyncPublish(SpeckleModel=filter_7, Collection=cc, Run=send)  # -> SpeckleModel, VersionID

bool_7 = Boolean(bool)
panel_2 = Panel("""## Send your design to Speckle

Enter the url of your model below and press send to synchronize your data.

> In this tutorial, the token is exposed in the App for testing. In your Apps, use the Secret Input component instead for better security (see the definition).""")
txt_2 = Text(txt)
merge_4 = Merge(Data1="LengthFactor", Data2="PlanarityStrength")
filter_8 = StreamFilter(Gate=bool_7, Stream1=merge_4)
merge_5 = Merge(Data1="BoundaryStart", Data2="BoundaryEnd", Data3="Optimize", Data4=filter_8)
imagewidget = ImageWidget(ExportName="Heatmap")
textwidget = TextWidget(Text="## Curvature Heatmap")
textwidget_2 = TextWidget(Text=panel_2)
textwidget_3 = TextWidget(Text=txt_2)  # -> flatten(Widget)

filter_9 = StreamFilter(Gate=bool_6, Stream1="Send")
merge_6 = Merge(Data1="Speckle Stream", Data2="Speckle Token", Data3=filter_9)  # -> flatten(Result)
paramctrl = ParameterControl(Name="Max Curvature")
paramctrl_2 = ParameterControl(Name=merge_6)
paramctrl_3 = ParameterControl(Name=merge_5)
controlswidget_2 = ControlsWidget(Controls=paramctrl)
controlswidget_3 = ControlsWidget(Controls=paramctrl_2)
controlswidget_4 = ControlsWidget(Controls=paramctrl_3)
merge_7 = Merge(Data1=controlswidget_4, Data2=controlswidget)
tab = Tab(Name="Design parameters", AppBuilderWidgets=merge_7)
container = Container(Location="left", AppBuilderTabs=tab)

merge_8 = Merge(Data1=textwidget_2, Data2=controlswidget_3, Data3=textwidget_3)  # -> flatten(Result)
merge_9 = Merge(Data1=textwidget, Data2=imagewidget, Data3=controlswidget_2)

tab_2 = Tab(Name="Speckle", AppBuilderWidgets=merge_8)
tab_3 = Tab(Name="Analysis", AppBuilderWidgets=merge_9)
merge_10 = Merge(Data1=tab_3, Data2=tab_2)
container_2 = Container(Location="right", AppBuilderTabs=merge_10)

merge_11 = Merge(Data1=container, Data2=container_2)

app = App(Containers=merge_11)
