# Grasshopper definition 2503B-Webinar_ShopifyWorkflow.ghx (Grasshopper 1.0.8)
# plug-ins: jSwan, MeshEdit Components, treesloth01, Pufferfish, ClipperComponents, MetaHopper, GrasshopperHyperGooComponents, ShapeDiverForGrasshopper, Wombat

# ----
# LEGEND
# All sliders, value lists, colors, ShapeDiver inputs (e.g. "SDTextInput"), etc. that will be available in
# the ShapeDiver platform as parameters or have the potential of becoming available (e.g. Panels
# with hardcoded data that can not be access directly in ShapeDiver).
# Parameters
# Basic Groups
# The Grasshopper definition should be built in small groups, "Basic Groups", with very specific tasks.
# Each "Basic Group" should have "Inputs", "Outputs", a title and an optional description if necessary.
# Inputs
# All data that goes inside a "Basic Group".
# NO DATA should go inside a "Basic Group" from any other area but the "Inputs".
# Outputs
# All data that goes outside a "Basic Group".
# NO DATA should go outside a "Basic Group" from any other area but the "Outputs".
# Exports /
# Data Outputs
# Contains the data that will be available via the ShapeDiver platform or API.
# Data is sent via the ShapeDiver outputs components (e.g. "SDExportDownload").
# This may also contain basic exports pre processing (e.g. "SDPropertiesExport").
# Contains the "SDDisplayGeometry" components or any geometry that has preview on.
# This is the geometry that will be visible in the ShapeDiver viewer.
# This may also contain simple material creation.
# Display
# Contains any components that are used just for local testing but need to be
# removed before uploading to ShapeDiver (e.g. Components that bake geometry in Rhino,
# C# scripts that affect the Rhino document or store data in the local machine,
# unsupported ShapeDiver plugins, etc.).
# Local Testing
# Ready to
# Organize
# Add all definition sections that are finsihed but still need to be organized.
# In Progress /
# To Implement /
# To Improve
# Add all definition groups that are still not ready.
# These sections need to be implemented, are still being tested or not finished.
# They also involve potential improvements.
data = Data()
data_2 = Data()
data_3 = Data()
data_4 = Data()
data_5 = Data()
data_6 = Data()
data_7 = Data()
data_8 = Data()
data_9 = Data()

# ---- group: Head
head_stone_shape = ValueList({"Round": 0, "Emerald": 1, "Heart": 2}, selected="Round")
prongs_style = ValueList({"No Prongs": 0, "Straight": 1, "Crossed": 2}, selected="Crossed")
elevate_gallery_rail = Slider(1, range=0..1.5)
head_stone_size = Slider(3, range=2..5)
gallery_rail = Mesh(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)
larger_than = LargerThan(FirstNumber=elevate_gallery_rail, SecondNumber=0.5)  # -> LargerThan, OrEqualTo
diamond_shape = Integer(head_stone_shape)
scale = Scale(Geometry=gallery_rail, Center=Point(0, 0, 0), Factor=head_stone_size)  # -> Geometry, Transform
equals = Equality(FirstNumber=prongs_style, SecondNumber=2)  # -> Equality, Inequality
cross_prongs = GateAnd(A=larger_than.OrEqualTo, B=equals.Equality)
gallery_rail_2 = BoundingRectangle(Geometry=scale.Geometry, Plane=PlaneXZ(0, 0, 0), Axis=0, Slide=0, Union=True)  # -> Bounding, flatten(DimensionX), flatten(DimensionY)

# ---- group: Materials
center_shank_metal = ValueList({"14k Yellow Gold", "18k Yellow Gold", "14k White Gold", "18k White Gold", "14k Rose Gold", "18k Rose Gold", "Platinum"}, selected="14k Yellow Gold")
side_shank_metal = ValueList({"14k Yellow Gold", "18k Yellow Gold", "14k White Gold", "18k White Gold", "14k Rose Gold", "18k Rose Gold", "Platinum"}, selected="14k Yellow Gold")
accent_stones_type = ValueList({"Diamond", "Blue Sapphire", "Emerald", "Ruby"}, selected="Diamond")
head_stone_type = ValueList({"Diamond", "Blue Sapphire", "Emerald", "Ruby"}, selected="Diamond")
materials_database_url = DirectTextInput(maxlength=10000, text="https://textures.shapediver.com/Demo/ring/materialsDatabase.json")
materials_sections_names = Panel("""headstone
shankcenter
shankside
sidestones""")
merge = Merge(Data1=head_stone_type, Data2=center_shank_metal, Data3=side_shank_metal, Data4=accent_stones_type)
material_database = ImportText(
    URI=materials_database_url,
    maximum_file_size=52428800,
    selected_file_formats="application/json,application/x-step,application/xml,text/csv,text/plain")  # -> Text, Filename
selected_materials = Text(merge)

# ---- group: Shank
finger_size = ValueList({"3": 14.01, "3 1/4": 14.22, "3 1/2": 14.43, "3 3/4": 14.64, "4": 14.84, "4 1/4": 15.05, "4 1/2": 15.26, "4 3/4": 15.47, "5": 15.67, "5 1/4": 15.88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}, selected="4")
base_section_segments = Slider(30, range=0..100)
add_accent_stones = ValueList({"No": false, "Yes": true}, selected="No")
center_shank_thickness = Slider(1, range=0.5..1.5)
side_shank_thickness = Slider(0.5, range=0.5..1.5)
price_per_gram = Slider(65, range=0..100)
division = Division(A=finger_size, B=2)
base_section = Polygon(Plane=PlaneXY(0, 0, 0), Radius=0.5, Segments=base_section_segments, FilletRadius=0)  # -> Polygon, Length
shank_radius = Number(division)

# ---- group: Exports
watertight_mesh_file_format = ValueList({"3DM": 0, "STL": 1, "OBJ": 2}, selected="STL")
watertight_mesh_edge_length = Slider(0.01, range=0.01..1)
process_watertight_mesh = BooleanToggle(False)
receiver_email_of_watertight_mesh = DirectTextInput(maxlength=10000)

# ---- group: UI
agent_mode = BooleanToggle(False)
ijewel3d = BooleanToggle(False)
context = DirectTextInput(maxlength=10000)

# ---- group: Create Ring Title and Description
connected = GetConnectedObjects(Objects=finger_size)
connected_2 = GetConnectedObjects(Objects=head_stone_size)
connected_3 = GetConnectedObjects(Objects=head_stone_shape)
connected_4 = GetConnectedObjects(Objects=prongs_style)
connected_5 = GetConnectedObjects(Objects=center_shank_metal)
connected_6 = GetConnectedObjects(Objects=side_shank_metal)
connected_7 = GetConnectedObjects(Objects=head_stone_type)
connected_8 = GetConnectedObjects(Objects=accent_stones_type)

# ---- group: Rails and Head / Create Center Shank Rail
shank_radius_2 = Number(shank_radius)
gallery_rail_width = Number(gallery_rail_2.DimensionX)
side_shank_thickness_2 = Number(side_shank_thickness)
extend_main_diamond_base = Number(elevate_gallery_rail)

# ---- group: Rails and Head / Create Side Shank Rail
center_shank_thickness_2 = Number(center_shank_thickness)
cross_prongs_2 = Boolean(cross_prongs)
gallery_rail_width_2 = Number(gallery_rail_2.DimensionX)
side_shank_thickness_3 = Number(side_shank_thickness)
shank_radius_3 = Number(shank_radius)

# ---- group: Create Ring Title and Description
merge_2 = Merge(
    Data1=connected,
    Data2=connected_2,
    Data3=connected_3,
    Data4=connected_4,
    Data5=connected_5,
    Data6=connected_6,
    Data7=connected_7,
    Data8=connected_8)
listdata = GetListData(ObjectToSet=merge_2)  # -> NickName, Keys, Values, SelectedIndex
sliderinfo = GetSliderProperties(Slider=merge_2)  # -> NickName, graft(Value), Range, Type, DecimalPlaces
item = ListItem(List=listdata.Keys, Index=listdata.SelectedIndex, Wrap=True)
concat = Concatenate(FragmentA=sliderinfo.Value, FragmentB="mm")
nulls_in_empty = NullsInEmptyBranches(DataWithEmptyBranches=item)
nullrep = ReplaceNulls(Items=nulls_in_empty, Replacements=concat)  # -> flatten(Items), Count
panel = Panel("The unique configuration ID of your product is {modelStateId}.")
concat_2 = Concatenate(FragmentA=nullrep.Items, FragmentB=listdata.NickName, JoinSeparator=" ")
item_2 = ListItem(List=concat_2, Index=0, Wrap=False)
concat_3 = Concatenate(FragmentA="* ", FragmentB=concat_2)
merge_3 = Merge(Data1="Summary:", Data2=concat_3, Data3=panel)

# ---- group: Rails and Head / Create Center Shank Rail
division_2 = Division(A=gallery_rail_width, B=-2)
division_3 = Division(A=side_shank_thickness_2, B=-2)
subtraction = Subtraction(A=division_2, B=division_3)
arc = Arc(Plane=Plane(origin=(0, 0, 0), x=(0, 0, 1), y=(-1, 0, 0)), Radius=shank_radius_2, Angle=Domain(0, 3.141592654))  # -> Arc, Length
X = UnitX(Factor=subtraction)
line = LineSDL(Start=X, Direction=Vector(0, 0, 1), Length=1)
clx = CurveLine(Curve=arc.Arc, Line=line, LimitFirst=True)  # -> Points, Params, Count
Z = UnitZ(Factor=extend_main_diamond_base)
ptstrimcrv = PointsTrimCurve(Curve=arc.Arc, Parameters=clx.Params, Flip=True)  # -> flatten(Trimmed), SubDomains, Intersected
move = Move(Geometry=clx.Points, Motion=Z)  # -> Geometry, Transform
rebcrv = RebuildCurve(Curve=ptstrimcrv.Trimmed, Degree=8, EndTangents=False)
center_shank = RelocateCurveEnds(Curve=reparameterize(rebcrv), Start=move.Geometry)

# ---- group: Rails and Head / Set Up Head
diamond_shape_2 = Integer(diamond_shape)
round_diamond = Mesh(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)
emerald_diamond = Mesh(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)
gallery_rail_3 = Mesh(scale.Geometry)
heart_diamond = Mesh(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)
stone_size = Number(head_stone_size)
center_shank_rail = Curve(center_shank)

curvepoint = PointOnCurve(center_shank_rail, parameter=0)
filter = StreamFilter(Gate=diamond_shape_2, Stream0=round_diamond, Stream1=emerald_diamond, Stream2=heart_diamond)
scale_2 = Scale(Geometry=filter, Center=Point(0, 0, 0), Factor=stone_size)  # -> Geometry, Transform
pt2num = PointsToNumbers(Points=curvepoint, Mask=11)  # -> flatten(Numbers)
merge_4 = Merge(Data1=scale_2.Geometry, Data2=gallery_rail_3)
Z_2 = UnitZ(Factor=pt2num)
move_2 = Move(Geometry=merge_4, Motion=Z_2)  # -> Geometry, Transform
head_mesh = Mesh(move_2.Geometry)

# ---- group: Rails and Head / Create Prongs Rail
head_mesh_2 = Mesh(graft(head_mesh))
prongs_style_2 = Integer(prongs_style)
side_shank_thickness_4 = Number(side_shank_thickness)
cross_prongs_3 = Boolean(cross_prongs)

bool = Boolean(prongs_style_2)
division_4 = Division(A=side_shank_thickness_4, B=3)
division_5 = Division(A=side_shank_thickness_4, B=-2)
filter_2 = StreamFilter(Gate=bool, Stream1=head_mesh_2)
panel_2 = Panel("""0.75
0.5""")
brec = BoundingRectangle(Geometry=filter_2, Plane=PlaneXY(0, 0, 0), Axis=0, Slide=graft(panel_2), Union=True)  # -> Bounding, DimensionX, DimensionY
sec = MeshPlane(Mesh=filter_2, Plane=brec.Bounding)
eval = EvaluateCurve(Curve=brec.Bounding, Parameter=cross_prongs_3)  # -> Point, Tangent, Angle
item_3 = ListItem(List=sec, Index=0, Wrap=True)
division_6 = Division(A=eval.Angle, B=2)
vrot = Rotate(Vector=eval.Tangent, Axis=Vector(0, 0, 1), Angle=division_6)
polyoffset = PolylineOffset(Polylines=item_3, Distance=division_4, Plane=brec.Bounding, Tolerance=0.001, ClosedFillet=1, OpenFillet=1, Miter=2)  # -> Contour, Holes
line_2 = LineSDL(Start=eval.Point, Direction=vrot, Length=1)
clx_2 = CurveLine(Curve=polyoffset.Contour, Line=line_2, LimitFirst=False)  # -> Points, Params, Count
dist = Distance(PointA=clx_2.Points, PointB=eval.Point)
sort = SortList(Keys=dist, ValuesA=clx_2.Points)  # -> Keys, ValuesA
item_4 = ListItem(List=sort.ValuesA, Index=0, Wrap=True)
brec_2 = BoundingRectangle(Geometry=flatten(filter_2), Plane=PlaneXY(0, 0, 0), Axis=0, Slide=1, Union=True)  # -> Bounding, DimensionX, DimensionY
item_5 = ListItem(List=flatten(item_4), Index=0, Wrap=True)  # -> Item, Item1
vec2pt = Vector2Pt(PointA=item_5.Item, PointB=item_5.Item1, Unitize=True)  # -> Vector, Length
projecta = ProjectAlong(Geometry=item_5.Item, Plane=brec_2.Bounding, Direction=vec2pt.Vector)  # -> Geometry, Transform
ln = Line(StartPoint=projecta.Geometry, EndPoint=item_5.Item1)
prongs = ExtendCurve(Curve=ln, Type=0, Start=division_5, End=0)

# ---- group: Rails and Head / Create Side Shank Rail
division_7 = Division(A=center_shank_thickness_2, B=-2)
x_plus_one = XPlusOne(NumberX=cross_prongs_2)
addition = Addition(A=shank_radius_3, B=division_7)
division_8 = Division(A=gallery_rail_width_2, B=-1.5)
division_9 = Division(A=side_shank_thickness_3, B=-2)
arc_2 = Arc(Plane=Plane(origin=(0, 0, 0), x=(0, 0, 1), y=(-1, 0, 0)), Radius=addition, Angle=Domain(0, 3.141592654))  # -> Arc, Length
Y = UnitY(Factor=division_7)
multiplication = Multiplication(A=division_9, B=x_plus_one)
move_3 = Move(Geometry=arc_2.Arc, Motion=Y)  # -> Geometry, Transform
rebcrv_2 = RebuildCurve(Curve=move_3.Geometry, Count=6, EndTangents=False)
filter_3 = StreamFilter(Gate=cross_prongs_2, Stream0=division_8, Stream1=division_9)
merge_5 = Merge(Data1=division_9, Data2=multiplication)
ext = ExtendCurve(Curve=rebcrv_2, Type=0, Start=filter_3, End=0)
curvepoint_2 = PointOnCurve(ext, parameter=0)
Y_2 = UnitY(Factor=merge_5)
addition_2 = Addition(A=curvepoint_2, B=Y_2)
changecurveends = CSharpScript(crv=ext, pntStart=addition_2)  # -> out, A; inputs crv: Curve
# ---------- changecurveends: C# ----------
    //if nothing was provided, return the original curve
    if(pntStart == null && vecStart == null && pntEnd == null && vecEnd == null){
      A = crv;
      return;
    }

    //convert curve into nurbs curve to be able to edit the ends
    NurbsCurve crvNurbs = (NurbsCurve) crv;

    //check if we need to change anything in the start of the curve
    if(pntStart != null || vecStart != null){

      //check which data was provided. If data is not provided, use the original data from curve
      Point3d _pntStart = pntStart == null ? crv.PointAtStart : (Point3d) pntStart;
      Vector3d _vecStart = vecStart == null ? crv.TangentAtStart : (Vector3d) vecStart;
      _vecStart.Unitize();

      //change start of curve
      crvNurbs.SetEndCondition(false, NurbsCurve.NurbsCurveEndConditionType.Tangency, _pntStart, _vecStart);
    }

    //check if we need to change anything in the end of the curve
    if(pntEnd != null || vecEnd != null){

      //check which data was provided. If data is not provided, use the original data from curve
      Point3d _pntEnd = pntEnd == null ? crv.PointAtEnd : (Point3d) pntEnd;
      Vector3d _vecEnd = vecEnd == null ? crv.TangentAtEnd : (Vector3d) vecEnd;
      _vecEnd.Unitize();

      //change end of curve
      crvNurbs.SetEndCondition(true, NurbsCurve.NurbsCurveEndConditionType.Tangency, _pntEnd, _vecEnd);
    }

    A = crvNurbs;
# ---------- end changecurveends ----------
shank_side_rail = Curve(changecurveends.A)

# ----
pshift = ShiftPaths(Data=listdata.Keys, Offset=1)

# ---- group: Create Ring Title and Description
value_lists_options = Text(pshift)
concat_4 = Concatenate(FragmentA=item_2, FragmentB=" Custom Ring")
join = TextJoin(Text=merge_3)

# ---- group: Parameters User Interface
panel_3 = Panel("""https://textures.shapediver.com/Demo/ring/headOptions/stone_shape_round.png
https://charlestonrings.com/cdn/shop/files/stone_shape_emerald.png
https://textures.shapediver.com/Demo/ring/headOptions/stone_shape_heart.png""")
head_stone_options = Integer(6)
shank_center_metal_options = Integer(4)
head_shape_options = Integer(2)
add_accent_stones_2 = Boolean(add_accent_stones)
value_lists_options_2 = Text(value_lists_options)

# ---- group: Export UI
panel_4 = Panel("""Watertight Mesh File Format
Receiver Email of Watertight Mesh""")
panel_5 = Panel("Watertight Mesh Edge Length")
panel_6 = Panel("""Download Watertight Mesh
Email Watertight Mesh""")
context_2 = Text(context)

# ---- group: Export UI / Process mesh before exporting
bool_2 = Boolean(True)
parametervalue = ParameterValue(Name="Process Watertight Mesh", Value=bool_2)

# ---- group: Export UI
tmatch = MatchText(Text=context_2, RegEx="order", Case=False)
filter_4 = StreamFilter(Gate=tmatch, Stream1=panel_4)
filter_5 = StreamFilter(Gate=tmatch, Stream1=panel_6)
merge_6 = Merge(Data1=panel_5, Data2=filter_4)
filter_6 = StreamFilter(Gate=tmatch, Stream1=merge_6)
paramctrl = ParameterControl(Name=filter_6)
exportctrl = ExportControl(Name=filter_5, ParameterValues=parametervalue)
merge_7 = Merge(Data1=paramctrl, Data2=exportctrl)
stack = StackWidget(Label="Exports", AppBuilderWidgets=merge_7)
filter_7 = StreamFilter(Gate=tmatch, Stream1=stack)
exports_ui = AppBuilderWidget(filter_7)

# ---- group: Meshes / Create Center Shank Mesh
center_shank_rail_2 = Curve(center_shank)
base_section_polygon = Curve(base_section.Polygon)
side_shank_thickness_5 = Number(side_shank_thickness)
center_shank_thickness_3 = Number(center_shank_thickness)

# ---- group: Meshes / Create Side Shank Mesh
base_section_polygon_2 = Curve(base_section.Polygon)
side_shank_thickness_6 = Number(side_shank_thickness)
prongs_curve = Curve(prongs)
shank_side_rail_2 = Curve(shank_side_rail)
base_section_segments_2 = Integer(base_section_segments)

division_10 = Division(A=side_shank_thickness_6, B=2)
long = LongestList(ListA=prongs_curve, ListB=graft(shank_side_rail_2), PaddingMode=2)  # -> ListA, ListB
merge_8 = Merge(Data1=long.ListA, Data2=long.ListB)
msphere = MeshSphere(Base=PlaneXY(0, 0, 0), Radius=division_10, UCount=10, VCount=base_section_segments_2)
connect = ConnectCurves(Curves=merge_8, Continuity=2, Close=False, Bulge=0.5)  # -> flatten(Curve)
item_6 = ListItem(List=connect, Index=0, Wrap=True)  # -> Item, Item1
mirror = Mirror(Geometry=item_6.Item1, Plane=PlaneYZ(0, 0, 0))  # -> Geometry, Transform
merge_9 = Merge(Data1=item_6.Item, Data2=mirror.Geometry)
join_2 = JoinCurves(Curves=merge_9, Preserve=False)
cluster = CenterShank(
    section=base_section_polygon_2,
    start_thickness=side_shank_thickness_6,
    end_thickness=side_shank_thickness_6,
    rail=join_2)  # -> wireframe, M, sections_size, pl_2
item_7 = ListItem(List=cluster.pl_2, Index=0, Wrap=True)  # -> Item1, Item
pflip = FlipPlane(Plane=item_7.Item1, ReverseX=False, ReverseY=True, SwapAxes=False)
plntrimmsh = PlaneTrimMesh(Mesh=msphere, Plane=PlaneXY(0, 0, 0), Flip=False, TrimType=1)  # -> Trimmed, Intersected
merge_10 = Merge(Data1=pflip, Data2=item_7.Item)
orient = Orient(Geometry=plntrimmsh.Trimmed, Source=PlaneXY(0, 0, 0), Target=merge_10)  # -> Geometry, Transform
merge_11 = Merge(Data1=cluster.M, Data2=orient.Geometry)
mjoin = MeshJoin(Meshes=merge_11)
alignvert = AlignVertices(Mesh=mjoin, Tolerance=0.01)  # -> Result, Count
mirror_2 = Mirror(Plane=PlaneXZ(0, 0, 0))  # -> Geometry, Transform
zerotran = ZeroedTransform()
weld = WeldMesh(Mesh=alignvert.Result, Angle=3.141592654)
merge_12 = Merge(Data1=zerotran, Data2=mirror_2.Transform)
attachtransform = AttachTransformations(Geometry=weld, Transform=merge_12)
side_shank = Mesh(attachtransform)

# ---- group: Meshes / Create Center Shank Mesh
center_shank_2 = CenterShank(
    section=base_section_polygon,
    start_thickness=side_shank_thickness_5,
    end_thickness=center_shank_thickness_3,
    rail=center_shank_rail_2)  # -> wireframe, M, sections_size, pl_2
item_8 = ListItem(List=center_shank_2.wireframe, Index=0, Wrap=True)
pline2msh = PolylineToMesh(Polyline=item_8, Quadrangulate=True)
merge_13 = Merge(Data1=pline2msh, Data2=center_shank_2.M)
mirror_3 = Mirror(Geometry=merge_13, Plane=PlaneYZ(0, 0, 0))  # -> Geometry, Transform
merge_14 = Merge(Data1=merge_13, Data2=mirror_3.Geometry)
mjoin_2 = MeshJoin(Meshes=merge_14)
alignvert_2 = AlignVertices(Mesh=mjoin_2, Tolerance=0.01)  # -> Result, Count

# ---- group: Parameters User Interface / Step every 0.5
num = Number(0.5)
slidersettings = SliderSettings(Step=num)

# ---- group: Parameters User Interface
panel_7 = Panel("""#F0F8FF
#0F52BA
#50C878
#E0115F""")
branch = TreeBranch(Tree=value_lists_options_2, Path=shank_center_metal_options, MaintainPaths=True)  # -> flatten(Branch)
branch_2 = TreeBranch(Tree=value_lists_options_2, Path=head_stone_options, MaintainPaths=True)  # -> flatten(Branch)
branch_3 = TreeBranch(Tree=value_lists_options_2, Path=head_shape_options, MaintainPaths=True)  # -> flatten(Branch)
split = TextSplit(Text=branch, Separators=" ")
vlitemdata = ValueListItemData(Name=branch_2, Tooltip=branch_2, Color=panel_7)
vlitemdata_2 = ValueListItemData(Name=branch_3, ImageUrl=panel_3)
item_9 = ListItem(List=split, Index=0, Wrap=False)
panel_8 = Panel("""#E6C27A
#D4AF37
#E8E9E8
#E1E1E1
#ECA9A6
#D89694
#E5E4E2""")
trim = TrimTree(Tree=item_9, Depth=1)
vlitemdata_3 = ValueListItemData(Name=branch, DisplayName=trim, Tooltip=branch, Color=panel_8)
panel_9 = Panel("""Center Shank Thickness
Side Shank Thickness""")
panel_10 = Panel("""Center Shank Metal
Side Shank Metal""")
valuelistsettings = ValueListSettings(Type="buttonflex")
valuelistsettings_2 = ValueListSettings(Type="color", ItemData=vlitemdata)
valuelistsettings_3 = ValueListSettings(Type="color", ItemData=vlitemdata_3)
valuelistsettings_4 = ValueListSettings(Type="grid", ItemData=vlitemdata_2)
filter_8 = StreamFilter(Gate=add_accent_stones_2, Stream1="Accent Stones Type")
paramctrl_2 = ParameterControl(Name="Finger Size")
paramctrl_3 = ParameterControl(Name=panel_9, Settings=slidersettings)
paramctrl_4 = ParameterControl(Name=panel_10, Settings=valuelistsettings_3)
paramctrl_5 = ParameterControl(Name="Add Accent Stones", Settings=valuelistsettings)
paramctrl_6 = ParameterControl(Name=filter_8, Settings=valuelistsettings_2)
paramctrl_7 = ParameterControl(Name="Head Stone Size", DisplayName="Size", Settings=slidersettings)
paramctrl_8 = ParameterControl(Name="Head Stone Shape", DisplayName="Shape", Settings=valuelistsettings_4)
paramctrl_9 = ParameterControl(Name="Head Stone Type", DisplayName="Type", Settings=valuelistsettings_2)
paramctrl_10 = ParameterControl(Name="Elevate Gallery Rail")
paramctrl_11 = ParameterControl(Name="Prongs Style", Settings=valuelistsettings)
panel_11 = Panel("""Accent
Stones""")
merge_15 = Merge(Data1=paramctrl_5, Data2=paramctrl_6)
merge_16 = Merge(Data1=paramctrl_7, Data2=paramctrl_8, Data3=paramctrl_9)
merge_17 = Merge(Data1=paramctrl_2, Data2=paramctrl_3, Data3=paramctrl_4)
stack_2 = StackWidget(Label=panel_11, AppBuilderWidgets=merge_15)
stack_3 = StackWidget(Label="Stone", AppBuilderWidgets=merge_16)
merge_18 = Merge(Data1=stack_3, Data2=paramctrl_10, Data3=paramctrl_11)
stack_4 = StackWidget(Label="Head", AppBuilderWidgets=merge_18)
merge_19 = Merge(Data1=merge_17, Data2=stack_4, Data3=stack_2)
parameters_ui = AppBuilderWidget(merge_19)

# ---- group: Meshes / Create Center Shank Mesh
center_shank_3 = WeldMesh(Mesh=alignvert_2.Result, Angle=3.141592654)
center_shank_section_sizes = Number(center_shank_2.sections_size)
center_shank_planes = Plane(center_shank_2.pl_2)

# ---- group: Accent Stones / Calculate accent stones base
shank_side_rail_3 = Curve(shank_side_rail)
center_shank_sz = Number(center_shank_section_sizes)
side_shank_thickness_7 = Number(side_shank_thickness)
add_accent_stones_3 = Boolean(add_accent_stones)
center_shank_pl = Plane(center_shank_planes)

# ---- group: Output Materials Database
panel_12 = Panel("""shapediver
ijewel3d""")
material_database_text = Text(material_database.Text)
ijewel3d_2 = Boolean(ijewel3d)
selected_materials_2 = Text(selected_materials)
materials_sections_names_2 = Text(materials_sections_names)

# ---- group: Output Materials Database / There are two viewers possibilities which describe materials differently: ijewel3d and ShapeDiver
item_10 = ListItem(List=panel_12, Index=ijewel3d_2, Wrap=False)
dejsonkv = DeserializeKeysAndValues(JSON=material_database_text, Keys=item_10)  # -> Key, Value

# ---- group: Output Materials Database
dejsonkv_2 = DeserializeKeysAndValues(JSON=dejsonkv.Value)  # -> Key, Value
standarize_text = StandarizeText(T=dejsonkv_2.Key)
standarize_text_2 = StandarizeText(T=selected_materials_2)
mindex = MemberIndex(Set=standarize_text, Member=standarize_text_2)  # -> Index, Count
item_11 = ListItem(List=dejsonkv_2.Value, Index=mindex.Index, Wrap=False)
nulls_in_empty_2 = NullsInEmptyBranches(DataWithEmptyBranches=item_11)
clean = CleanTree(
    RemoveNulls=True,
    RemoveInvalid=True,
    RemoveEmpty=False,
    Tree=flatten(nulls_in_empty_2),
    SynchronousTree1=materials_sections_names_2)  # -> Tree, SynchronousTree1
rejsonkv = SerializeKeysAndValues(Key=clean.SynchronousTree1, Value=clean.Tree)
materials = ParseJSON(JSON=rejsonkv)
materialdatabase = DirectDataOutput(Data=materials)

# ----
exportobj = ObjExportOptions(
    EndOfLine="CRLF",
    YUp=True,
    WrapLongLines=False,
    WritePrecision=17,
    ExportRhinoObjectNames="DoNotExportObjectNames",
    N=False)

# ---- group: Calculate metal price
price_per_gram_2 = Number(price_per_gram)

# ---- group: Add to Cart UI
ring_description = Text(join)
ring_title = Text(concat_4)

createmodelstate = CreateModelStateAction(Image=True)
actionctrl = ActionControl(Label="Share link", Action=createmodelstate)

# ---- group: Accent Stones / Calculate accent stones base
division_11 = Division(A=side_shank_thickness_7, B=2)
filter_9 = StreamFilter(Gate=add_accent_stones_3, Stream1=shank_side_rail_3)
filter_10 = StreamFilter(Gate=add_accent_stones_3, Stream1=center_shank_pl)
filter_11 = StreamFilter(Gate=add_accent_stones_3, Stream1=center_shank_sz)
division_12 = Division(A=filter_11, B=3)
division_13 = Division(A=filter_11, B=-2)
ext_2 = ExtendCurve(Curve=filter_9, Type=0, Start=division_11, End=0)
deplane = DeconstructPlane(Plane=filter_10)  # -> Origin, XAxis, YAxis, ZAxis
amp = Amplitude(Vector=deplane.YAxis, Amplitude=division_12)
Y_3 = UnitY(Factor=division_13)
offset_l = OffsetCurveLoose(Curve=ext_2, Distance=division_11, Plane=PlaneXZ(0, 0, 0))
neg = Negative(Value=division_11)
addition_3 = Addition(A=deplane.Origin, B=amp, C=Y_3)
Y_4 = UnitY(Factor=neg)
intcrv = Interpolate(Vertices=addition_3, Degree=3, Periodic=False, KnotStyle=1)  # -> Curve, Length, Domain
move_4 = Move(Geometry=offset_l, Motion=Y_4)  # -> Geometry, Transform
neg_2 = Negative(Value=side_shank_thickness_7)
ext_3 = ExtendCurve(Curve=intcrv.Curve, Type=0, Start=neg_2, End=0)
plntrimcrv = PlaneTrimCurve(Curve=move_4.Geometry, Plane=PlaneXY(0, 0, 0), Flip=False)  # -> Trimmed, Parameters, Intersected
plntrimcrv_2 = PlaneTrimCurve(Curve=ext_3, Plane=PlaneXY(0, 0, 0), Flip=False)  # -> Trimmed, Parameters, Intersected
curvepoint_3 = PointOnCurve(plntrimcrv_2.Trimmed, parameter=0)
curvepoint_4 = PointOnCurve(plntrimcrv.Trimmed, parameter=0)
crv_cp = CurveClosestPoint(Point=curvepoint_3, Curve=plntrimcrv.Trimmed)  # -> Point, Parameter, Distance
crv_cp_2 = CurveClosestPoint(Point=curvepoint_4, Curve=plntrimcrv_2.Trimmed)  # -> Point, Parameter, Distance
ptstrimcrv_2 = PointsTrimCurve(Curve=plntrimcrv.Trimmed, Parameters=crv_cp.Parameter, Flip=True)  # -> flatten(Trimmed), SubDomains, Intersected
ptstrimcrv_3 = PointsTrimCurve(Curve=plntrimcrv_2.Trimmed, Parameters=crv_cp_2.Parameter, Flip=True)  # -> flatten(Trimmed), SubDomains, Intersected
gap_between_stones = Number(0.1)
ext_4 = ExtendCurve(Curve=ptstrimcrv_2.Trimmed, Type=2, Start=gap_between_stones, End=0)
ext_5 = ExtendCurve(Curve=ptstrimcrv_3.Trimmed, Type=2, Start=gap_between_stones, End=0)
packcirclesalongtwopaths = PackCirclesAlongTwoPaths(crva=ext_4, crvb=ext_5, gap=gap_between_stones, distribute=True, tolerance=0.01)

# ---- group: Accent Stones / Calculate accent stones base / Circles have to be at least 1mm for the basket and stone
darc = DeconstructArc(Arc=packcirclesalongtwopaths)  # -> BasePlane, Radius, Angle
roundd = RoundToDecimalPlace(NumberX=darc.Radius, DecimalPlace=1, RoundType=0)  # -> Rounded, Difference
larger = LargerThan(FirstNumber=roundd.Rounded, SecondNumber=0.4)  # -> LargerThan, OrEqualTo
bool_3 = Boolean(True)
mindex_2 = MemberIndex(Set=larger.OrEqualTo, Member=bool_3)  # -> flatten(Index), Count
hilonums = HighestLowestNumbers(Numbers=mindex_2.Index)  # -> Highest, Lowest
x_plus_one_2 = XPlusOne(NumberX=hilonums.Highest)
split_2 = SplitList(List=packcirclesalongtwopaths, Index=x_plus_one_2)  # -> ListA, ListB

# ---- group: Accent Stones / Calculate accent stones base (continued)
accent_stones_base = Circle(split_2.ListA)

# ---- group: Accent Stones / Get Accent Stones Transformations
accent_stones_base_2 = Circle(accent_stones_base)
darc_2 = DeconstructArc(Arc=accent_stones_base_2)  # -> BasePlane, Radius, Angle
multiplication_2 = Multiplication(A=darc_2.Radius, B=2)
mirror_4 = Mirror(Plane=PlaneYZ(0, 0, 0))  # -> Geometry, Transform
zerotran_2 = ZeroedTransform()
orient_2 = Orient(Source=PlaneXY(0, 0, 0), Target=darc_2.BasePlane)  # -> Geometry, Transform
scale_3 = Scale(Center=Point(0, 0, 0), Factor=multiplication_2)  # -> Geometry, Transform
merge_20 = Merge(Data1=zerotran_2, Data2=mirror_4.Transform)  # -> graft(Result)
empty = EmptyObjectToEmptyBranch(DataIn=flatten(orient_2.Transform))
long_2 = LongestList(ListA=scale_3.Transform, ListD=orient_2.Transform, ListB=merge_20, PaddingMode=2)  # -> ListA, ListD, ListB
lng = ListLength(List=empty)
merge_21 = Merge(Data1=graft(long_2.ListA), Data2=graft(long_2.ListD), Data3=graft(long_2.ListB))
bool_4 = Boolean(lng)
mirror_5 = Mirror(Plane=PlaneXZ(0, 0, 0))  # -> Geometry, Transform
comp = Compound(Transforms=merge_21)
long_3 = LongestList(ListA=comp, ListB=mirror_5.Transform, PaddingMode=2)  # -> ListA, ListB
merge_22 = Merge(Data1=long_3.ListA, Data2=long_3.ListB)
comp_2 = Compound(Transforms=merge_22)
merge_23 = Merge(Data1=comp, Data2=comp_2)
filter_12 = StreamFilter(Gate=bool_4, Stream1=flatten(merge_23))
accent_stones_transformations = Transform(filter_12)

# ---- group: Display Ring
head_mesh_3 = Mesh(head_mesh)
center_shank_4 = Mesh(center_shank_3)
side_shank_2 = Mesh(side_shank)
base_basket_geometry = Mesh(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)
base_accent_stone_geometry = Mesh(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)
accent_stones_transformations_2 = Transform(accent_stones_transformations)
materials_sections_names_3 = Text(materials_sections_names)

item_12 = ListItem(List=head_mesh_3, Index=0, Wrap=True)  # -> Item, Item1
attachtransform_2 = AttachTransformations(Geometry=base_basket_geometry, Transform=accent_stones_transformations_2)
merge_24 = Merge(Data1=item_12.Item1, Data2=center_shank_4)
merge_25 = Merge(Data1=side_shank_2, Data2=attachtransform_2)
attachtransform_3 = AttachTransformations(Geometry=base_accent_stone_geometry, Transform=accent_stones_transformations_2)
entwine = Entwine(Branch00=item_12.Item, Branch01=merge_24, Branch02=merge_25, Branch03=attachtransform_3, FlattenInputs=True)  # -> simplify(Result)
create_material_only_with_name = CreateMaterialOnlyWithName(N=materials_sections_names_3)
ring_all_meshes = Mesh(entwine)
ring = GlTF20Display(Geometry=entwine, Material=create_material_only_with_name)

# ---- group: Calculate metal price (continued)
ring_all_meshes_2 = Mesh(ring_all_meshes)

split_3 = SplitTree(Data=ring_all_meshes_2, Masks="{0}")  # -> Positive, graft(Negative)
volume = MeshVolume(Mesh=split_3.Negative)  # -> Volume, Centroid
abs = Absolute(Value=volume.Volume)

# ---- group: Calculate metal price / Get how much the geometry was scaled
accesskey = AccessKey(Object=split_3.Negative, Key="transform")
clean_2 = CleanTree(RemoveNulls=True, RemoveInvalid=False, RemoveEmpty=True, Tree=accesskey)
explodestransformlist = ExplodeTransformList(TransformList=clean_2)
dematrix = DeconstructMatrix(Matrix=explodestransformlist)  # -> Rows, Columns, Values
item_13 = ListItem(List=dematrix.Values, Index=0, Wrap=True)  # -> Item, Item1, Item2
vec = VectorXYZ(XComponent=item_13.Item, YComponent=item_13.Item1, ZComponent=item_13.Item2)  # -> Vector, Length
trim_2 = TrimTree(Tree=vec.Length, Depth=2)

# ---- group: Calculate metal price (continued)
add_unmatched = AddUnmatched(Data0=abs, Data1=trim_2, nullPath=False)  # -> Data0, Data1
multiplication_3 = Multiplication(A=add_unmatched.Data0, B=add_unmatched.Data1)
flatten = FlattenTree(Tree=multiplication_3, Path="{0}")
ma = MassAddition(Input=flatten)  # -> Result, PartialResults
multiplication_4 = Multiplication(A=price_per_gram_2, B=ma.Result)
ring_price = RoundToDecimalPlace(NumberX=multiplication_4, DecimalPlace=2, RoundType=0)  # -> Rounded, Difference

# ---- group: Add to Cart UI (continued)
ring_price_2 = Number(ring_price.Rounded)

addtocart = AddToCartAction(Image=True, Price=ring_price_2, Description=ring_description)
concat_5 = Concatenate(FragmentA="**Price: $", FragmentB=ring_price_2, FragmentC="**")
parsejson = ParseJSON(JSON=addtocart)
constructjson = ConstructJSON(Object=parsejson, Data=ring_title, AddressString="props.title")
actionctrl_2 = ActionControl(Label="Add to Cart", Action=constructjson)
merge_26 = Merge(Data1=actionctrl, Data2=actionctrl_2)  # -> graft(Result)
controlswidget = ControlsWidget(Controls=merge_26)
trim_3 = TrimTree(Tree=controlswidget, Depth=1)
textwidget = TextWidget(Text=concat_5)
merge_27 = Merge(Data1=trim_3, Data2=textwidget)
add_to_cart_and_share_ui = AppBuilderWidget(merge_27)

# ---- group: Create App
agent_context = Panel("The app allows to configure a diamond ring. The head stone has three options, Round = 0, Emerald = 1, Heart   = 2")
exports_ui_2 = AppBuilderWidget(exports_ui)
ijewel3d_3 = Boolean(ijewel3d)
parameters_ui_2 = AppBuilderWidget(parameters_ui)
agent_mode_2 = Boolean(agent_mode)
add_to_cart_and_share_ui_2 = AppBuilderWidget(add_to_cart_and_share_ui)

# ---- group: Download Watertight Mesh
ring_all_meshes_3 = Mesh(ring_all_meshes)
watertight_mesh_file_format_2 = Integer(watertight_mesh_file_format)
process_watertight_mesh_2 = Boolean(process_watertight_mesh)
watertight_mesh_edge_length_2 = Number(watertight_mesh_edge_length)
receiver_email_of_watertight_mesh_2 = Text(receiver_email_of_watertight_mesh)
ring_title_2 = Text(concat_4)
ring_price_3 = Number(ring_price.Rounded)

# ---- group: Create App / IJewel3D does not support floating containers
cmf = ContainerMobileFallback(Location="right")
cp = ContainerProperties(Justification="bottom_right", AppBuilderContainerMobileFallback=cmf)
sp = ScreenPoint(XPosition="100%", YPosition="100%")
gate = StreamGate(Stream=add_to_cart_and_share_ui_2, Gate=ijewel3d_3)  # -> Target0, Target1
fcontainer = FloatingContainer(Location=sp, AppBuilderContainerProperties=cp, AppBuilderWidgets=gate.Target0)
container = Container(Location="bottom", AppBuilderWidgets=gate.Target1)
filter_13 = StreamFilter(Gate=ijewel3d_3, Stream0=fcontainer, Stream1=container)

# ---- group: Create App
rejson = SerializeJson(Context=agent_context, IncludeNullAndEmptyProperties=False)
rejson_2 = SerializeJson(Type="agent", Props=rejson, IncludeNullAndEmptyProperties=False)
filter_14 = StreamFilter(Gate=agent_mode_2, Stream1=rejson_2)
merge_28 = Merge(Data1=parameters_ui_2, Data2=exports_ui_2, Data3=filter_14)
container_2 = Container(Location="left", AppBuilderWidgets=merge_28)
merge_29 = Merge(Data1=container_2, Data2=filter_13)
app = App(Containers=merge_29)

# ---- group: Download Watertight Mesh
filter_15 = StreamFilter(Gate=process_watertight_mesh_2, Stream1=ring_all_meshes_3)
concat_6 = Concatenate(FragmentD=ring_title_2, FragmentA=" $", FragmentB=ring_price_3)
panel_13 = Panel("""1
2""")
zerotran_3 = ZeroedTransform()
export3dm = _3dmExportOptions(Version=8)
exportstl = StlExportOptions(FileFormat="Binary", N=False)
filter_16 = StreamFilter(Gate=watertight_mesh_file_format_2, Stream0=export3dm, Stream1=exportstl, Stream2=exportobj)

# ----
branch_4 = TreeBranch(Tree=filter_15, Path=panel_13, MaintainPaths=True)

# ---- group: Download Watertight Mesh (continued)
accesskey_2 = AccessKey(Object=branch_4, Key="transform")
explodestransformlist_2 = ExplodeTransformList(TransformList=accesskey_2)
nulls_in_empty_3 = NullsInEmptyBranches(DataWithEmptyBranches=explodestransformlist_2)
nullrep_2 = ReplaceNulls(Items=nulls_in_empty_3, Replacements=zerotran_3)  # -> Items, Count
transform = Transform(Geometry=graft(branch_4), Transform=nullrep_2.Items)  # -> flatten(Geometry)
wrap = ShrinkWrap(Geometry=transform, EdgeLength=watertight_mesh_edge_length_2, Offset=0, Smoothing=0, Optimization=100, FillHoles=True)
email_watertight_mesh = EmailExport(
    Data=wrap,
    Options=filter_16,
    Name=concat_6,
    To=receiver_email_of_watertight_mesh_2,
    Subject=concat_6,
    Body="__PARAMS__",
    AttachExport=True,
    AttachJSON=False)
download_watertight_mesh = DownloadExport(Data=wrap, Options=filter_16, Name=concat_6)

# ==== cluster CenterShank
start_thickness = ClusterInput()
end_thickness = ClusterInput()
section = ClusterInput()
rail = ClusterInput()
dom = ConstructDomain(StartThickness=start_thickness, EndThickness=end_thickness)
topoly = CurveToPolyline(Curve=rail, ToleranceDistance=0.005, ToleranceAngle=0)  # -> Polyline, Segments
disc = Discontinuity(Curve=topoly.Polyline, Level=1)  # -> Points, Parameters
trim = TrimTree(Tree=disc.Parameters, Depth=1)
graph = GraphMapper(
    trim,
    x0=0,
    x1=1,
    y0=0,
    y1=1,
    container_name="Bezier",
    cpx=[0, 0.0007412675768, 0.6550748348, 1],
    cpy=[0, 0.5333207846, 1, 1])
eval = EvaluateCurve(Curve=rail, Parameter=trim)  # -> Point, Tangent, Angle
slideindom = SlideWithinDomain(Domain=dom, Factor=graph)
xprod = CrossProduct(VectorA=Vector(0, 1, 0), VectorB=eval.Tangent, Unitize=False)  # -> Vector, Length
sections_size = ClusterOutput(slideindom)
pl = ConstructPlane(Origin=eval.Point, XAxis=Vector(0, 1, 0), YAxis=xprod.Vector)
scale = Scale(Geometry=section, Center=Point(0, 0, 0), Factor=slideindom)  # -> Geometry, Transform
orient = Orient(Geometry=scale.Geometry, Source=PlaneXY(0, 0, 0), Target=pl)  # -> Geometry, Transform
loftmesh = LoftMesh(Polylines=orient.Geometry, ComputeUV=False, IsometricUV=False, UVSize=1)
crv = Curve(orient.Geometry)
wireframe = ClusterOutput(crv)
M = ClusterOutput(loftmesh)
pl_2 = ClusterOutput(pl)

# ==== cluster StandarizeText
T = ClusterInput()
split = TextSplit(Text=T, Separators=" ")
trim = TextTrim(Text=split, Start=True, End=True)
join = TextJoin(Text=trim)
case = TextCase(Text=join, Culture=127)  # -> UpperCase, LowerCase
trim_2 = TrimTree(Tree=case.LowerCase, Depth=1)
T_2 = ClusterOutput(trim_2)

# ==== cluster CreateMaterialOnlyWithName
N = ClusterInput()
gltf2material = GlTF20Material(
    Name=N,
    BaseColorFactor=RGB(255, 255, 255),
    MetallicFactor=1,
    RoughnessFactor=0.5,
    EmissiveFactor=RGB(0, 0, 0),
    AlphaMode="OPAQUE",
    AlphaCutoff=0.5,
    DoubleSided=True)
M = ClusterOutput(gltf2material)

# ==== cluster PackCirclesAlongTwoPaths
distribute = ClusterInput()
tolerance = ClusterInput()
crva = ClusterInput()
crvb = ClusterInput()
gap = ClusterInput()
sizes = ClusterInput()
crva_2 = Curve(crva)
crvb_2 = Curve(crvb)
gap_2 = Number(gap)
sizes_2 = Number(sizes)
distribute_2 = Boolean(distribute)
tolerance_2 = Number(tolerance)
c_script = CSharpScript(CrvA=crva_2, CrvB=crvb_2, Gap=gap_2, Sizes=sizes_2, Distribute=distribute_2, Tolerance=tolerance_2)  # -> out, Circles; inputs CrvA: Curve, CrvB: Curve, Gap: Double, Sizes: list of Double, Distribute: Boolean, Tolerance: Double
# ---------- c_script: C# usings ----------
using System.Linq;
# ---------- c_script: C# ----------
    double totalRemainingSpace;
    var nurbsA = CrvA.ToNurbsCurve();
    nurbsA = nurbsA.Rebuild(nurbsA.Points.Count * 10, nurbsA.Degree, true);
    var nurbsB = CrvB.ToNurbsCurve();
    nurbsB = nurbsB.Rebuild(nurbsB.Points.Count * 10, nurbsB.Degree, true);
    var newDomain = new Interval(0, Math.Max(CrvA.GetLength(), CrvB.GetLength()));
    nurbsA.Domain = newDomain;
    nurbsB.Domain = newDomain;
    string errors = "";
    var circles = FitCirclesInCurves(nurbsA, nurbsB, 0, Gap, -1, -1, Tolerance, Sizes, out totalRemainingSpace, out errors);
    Print(errors);
    //Print(totalRemainingSpace.ToString());
    if(Distribute && circles.Count>0)
    {
      double finalGap = totalRemainingSpace / circles.Count;
      Print(circles.Count.ToString());
      //finalGap * 0.5
      //circles = FitCirclesInCurves(nurbsA, nurbsB, 0, 0, totalRemainingSpace, circles.Count, Sizes, out totalRemainingSpace);
      circles = FitCirclesInCurves(nurbsA, nurbsB, finalGap * 0.5, finalGap, totalRemainingSpace, circles.Count, Tolerance * 10, Sizes, out totalRemainingSpace, out errors);
    Print(errors);
    }

    Circles = circles;
# ---------- c_script: C# additional code ----------
  public static List<Circle> FitCirclesInCurves(NurbsCurve CrvA, NurbsCurve CrvB, double start, double gap, double potentialRemainingSpace, double aimAmount, double tolerance, List<double> sizes, out double totalRemainingSpace, out string errors)
  {
    errors = "";
    List<Circle> circles = new List<Circle>();
    totalRemainingSpace = 0;

    double lengthA = CrvA.GetLength();
    double lengthB = CrvB.GetLength();
    bool isALongest = lengthA > lengthB;
    double length = isALongest ? lengthA : lengthB;
    double previousParamAEnd = -1;
    double previousParamBEnd = -1;
    double previousParamX = -1;
    Point3d previousPnt = Point3d.Unset;

    Curve previousCircle = null;

    int counter = 0;
    while (true)
    {
      counter++;
      Circle circle;
      //if(aimAmount > 0)gap = (potentialRemainingSpace - totalRemainingSpace) / (aimAmount - circles.Count + (circles.Count == 0 ? 0 : 1));
      if (previousCircle == null)
      {
        Point3d pntA = CrvA.PointAtStart;
        Point3d pntB = CrvB.PointAtStart;
        Vector3d vectorX = new Vector3d(pntA.X - pntB.X, pntA.Y - pntB.Y, pntA.Z - pntB.Z);

        //double startt = aimAmount > 0 ? gap / 2 : 0;
        double startRadius = (vectorX.Length * 0.5) + start;
        //totalRemainingSpace += startt;
        
        circle = Circle.TryFitCircleTT(CrvA, CrvB, startRadius, startRadius);

        if (!circle.IsValid)break;

        Plane circlePlane = circle.Plane;

        double tA,tB;
        CrvA.ClosestPoint(circlePlane.Origin, out tA);
        CrvB.ClosestPoint(circlePlane.Origin, out tB);
        double alignAngle = Vector3d.VectorAngle(circlePlane.YAxis, (CrvA.TangentAt(tA) + CrvB.TangentAt(tB)) / 2, circlePlane);

        if(alignAngle != 0)
        {
          if(circlePlane.Rotate(alignAngle, circlePlane.Normal))circle.Plane = circlePlane;
        }
      }
      else
      {
        Point3d pntA = CrvA.PointAt(previousParamAEnd);
        Point3d pntB = CrvB.PointAt(previousParamBEnd);

        Point3d origin = (pntA + pntB) * 0.5;

        Vector3d vectorX = new Vector3d(pntA.X - pntB.X, pntA.Y - pntB.Y, pntA.Z - pntB.Z);
        Vector3d vectorY = (CrvA.TangentAt(previousParamAEnd) + CrvB.TangentAt(previousParamBEnd)) * 0.5;

        double paramAEnd = previousParamAEnd;
        double paramBEnd = previousParamBEnd;

        if(gap > 0)
        {
          Plane startPln = new Plane(origin, vectorX, vectorY);

          paramAEnd += gap;
          paramBEnd += gap;
          pntA = CrvA.PointAt(paramAEnd);
          pntB = CrvB.PointAt(paramBEnd);

          origin = (pntA + pntB) * 0.5;

          vectorX = new Vector3d(pntA.X - pntB.X, pntA.Y - pntB.Y, pntA.Z - pntB.Z);
          vectorY = (CrvA.TangentAt(paramAEnd) + CrvB.TangentAt(paramBEnd)) * 0.5;

          Plane endPln = new Plane(origin, vectorX, vectorY);

          previousCircle.Transform(Transform.PlaneToPlane(startPln, endPln));
        }

        double potentialDiameter = FindClosestBelow(sizes, vectorX.Length);
        if(potentialDiameter == -1)potentialDiameter = vectorX.Length;
        double potentialRadius = vectorX.Length * 0.5;

        double testLength = (isALongest ? paramAEnd : paramBEnd) + potentialDiameter - (potentialDiameter * tolerance);
        if(aimAmount <= 0 && (testLength < (isALongest ? previousParamAEnd : previousParamBEnd) || testLength >= length))
          break;
        else
        {
          paramAEnd += potentialRadius;
          paramBEnd += potentialRadius;
        }
/*
        double testLengthB = paramBEnd + potentialDiameter - (potentialDiameter * tolerance);
        if(aimAmount <= 0 && (testLengthB < previousParamBEnd || testLengthB >= lengthB))
          break;
        else
          paramBEnd += potentialRadius;
*/
          circle = Circle.TryFitCircleTT(CrvA, CrvB, paramAEnd, paramBEnd);
        //circle = Circle.TryFitCircleTTT(CrvA, CrvB, previousCircle, paramAEnd, paramBEnd, previousParamX);

        if(tolerance > 0 && !circle.IsValid)
        {
          Curve extendCrvA = CrvA.DuplicateCurve().Extend(CurveEnd.End, potentialRadius, CurveExtensionStyle.Smooth);
          Curve extendCrvB = CrvB.DuplicateCurve().Extend(CurveEnd.End, potentialRadius, CurveExtensionStyle.Smooth);
          //circle = Circle.TryFitCircleTTT(extendCrvA, extendCrvB, previousCircle, paramAEnd, paramBEnd, previousParamX);
          circle = Circle.TryFitCircleTT(extendCrvA, extendCrvB, paramAEnd, paramBEnd);
        }
        if(!circle.IsValid)break;

        Plane circlePlane = circle.Plane;
        double tA,tB;
        CrvA.ClosestPoint(circlePlane.Origin, out tA);
        CrvB.ClosestPoint(circlePlane.Origin, out tB);
        double alignAngle = Vector3d.VectorAngle(circlePlane.YAxis, (CrvA.TangentAt(tA) + CrvB.TangentAt(tB)) / 2, circlePlane);

        if(alignAngle != 0)
        {
          //if(circlePlane.Rotate(alignAngle, circlePlane.Normal) && circlePlane.Transform(Transform.Mirror(circlePlane.Origin, circlePlane.YAxis)))circle.Plane = circlePlane;
          if(circlePlane.Rotate(alignAngle, circlePlane.Normal))circle.Plane = circlePlane;
        }
      }

      if(sizes.Count > 0)
      {
        double originalDiameter = circle.Diameter;
        double newDiameter = FindClosestBelow(sizes, originalDiameter);
        if(newDiameter != -1)
        {
          double paramA,paramB,param;
          var curve = circle.ToNurbsCurve();
          curve.LengthParameter(curve.GetLength() * 0.75, out param);
          Point3d pt = curve.PointAt(param);

          CrvA.ClosestPoint(pt, out paramA);
          CrvB.ClosestPoint(pt, out paramB);

          Point3d pntA = CrvA.PointAt(paramA);
          Point3d pntB = CrvB.PointAt(paramB);

          Point3d origin = (pntA + pntB) * 0.5;

          Vector3d vectorX = new Vector3d(pntA.X - pntB.X, pntA.Y - pntB.Y, pntA.Z - pntB.Z);
          Vector3d vectorY = (CrvA.TangentAt(paramA) + CrvB.TangentAt(paramB)) * 0.5;

          Plane endPln = new Plane(origin, vectorX, vectorY);

          circle.Diameter = newDiameter;
          curve = circle.ToNurbsCurve();
          curve.LengthParameter(curve.GetLength() * 0.75, out param);
          pt = curve.PointAt(param);

          CrvA.ClosestPoint(pt, out paramA);
          CrvB.ClosestPoint(pt, out paramB);

          pntA = CrvA.PointAt(paramA);
          pntB = CrvB.PointAt(paramB);

          origin = (pntA + pntB) * 0.5;

          vectorX = new Vector3d(pntA.X - pntB.X, pntA.Y - pntB.Y, pntA.Z - pntB.Z);
          vectorY = (CrvA.TangentAt(paramA) + CrvB.TangentAt(paramB)) * 0.5;

          Plane startPln = new Plane(origin, vectorX, vectorY);

          circle.Transform(Transform.PlaneToPlane(startPln, endPln));
        }
      }

      if(previousCircle != null)
      {
        double currentParam;
        var currentCircle = circle.ToNurbsCurve();
        currentCircle.LengthParameter(currentCircle.GetLength() * 0.75, out currentParam);
        Point3d currentPnt = currentCircle.PointAt(currentParam);

        Vector3d correctionVec = new Vector3d(previousPnt.X - currentPnt.X, previousPnt.Y - currentPnt.Y, previousPnt.Z - currentPnt.Z);
        double correctionDistance = correctionVec.Length - gap;
        if(Math.Abs(correctionDistance) > 0.01)
        {
          correctionVec.Unitize();
          circle.Translate(correctionVec * correctionDistance);
        }
      }
      else
      {

      }

      {
        if(previousCircle != null)
        {
          double currentParam;
          var currentCircle = circle.ToNurbsCurve();
          currentCircle.LengthParameter(currentCircle.GetLength() * 0.75, out currentParam);
          Point3d currentPnt = currentCircle.PointAt(currentParam);

          totalRemainingSpace += currentPnt.DistanceTo(previousPnt);
        }

        previousCircle = circle.ToNurbsCurve();
        previousCircle.LengthParameter(previousCircle.GetLength() * 0.25, out previousParamX);
        previousPnt = previousCircle.PointAt(previousParamX);

        CrvA.ClosestPoint(previousPnt, out previousParamAEnd);
        CrvB.ClosestPoint(previousPnt, out previousParamBEnd);
      }

      circles.Add(circle);
      if((aimAmount > 0 && circles.Count == aimAmount) || counter > 100)break;
    }

    //totalRemainingSpace = previousParamAEnd;
    totalRemainingSpace += (CrvA.GetLength(new Interval(previousParamAEnd, CrvA.Domain.Max)) + CrvB.GetLength(new Interval(previousParamBEnd, CrvB.Domain.Max))) * 0.5;

    return circles;
  }

  public static double FindClosestBelow(List<double> numbers, double threshold)
  {
    if(numbers.Count == 0)return -1;

    // Filter numbers below the threshold
    var belowThreshold = numbers.Where(n => n < threshold);

    // Return false if no numbers found below threshold
    if (!belowThreshold.Any())return -1;

    // Find the number closest to the threshold
    return belowThreshold.Aggregate((current, next) => Math.Abs(next - threshold) < Math.Abs(current - threshold) ? next : current);
  }
# ---------- end c_script ----------
circle = Circle(c_script.Circles)
circle_2 = ClusterOutput(circle)
