# Grasshopper definition DEMO-ModularCabinets.ghx (Grasshopper 1.0.7)
# plug-ins: ShapeDiverForGrasshopper, jSwan, BitmapComponent, Pufferfish, treesloth01, GrasshopperHyperGooComponents, Wombat

# ----
# LEGEND
# All sliders, value lists, colors, ShapeDiver inputs (e.g. "SDTextInput"), etc. that will be available in
# the ShapeDiver platform as parameters or have the potential of becoming available (e.g. Panels
# with hardcoded data that can not be access directly in ShapeDiver).
# Parameters
# Basic Groups
# The Grasshopper definition should be built in small groups, "Basic Groups", with very specific tasks.
# Each "Basic Group" should have "Inputs", "Outputs", a title and an optional description if necessary.
# Inputs
# All data that goes inside a "Basic Group".
# NO DATA should go inside a "Basic Group" from any other area but the "Inputs".
# Outputs
# All data that goes outside a "Basic Group".
# NO DATA should go outside a "Basic Group" from any other area but the "Outputs".
# Exports /
# Data Outputs
# Contains the data that will be available via the ShapeDiver platform or API.
# Data is sent via the ShapeDiver outputs components (e.g. "SDExportDownload").
# This may also contain basic exports pre processing (e.g. "SDPropertiesExport").
# Contains the "SDDisplayGeometry" components or any geometry that has preview on.
# This is the geometry that will be visible in the ShapeDiver viewer.
# This may also contain simple material creation.
# Display
# Contains any components that are used just for local testing but need to be
# removed before uploading to ShapeDiver (e.g. Components that bake geometry in Rhino,
# C# scripts that affect the Rhino document or store data in the local machine,
# unsupported ShapeDiver plugins, etc.).
# Local Testing
# Ready to
# Organize
# Add all definition sections that are finsihed but still need to be organized.
# In Progress /
# To Implement /
# To Improve
# Add all definition groups that are still not ready.
# These sections need to be implemented, are still being tested or not finished.
# They also involve potential improvements.
data = Data()
data_2 = Data()
data_3 = Data()
data_4 = Data()
data_5 = Data()
data_6 = Data()
data_7 = Data()
data_8 = Data()
data_9 = Data()

minimum_cabinet_size = Slider(200, range=0..1000)
material_thickness = Slider(18, range=1..100)
material_size = Slider(1000, range=1..10000)
icons_size = Slider(100, range=1..1000)
height = Slider(500, range=0..2000)
depth = Slider(500, range=0..2000)
width = Slider(500, range=0..2000)
show_icons = BooleanToggle(True)
icon_mesh = Mesh(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)
add_cabinets = SelectionInput(
    Hover=True,
    MaxObjectsSelected=1,
    MinObjectsSelected=0,
    NameFilters_Branch0_Path="{0}",
    NameFilters_Branch0_Item0_null_string=False,
    NameFilters_Branch0_Item0_string="add.*")
remove_cabinets = SelectionInput(
    Hover=True,
    MaxObjectsSelected=1,
    MinObjectsSelected=0,
    NameFilters_Branch0_Path="{0}",
    NameFilters_Branch0_Item0_null_string=False,
    NameFilters_Branch0_Item0_string="remove.*")
edit_cabinets = SelectionInput(
    Hover=True,
    MaxObjectsSelected=1,
    MinObjectsSelected=0,
    NameFilters_Branch0_Path="{0}",
    NameFilters_Branch0_Item0_null_string=False,
    NameFilters_Branch0_Item0_string="cabinets.*")
cabinets_state = DirectTextInput(Lines=1, maxlength=100000)
merge = Merge(Data1=width, Data2=depth, Data3=height)
scale = Scale(Geometry=icon_mesh, Center=Point(0, 0, 0), Factor=icons_size)  # -> Geometry, Transform
dimensions = Number(merge)
icon_mesh_2 = Mesh(scale.Geometry)

# ---- group: Base Data / Extract Cabinets State
cabinets_state_2 = Text(cabinets_state)
remove_cabinets_2 = Text(remove_cabinets)
edit_cabinets_2 = Text(edit_cabinets)

# ----
dejson = DeserializeJson(JSON=cabinets_state_2, OutputsLocked=False)  # -> NewCabinetId, State

# ---- group: Base Data / Extract Cabinets State / Check which cabinets need to be removed and edited / Keep it in separate branches in case it is empty to conserve order.
entwine = Entwine(Branch00=remove_cabinets_2, Branch01=edit_cabinets_2, FlattenInputs=True)

# ---- group: Base Data / Extract Cabinets State / Check which cabinets need to be removed and edited
panel = Panel("""remove.
cabinets.""")
dejsonkv = DeserializeKeysAndValues(JSON=dejson.State, Keys="id")  # -> Key, Value
rep = ReplaceText(Text=entwine, Find=graft(panel), RecursiveReplace=False)
txt = Text(dejsonkv.Value)
mindex = MemberIndex(Set=flatten(txt), Member=rep)  # -> Index, Count

# ---- group: Base Data / Extract Cabinets State / Graft to conserve the original state index order.
shift_paths = ShiftPaths(Data=graft(dejson.State), Offset=2)

# ---- group: Base Data / Extract Cabinets State / Default first cabinet to 0 ID
addition = Addition(A=dejson.NewCabinetId, B=0)

# ---- group: Display / Default Wood Material
presetmaterial = PresetMaterial(Color=RGB(255, 255, 255), MaterialIndex=500)

# ---- group: APP Builder / Create UI / Just allow to change dimensions every 100 units
num = Number(100)

# ---- group: APP Builder / Create UI / Always reset add and remove selections so the user can continue adding or selecting new parts of the model
panel_2 = Panel("{\"names\":[]}")

# ---- group: APP Builder / Create Cabinets JSON State / This parameter is just to store the state so we dont need to expose it to the user
bool = Boolean(True)
rejson = SerializeJson(Hidden=bool, IncludeNullAndEmptyProperties=True)
rejson_2 = SerializeJson(Overrides=rejson, IncludeNullAndEmptyProperties=True)
rejson_3 = SerializeJson(Props=rejson_2, IncludeNullAndEmptyProperties=True)

# ---- group: Base Data / Extract Cabinets State
bang = ExplodeTree(Data=mindex.Index)  # -> Branch0, Branch1

# ---- group: Base Data / Extract Cabinets State / Remove Cabinets
path = DataPath(bang.Branch0)
split = SplitTree(Data=shift_paths, Masks=path)  # -> Positive, Negative

# ---- group: Base Data / Extract Cabinets State (continued)
dejson_2 = DeserializeJson(JSON=split.Negative, OutputsLocked=True)  # -> Width, Depth, Height, Position, Id, Selected
list_length = ListLength(List=flatten(split.Negative))
merge_2 = Merge(Data1=dejson_2.Width, Data2=dejson_2.Depth, Data3=dejson_2.Height)
dejson_3 = DeserializeJson(JSON=dejson_2.Position, OutputsLocked=True)  # -> X, Y, Z

cabinets_state_position = ConstructPoint(XCoordinate=dejson_3.X, YCoordinate=0, ZCoordinate=dejson_3.Z)
selected_cabinet_path = DataPath(bang.Branch1)
new_cabinet_id = Text(addition)
cabinets_state_json = Data(split.Negative)
cabinets_state_dimensions = Number(merge_2)
cabinets_state_is_selected = Boolean(dejson_2.Selected)
cabinets_quantity = Integer(list_length)
cabinets_state_id = Text(dejson_2.Id)

# ---- group: Base Data / Set new dimensions to selected ID
state_is_selected = Boolean(cabinets_state_is_selected)
dimensions_2 = Number(dimensions)
cabinets_state_dimensions_2 = Number(cabinets_state_dimensions)
selected_cabinet_path_2 = DataPath(selected_cabinet_path)

# ---- group: Base Data / Check that the currectly selected cabinet is already set as selected in the state to make sure that the UI and the state are syncronized
branch = TreeBranch(Tree=state_is_selected, Path=selected_cabinet_path_2, MaintainPaths=True)
null = NullPlaceholder()
filter = StreamFilter(Gate=branch, Stream0=null, Stream1=dimensions_2)

# ---- group: Base Data / Separate selected cabinet
split_2 = SplitTree(Data=cabinets_state_dimensions_2, Masks=selected_cabinet_path_2)  # -> Positive, Negative

# ---- group: Base Data / Update the selected cabinet with the new dimensions, if the UI is already syncronized with the selected cabinet.
nullrep = ReplaceNulls(Items=graft(filter), Replacements=graft(split_2.Positive))  # -> Items, Count
trim = TrimTree(Tree=nullrep.Items, Depth=1)

# ---- group: Base Data / Set new dimensions to selected ID
merge_3 = Merge(Data1=trim, Data2=split_2.Negative)

selected_cabinet_dimensions = Number(trim)
final_dimensions = Number(merge_3)

# ---- group: Create Geometry / Create Existing Cabinets Wireframe
cabinets_state_position_2 = Point(cabinets_state_position)
final_dimensions_2 = Number(final_dimensions)
material_thickness_2 = Number(material_thickness)

xz = XZPlane(Origin=cabinets_state_position_2)
item = ListItem(List=final_dimensions_2, Index=0, Wrap=True)  # -> Item, Item1, Item2
rectangle = Rectangle(Plane=xz, XSize=item.Item, YSize=item.Item2, Radius=0)  # -> Rectangle, Length
create_cabinet_wireframe = CreateCabinetWireframe(base_rectangle=rectangle.Rectangle, depth=item.Item1, material_thickness=material_thickness_2)

icons_position = IconsPosition(cabinets_wireframe=create_cabinet_wireframe)  # -> icons_direction, icons_position, cabinets_potential_segments
cabinets_wireframe = Rectangle(create_cabinet_wireframe)

# ---- group: Create Geometry / Create new Cabinet
cabinets_potential_segments = Line(icons_position.cabinets_potential_segments)
icons_position_2 = Point(icons_position.icons_position)
add_cabinets_2 = Text(add_cabinets)
width_2 = Number(width)
height_2 = Number(height)
depth_2 = Number(depth)
material_thickness_3 = Number(material_thickness)
cabinets_quantity_2 = Integer(cabinets_quantity)

# ---- group: Create Geometry / Create new Cabinet / Default start line in case nothing exists
bool_2 = Boolean(cabinets_quantity_2)
filter_2 = StreamFilter(Gate=bool_2, Stream0=width_2)
X = UnitX(Factor=filter_2)
neg = Negative(Value=filter_2)
line = LineSDL(Start=X, Direction=Vector(1, 0, 0), Length=neg)

# ---- group: Create Geometry / Create new Cabinet
rep_2 = ReplaceText(Text=add_cabinets_2, Find="add.", RecursiveReplace=False)

# ---- group: Create Geometry / Create new Cabinet / Check if anything needs to be added. Default to 0.
len = TextLength(Text=rep_2)
addition_2 = Addition(A=len, B=0)
bool_3 = Boolean(addition_2)
filter_3 = StreamFilter(Gate=bool_3, Stream1=icons_position_2)

# ---- group: Create Geometry / Create new Cabinet / Select the relevant edge where the new cabinet should be positioned
point_to_id = PointToID(P=filter_3)  # -> flatten(R)
mindex_2 = MemberIndex(Set=point_to_id, Member=rep_2)  # -> Index, Count
clean = CleanTree(RemoveNulls=True, RemoveInvalid=True, RemoveEmpty=True, Tree=mindex_2.Index)
item_2 = ListItem(List=cabinets_potential_segments, Index=clean, Wrap=False)

# ---- group: Create Geometry / Create new Cabinet (continued)
merge_4 = Merge(Data1=item_2, Data2=line)

# ---- group: Check if the selected edge is oriented horizontally or vertically to use the correct default for the other dimension of the cabinet
dprod = DotProduct(VectorA=merge_4, VectorB=Vector(1, 0, 0), Unitize=True)
bool_4 = Boolean(dprod)
filter_4 = StreamFilter(Gate=bool_4, Stream0=width_2, Stream1=height_2)

# ---- group: Create Geometry / Create new Cabinet (continued)
offcrv = OffsetCurve(Curve=merge_4, Plane=PlaneXZ(0, 0, 0), Distance=filter_4, BothSides=0, Kinks=0, CapType=1)

# ---- group: Create Geometry / Create new Cabinet / Orient the new boundary curve in the XZ plane by getting its bounding rectangle.
bounding_rectangle = BoundingRectangle(Geometry=offcrv, Plane=PlaneXZ(0, 0, 0), Axis=0, Slide=0, Union=True)  # -> Bounding, DimensionX, DimensionY

# ---- group: Create Geometry / Create new Cabinet (continued)
create_cabinet_wireframe_2 = CreateCabinetWireframe(base_rectangle=bounding_rectangle.Bounding, depth=depth_2, material_thickness=material_thickness_3)

# ---- group: Create Geometry / Create new Cabinet / Send to the end of the list of cabinets
flatten = FlattenTree(Tree=create_cabinet_wireframe_2, Path=cabinets_quantity_2)

# ---- group: Create Geometry / Create new Cabinet (continued)
lng = ListLength(List=flatten)

# ---- group: Create Geometry / Create new Cabinet / Default to 0 when no new cabinet exist
addition_3 = Addition(A=lng, B=0)

# ---- group: Create Geometry / Create new Cabinet
new_cabinet_exists = Boolean(addition_3)
new_cabinet_wireframe = Rectangle(flatten)

# ---- group: Create Geometry / Create Remove Icons
icon_mesh_3 = Mesh(icon_mesh_2)
cabinets_wireframe_2 = Rectangle(cabinets_wireframe)
new_cabinet_wireframe_2 = Rectangle(new_cabinet_wireframe)

# ---- group: Create Geometry / Create Add Icons
icon_mesh_4 = Mesh(icon_mesh_2)
icons_size_2 = Number(icons_size)
show_icons_2 = Boolean(show_icons)
cabinets_wireframe_3 = Rectangle(cabinets_wireframe)
new_cabinet_wireframe_3 = Rectangle(new_cabinet_wireframe)
minimum_cabinet_size_2 = Number(minimum_cabinet_size)

# ----
new_cabinet_exists_2 = Boolean(new_cabinet_exists)

# ---- group: Create Geometry / Create Cabinets Mesh
cabinets_wireframe_4 = Rectangle(cabinets_wireframe)
new_cabinet_wireframe_4 = Rectangle(new_cabinet_wireframe)
material_size_2 = Number(material_size)

# ---- group: Create Geometry / Create Add Icons
merge_5 = Merge(Data1=cabinets_wireframe_3, Data2=new_cabinet_wireframe_3)
filter_5 = StreamFilter(Gate=show_icons_2, Stream1=merge_5)
icons_position_3 = IconsPosition(cabinets_wireframe=filter_5)  # -> icons_direction, icons_position, cabinets_potential_segments
len_2 = Length(Curve=icons_position_3.cabinets_potential_segments)
larger = LargerThan(FirstNumber=len_2, SecondNumber=minimum_cabinet_size_2)  # -> LargerThan, OrEqualTo
cull_multiple = CullMultiple(L0=icons_position_3.icons_direction, L1=icons_position_3.icons_position, P=larger.LargerThan)  # -> L0, L1
xprod = CrossProduct(VectorA=Vector(0, 1, 0), VectorB=cull_multiple.L0, Unitize=True)  # -> Vector, Length
amp = Amplitude(Vector=xprod.Vector, Amplitude=icons_size_2)
addition_4 = Addition(A=amp, B=cull_multiple.L1)
point_to_id_2 = PointToID(P=cull_multiple.L1)
constructattr = ConstructAttributes(Keys="name", Values=point_to_id_2)  # -> flatten(Attributes)
move = Move(Geometry=icon_mesh_4, Motion=addition_4)  # -> Geometry, Transform
injectattr = InjectAttributes(Object=move.Geometry, Attributes=constructattr)
add_icons = Mesh(injectattr)

# ---- group: Create Geometry / Create Cabinets Mesh
merge_6 = Merge(Data1=cabinets_wireframe_4, Data2=new_cabinet_wireframe_4)
loftmesh = LoftMesh(Polylines=merge_6, ComputeUV=True, IsometricUV=False, UVSize=material_size_2)
cabinets = UnweldMesh(Mesh=loftmesh, Angle=1.570796327)  # -> flatten(Result)

# ---- group: APP Builder / Gather New Cabinet Data
new_cabinet_wireframe_5 = Rectangle(new_cabinet_wireframe)
depth_3 = Number(depth)
new_cabinet_id_2 = Text(new_cabinet_id)

item_3 = ListItem(List=new_cabinet_wireframe_5, Index=0, Wrap=False)  # -> flatten(Item)
drec = DeconstuctRectangle(Rectangle=item_3)  # -> BasePlane, XInterval, YInterval
merge_7 = Merge(Data1=drec.XInterval, Data2=depth_3, Data3=drec.YInterval)
curvepoint = PointOnCurve(item_3, parameter=0)
num_2 = Number(merge_7)
store_that_the_new_cabinet_is_selected = Boolean(True)
panel_3 = Panel("""selected
id
position
width
depth
height""")
merge_8 = Merge(Data1=store_that_the_new_cabinet_is_selected, Data2=new_cabinet_id_2, Data3=curvepoint, Data4=num_2)
rejsonkv = SerializeKeysAndValues(Key=panel_3, Value=merge_8)
clean_2 = CleanTree(RemoveNulls=True, RemoveInvalid=True, RemoveEmpty=True, Tree=rejsonkv, SynchronousTree1=num_2)  # -> Tree, SynchronousTree1

new_cabinet_data = Data(clean_2.Tree)
new_cabinet_dimensions = Number(clean_2.SynchronousTree1)

# ---- group: APP Builder / Create Cabinets JSON State
final_dimensions_3 = Number(final_dimensions)
cabinets_state_json_2 = Data(cabinets_state_json)
new_cabinet_data_2 = Data(new_cabinet_data)
new_cabinet_exists_3 = Boolean(new_cabinet_exists)
new_cabinet_id_3 = Text(new_cabinet_id)

# ---- group: APP Builder / Create UI
panel_4 = Panel("alwaysActive")
panel_5 = Panel("cabinets.")
panel_6 = Panel("""Width
Depth
Height""")
new_cabinet_id_4 = Text(new_cabinet_id)
new_cabinet_dimensions_2 = Number(new_cabinet_dimensions)
new_cabinet_exists_4 = Boolean(new_cabinet_exists)

# ---- group: APP Builder / Create UI / If a new cabinet is added, this will automatically select that cabinet so the user can start editing it. Otherwise, just stay with the current state of the parameter.
concat = Concatenate(FragmentA=panel_5, FragmentB=new_cabinet_id_4)
rejson_4 = SerializeJson(Names=concat, IncludeNullAndEmptyProperties=False)
txt_2 = Text(rejson_4)
null_2 = NullPlaceholder()
filter_6 = StreamFilter(Gate=new_cabinet_exists_4, Stream0=null_2, Stream1=txt_2)

# ---- group: APP Builder / Create UI / Make the selections always active
rejson_5 = SerializeJson(ActiveMode=panel_4, IncludeNullAndEmptyProperties=False)

# ---- group: Update new cabinet ID if a new one was added to keep the IDs unique but consistent. Random IDs are not good for performance because the results are then no cached.
addition_5 = Addition(A=new_cabinet_exists_3, B=new_cabinet_id_3)

# ---- group: Create Geometry / Create Remove Icons
show_icons_3 = Boolean(show_icons)
cabinets_quantity_3 = Integer(cabinets_quantity)
merge_9 = Merge(Data1=cabinets_wireframe_2, Data2=new_cabinet_wireframe_2)

# ---- group: More than one cabinet must exist to allow the user delete cabinets
addition_6 = Addition(A=new_cabinet_exists_2, B=cabinets_quantity_3)
larger_2 = LargerThan(FirstNumber=addition_6, SecondNumber=1)  # -> LargerThan, OrEqualTo
and = GateAnd(A=larger_2.LargerThan, B=show_icons_3)

# ---- group: Create Geometry / Create Remove Icons (continued)
filter_7 = StreamFilter(Gate=and, Stream1=merge_9)
item_4 = ListItem(List=filter_7, Index=0, Wrap=False)  # -> flatten(Item)
paramptinrec = ParameterPointInRectangle(Rectangle=item_4, ParameterX=0.5, ParameterY=0.5)  # -> Point, Normal
move_2 = Move(Geometry=icon_mesh_3, Motion=paramptinrec.Point)  # -> Geometry, Transform
remove_icons = Mesh(move_2.Geometry)

# ---- group: Display
cabinets_mesh = Mesh(cabinets)
remove_icons_2 = Mesh(remove_icons)
cabinets_state_id_2 = Text(cabinets_state_id)
add_icons_2 = Mesh(add_icons)
minus_icon = Bitmap(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)
plus_icon = Bitmap(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)

new_cabinet_exists_5 = Boolean(new_cabinet_exists)
new_cabinet_id_5 = Text(new_cabinet_id)
gltf2material = GlTF20Material(
    BaseColorFactor=RGB(255, 255, 255),
    BaseColorTexture=minus_icon,
    MetallicFactor=0,
    RoughnessFactor=1,
    EmissiveFactor=RGB(0, 0, 0),
    AlphaMode="MASK",
    AlphaCutoff=0.5,
    DoubleSided=True)
gltf2material_2 = GlTF20Material(
    BaseColorFactor=RGB(255, 255, 255),
    BaseColorTexture=plus_icon,
    MetallicFactor=0,
    RoughnessFactor=1,
    EmissiveFactor=RGB(0, 0, 0),
    EmissiveTexture=plus_icon,
    AlphaMode="MASK",
    AlphaCutoff=0.5,
    DoubleSided=True)
add = GlTF20Display(Geometry=add_icons_2, Material=gltf2material_2)

# ---- group: Send the new ID to the end of the list
match = MatchTree(Tree=new_cabinet_id_5, Guide=new_cabinet_exists_5)

# ---- group: Display (continued)
filter_8 = StreamFilter(Gate=new_cabinet_exists_5, Stream1=match)
merge_10 = Merge(Data1=cabinets_state_id_2, Data2=filter_8)
construct_attributes = ConstructAttributes(Keys="name", Values=merge_10)  # -> flatten(Attributes)
injectattr_2 = InjectAttributes(Object=cabinets_mesh, Attributes=construct_attributes)
injectattr_3 = InjectAttributes(Object=remove_icons_2, Attributes=construct_attributes)
cabinets_2 = GlTF20Display(Geometry=injectattr_2, Material=presetmaterial)
remove = GlTF20Display(Geometry=injectattr_3, Material=gltf2material)

# ---- group: APP Builder / Create Cabinets JSON State
selected_cabinet_path_3 = DataPath(selected_cabinet_path)
split_3 = SplitTree(Data=cabinets_state_json_2, Masks=selected_cabinet_path_3)  # -> Positive, Negative

# ---- group: APP Builder / Create Cabinets JSON State / Update Selected Cabinet
branch_2 = TreeBranch(Tree=final_dimensions_3, Path=selected_cabinet_path_3, MaintainPaths=True)  # -> flatten(Branch)
store_that_the_cabinet_is_currently_sele = Boolean(True)  # "store that the cabinet is currently selected"
panel_7 = Panel("""width
depth
height
selected""")
merge_11 = Merge(Data1=branch_2, Data2=store_that_the_cabinet_is_currently_sele)
rejsonkv_2 = SerializeKeysAndValues(Key=panel_7, Value=merge_11)
jmerge = MergeJson(SourceJson=split_3.Positive, OverrideJson=rejsonkv_2)

# ---- group: APP Builder / Create Cabinets JSON State / Store that the rest of cabinets are not selected
bool_5 = Boolean(False)
rejson_6 = SerializeJson(Selected=bool_5, IncludeNullAndEmptyProperties=False)
jmerge_2 = MergeJson(SourceJson=split_3.Negative, OverrideJson=rejson_6)

# ---- group: APP Builder / Create UI
selected_cabinet_dimensions_2 = Number(flatten(selected_cabinet_dimensions))
minimum_cabinet_size_3 = Number(minimum_cabinet_size)
merge_12 = Merge(Data1=filter_6, Data2=panel_2, Data3=panel_2)
rejson_7 = SerializeJson(ResetValue=merge_12, Props=rejson_5, IncludeNullAndEmptyProperties=False)
panel_8 = Panel("""Edit Cabinets
Add Cabinets
Remove Cabinets""")
paramctrl = ParameterControl(Name=panel_8, Settings=rejson_7)

# ---- group: APP Builder / Create UI / Reset the values of the dimensions sliders so they reflect the size of the selected or new cabinet
filter_9 = StreamFilter(Gate=new_cabinet_exists_4, Stream0=selected_cabinet_dimensions_2, Stream1=new_cabinet_dimensions_2)
rejson_8 = SerializeJson(ResetValue=filter_9, Min=minimum_cabinet_size_3, Step=num, IncludeNullAndEmptyProperties=False)

# ---- group: APP Builder / Create Cabinets JSON State (continued)
merge_13 = Merge(Data1=jmerge, Data2=jmerge_2)

# ---- group: APP Builder / Create Cabinets JSON State / add new cabinet to the state
merge_14 = Merge(Data1=flatten(merge_13), Data2=new_cabinet_data_2)

# ---- group: APP Builder / Create Cabinets JSON State (continued)
rejson_9 = SerializeJson(State=merge_14, NewCabinetId=addition_5, IncludeNullAndEmptyProperties=False)
txt_3 = Text(rejson_9)
rejson_10 = SerializeJson(ResetValue=txt_3, IncludeNullAndEmptyProperties=False)
paramctrl_2 = ParameterControl(Name="Cabinets State", Settings=rejson_10)
cabinets_state_parameter = MergeJson(SourceJson=paramctrl_2, OverrideJson=rejson_3)

# ---- group: APP Builder / Create UI (continued)
empty = EmptyObjectToEmptyBranch(DataIn=filter_9)
lng_2 = ListLength(List=empty)
paramctrl_3 = ParameterControl(Name=panel_6, Settings=rejson_8)
bool_6 = Boolean(lng_2)

# ---- group: APP Builder / Create UI / Just show these parameters if something is selected, new or existing
filter_10 = StreamFilter(Gate=bool_6, Stream1=paramctrl_3)

# ---- group: APP Builder / Create UI (continued)
cabinets_parameters = Merge(Data1=paramctrl, Data2=filter_10)

# ---- group: APP Builder / Output App Builder UI in Floating Container
cabinets_parameters_2 = Data(cabinets_parameters)
cabinets_state_parameter_2 = Data(cabinets_state_parameter)

merge_15 = Merge(Data1=cabinets_parameters_2, Data2=cabinets_state_parameter_2)
cp = ContainerProperties(Justification="top_right", UseContainer=False)
sp = ScreenPoint(XPosition="100%", YPosition="0%")
controlswidget = ControlsWidget(Controls=merge_15)
fcontainer = FloatingContainer(Location=sp, AppBuilderContainerProperties=cp, AppBuilderWidgets=controlswidget)
app = App(Containers=fcontainer)

# ==== cluster IconsPosition
cabinets_wireframe = ClusterInput()
item = ListItem(List=cabinets_wireframe, Index=0, Wrap=True)
runion = RegionUnion(Curves=flatten(item), Plane=PlaneXZ(0, 0, 0))
explode = Explode(Curve=runion, Recursive=True)  # -> flatten(Segments), Vertices
eval = EvaluateCurve(Curve=reparameterize(explode.Segments), Parameter=0.5)  # -> Point, Tangent, Angle
pt2num = PointsToNumbers(Points=eval.Point, Mask=11)  # -> flatten(Numbers)
larger = LargerThan(FirstNumber=pt2num, SecondNumber=0.01)  # -> LargerThan, OrEqualTo
cull_multiple = CullMultiple(L0=explode.Segments, L1=eval.Point, L2=eval.Tangent, P=larger.LargerThan)  # -> L0, L1, L2
icons_direction = ClusterOutput(cull_multiple.L2)
icons_position = ClusterOutput(cull_multiple.L1)
cabinets_potential_segments = ClusterOutput(cull_multiple.L0)

# ==== cluster PointToID
P = ClusterInput()
pt2num = PointsToNumbers(Points=graft(P), Mask=4)
split = TextSplit(Text=pt2num, Separators=".")
trim = TrimTree(Tree=split, Depth=2)
join = TextJoin(Text=trim)
R = ClusterOutput(join)

# ==== cluster CreateCabinetWireframe
base_rectangle = ClusterInput()
depth = ClusterInput()
material_thickness = ClusterInput()
neg = Negative(Value=material_thickness)
neg_2 = Negative(Value=depth)
offset = OffsetCurve(Curve=base_rectangle, Distance=neg, Plane=PlaneXZ(0, 0, 0), Corners=1)
trim = TrimTree(Tree=offset, Depth=1)
merge = Merge(Data1=base_rectangle, Data2=trim)
Y = UnitY(Factor=neg_2)
move = Move(Geometry=merge, Motion=Y)  # -> Geometry, Transform
item = ListItem(List=merge, Index=0, Wrap=True)
merge_2 = Merge(Data1=merge, Data2=reverse(move.Geometry), Data3=item)
clean = CleanTree(RemoveNulls=True, RemoveInvalid=True, RemoveEmpty=True, Tree=merge_2)
cabinets_wireframe = ClusterOutput(clean)
