# Grasshopper definition DEMO-UrbanFrame.ghx (Grasshopper 1.0.8)
# plug-ins: jSwan, Squid (ShapeDiver Edition), ShapeDiverForGrasshopper

# ----
# Inputs: ShapeDiver parameters exposed in the configurator: street plan and widths, block rules, typology, density and height controls, program mix, display toggles (Show Block Labels, Colour by Use) and the Block Overrides text (blockId,typology,densityWeight; ... with typology 0 perimeter, 1 slab rows, 2 point grid, 3 park, -1 keep). One output relay per value.
street_plan = ValueList({"Manhattan (Midtown East)": 0, "Barcelona (Eixample and Diagonal)": 1, "Chicago (Loop)": 2, "Amsterdam (canal ring)": 3}, selected="Barcelona (Eixample and Diagonal)")
primary_street_width = Slider(26, range=12..40)
secondary_street_width = Slider(14, range=8..24)
front_setback = Slider(2, range=0..10)
corner_radius = Slider(6, range=0..15)
min_block_area = Slider(1500, range=500..5000)
typology = ValueList({"Perimeter Block": 0, "Slab Rows": 1, "Point Grid": 2, "Mixed": 3}, selected="Perimeter Block")
layout_seed = Slider(7, range=0..100)
building_depth = Slider(20, range=10..24)
plot_frontage = Slider(22, range=10..50)
row_spacing = Slider(18, range=8..40)
point_block_size = Slider(22, range=12..40)
point_block_spacing = Slider(14, range=6..40)
park_share = Slider(10, range=0..50)
target_far = Slider(2.5, range=0.5..6)
height_variation = Slider(40, range=0..100)
height_seed = Slider(3, range=0..100)
min_storeys = Slider(3, range=1..10)
max_storeys = Slider(18, range=2..40)
ground_floor_height = Slider(4.5, range=3.5..6)
upper_floor_height = Slider(3.2, range=2.8..4)
office_share = Slider(25, range=0..100)
show_block_labels = BooleanToggle(False)
colour_by_use = BooleanToggle(True)
block_overrides = DirectTextInput(maxlength=2000)
street_plan_2 = StreetPlan(street_plan)
primary_street_width_2 = PrimaryStreetWidth(primary_street_width)
secondary_street_width_2 = SecondaryStreetWidth(secondary_street_width)
front_setback_2 = FrontSetback(front_setback)
corner_radius_2 = CornerRadius(corner_radius)
min_block_area_2 = MinBlockArea(min_block_area)
typology_2 = Typology(typology)
layout_seed_2 = LayoutSeed(layout_seed)
building_depth_2 = BuildingDepth(building_depth)
plot_frontage_2 = PlotFrontage(plot_frontage)
row_spacing_2 = RowSpacing(row_spacing)
point_block_size_2 = PointBlockSize(point_block_size)
point_block_spacing_2 = PointBlockSpacing(point_block_spacing)
park_share_2 = ParkShare(park_share)
target_far_2 = TargetFAR(target_far)
height_variation_2 = HeightVariation(height_variation)
height_seed_2 = HeightSeed(height_seed)
min_storeys_2 = MinStoreys(min_storeys)
max_storeys_2 = MaxStoreys(max_storeys)
ground_floor_height_2 = GroundFloorHeight(ground_floor_height)
upper_floor_height_2 = UpperFloorHeight(upper_floor_height)
office_share_2 = OfficeShare(office_share)
show_block_labels_2 = ShowBlockLabels(show_block_labels)
colour_by_use_2 = ColourByUse(colour_by_use)
block_overrides_2 = BlockOverrides(block_overrides)

# ----
# Logic: All urban massing logic in one Rhino 8 C# script (UrbanMassingLogic.cs): street regions from the preset centre lines, blocks (region difference), parks and small green blocks, block overrides, typologies, perimeter/slab/grid footprints, storeys, massing, KPIs and the urban report JSON (output AgentMetric), black edge polylines, display layers and the data for the App Builder UI. The preset street centre lines and their hierarchy classes are internalised next to the script. Street plans (Manhattan, Barcelona, Chicago, Amsterdam) are OpenStreetMap streets fetched with Overpass (see OverpassStreets.gh), simplified to one centre line per named street (straight for the grid cities, curved for the Amsterdam canal ring), rotated to align the grid and internalised in the Preset / Class / Names parameters. The first four curves of each plan are the outer streets in loop order: the site is their closed loop, and the script outputs a name tag plane and text for each (StreetLabelPlanes / StreetLabelTexts, 3D text in the Outputs group, always shown).
street_plan_3 = StreetPlan(street_plan_2)
secondary_street_width_3 = SecondaryStreetWidth(secondary_street_width_2)
corner_radius_3 = CornerRadius(corner_radius_2)
park_share_3 = ParkShare(park_share_2)
layout_seed_3 = LayoutSeed(layout_seed_2)
plot_frontage_3 = PlotFrontage(plot_frontage_2)
point_block_size_3 = PointBlockSize(point_block_size_2)
target_far_3 = TargetFAR(target_far_2)
height_seed_3 = HeightSeed(height_seed_2)
max_storeys_3 = MaxStoreys(max_storeys_2)
upper_floor_height_3 = UpperFloorHeight(upper_floor_height_2)
colour_by_use_3 = ColourByUse(colour_by_use_2)
preset_manhattan = PresetManhattan([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])
names_manhattan = NamesManhattan(["51st Street", "2nd Avenue", "56th Street", "Park Avenue", "52nd Street", "54th Street", "53rd Street", "55th Street", "3rd Avenue", "Lexington Avenue"])
class_barcelona = ClassBarcelona([1, 1, 0, 0, 1, 1, 0, 0])
preset_chicago = PresetChicago([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])
names_chicago = NamesChicago(["Jackson Boulevard", "Wabash Avenue", "Madison Street", "LaSalle Street", "Clark Street", "Monroe Street", "State Street", "Quincy Street", "Dearborn Street", "Adams Street"])
class_amsterdam = ClassAmsterdam([0, 1, 0, 1, 1, 0, 1])
primary_street_width_3 = PrimaryStreetWidth(primary_street_width_2)
front_setback_3 = FrontSetback(front_setback_2)
min_block_area_3 = MinBlockArea(min_block_area_2)
typology_3 = Typology(typology_2)
building_depth_3 = BuildingDepth(building_depth_2)
row_spacing_3 = RowSpacing(row_spacing_2)
point_block_spacing_3 = PointBlockSpacing(point_block_spacing_2)
height_variation_3 = HeightVariation(height_variation_2)
min_storeys_3 = MinStoreys(min_storeys_2)
ground_floor_height_3 = GroundFloorHeight(ground_floor_height_2)
office_share_3 = OfficeShare(office_share_2)
block_overrides_3 = BlockOverrides(block_overrides_2)
class_manhattan = ClassManhattan([1, 0, 1, 0, 1, 0, 0, 1, 0, 0])
preset_barcelona = PresetBarcelona([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])
names_barcelona = NamesBarcelona(["Carrer del Rosselló", "Rambla de Catalunya", "Avinguda Diagonal", "Carrer d'Aribau", "Carrer de Còrsega", "Carrer d'Enric Granados", "Carrer de Balmes", "Carrer de París"])
class_chicago = ClassChicago([0, 0, 0, 0, 0, 0, 0, 1, 0, 0])
preset_amsterdam = PresetAmsterdam([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])
names_amsterdam = NamesAmsterdam(["Prinsengracht", "Vijzelstraat", "Herengracht", "Leidsestraat", "Nieuwe Spiegelstraat", "Keizersgracht", "Kerkstraat"])
urbanmassinglogic = CSharpScript(
    StreetPlan=street_plan_3,
    PrimaryWidth=primary_street_width_3,
    SecondaryWidth=secondary_street_width_3,
    FrontSetback=front_setback_3,
    CornerRadius=corner_radius_3,
    MinBlockArea=min_block_area_3,
    ParkShare=park_share_3,
    Typology=typology_3,
    LayoutSeed=layout_seed_3,
    BuildingDepth=building_depth_3,
    PlotFrontage=plot_frontage_3,
    RowSpacing=row_spacing_3,
    PointSize=point_block_size_3,
    PointSpacing=point_block_spacing_3,
    TargetFAR=target_far_3,
    HeightVariation=height_variation_3,
    HeightSeed=height_seed_3,
    MinStoreys=min_storeys_3,
    MaxStoreys=max_storeys_3,
    GroundFloorHeight=ground_floor_height_3,
    UpperFloorHeight=upper_floor_height_3,
    OfficeShare=office_share_3,
    ColourByUse=colour_by_use_3,
    BlockOverrides=block_overrides_3,
    ManhattanStreets=preset_manhattan,
    ManhattanClasses=class_manhattan,
    ManhattanNames=names_manhattan,
    BarcelonaStreets=preset_barcelona,
    BarcelonaClasses=class_barcelona,
    BarcelonaNames=names_barcelona,
    ChicagoStreets=preset_chicago,
    ChicagoClasses=class_chicago,
    ChicagoNames=names_chicago,
    AmsterdamStreets=preset_amsterdam,
    AmsterdamClasses=class_amsterdam,
    AmsterdamNames=names_amsterdam)  # -> Street, Plot, Green, Retail, Residential, Office, Edges, Colours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; inputs ManhattanStreets: list, ManhattanClasses: list, ManhattanNames: list, BarcelonaStreets: list, BarcelonaClasses: list, BarcelonaNames: list, ChicagoStreets: list, ChicagoClasses: list, ChicagoNames: list, AmsterdamStreets: list, AmsterdamClasses: list, AmsterdamNames: list
# ---------- urbanmassinglogic: C# ----------
// UrbanFrame – urban massing logic (Rhino 8 C# Script component)
// One script for the whole model: streets -> blocks -> overrides -> typologies -> footprints
// -> storeys -> massing -> KPIs / report -> edges -> display layers -> App Builder data.
// Units: meters. Only RhinoCommon is used (no file access, no reflection) so it runs on ShapeDiver.
using System;
using System.Collections.Generic;
using System.Drawing;
using System.Globalization;
using System.Linq;
using System.Text;
using Rhino;
using Rhino.Geometry;
using Grasshopper;
using Grasshopper.Kernel;

public class Script_Instance : GH_ScriptInstance
{
  // ---------------------------------------------------------------- constants
  const double Tol = 0.001;              // model tolerance (meters)
  const double NetToGross = 0.8;         // KPI assumptions
  const double AvgUnitSize = 75;         // m2 per housing unit
  const double PersonsPerUnit = 2.1;
  const double OfficeAreaPerJob = 20;    // m2 GFA per office job
  const double RetailAreaPerJob = 40;    // m2 GFA per retail job
  static readonly string[] TypologyNames = { "perimeter", "slab", "grid", "park" };
  // material order: Street, Plot, Green, Retail, Residential, Office, Label, Edges
  static readonly Color[] GreyColours = {
    Color.FromArgb(60,60,60), Color.FromArgb(166,166,166), Color.FromArgb(122,122,122), Color.FromArgb(92,92,92),
    Color.FromArgb(200,200,200), Color.FromArgb(149,149,149), Color.FromArgb(0,0,0), Color.FromArgb(0,0,0) };
  static readonly Color[] UseColours = {
    Color.FromArgb(58,61,66), Color.FromArgb(179,172,156), Color.FromArgb(78,140,58), Color.FromArgb(200,118,43),
    Color.FromArgb(217,199,158), Color.FromArgb(76,125,176), Color.FromArgb(0,0,0), Color.FromArgb(0,0,0) };
  static readonly CultureInfo Inv = CultureInfo.InvariantCulture;
  const double StreetLabelGap = 8.0;   // m between the street edge and the centre of its name tag

  private void RunScript(
		object StreetPlan_,
		object PrimaryWidth_,
		object SecondaryWidth_,
		object FrontSetback_,
		object CornerRadius_,
		object MinBlockArea_,
		object ParkShare_,
		object Typology_,
		object LayoutSeed_,
		object BuildingDepth_,
		object PlotFrontage_,
		object RowSpacing_,
		object PointSize_,
		object PointSpacing_,
		object TargetFAR_,
		object HeightVariation_,
		object HeightSeed_,
		object MinStoreys_,
		object MaxStoreys_,
		object GroundFloorHeight_,
		object UpperFloorHeight_,
		object OfficeShare_,
		object ColourByUse_,
		object BlockOverrides_,
		List<object> ManhattanStreets_,
		List<object> ManhattanClasses_,
		List<object> ManhattanNames_,
		List<object> BarcelonaStreets_,
		List<object> BarcelonaClasses_,
		List<object> BarcelonaNames_,
		List<object> ChicagoStreets_,
		List<object> ChicagoClasses_,
		List<object> ChicagoNames_,
		List<object> AmsterdamStreets_,
		List<object> AmsterdamClasses_,
		List<object> AmsterdamNames_,
		ref object Street,
		ref object Plot,
		ref object Green,
		ref object Retail,
		ref object Residential,
		ref object Office,
		ref object Edges,
		ref object Colours,
		ref object LabelPlanes,
		ref object LabelTexts,
		ref object Report,
		ref object HeadlineMd,
		ref object KpiMd,
		ref object GfaByUse,
		ref object LandUse,
		ref object StoreyBins,
		ref object BlockIds,
		ref object BlockKeys,
		ref object BlockTypologies,
		ref object BlockAreas,
		ref object BlockWeights,
		ref object BlockBuildings,
		ref object BlockGfa,
		ref object BlockFar,
		ref object BlockTargetFar,
		ref object StreetLabelPlanes,
		ref object StreetLabelTexts)
  {
    // ---- input conversion (script inputs are untyped so the component signature stays stable)
    var StreetPlan = I(StreetPlan_);
    var ManhattanStreets = Curves(ManhattanStreets_);
    var ManhattanClasses = Ints(ManhattanClasses_);
    var ManhattanNames = Strs(ManhattanNames_);
    var BarcelonaStreets = Curves(BarcelonaStreets_);
    var BarcelonaClasses = Ints(BarcelonaClasses_);
    var BarcelonaNames = Strs(BarcelonaNames_);
    var ChicagoStreets = Curves(ChicagoStreets_);
    var ChicagoClasses = Ints(ChicagoClasses_);
    var ChicagoNames = Strs(ChicagoNames_);
    var AmsterdamStreets = Curves(AmsterdamStreets_);
    var AmsterdamClasses = Ints(AmsterdamClasses_);
    var AmsterdamNames = Strs(AmsterdamNames_);
    var PrimaryWidth = D(PrimaryWidth_);
    var SecondaryWidth = D(SecondaryWidth_);
    var FrontSetback = D(FrontSetback_);
    var CornerRadius = D(CornerRadius_);
    var MinBlockArea = D(MinBlockArea_);
    var ParkShare = D(ParkShare_);
    var Typology = I(Typology_);
    var LayoutSeed = I(LayoutSeed_);
    var BuildingDepth = D(BuildingDepth_);
    var PlotFrontage = D(PlotFrontage_);
    var RowSpacing = D(RowSpacing_);
    var PointSize = D(PointSize_);
    var PointSpacing = D(PointSpacing_);
    var TargetFAR = D(TargetFAR_);
    var HeightVariation = D(HeightVariation_);
    var HeightSeed = I(HeightSeed_);
    var MinStoreys = D(MinStoreys_);
    var MaxStoreys = D(MaxStoreys_);
    var GroundFloorHeight = D(GroundFloorHeight_);
    var UpperFloorHeight = D(UpperFloorHeight_);
    var OfficeShare = D(OfficeShare_);
    var ColourByUse = B(ColourByUse_);
    var BlockOverrides = S(BlockOverrides_);

    // ============================================================ 1 STREETS
    // City street plans: OpenStreetMap streets (see OverpassStreets.gh), simplified to one centre line per street.
    // The first four curves of each plan are the real streets around the site, in loop order.
    List<Curve> centre; List<int> cls; List<string> names;
    if (StreetPlan == 1) { centre = BarcelonaStreets; cls = BarcelonaClasses; names = BarcelonaNames; }
    else if (StreetPlan == 2) { centre = ChicagoStreets; cls = ChicagoClasses; names = ChicagoNames; }
    else if (StreetPlan == 3) { centre = AmsterdamStreets; cls = AmsterdamClasses; names = AmsterdamNames; }
    else { centre = ManhattanStreets; cls = ManhattanClasses; names = ManhattanNames; }
    centre = centre.Where(c => c != null).ToList();
    if (centre.Count == 0) { AddRuntimeMessage(GH_RuntimeMessageLevel.Error, "No street curves."); return; }

    // site = the loop of the four boundary streets (may be curved); bounding box as a fallback
    Curve site = null;
    var siteLoop = centre.Count >= 4 ? Curve.JoinCurves(centre.Take(4), 0.05) : null;
    bool siteFromStreets = siteLoop != null && siteLoop.Length == 1 && siteLoop[0].IsClosed && siteLoop[0].IsPlanar();
    if (siteFromStreets)
    {
      site = siteLoop[0];
      if (site.ClosedCurveOrientation(Vector3d.ZAxis) == CurveOrientation.Clockwise) site.Reverse();
    }
    else
    {
      var siteBox = BoundingBox.Empty;
      foreach (var c in centre) siteBox.Union(c.GetBoundingBox(Plane.WorldXY));
      site = new Rectangle3d(Plane.WorldXY, new Interval(siteBox.Min.X, siteBox.Max.X), new Interval(siteBox.Min.Y, siteBox.Max.Y)).ToNurbsCurve();
    }
    double siteArea = AreaMassProperties.Compute(site).Area;

    var streetRegions = new List<Curve>();
    for (int i = 0; i < centre.Count; i++)
    {
      int k = cls.Count == 0 ? 0 : cls[i % cls.Count];
      double half = (k == 0 ? PrimaryWidth : SecondaryWidth) / 2.0;
      var left = Offset(centre[i], half);
      var right = Offset(centre[i], -half);
      if (left.Count == 0 || right.Count == 0) continue;
      var parts = new List<Curve>();
      parts.AddRange(left);
      parts.Add(new LineCurve(left[0].PointAtStart, right[0].PointAtStart));
      parts.AddRange(right);
      parts.Add(new LineCurve(left[left.Count - 1].PointAtEnd, right[right.Count - 1].PointAtEnd));
      var joined = Curve.JoinCurves(parts, Tol, false);
      if (joined != null) streetRegions.AddRange(joined);
    }

    // ============================================================ 2 BLOCKS
    // Sequential region difference keeps the block order (= block ids) stable.
    var raw = new List<Curve> { site };
    foreach (var s in streetRegions)
    {
      var next = new List<Curve>();
      foreach (var a in raw)
      {
        var r = Curve.CreateBooleanDifference(a, s, Tol);
        if (r == null || r.Length == 0) next.Add(a); else next.AddRange(r);
      }
      raw = next;
    }
    int rawCount = raw.Count;
    var rawArea = raw.Select(Area).ToList();
    var rawCentroid = raw.Select(c => AreaMassProperties.Compute(c).Centroid).ToList();

    var buildableIdx = new List<int>(); var smallIds = new List<int>();
    for (int i = 0; i < rawCount; i++) { if (rawArea[i] > MinBlockArea) buildableIdx.Add(i); else smallIds.Add(i); }
    var parkRnd = new Random(LayoutSeed);
    var parkIds = new List<int>(); var devIds = new List<int>();
    foreach (int i in buildableIdx)
    {
      double u = parkRnd.NextDouble();
      if (u * 100 < ParkShare) parkIds.Add(i); else devIds.Add(i);
    }
    // developable blocks (raw outline), then inset by the setback and filleted
    var devRaw = devIds.Select(i => raw[i]).ToList();
    var devArea = devIds.Select(i => rawArea[i]).ToList();
    var blocks = new List<Curve>(); var blockRef = new List<int>(); var blockNet = new List<double>();
    for (int j = 0; j < devRaw.Count; j++)
    {
      var inset = FrontSetback > 0 ? Offset(devRaw[j], -FrontSetback) : new List<Curve> { devRaw[j].DuplicateCurve() };
      foreach (var c in inset)
      {
        Curve f = c;
        if (CornerRadius > 0)
        {
          var fc = Fillet(c, CornerRadius);
          if (fc != null) f = fc;
        }
        blocks.Add(f); blockRef.Add(devIds[j]); blockNet.Add(devArea[j]);
      }
    }
    int blockCount = blocks.Count;

    // ============================================================ 3 OVERRIDES + TYPOLOGY
    var weight = Enumerable.Repeat(1.0, blockCount).ToList();
    var typ = new List<int>();
    var typRnd = new Random(LayoutSeed);
    for (int b = 0; b < blockCount; b++)
    {
      double u = typRnd.NextDouble();
      typ.Add(Typology > 2 ? (int)Math.Floor(u * 2.999) : Typology);
    }
    foreach (var entry in (BlockOverrides ?? "").Split(';'))
    {
      if (entry.Length <= 4.5) continue;   // at least "a,b,c"
      var f = entry.Split(',');
      double id, t, w;
      if (!Num(f[0], out id) || !Num(f[1 % f.Length], out t) || !Num(f[2 % f.Length], out w)) continue;
      for (int b = 0; b < blockCount; b++)
      {
        if (blockRef[b] != id) continue;
        weight[b] = w;
        if (t > -0.5) typ[b] = (int)Math.Round(t);
      }
    }
    var notPark = typ.Select(t => t < 2.5).ToList();

    // ============================================================ 4 FOOTPRINTS
    var fpBrep = new List<Brep>(); var fpBlock = new List<int>();
    var courtyards = new List<Curve>();
    // 4a perimeter blocks: ring between block edge and courtyard, split into plots
    for (int b = 0; b < blockCount; b++)
    {
      if (typ[b] != 0) continue;
      var block = blocks[b];
      var court = Offset(block, -BuildingDepth);
      courtyards.AddRange(court);
      var ringEdges = new List<Curve> { block }; ringEdges.AddRange(court);
      var rings = Brep.CreatePlanarBreps(ringEdges, Tol);
      if (rings == null) continue;
      var cuts = new List<Curve>();
      var segs = Segments(block);
      foreach (var seg in segs)
      {
        int n = (int)Math.Round(seg.GetLength() / PlotFrontage);
        if (n < 2) continue;
        var ts = seg.DivideByCount(n, true);
        if (ts == null) continue;
        for (int k = 1; k < ts.Length - 1; k++)
        {
          var p = seg.PointAt(ts[k]);
          var inward = Vector3d.CrossProduct(Vector3d.ZAxis, seg.TangentAt(ts[k]));
          inward.Unitize();
          var start = p - inward;
          cuts.Add(new LineCurve(start, start + inward * (BuildingDepth + 2)));
        }
      }
      foreach (var ring in rings)
      {
        var pieces = cuts.Count > 0 ? ring.Faces[0].Split(cuts, Tol) : ring;
        if (pieces == null) pieces = ring;
        for (int fi = 0; fi < pieces.Faces.Count; fi++)
        {
          fpBrep.Add(pieces.Faces[fi].DuplicateFace(false));
          fpBlock.Add(b);
        }
      }
    }
    // 4b slab rows / point grid: array of cells aligned with the longest block edge
    for (int b = 0; b < blockCount; b++)
    {
      if (typ[b] == 0) continue;
      var block = blocks[b];
      bool grid = typ[b] == 2;
      double pitchX = grid ? PointSize + PointSpacing : PlotFrontage;
      double cellX = grid ? PointSize : PlotFrontage;
      double pitchY = grid ? PointSize + PointSpacing : BuildingDepth + RowSpacing;
      double cellY = grid ? PointSize : BuildingDepth;
      double halfPerim = block.GetLength() / 2.0;
      int nx = (int)Math.Ceiling(halfPerim / pitchX);
      int ny = (int)Math.Ceiling(halfPerim / pitchY);
      var segs = Segments(block);
      var lens = segs.Select(s => s.GetLength()).ToArray();
      var order = Enumerable.Range(0, segs.Length).ToArray();
      Array.Sort(lens, order);
      var longest = segs[order[order.Length - 1]];
      var xDir = longest.PointAtEnd - longest.PointAtStart;
      var yDir = Vector3d.CrossProduct(Vector3d.ZAxis, xDir);
      var frame = new Plane(longest.PointAtStart, xDir, yDir);
      double hx = cellX / 2.0, hy = cellY / 2.0;
      var ux = frame.XAxis * hx; var uy = frame.YAxis * hy;
      for (int i = -nx; i <= nx; i++)
      {
        double x = i * pitchX + hx;
        for (int j = 0; j <= ny; j++)
        {
          double y = j * pitchY + hy + 0.05;
          var c = frame.PointAt(x, y);
          if (!Inside(block, c) || !Inside(block, c + ux + uy) || !Inside(block, c + ux - uy) ||
              !Inside(block, c - ux - uy) || !Inside(block, c - ux + uy)) continue;
          var cf = new Plane(c, frame.XAxis, frame.YAxis);
          var rect = new Rectangle3d(cf, new Interval(-hx, hx), new Interval(-hy, hy)).ToNurbsCurve();
          var srf = Brep.CreatePlanarBreps(rect, Tol);
          if (srf == null || srf.Length == 0) continue;
          fpBrep.Add(srf[0]); fpBlock.Add(b);
        }
      }
    }
    // parks get no buildings
    var keep = Enumerable.Range(0, fpBrep.Count).Where(i => notPark[fpBlock[i]]).ToList();
    fpBrep = keep.Select(i => fpBrep[i]).ToList();
    fpBlock = keep.Select(i => fpBlock[i]).ToList();
    int nB = fpBrep.Count;
    var fpArea = fpBrep.Select(br => AreaMassProperties.Compute(br).Area).ToList();

    // ============================================================ 5 STOREYS
    var blockFootprint = new double[blockCount];
    for (int i = 0; i < nB; i++) blockFootprint[fpBlock[i]] += fpArea[i];
    var blockAvg = new double[blockCount];
    for (int b = 0; b < blockCount; b++) blockAvg[b] = TargetFAR * weight[b] * blockNet[b] / Math.Max(blockFootprint[b], 1);
    var hRnd = new Random(HeightSeed); var oRnd = new Random(HeightSeed);
    var storeys = new List<double>(); var isOffice = new List<bool>();
    for (int i = 0; i < nB; i++)
    {
      double r = -1 + 2 * hRnd.NextDouble();
      double s = Math.Round(blockAvg[fpBlock[i]] * (1 + HeightVariation * r / 100));
      storeys.Add(Math.Max(MinStoreys, Math.Min(Math.Max(MinStoreys, MaxStoreys), s)));
      isOffice.Add(oRnd.NextDouble() * 100 < OfficeShare);
    }

    // ============================================================ 6 MASSING
    var retail = new List<Brep>(); var office = new List<Brep>(); var residential = new List<Brep>();
    var gfVec = new Vector3d(0, 0, GroundFloorHeight);
    for (int i = 0; i < nB; i++)
    {
      var g = Extrude(fpBrep[i], gfVec);
      if (g != null) retail.Add(g);
      if (storeys[i] > 1.5)
      {
        var baseUp = fpBrep[i].DuplicateBrep(); baseUp.Translate(gfVec);
        var u = Extrude(baseUp, new Vector3d(0, 0, (storeys[i] - 1) * UpperFloorHeight));
        if (u != null) (isOffice[i] ? office : residential).Add(u);
      }
    }

    // ============================================================ 7 KPIs + REPORT
    double netLand = 0; for (int b = 0; b < blockCount; b++) if (notPark[b]) netLand += blockNet[b];
    double totalFootprint = fpArea.Sum();
    var gfa = Enumerable.Range(0, nB).Select(i => fpArea[i] * storeys[i]).ToList();
    double totalGfa = gfa.Sum();
    double officeGfa = Enumerable.Range(0, nB).Where(i => isOffice[i]).Sum(i => fpArea[i] * (storeys[i] - 1));
    var greenOutlines = new List<Curve>();
    greenOutlines.AddRange(smallIds.Select(i => raw[i]));
    greenOutlines.AddRange(parkIds.Select(i => raw[i]));
    for (int b = 0; b < blockCount; b++) if (typ[b] == 3) greenOutlines.Add(blocks[b]);
    double courtyardTotal = courtyards.Sum(Area);
    double greenArea = greenOutlines.Sum(Area) + courtyardTotal;
    double maxStoreys = storeys.Count > 0 ? Math.Max(0, storeys.Max()) : 0;

    double kSite = Math.Round(siteArea), kNet = Math.Round(netLand), kFoot = Math.Round(totalFootprint);
    double kGfa = Math.Round(totalGfa), kRetail = kFoot, kOffice = Math.Round(officeGfa);
    double kRes = Math.Round(totalGfa - totalFootprint - officeGfa);
    double kFar = Math.Round(totalGfa / Math.Max(netLand, 1) * 100) / 100;
    double kGsi = Math.Round(totalFootprint / Math.Max(netLand, 1) * 100) / 100;
    double kGreen = Math.Round(greenArea), kGreenRatio = Math.Round(greenArea / siteArea * 100) / 100;
    double kAvgSt = Math.Round(storeys.Sum() / Math.Max(nB, 1) * 10) / 10;
    double kMaxH = maxStoreys < 1 ? 0 : Math.Round((GroundFloorHeight + (maxStoreys - 1) * UpperFloorHeight) * 10) / 10;
    double kUnits = Math.Round(kRes * NetToGross / AvgUnitSize);
    double kResidents = Math.Round(kUnits * PersonsPerUnit);
    double kJobs = Math.Round(officeGfa / OfficeAreaPerJob + totalFootprint / RetailAreaPerJob);

    var bBuildings = new double[blockCount]; var bGfa = new double[blockCount];
    for (int i = 0; i < nB; i++) { bBuildings[fpBlock[i]] += 1; bGfa[fpBlock[i]] += gfa[i]; }
    var blockEntries = new List<string>();
    var tNames = new List<string>(); var tAreas = new List<double>(); var tGfa = new List<double>();
    var tFar = new List<double>(); var tTarget = new List<double>(); var tKeys = new List<string>();
    for (int b = 0; b < blockCount; b++)
    {
      string name = TypologyNames[((typ[b] % 4) + 4) % 4];
      double area = Math.Round(blockNet[b]);
      double far = Math.Round(bGfa[b] / blockNet[b] * 100) / 100;
      tNames.Add(name); tAreas.Add(area); tGfa.Add(Math.Round(bGfa[b])); tFar.Add(far);
      tTarget.Add(notPark[b] ? Math.Round(TargetFAR * weight[b] * 100) / 100 : 0);
      tKeys.Add("B" + N(blockRef[b]));
      blockEntries.Add(string.Format(Inv, "{{\"id\":{0},\"typology\":\"{1}\",\"area\":{2},\"densityWeight\":{3},\"buildings\":{4},\"gfa\":{5},\"far\":{6}}}",
        blockRef[b], name, area, weight[b], bBuildings[b], Math.Round(bGfa[b]), far));
    }
    string summary = string.Format(Inv,
      "{{\"siteArea\":{0},\"netBlockArea\":{1},\"buildingFootprint\":{2},\"totalGFA\":{3},\"retailGFA\":{4},\"officeGFA\":{5},\"residentialGFA\":{6},\"targetFAR\":{7},\"achievedFAR\":{8},\"GSI\":{9},\"greenArea\":{10},\"greenRatio\":{11},\"blocks\":{12},\"buildings\":{13},\"avgStoreys\":{14},\"maxStoreys\":{15},\"maxHeight\":{16},\"housingUnits\":{17},\"residents\":{18},\"jobs\":{19}}}",
      kSite, kNet, kFoot, kGfa, kRetail, kOffice, kRes, TargetFAR, kFar, kGsi, kGreen, kGreenRatio,
      blockCount, nB, kAvgSt, maxStoreys, kMaxH, kUnits, kResidents, kJobs);
    Report = string.Format(Inv, "{{\"summary\":{0},\"blocks\":[{1}],\"parkBlocksByShare\":[{2}],\"tooSmallBlocks\":[{3}]}}",
      summary, string.Join(",", blockEntries), string.Join(",", parkIds), string.Join(",", smallIds));

    // ============================================================ 8 APP BUILDER DATA
    double greenPct = Math.Round(kGreenRatio * 100);
    HeadlineMd = string.Format(Inv, "**FAR {0}** (target {1}) · {2} m² floor area · {3} homes · {4} residents · {5} jobs · {6}% green",
      kFar, TargetFAR, kGfa, kUnits, kResidents, kJobs, greenPct);
    KpiMd = string.Format(Inv, "### Key figures\n| Indicator | Value |\n|---|---|\n| Floor area ratio (FAR) | **{0}** (target {1}) |\n| Ground coverage (GSI) | {2} |\n| Total floor area | {3} m² |\n| Residential / office / retail | {4} / {5} / {6} m² |\n| Housing units | {7} |\n| Residents | {8} |\n| Jobs | {9} |\n| Green space | {10} m² ({11}% of site) |\n| Buildings / blocks | {12} / {13} |\n| Average / max storeys | {14} / {15} |\n| Max height | {16} m |",
      kFar, TargetFAR, kGsi, kGfa, kRes, kOffice, kRetail, kUnits, kResidents, kJobs, kGreen, greenPct, nB, blockCount, kAvgSt, maxStoreys, kMaxH);
    GfaByUse = new List<double> { kRes, kOffice, kRetail };
    double landParks = Math.Max(0, Math.Round(greenArea - courtyardTotal));
    LandUse = new List<double> {
      kFoot,
      Math.Max(0, Math.Round(netLand - totalFootprint - courtyardTotal)),
      Math.Round(courtyardTotal),
      landParks,
      Math.Max(0, Math.Round(siteArea - netLand - landParks)) };
    var bins = new int[7];
    foreach (var s in storeys) bins[(int)Math.Min(6, Math.Floor((s - 1) / 3))]++;
    StoreyBins = bins.ToList();
    BlockIds = blockRef; BlockKeys = tKeys; BlockTypologies = tNames; BlockAreas = tAreas;
    BlockWeights = weight; BlockBuildings = bBuildings.ToList(); BlockGfa = tGfa; BlockFar = tFar;
    BlockTargetFar = tTarget;

    // ============================================================ 9 EDGES (few polylines)
    var edges = new List<Curve>();
    for (int i = 0; i < nB; i++)
    {
      double h = GroundFloorHeight + (storeys[i] - 1) * UpperFloorHeight;
      var naked = fpBrep[i].Edges.Where(e => e.Valence == EdgeAdjacency.Naked).Select(e => e.DuplicateCurve()).ToList();
      var loops = Curve.JoinCurves(naked, Tol, false);
      foreach (var loop in loops)
      {
        var pc = loop.ToPolyline(0, 0, 0.1, 0, 0, 0.1, 0, 0, true);
        if (pc == null) continue;
        Polyline pl; if (!pc.TryGetPolyline(out pl)) continue;
        var bv = pl.Take(pl.Count - 1).ToList();                 // base vertices (open)
        if (bv.Count < 2) continue;
        var path = new List<Point3d>();
        path.AddRange(bv); path.Add(bv[0]);                       // base outline
        path.AddRange(bv.Select(p => p + gfVec)); path.Add(bv[0] + gfVec); path.Add(bv[0]); // ground floor line
        var up = new Vector3d(0, 0, h);
        foreach (var p in bv) { path.Add(p + up); path.Add(p); path.Add(p + up); }       // roof with vertical spikes
        path.Add(bv[0] + up);
        edges.Add(new PolylineCurve(path));
      }
    }
    var streetEdgeCurves = new List<Curve> { site }; streetEdgeCurves.AddRange(devRaw);
    foreach (var c in streetEdgeCurves) { var d = c.DuplicateCurve(); d.Translate(0, 0, 0.02); edges.Add(d); }
    var greenEdgeCurves = new List<Curve>(greenOutlines); greenEdgeCurves.AddRange(courtyards);
    foreach (var c in greenEdgeCurves) { var d = c.DuplicateCurve(); d.Translate(0, 0, 0.07); edges.Add(d); }

    // ============================================================ 10 DISPLAY LAYERS
    var street = Brep.CreatePlanarBreps(site, Tol) ?? new Brep[0];
    foreach (var s in street) s.Translate(0, 0, -0.1);
    var plots = new List<Brep>();
    foreach (var c in devRaw) { var p = Brep.CreatePlanarBreps(c, Tol); if (p != null) plots.AddRange(p); }
    var green = new List<Brep>();
    foreach (var c in greenEdgeCurves) { var p = Brep.CreatePlanarBreps(c, Tol); if (p != null) foreach (var s in p) { s.Translate(0, 0, 0.05); green.Add(s); } }

    Street = street.ToList(); Plot = plots; Green = green; Retail = retail; Residential = residential;
    Office = office; Edges = edges; Colours = (ColourByUse ? UseColours : GreyColours).ToList();
    LabelPlanes = rawCentroid.Select(c => new Plane(c, Vector3d.ZAxis)).ToList();
    LabelTexts = Enumerable.Range(0, rawCount).Select(i => i.ToString(Inv)).ToList();

    // street name tags outside the site, centred on each boundary street, reading left to right
    var slPlanes = new List<Plane>(); var slTexts = new List<string>();
    if (siteFromStreets)
      for (int i = 0; i < 4; i++)
      {
        var e = centre[i];
        double t; if (!e.LengthParameter(e.GetLength() / 2.0, out t)) continue;
        var p = e.PointAt(t); var tan = e.TangentAt(t);
        if (tan.X < -1e-6 || (Math.Abs(tan.X) <= 1e-6 && tan.Y < 0)) tan.Reverse();
        var nrm = Vector3d.CrossProduct(Vector3d.ZAxis, tan); nrm.Unitize();
        if (site.Contains(p + nrm, Plane.WorldXY, 0.01) == PointContainment.Inside) nrm.Reverse();
        int k = cls.Count == 0 ? 0 : cls[i % cls.Count];
        double off = (k == 0 ? PrimaryWidth : SecondaryWidth) / 2.0 + StreetLabelGap;
        var o = p + nrm * off; o.Z = 0.3;
        slPlanes.Add(new Plane(o, tan, Vector3d.CrossProduct(Vector3d.ZAxis, tan)));
        slTexts.Add(i < names.Count ? names[i] : "");
      }
    StreetLabelPlanes = slPlanes; StreetLabelTexts = slTexts;
  }

  // ---------------------------------------------------------------- helpers
  static double D(object o) { if (o == null) return 0; if (o is double d) return d; if (o is int i) return i; double v; return double.TryParse(o.ToString(), NumberStyles.Float, CultureInfo.InvariantCulture, out v) ? v : 0; }
  static int I(object o) { return (int)Math.Round(D(o)); }
  static bool B(object o) { if (o is bool b) return b; return o != null && o.ToString().Trim().ToLowerInvariant() == "true"; }
  static string S(object o) { return o == null ? "" : o.ToString(); }
  static List<Curve> Curves(List<object> l) { return l == null ? new List<Curve>() : l.OfType<Curve>().ToList(); }
  static List<int> Ints(List<object> l) { return l == null ? new List<int>() : l.Select(I).ToList(); }
  static List<string> Strs(List<object> l) { return l == null ? new List<string>() : l.Select(S).ToList(); }
  // Explode a curve into its segments (like Grasshopper's Explode with Recursive = true)
  static Curve[] Segments(Curve c)
  {
    var res = new List<Curve>();
    if (c is PolyCurve pc)
    {
      foreach (var s in pc.Explode()) res.AddRange(Segments(s));
    }
    else
    {
      Polyline pl;
      if (c.TryGetPolyline(out pl)) { foreach (var l in pl.GetSegments()) res.Add(new LineCurve(l)); }
      else
      {
        var dup = c.DuplicateSegments();
        if (dup != null && dup.Length > 0) res.AddRange(dup); else res.Add(c);
      }
    }
    return res.ToArray();
  }
  // Fillet all corners. Polylines: each corner radius is reduced so that a fillet never uses
  // more than half of an adjacent edge (same behaviour as Grasshopper's Fillet component).
  static Curve Fillet(Curve c, double r)
  {
    Polyline pl;
    if (!c.TryGetPolyline(out pl) || !pl.IsClosed)
      return Curve.CreateFilletCornersCurve(c, r, Tol, RhinoMath.ToRadians(1));
    var v = pl.Take(pl.Count - 1).ToList();
    int n = v.Count;
    if (n < 3) return c;
    // no corner needs a reduced radius: use RhinoCommon's fillet directly
    bool clamp = false;
    for (int i = 0; i < n; i++)
    {
      var u0 = v[(i - 1 + n) % n] - v[i]; var w0 = v[(i + 1) % n] - v[i];
      double a0 = Vector3d.VectorAngle(u0, w0);
      if (a0 < 1e-6 || Math.PI - a0 < RhinoMath.ToRadians(1)) continue;
      if (r / Math.Tan(a0 / 2) > Math.Min(u0.Length, w0.Length) / 2 + Tol) { clamp = true; break; }
    }
    if (!clamp) return Curve.CreateFilletCornersCurve(c, r, Tol, RhinoMath.ToRadians(1));
    var arcStart = new Point3d[n]; var arcs = new Curve[n];
    for (int i = 0; i < n; i++)
    {
      var p = v[(i - 1 + n) % n]; var q = v[i]; var x = v[(i + 1) % n];
      var u = p - q; var w = x - q;
      double lu = u.Length, lw = w.Length;
      u.Unitize(); w.Unitize();
      double ang = Vector3d.VectorAngle(u, w);
      if (ang < 1e-6 || Math.PI - ang < RhinoMath.ToRadians(1)) { arcStart[i] = q; arcs[i] = null; continue; }
      double t = r / Math.Tan(ang / 2);
      t = Math.Min(t, Math.Min(lu, lw) / 2);
      var a = q + u * t; var b = q + w * t;
      arcStart[i] = a;
      arcs[i] = new ArcCurve(new Arc(a, -u, b));
    }
    var pc = new PolyCurve();
    for (int i = 0; i < n; i++)
    {
      var end = arcs[i] != null ? arcs[i].PointAtEnd : v[i];
      if (arcs[i] != null) pc.Append(arcs[i]);
      var next = arcStart[(i + 1) % n];
      if (end.DistanceTo(next) > Tol) pc.Append(new LineCurve(end, next));
    }
    return pc;
  }
  static List<Curve> Offset(Curve c, double d)
  {
    var r = c.Offset(Plane.WorldXY, d, Tol, CurveOffsetCornerStyle.Sharp);
    return r == null ? new List<Curve>() : r.ToList();
  }
  static double Area(Curve c)
  {
    var m = AreaMassProperties.Compute(c);
    return m == null ? 0 : m.Area;
  }
  static bool Inside(Curve c, Point3d p) { return c.Contains(p, Plane.WorldXY, Tol) == PointContainment.Inside; }
  static bool Num(string s, out double v) { return double.TryParse(s.Trim(), NumberStyles.Float, CultureInfo.InvariantCulture, out v); }
  static string N(double v) { return v.ToString(CultureInfo.InvariantCulture); }
  static Brep Extrude(Brep footprint, Vector3d v)
  {
    var face = footprint.Faces[0];
    var start = footprint.GetBoundingBox(true).Min;
    var path = new LineCurve(start, start + v);
    var b = face.CreateExtrusion(path, true);
    if (b != null && b.SolidOrientation == BrepSolidOrientation.Inward) b.Flip();
    return b;
  }
}
# ---------- end urbanmassinglogic ----------
plot = Plot(urbanmassinglogic.Plot)
colours = Colours(urbanmassinglogic.Colours)
headlinemd = HeadlineMd(urbanmassinglogic.HeadlineMd)
gfabyuse = GfaByUse(urbanmassinglogic.GfaByUse)
storeybins = StoreyBins(urbanmassinglogic.StoreyBins)
blockkeys = BlockKeys(urbanmassinglogic.BlockKeys)
blockfar = BlockFar(urbanmassinglogic.BlockFar)
streetlabelplanes = StreetLabelPlanes(urbanmassinglogic.StreetLabelPlanes)
retail = Retail(urbanmassinglogic.Retail)
office = Office(urbanmassinglogic.Office)
labeltexts = LabelTexts(urbanmassinglogic.LabelTexts)
blockareas = BlockAreas(urbanmassinglogic.BlockAreas)
blockbuildings = BlockBuildings(urbanmassinglogic.BlockBuildings)
street = Street(urbanmassinglogic.Street)
green = Green(urbanmassinglogic.Green)
residential = Residential(urbanmassinglogic.Residential)
edges = Edges(urbanmassinglogic.Edges)
labelplanes = LabelPlanes(urbanmassinglogic.LabelPlanes)
report = Report(urbanmassinglogic.Report)
kpimd = KpiMd(urbanmassinglogic.KpiMd)
blockids = BlockIds(urbanmassinglogic.BlockIds)
blocktypologies = BlockTypologies(urbanmassinglogic.BlockTypologies)
blockweights = BlockWeights(urbanmassinglogic.BlockWeights)
blockgfa = BlockGfa(urbanmassinglogic.BlockGfa)
landuse = LandUse(urbanmassinglogic.LandUse)
blocktargetfar = BlockTargetFar(urbanmassinglogic.BlockTargetFar)
streetlabeltexts = StreetLabelTexts(urbanmassinglogic.StreetLabelTexts)

# ----
# Outputs: ShapeDiver outputs: the display layers from the logic script (street, plots, green, retail, residential, office, black edges) plus the block labels (Squid text curves at the block centroids, hidden with Show Block Labels) are entwined into one branch per material for the glTF 2.0 display; material colours come from the script (grey or by use). The urban report JSON goes to the Direct Data Output "AgentMetric"; the agent's get_output tool reads it by that name (the tool description points agents to AgentMetric).
street_2 = Street(street)
plot_2 = Plot(plot)
green_2 = Green(green)
retail_2 = Retail(retail)
residential_2 = Residential(residential)
office_2 = Office(office)
labelplanes_2 = LabelPlanes(labelplanes)
labeltexts_2 = LabelTexts(labeltexts)
show_block_labels_3 = ShowBlockLabels(show_block_labels_2)
edges_2 = Edges(edges)
colours_2 = Colours(colours)
report_2 = Report(report)
streetlabelplanes_2 = StreetLabelPlanes(streetlabelplanes)
streetlabeltexts_2 = StreetLabelTexts(streetlabeltexts)
labelfont = Font(Family="Arial", Size=10, Bold=True, Italic=False, Underline=False)
streetlabelfont = Font(Family="Arial", Size=7, Bold=True, Italic=False, Underline=False)
streetlabelalign = Paragraph(HAlign=1, VAlign=1, RightLeft=False)
labelcurves = TextCurves(Plane=labelplanes_2, Text=labeltexts_2, Font=labelfont)
streetlabelcurves = TextCurves(Plane=streetlabelplanes_2, Text=streetlabeltexts_2, Font=streetlabelfont, Paragraph=streetlabelalign)
labelsurfaceraw = BoundarySurfaces(Edges=labelcurves)
labellift = UnitZ(Factor=0.3)
streetlabelsurface = BoundarySurfaces(Edges=streetlabelcurves)
labelsurfacemoved = Move(Geometry=labelsurfaceraw, Motion=labellift)  # -> Geometry, Transform
labelsurface = CullPattern(List=flatten(labelsurfacemoved.Geometry), CullPattern=show_block_labels_3)
labels_lmerge = Merge(Data1=flatten(labelsurface), Data2=flatten(streetlabelsurface))
displaylayers = Entwine(
    Branch00=flatten(street_2),
    Branch01=flatten(plot_2),
    Branch02=flatten(green_2),
    Branch03=flatten(retail_2),
    Branch04=flatten(residential_2),
    Branch05=flatten(office_2),
    Branch06=flatten(labels_lmerge),
    Branch07=flatten(edges_2),
    FlattenInputs=True)
materials = GlTF20Material(
    BaseColorFactor=colours_2,
    MetallicFactor=[0, 0],
    RoughnessFactor=[1, 0.9],
    EmissiveFactor=RGB(0, 0, 0),
    AlphaMode="OPAQUE",
    AlphaCutoff=0.5,
    DoubleSided=True)
urban_massing_display = GlTF20Display(Geometry=displaylayers, Material=flatten(materials))
agentmetric = DirectDataOutput(Data=report_2)

d_paramnames = Panel("""Street Plan
Typology
Target FAR
Height Variation
Park Share
Office Share
Primary Street Width
Secondary Street Width
Front Setback
Corner Radius
Min Block Area
Layout Seed
Building Depth
Plot Frontage
Row Spacing
Point Block Size
Point Block Spacing
Min Storeys
Max Storeys
Height Seed
Ground Floor Height
Upper Floor Height
Show Block Labels
Colour by Use""")
d_paramdisplaynames = Panel("""Street plan
Building typology
Density (target FAR)
Height variation (%)
Parks (% of blocks)
Office share (%)
Primary street width (m)
Secondary street width (m)
Front setback (m)
Block corner radius (m)
Minimum block area (m²)
Layout seed
Building depth (m)
Plot frontage (m)
Slab row spacing (m)
Point building size (m)
Point building spacing (m)
Minimum storeys
Maximum storeys
Height seed
Ground floor height (m)
Upper floor height (m)
Show block numbers
Colour by use""")
d_paramtooltips = Panel("""Preset street network the district is built on.
Perimeter blocks, slab rows, point grid, or a random mix per block.
Floor area ratio targeted in every block: built floor area / block area.
How much individual building heights deviate from the block average.
Share of developable blocks turned into parks.
Share of buildings with offices on the upper floors (others are residential).
Width of the primary streets.
Width of the secondary streets.
Distance between the block edge and the building line.
Radius used to round the block corners.
Blocks up to this area stay unbuilt open space.
Random seed for the choice of parks and per-block typologies.
Depth of perimeter and slab buildings.
Length of each plot along the street in perimeter blocks.
Distance between parallel slab rows.
Footprint width of each point building.
Gap between neighbouring point buildings.
Lowest number of storeys a building can have.
Highest number of storeys a building can have.
Random seed for the building height variation.
Height of the retail ground floor.
Floor-to-floor height of the upper floors.
Show the block numbers in the viewer.
Colour buildings by use (retail, residential, office).""")
d_paramcontrols = ParameterControl(Name=d_paramnames, DisplayName=d_paramdisplaynames, Tooltip=d_paramtooltips)
d_paramspertab = Panel("""6
6
5
5
2""")
d_tabicons = Panel("""tabler:adjustments
tabler:road
tabler:layout-grid
tabler:stairs-up
tabler:eye""")
d_tabtooltips = Panel("""Street plan, typology, density, height variation, parks and office share
Street widths, setbacks and block rules
Dimensions of perimeter blocks, slabs and point buildings
Storey limits, floor heights and height randomness
Viewer display options""")
d_paramcontrolsbytab = PartitionList(List=d_paramcontrols, Size=d_paramspertab)
d_tabcontrols = ControlsWidget(Controls=d_paramcontrolsbytab)
d_tabs = Tab(Icon=graft(d_tabicons), Tooltip=graft(d_tabtooltips), AppBuilderWidgets=d_tabcontrols)
l_parsedesign = ParseJSON(JSON=flatten(d_tabs))
l_designprops = SerializeJson(
    Label="Design",
    Icon="tabler:building-community",
    Tooltip="Main design controls",
    Tabs=l_parsedesign,
    IncludeNullAndEmptyProperties=False)
l_designitem = SerializeJson(Id="toolbar-design", Type="tabs", Props=l_designprops, IncludeNullAndEmptyProperties=False)

d_scenarioparams = Panel("""Street Plan
Typology
Target FAR
Park Share
Min Storeys
Max Storeys
Height Variation
Office Share
Primary Street Width
Secondary Street Width
Front Setback
Corner Radius
Building Depth
Plot Frontage
Row Spacing
Point Block Size
Point Block Spacing
Ground Floor Height
Upper Floor Height""")
d_presetvalues = Panel("""0,2,6,0,8,40,70,50,30,18,0,0,16,20,18,30,8,5,3.6
1,0,4.5,0,6,9,15,20,30,20,0,15,20,20,18,22,14,4.5,3.1
2,1,6,5,12,40,80,85,30,20,0,0,24,25,14,35,12,6,4
3,0,2.5,0,4,6,25,30,40,10,0,0,15,10,18,22,14,4,3.2""")
d_presetvaluessplit = TextSplit(Text=d_presetvalues, Separators=",")
d_presetparamvalues = ParameterValue(Name=d_scenarioparams, Value=d_presetvaluessplit)
d_presettooltips = Panel("""Midtown East: office and apartment towers of 8-40 storeys on 30 m avenues and 18 m streets.
Eixample: chamfered perimeter blocks of 6-9 storeys around courtyards on 20 m streets.
The Loop: deep office slabs of 12-40 storeys on 30 m streets.
Canal ring: narrow 4-6 storey canal houses around courtyards, wide canals and narrow side streets.""")
d_preseticons = Panel("""tabler:building-skyscraper
tabler:building-community
tabler:building-estate
tabler:ripple""")
d_presetlabels = Panel("""Manhattan Midtown
Barcelona Eixample
Chicago Loop
Amsterdam canals""")
d_presetactions = SetParameterValuesAction(ParameterValues=d_presetparamvalues)
d_presetcontrols = ActionControl(Label=graft(d_presetlabels), Icon=graft(d_preseticons), Tooltip=graft(d_presettooltips), Action=d_presetactions)  # -> flatten(Control)
d_scenariostitle = Panel("""### Quick scenarios
Load one of the four city street plans together with a typology, density, heights, street widths and office share that match the place.""")
d_scenariostext = TextWidget(Text=d_scenariostitle)
d_scenariocontrols = ControlsWidget(Controls=d_presetcontrols)
l_scenariowidgetsmerge = Merge(Data1=d_scenariostext, Data2=d_scenariocontrols)
l_parsescenarios = ParseJSON(JSON=l_scenariowidgetsmerge)
l_scenariosprops = SerializeJson(
    Label="Scenarios",
    Icon="tabler:wand",
    Tooltip="Quick scenarios",
    Widgets=l_parsescenarios,
    IncludeNullAndEmptyProperties=False)
l_scenariositem = SerializeJson(Id="toolbar-scenarios", Type="widgets", Props=l_scenariosprops, IncludeNullAndEmptyProperties=False)

target = Panel("_blank")
logo = Panel("data:image/png;base64,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")
h_logoimage = ImageWidget(URI=logo, Description="UrbanFrame logo", Link="https://example.com", Target=target)
h_titletext = TextWidget(Text="**UrbanFrame** · District massing studio")
h_linkhelptext = TextWidget(Text="[Help](https://example.com/help)")
h_linkwebsitetext = TextWidget(Text="[Website](https://example.com)")
h_linkcontacttext = TextWidget(Text="[Contact](mailto:hello@example.com)")
h_topcontainer_wmerge = Merge(Data1=h_logoimage, Data2=h_titletext, Data3=h_linkhelptext, Data4=h_linkwebsitetext, Data5=h_linkcontacttext)
h_topcontainer = Container(Location="top", AppBuilderWidgets=h_topcontainer_wmerge)

panel = Panel("""Generate a district from a street plan: shape it with the tools on the left, or ask the planning assistant below, for example:
- *What is the current density and how many people live here?*
- *Make the district greener without losing more than 10% of the homes.*
- *Reach a FAR of 3 with at most 12 storeys.*
- *Turn block 5 into a park and put towers along the diagonal avenue.*""")
g_hostedagentprops = SerializeJson(Title="Urban planning assistant", Height="calc(100vh - 440px)", IncludeNullAndEmptyProperties=False)
g_promptstext = TextWidget(Text=panel)
g_hostedagentwidget = SerializeJson(Type="hostedAgent", Props=g_hostedagentprops, IncludeNullAndEmptyProperties=False)
a_rightpanel_wmerge = Merge(Data1=g_promptstext, Data2=g_hostedagentwidget)
a_rightcontainer = Container(Location="right", AppBuilderWidgets=a_rightpanel_wmerge)

uc = UseContainer(False)

# ----
# Agent: Planning agent for the App component (jSwan): id urban-planner, name, system prompt from the G_SystemPrompt panel (copy in AgentSystemPrompt.md) and useGenericToolDefaults. The output relay Agent goes to the App component's Agent input.
system_prompt = Panel("""You are the Urban Planning Assistant of the "Urban Massing" ShapeDiver app. You help planners, developers and students explore massing scenarios for a new urban district. You can read the model's parameters and its report, change parameters, and look at the 3D view. Answer high-level questions in plain language, translate design intentions into parameter changes, and iterate until the user's goals are met.

## The model
A street network (preset) is offset by street widths into blocks. Blocks smaller than "Min Block Area" and a random share of blocks ("Park Share") become green space. Every other block receives a building typology and is filled with buildings. For every block the model computes a target floor area = Target FAR x block area x block density weight, divides it by the block's building footprint to get an average number of storeys, then varies each building's storeys randomly by +/- "Height Variation" %, clamped between "Min Storeys" and "Max Storeys". Ground floors are retail; upper floors are residential, or office for a random "Office Share" of the buildings. Every block shows its id number in the viewer (stable for a given street plan, independent of other settings).

## Parameters (use these exact names)
Main parameters:
- "Street Plan" (choice): 0 Manhattan (Midtown East, 21 ha: between 51st and 56th Street, Park and 2nd Avenue), 1 Barcelona (Eixample, 15 ha: between Carrer del Rosselló, Rambla de Catalunya, the Avinguda Diagonal and Carrer d'Aribau), 2 Chicago (the Loop, 22 ha: between Jackson Boulevard, Wabash Avenue, Madison Street and LaSalle Street), 3 Amsterdam (canal ring, 17 ha: between Prinsengracht, Vijzelstraat, Herengracht and Leidsestraat, with curved canal streets). All plans are real OpenStreetMap streets simplified to one centre line per street; the site is bounded by the four named outer streets, whose names are shown in the viewer. The exact site area is siteArea in AgentMetric.
- "Typology" (choice): 0 Perimeter Block (courtyard blocks split into plots), 1 Slab Rows (parallel bars along the longest block edge), 2 Point Grid (free-standing point buildings/towers), 3 Mixed (random typology per block, depends on "Layout Seed").
- "Target FAR" 0.5-6: floor area ratio aimed for in every developable block (gross floor area / block area).
- "Height Variation" 0-100 %: skyline variety around the block average.
- "Park Share" 0-50 %: share of developable blocks turned into parks (random, "Layout Seed").
- "Office Share" 0-100 %: share of buildings with office upper floors.
Advanced parameters:
- "Primary Street Width" 12-40 m, "Secondary Street Width" 8-24 m, "Front Setback" 0-10 m, "Corner Radius" 0-15 m, "Min Block Area" 500-5000 m², "Layout Seed" 0-100.
- "Building Depth" 10-24 m (perimeter wings and slabs; 12-16 m gives good daylight for housing), "Plot Frontage" 10-50 m (building length along the street / slab), "Row Spacing" 8-40 m (gap between slabs), "Point Block Size" 12-40 m, "Point Block Spacing" 6-40 m.
- "Min Storeys" 1-10, "Max Storeys" 2-40, "Height Seed" 0-100, "Ground Floor Height" 3.5-6 m, "Upper Floor Height" 2.8-4 m.
- "Show Block Labels" (true/false): block id numbers in the viewer.
- "Colour by Use" (true/false): by default the massing is shown in shades of grey; when true, buildings are coloured by use (retail ground floors, residential, office) and green spaces in green. Turn it on when the user asks about uses or wants to see where offices or parks are.
- "Block Overrides" (text): per-block changes, entries separated by ";", each entry "blockId,typology,densityWeight". Typology codes: 0 perimeter, 1 slab rows, 2 point grid, 3 park, -1 keep the current typology. densityWeight multiplies the block's target FAR (1 = unchanged, 2 = double, 0.5 = half). Example: "7,3,1;9,2,2.5;12,-1,0.6". Setting this parameter REPLACES all existing overrides, so always read the current value first and keep the entries the user did not ask to change. Use "" to clear all overrides.
Choice parameters are set with their 0-based index as a string; numbers as strings; always check list_parameter_definitions once per conversation for exact ids and ranges, and stay within the ranges.

## The report
Read the data output "AgentMetric" (the urban report; get_output with output "AgentMetric") whenever you need numbers. It is JSON:
- summary: siteArea, netBlockArea (developable land, m²), buildingFootprint, totalGFA, retailGFA, officeGFA, residentialGFA (m²), targetFAR, achievedFAR (totalGFA / netBlockArea), GSI (footprint / netBlockArea), greenArea (small blocks, parks and courtyards), greenRatio (greenArea / siteArea), blocks, buildings, avgStoreys, maxStoreys, maxHeight (m), housingUnits, residents, jobs.
- blocks: one entry per developable block: id, typology, area, densityWeight, buildings, gfa, far.
- parkBlocksByShare: ids turned into parks by "Park Share"; tooSmallBlocks: ids below "Min Block Area".
Assumptions behind the estimates: 80% net-to-gross, 75 m² per housing unit, 2.1 residents per unit, 20 m² GFA per office job, 40 m² per retail job. Mention them when users ask how numbers are derived.

## How to work
1. For questions about the current design, read the report (and parameter values if needed) and answer with concrete figures. Never invent numbers; quote the report.
2. For change requests, translate the intent into the smallest sensible set of parameter changes, apply them in ONE set_parameter_values call, then read the report again and summarise what changed (before -> after for the key figures the user cares about).
3. For targets ("reach FAR 3", "at least 2000 homes", "30% green", "max 40 m high"), iterate: change, read the report, adjust. Stop after at most 5 iterations and report the closest result and the limiting factor.
4. If a request is ambiguous or has a real trade-off (e.g. more green AND more homes), state the trade-off briefly and either pick the most reasonable interpretation or ask one short question (ask_user_question).
5. When the user asks to "show" something, you may use set_camera / get_screenshot; block ids are visible as labels.
6. Keep answers short: a sentence or two plus a compact list of figures. Use m, m², storeys; round sensibly (e.g. 237,600 m², FAR 2.5).

## Planning knowledge and levers
- Achieved FAR falls below target when storeys are capped: if achievedFAR < targetFAR, raise "Max Storeys", increase coverage ("Building Depth", smaller "Row Spacing" / "Point Block Spacing", larger "Point Block Size") or switch typology to Perimeter Block (highest coverage). It exceeds the target when "Min Storeys" is high relative to a low FAR.
- Typical FAR: suburban/garden city 0.5-1, townhouses 1-1.5, European perimeter blocks 2-3.5, dense urban centres 3.5-6. Typical GSI: point grid 0.2-0.3, slabs 0.25-0.35, perimeter blocks 0.4-0.55.
- Height: building height = Ground Floor Height + (storeys - 1) x Upper Floor Height. To cap height at H metres set "Max Storeys" = floor((H - Ground Floor Height) / Upper Floor Height) + 1. Lower "Height Variation" for calm, uniform streets; raise it for an expressive skyline.
- Green: raise "Park Share", turn specific blocks into parks via overrides (typology 3), or use Perimeter Blocks (courtyards count as green). To keep total floor area while adding parks, raise "Target FAR" accordingly (total GFA ≈ Target FAR x developable area).
- Homes vs jobs: "Office Share" moves upper floors from residential to office; retail is always the ground floor.
- Local intensification: use "Block Overrides" weights (e.g. 2-3 on blocks along a primary street or the diagonal avenue for towers, often with typology 2; 0.5 for quieter edges). Primary streets are the site perimeter, the central north-south street in the grid plans, the diagonal avenue in the diagonal plan, and the curved east-west main street in the organic plan.
- "Layout Seed" and "Height Seed" only reshuffle random choices; suggest them when the user wants "another variant".
- Street widths and setbacks reduce developable land; changing the street plan renumbers blocks, so re-read the report before using block ids.

You only control this model. If asked about regulations, costs or anything the model cannot represent, answer from general knowledge, say clearly that it is outside the model, and suggest how the model could approximate it.""")
g_agent = SerializeJson(
    Id="urban-planner",
    Name="Urban planning assistant",
    Message=system_prompt,
    UseGenericToolDefaults=True,
    IncludeNullAndEmptyProperties=False)

# ----
# App Builder: Whole App Builder UI. The App merges four containers, laid out top to bottom in that order:
# - Header (top container, purple sub-group): logo, name and Help/Website/Contact markdown links.
# - Right container (regular, location right): intro and example prompts text and the hosted agent widget (height calc(100vh - 440px), sized for the 1/4-width right column of the theme).
# - Left toolbar "main-toolbar": App Builder has no toolbar component, so each button is two jSwan objects (props: label, icon, tooltip, widgets or tabs; item: id, type, props) and one Construct JSON inserts the list of buttons at .groups[0] of the toolbar object. Widgets and tabs go through Parse JSON before jSwan, and jSwan output through Parse JSON before Construct JSON. Buttons: Scenarios (quick scenario buttons and Reset), Design (icon-only tabs Main, Streets, Typologies, Heights, Display), Key figures (KPI table), Insights (icon-only tabs Floor area, Land use, Storeys) and Blocks (tabs Density FAR chart and Table). Icon-only tabs simply have no name.
# - FAR headline: Floating Container at the top right of the viewer (Screen Point + Container Properties, not draggable via the Custom Properties input).
# Design tabs and quick scenarios run on data trees: one Parameter Control for all 24 parameters, split per tab by Partition List (D_ParamsPerTab), then one Controls Widget and one Tab component; one line per preset in D_PresetValues, split by Text Split into one branch per preset, then one Parameter Value, Set Parameter Values Action and Action Control. The Block Overrides parameter has no UI control and is used by the agent only.
# Data inputs come from the logic script (headline/KPI markdown, chart and table values).
kpimd_2 = KpiMd(kpimd)
storeybins_2 = StoreyBins(storeybins)
landuse_2 = LandUse(landuse)
blockkeys_2 = BlockKeys(blockkeys)
blockfar_2 = BlockFar(blockfar)
blocktargetfar_2 = BlockTargetFar(blocktargetfar)
blockids_2 = BlockIds(blockids)
blocktypologies_2 = BlockTypologies(blocktypologies)
blockareas_2 = BlockAreas(blockareas)
blockweights_2 = BlockWeights(blockweights)
blockbuildings_2 = BlockBuildings(blockbuildings)
blockgfa_2 = BlockGfa(blockgfa)
headlinemd_2 = HeadlineMd(headlinemd)
gfabyuse_2 = GfaByUse(gfabyuse)
l_toolbarprops = SerializeJson(Id="main-toolbar", Side="left", Align="center", IncludeNullAndEmptyProperties=False)
l_toolbarbase = SerializeJson(Name="toolbar", Props=l_toolbarprops, IncludeNullAndEmptyProperties=False)
l_parsetoolbarbase = ParseJSON(JSON=l_toolbarbase)

panel_2 = Panel("""id
typology
area
buildings
gfa
far
densityWeight""")
panel_3 = Panel("""Block
Typology
Area m²
Bldgs
GFA m²
FAR
Weight""")
i_tablerecord = SerializeJson(
    Id=flatten(blockids_2),
    Typology=flatten(blocktypologies_2),
    Area=flatten(blockareas_2),
    DensityWeight=flatten(blockweights_2),
    Buildings=flatten(blockbuildings_2),
    Gfa=flatten(blockgfa_2),
    Far=flatten(blockfar_2),
    IncludeNullAndEmptyProperties=False)
i_blockplotgrid = ValueList({"x", "y", "xy", "none"}, selected="y")
i_tablecolumn = SerializeJson(Accessor=panel_2, Title=panel_3, Sortable=True, IncludeNullAndEmptyProperties=False)
i_fartargetseries = ChartDataSeries(Name="Target", Color=RGB(164, 182, 201), Values=flatten(blocktargetfar_2))
i_farachievedseries = ChartDataSeries(Name="Achieved", Color=RGB(214, 174, 122), Values=flatten(blockfar_2))
i_tableprops = SerializeJson(
    Caption="Developable blocks (ids match the labels in the viewer)",
    Striped=True,
    HighlightOnHover=True,
    StickyHeader=True,
    Height=420,
    Columns=flatten(i_tablecolumn),
    Records=flatten(i_tablerecord),
    IncludeNullAndEmptyProperties=False)
i_blockplot = PlotSettings(XAxis=True, XLabel="Block", YAxis=True, YLabel="FAR", Grid=i_blockplotgrid, Dots=False, Legend=True, N=False)
i_fardataset_smerge = Merge(Data1=i_farachievedseries, Data2=i_fartargetseries)
i_farcharttype = ValueList({"default", "stacked", "percent", "waterfall"}, selected="default")
i_fardataset = ChartDataSet(Keys=flatten(blockkeys_2), Series=i_fardataset_smerge)
i_farchart = BarChartWidget(Name="FAR per block: achieved vs target", Type=i_farcharttype, PlotSettings=i_blockplot, DataSet=i_fardataset, N=False)
i_tablewidget = SerializeJson(Type="table", Props=i_tableprops, IncludeNullAndEmptyProperties=False)
i_tabletab = Tab(Name="Table", Icon="tabler:table", Tooltip="Figures per block", AppBuilderWidgets=i_tablewidget)
i_densitytab = Tab(Name="Density", Icon="tabler:chart-bar", Tooltip="Achieved and target FAR per block", AppBuilderWidgets=i_farchart)
l_blockstabsmerge = Merge(Data1=i_densitytab, Data2=i_tabletab)
l_parseblocks = ParseJSON(JSON=l_blockstabsmerge)
l_blocksprops = SerializeJson(
    Label="Blocks",
    Icon="tabler:table",
    Tooltip="Density and floor area per block",
    Tabs=l_parseblocks,
    IncludeNullAndEmptyProperties=False)
l_blocksitem = SerializeJson(Id="toolbar-blocks", Type="tabs", Props=l_blocksprops, IncludeNullAndEmptyProperties=False)

i_storeyplotgrid = ValueList({"x", "y", "xy", "none"}, selected="y")
i_gfanames = Panel("""Residential
Office
Retail""")
i_storeyplot = PlotSettings(XAxis=True, XLabel="Storeys", YAxis=True, YLabel="Buildings", Grid=i_storeyplotgrid, Dots=False, Legend=False, N=False)
i_storeybins = Panel("""1-3
4-6
7-9
10-12
13-15
16-18
19+""")
i_landnames = Panel("""Buildings
Open plot space
Courtyards
Parks & green
Streets""")
i_storeyseries = ChartDataSeries(Name="Buildings", Color=RGB(127, 143, 166), Values=flatten(storeybins_2))
i_storeycharttype = ValueList({"default", "stacked", "percent", "waterfall"}, selected="default")
i_gfachartstyle = ValueList({"donut", "pie"}, selected="donut")
i_landchartstyle = ValueList({"donut", "pie"}, selected="donut")
i_gfadata = RoundChartData(Name=i_gfanames, Color=[RGB(217, 199, 158), RGB(76, 125, 176), RGB(200, 118, 43)], Value=flatten(gfabyuse_2))
i_storeydataset = ChartDataSet(Keys=i_storeybins, Series=i_storeyseries)
i_landdata = RoundChartData(
    Name=i_landnames,
    Color=[RGB(92, 92, 92), RGB(179, 172, 156), RGB(127, 176, 106), RGB(78, 140, 58), RGB(58, 61, 66)],
    Value=flatten(landuse_2))
i_gfachart = RoundChartWidget(Name="Floor area by use (m²)", Style=i_gfachartstyle, Labels=False, Legend=True, Data=i_gfadata, N=False)
i_storeychart = BarChartWidget(
    Name="Buildings by number of storeys",
    Type=i_storeycharttype,
    PlotSettings=i_storeyplot,
    DataSet=i_storeydataset,
    N=False)
i_landchart = RoundChartWidget(Name="Land use (m²)", Style=i_landchartstyle, Labels=False, Legend=True, Data=i_landdata, N=False)
i_floorareatab = Tab(Icon="tabler:chart-pie", Tooltip="Floor area by use", AppBuilderWidgets=i_gfachart)
i_storeystab = Tab(Icon="tabler:chart-bar", Tooltip="Buildings per storey range", AppBuilderWidgets=i_storeychart)
i_landusetab = Tab(Icon="tabler:chart-donut", Tooltip="Land use of the site", AppBuilderWidgets=i_landchart)
l_insightstabsmerge = Merge(Data1=i_floorareatab, Data2=i_landusetab, Data3=i_storeystab)
l_parseinsights = ParseJSON(JSON=l_insightstabsmerge)
l_insightsprops = SerializeJson(
    Label="Insights",
    Icon="tabler:chart-pie",
    Tooltip="Charts: floor area, land use and storeys",
    Tabs=l_parseinsights,
    IncludeNullAndEmptyProperties=False)
l_insightsitem = SerializeJson(Id="toolbar-insights", Type="tabs", Props=l_insightsprops, IncludeNullAndEmptyProperties=False)

f_headlinelocation = ScreenPoint(XPosition="calc(100% - 16px)", YPosition="16px")
bool = Boolean(False)
f_headlinecustomprops = SerializeJson(Draggable=bool, IncludeNullAndEmptyProperties=False)
f_headlineprops = ContainerProperties(MaxWidth="calc(100% - 32px)", Justification="Top Right", UseContainer=uc, CustomProperties=f_headlinecustomprops)
d_headlinetext = TextWidget(Text=headlinemd_2)
f_headlinecontainer = FloatingContainer(Location=f_headlinelocation, AppBuilderContainerProperties=f_headlineprops, AppBuilderWidgets=d_headlinetext)

i_kpitext = TextWidget(Text=kpimd_2)
l_parsekpis = ParseJSON(JSON=i_kpitext)
l_kpisprops = SerializeJson(
    Label="Key figures",
    Icon="tabler:list-numbers",
    Tooltip="Key figures of the district",
    Widgets=l_parsekpis,
    IncludeNullAndEmptyProperties=False)
l_kpisitem = SerializeJson(Id="toolbar-kpis", Type="widgets", Props=l_kpisprops, IncludeNullAndEmptyProperties=False)

l_toolbaritemsmerge = Merge(Data1=l_scenariositem, Data2=l_designitem, Data3=l_kpisitem, Data4=l_insightsitem, Data5=l_blocksitem)
l_parsetoolbaritems = ParseJSON(JSON=l_toolbaritemsmerge)
l_toolbar = ConstructJSON(Object=l_parsetoolbarbase, Data=l_parsetoolbaritems, AddressString=".groups[0]")
appbuilder_cmerge = Merge(Data1=h_topcontainer, Data2=a_rightcontainer, Data3=l_toolbar, Data4=f_headlinecontainer)  # -> flatten(Result)
appbuilder = App(AppBuilderContainer=appbuilder_cmerge, AppBuilderAgent=g_agent)
