# Grasshopper definition 2410A-Webinar_BarcelonaNeighbourhood.ghx (Grasshopper 1.0.8)
# plug-ins: jSwan, Heteroptera, treesloth01, Pufferfish, Bowerbird2, GrasshopperHyperGooComponents, ShapeDiverForGrasshopper, Wombat

example_selection = Panel("""buildings.1.2
buildings.1.1""")
example_selection_2 = Panel("buildings.0.2")
example_selection_3 = Panel("buildings.0")
default_max_building_length = Slider(20, range=15..30)

# ----
# LEGEND
# All sliders, value lists, colors, ShapeDiver inputs (e.g. "SDTextInput"), etc. that will be available in
# the ShapeDiver platform as parameters or have the potential of becoming available (e.g. Panels
# with hardcoded data that can not be access directly in ShapeDiver).
# Parameters
# Basic Groups
# The Grasshopper definition should be built in small groups, "Basic Groups", with very specific tasks.
# Each "Basic Group" should have "Inputs", "Outputs", a title and an optional description if necessary.
# Inputs
# All data that goes inside a "Basic Group".
# NO DATA should go inside a "Basic Group" from any other area but the "Inputs".
# Outputs
# All data that goes outside a "Basic Group".
# NO DATA should go outside a "Basic Group" from any other area but the "Outputs".
# Exports /
# Data Outputs
# Contains the data that will be available via the ShapeDiver platform or API.
# Data is sent via the ShapeDiver outputs components (e.g. "SDExportDownload").
# This may also contain basic exports pre processing (e.g. "SDPropertiesExport").
# Contains the "SDDisplayGeometry" components or any geometry that has preview on.
# This is the geometry that will be visible in the ShapeDiver viewer.
# This may also contain simple material creation.
# Display
# Contains any components that are used just for local testing but need to be
# removed before uploading to ShapeDiver (e.g. Components that bake geometry in Rhino,
# C# scripts that affect the Rhino document or store data in the local machine,
# unsupported ShapeDiver plugins, etc.).
# Local Testing
# Ready to
# Organize
# Add all definition sections that are finsihed but still need to be organized.
# In Progress /
# To Implement /
# To Improve
# Add all definition groups that are still not ready.
# These sections need to be implemented, are still being tested or not finished.
# They also involve potential improvements.
data = Data()
data_2 = Data()
data_3 = Data()
data_4 = Data()
data_5 = Data()
data_6 = Data()
data_7 = Data()
data_8 = Data()
data_9 = Data()

default_courtyard_size = Slider(0.5, range=0.35..0.65)
default_block_corner = Slider(10, range=0..20)
default_block_size = Slider(0.7, range=0.55..0.85)
blocks_quantity_x = Slider(2, range=1..10)
blocks_quantity_y = Slider(2, range=1..10)
charts_buildings_area_color = ColourSwatch(SwatchColor=RGB(255, 160, 0))
buildings_color_selected = ColourSwatch(SwatchColor=RGB(255, 0, 0))
charts_open_area_color = ColourSwatch(SwatchColor=RGB(0, 196, 0))
blocks_color_selected = ColourSwatch(SwatchColor=RGB(89, 0, 0))
blocks_ground_color = ColourSwatch(SwatchColor=RGB(163, 163, 163))
buildings_color = ColourSwatch(SwatchColor=RGB(227, 227, 227))
streets_color = ColourSwatch(SwatchColor=RGB(8, 8, 8))
pavement_height = Vector(Vector(0, 0, -0.15))
select_block = SelectionInput(
    Hover=True,
    MaxObjectsSelected=1,
    MinObjectsSelected=1,
    NameFilters_Branch0_Path="{0}",
    NameFilters_Branch0_Item0_null_string=False,
    NameFilters_Branch0_Item0_string="buildings.*")
appbuilder = DirectTextInput(maxlength=10000)

# ---- group: Base Data / Getting Custom Parameter Values
appbuilder_text = Text(appbuilder)
dejsonkv = DeserializeKeysAndValues(JSON=appbuilder_text, Keys="appBuilderState")  # -> Key, flatten(Value)
nullrep = ReplaceNulls(Items=dejsonkv.Value, Replacements=appbuilder_text)  # -> Items, Count
jmerge = MergeJson(SourceJson=nullrep.Items, OverrideJson=appbuilder_text)
dejsonkv_2 = DeserializeKeysAndValues(JSON=jmerge)  # -> flatten(Key), flatten(Value)
tmatch = MatchText(Text=dejsonkv_2.Key, Pattern="appBuilderState", Case=True)
tmatch_2 = MatchText(Text=dejsonkv_2.Key, Pattern="selectBuilding", Case=True)
or = GateOr(A=tmatch, B=tmatch_2)
cull = CullPattern(List=dejsonkv_2.Value, CullPattern=tmatch_2)
dejson = DeserializeJson(JSON=cull, OutputsLocked=True)  # -> flatten(Names)
cull_multiple = CullMultiple(L0=dejsonkv_2.Key, L1=dejsonkv_2.Value, P=invert(or))  # -> L0, L1

instructions_keys = Text(cull_multiple.L0)
instructions_values = Number(cull_multiple.L1)
selectedbuidings = Text(dejson)

# ---- group: Base Data / Get Index of Selected Objects
selected_objects_ids = Text(select_block)
selectedbuidings_2 = Text(selectedbuidings)

split = TextSplit(Text=selected_objects_ids, Separators=".")  # -> flatten(Result)
split_2 = TextSplit(Text=selectedbuidings_2, Separators=".")
item = ListItem(List=split, Index=1, Wrap=False)  # -> Item, Item1
item_2 = ListItem(List=split_2, Index=1, Wrap=True)  # -> Item, Item1
equals = Equality(FirstNumber=item.Item, SecondNumber=item_2.Item)  # -> Equality, Inequality
cull_2 = CullPattern(List=item_2.Item1, CullPattern=equals.Equality)  # -> flatten(List)
empty = EmptyObjectToEmptyBranch(DataIn=cull_2)

selected_block = Integer(item.Item)
selected_building = Integer(empty)

# ---- group: App Builder / Gross Floor Area Plot Settings
selected_block_2 = Integer(selected_block)
selected_building_2 = Integer(selected_building)

x_plus_one = XPlusOne(NumberX=selected_building_2)
x_plus_one_2 = XPlusOne(NumberX=selected_block_2)
lng = ListLength(List=selected_building_2)
join = TextJoin(Text=x_plus_one, Join=", ")
concat = Concatenate(FragmentA=" (", FragmentB=x_plus_one_2, FragmentC=" selected)")
concat_2 = Concatenate(FragmentA=" (", FragmentB=join, FragmentC=" selected)")
null = NullItem(Item=selected_block_2)  # -> NullFlags, InvalidFlags, Description
bool = Boolean(lng)
p_n_c = PickNChoose(Pattern=null.NullFlags, Stream0=concat)
p_n_c_2 = PickNChoose(Pattern=bool, Stream1=concat_2)
panel = Panel("""Block
Building""")
merge = Merge(Data1=p_n_c, Data2=p_n_c_2)
concat_3 = Concatenate(FragmentA=panel, FragmentB=merge)
gross_floor_area = PlotSettings(XAxis=True, XLabel=simplify(graft(concat_3)), YAxis=True, YLabel="Area", Grid="x", Dots=True, Legend=False, N=False)

# ----
bool_2 = Boolean(False)

# ---- group: Display / Trees
trees_leaves = Mesh(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)
trees_trunk = Mesh(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)
col = Colour(RGB(0, 173, 0))
col_2 = Colour(RGB(110, 83, 25))

# ---- group: Make sure selected buildings height is also changed
selected_building_3 = Integer(selected_building)
selected_block_3 = Integer(selected_block)

# ---- group: Base Data / Merging Custom Parameters Values with Default Values
courtyard_size = Number(default_courtyard_size)
blocks_quantity_x_2 = Integer(blocks_quantity_x)
blocks_quantity_y_2 = Integer(blocks_quantity_y)
instructions_values_2 = Number(instructions_values)
block_size = Number(default_block_size)
instructions_values_3 = Number(instructions_values)
instructions_keys_2 = Text(instructions_keys)
block_corner = Number(default_block_corner)
max_building_length = Integer(default_max_building_length)
instructions_keys_3 = Text(instructions_keys)

# ---- group: Base Data / Custom Parameters Base
panel_2 = Panel("""{
  "id": "selectBuilding",
  "name":"Select Building",
  "type": "Interaction",
  "settings":{
    "type":"selection",
    "props":{
      "hover":true,
      "minimumSelection": 1
    }
  },
  "defval":"",
  "hidden": false,
  "interactionType": "selection"
}""")
panel_3 = Panel("""{
  "name":"Block Size",
  "type": "Float",
  "min": 0.55,
  "max": 0.85,
  "defval":"0.55",
  "decimalplaces": 2,
  "hidden": false,
}""")
panel_4 = Panel("""{
  "name":"Courtyard Size",
  "type": "Float",
  "min": 0.35,
  "max": 0.65,
  "defval":"0.35",
  "decimalplaces": 2,
  "hidden": false,
}""")
panel_5 = Panel("""{
  "name":"Block Corner",
  "type": "Float",
  "min": 0,
  "max": 20,
  "defval":"0",
  "decimalplaces": 2,
  "hidden": false,
}""")
panel_6 = Panel("""{
  "name":"Max Building Length",
  "type": "Float",
  "min": 15,
  "max": 30,
  "defval":"15",
  "decimalplaces": 2,
  "hidden": false,
}""")
panel_7 = Panel("""{
  "name":"Number of Floors",
  "type": "Float",
  "min": 0,
  "max": 15,
  "defval":"1",
  "decimalplaces": 0,
  "hidden": false,
}""")
panel_8 = Panel("""{
  "name":"appBuilderState",
  "type": "String",
  "max": 10000,
  "hidden": false,
  "defval":"{}"
}""")
panel_9 = Panel("""settings.props.maximumSelection
settings.props.nameFilter[0]""")
parsejson = ParseJSON(JSON=panel_2)

selected_block_4 = Integer(selected_block)

# ---- group: Make sure selected buildings height is also changed
path = DataPath(selected_block_3)
item_3 = ListItem(List=selected_building_3, Index=0, Wrap=True)

# ---- group: Base Data / Merging Custom Parameters Values with Default Values
multiplication = Multiplication(A=blocks_quantity_x_2, B=blocks_quantity_y_2)

# ---- group: Base Data / Custom Parameters Base (continued)
concat_4 = Concatenate(FragmentA="buildings", FragmentB=selected_block_4, FragmentC="*", JoinSeparator=".")

# ---- group: Base Data / Merging Custom Parameters Values with Default Values
blocksize = BuildingsFloorsQuantity(
    gloval_value=block_size,
    quantity=multiplication,
    instructions_values=instructions_values_3,
    instructions_keys=instructions_keys_2,
    attribute="blockSize")
courtyardsize = BuildingsFloorsQuantity(
    gloval_value=courtyard_size,
    quantity=multiplication,
    instructions_values=instructions_values_3,
    instructions_keys=instructions_keys_2,
    attribute="courtyardSize")
blockcorner = BuildingsFloorsQuantity(
    gloval_value=block_corner,
    quantity=multiplication,
    instructions_values=instructions_values_3,
    instructions_keys=instructions_keys_2,
    attribute="blockCorner")
maxbuildinglength = BuildingsFloorsQuantity(
    gloval_value=max_building_length,
    quantity=multiplication,
    instructions_values=instructions_values_3,
    instructions_keys=instructions_keys_2,
    attribute="maxBuildingLength")

# ---- group: Base Boundary / Blocks Base Boundary
blocksize_final = Number(blocksize)
courtyardsize_final = Number(courtyardsize)
blockcorner_final = Number(blockcorner)
blocks_quantity_x_3 = Integer(blocks_quantity_x)
blocks_quantity_y_3 = Integer(blocks_quantity_y)

sqgrid = Square(Plane=PlaneXY(0, 0, 0), Size=100, ExtentX=blocks_quantity_x_3, ExtentY=blocks_quantity_y_3)  # -> flatten(Cells), Points
center = Center(Geometric=sqgrid.Cells)  # -> Center, Dimension
scale = Scale(Geometry=sqgrid.Cells, Center=center.Center, Factor=blocksize_final)  # -> Geometry, Transform
scale_2 = Scale(Geometry=scale.Geometry, Center=center.Center, Factor=courtyardsize_final)  # -> Geometry, Transform
fillet = Fillet(Curve=scale.Geometry, Radius=blockcorner_final)
explode = Explode(Curve=fillet, Recursive=True)  # -> Segments, Vertices

blocks_total = BoundingRectangle(Geometry=sqgrid.Cells, Plane=PlaneXY(0, 0, 0), Axis=0, Slide=0, Union=True)  # -> Bounding, DimensionX, DimensionY
blocks = PolyLine(Vertices=explode.Vertices, Closed=False)
block_rectangle = Rectangle(scale.Geometry)
courtyard_rectangle = Rectangle(scale_2.Geometry)

# ---- group: Constructing Meshes / Blocks Ground Mesh
blocks_boundary = Curve(blocks)
pavement_height_2 = Vector(pavement_height)

# ---- group: Constructing Meshes / Street Mesh
blocks_total_boundary = Rectangle(blocks_total.Bounding)
pavement_height_3 = Vector(pavement_height)

# ---- group: Base Boundary / Buildings Boundary
blocks_boundary_2 = Curve(blocks)
block_rectangle_2 = Rectangle(block_rectangle)
courtyard_rectangle_2 = Rectangle(courtyard_rectangle)
maxbuildinglength_final = Number(maxbuildinglength)

# ---- group: Constructing Meshes / Blocks Ground Mesh
offset = OffsetCurve(Curve=blocks_boundary, Distance=6, Corners=1)
move = Move(Geometry=offset, Motion=pavement_height_2)  # -> Geometry, Transform
pline2msh = PolylineToMesh(Polyline=offset, Quadrangulate=True)
merge_2 = Merge(Data1=offset, Data2=move.Geometry)
loftmesh = LoftMesh(Polylines=merge_2, ComputeUV=False, IsometricUV=False, UVSize=1)
merge_3 = Merge(Data1=pline2msh, Data2=loftmesh)
blocks_ground = MeshJoin(Meshes=merge_3)

# ---- group: Constructing Meshes / Street Mesh
offset_2 = OffsetCurve(Curve=blocks_total_boundary, Distance=5, Plane=PlaneXY(0, 0, 0), Corners=1)
mplane = MeshPlane(Boundary=offset_2, WidthCount=1, HeightCount=1)  # -> Mesh, Area
move_2 = Move(Geometry=mplane.Mesh, Motion=pavement_height_3)  # -> Geometry, Transform
street_mesh = Mesh(move_2.Geometry)

# ---- group: Base Boundary / Buildings Boundary
repeat = RepeatData(Data=blocks_boundary_2, Length=4)
explode_2 = Explode(Curve=block_rectangle_2, Recursive=True)  # -> Segments, Vertices
explode_3 = Explode(Curve=courtyard_rectangle_2, Recursive=True)  # -> Segments, Vertices
trim = TrimTree(Tree=repeat, Depth=1)
len = Length(Curve=explode_3.Segments)
division = Division(A=len, B=graft(maxbuildinglength_final))
round = Round(Number=division)  # -> Nearest, Floor, Ceiling
int = Integer(1)
max = Maximum(A=round.Floor, B=int)
divide = DivideCurve(Curve=explode_3.Segments, Count=max, Kinks=False)  # -> Points, Tangents, Parameters
crv_cp = CurveClosestPoint(Point=divide.Points, Curve=graft(explode_2.Segments))  # -> Point, Parameter, Distance
shift = ShiftList(List=divide.Points, Shift=1, Wrap=False)
item_4 = ListItem(List=crv_cp.Point, Index=0, Wrap=True)  # -> Item1, Item
short = ShortestList(ListA=crv_cp.Point, ListB=shift, TrimMode=2)  # -> ListA, ListB
trim_2 = TrimTree(Tree=item_4.Item1, Depth=1)
trim_3 = TrimTree(Tree=item_4.Item, Depth=1)
shift_2 = ShiftList(List=trim_2, Shift=-1, Wrap=True)
trim_4 = TrimTree(Tree=shift_2, Depth=1)
rec_2pt = Rectangle2Pt(Plane=PlaneXY(0, 0, 0), PointA=trim_4, PointB=trim_3, Radius=0)  # -> Rectangle, Length
rec_2pt_2 = Rectangle2Pt(Plane=PlaneXY(0, 0, 0), PointA=short.ListA, PointB=short.ListB, Radius=0)  # -> Rectangle, Length
bbint = BBIntersection(A=graft(trim), B=graft(rec_2pt.Rectangle), P=PlaneXY(0, 0, 0))
merge_4 = Merge(Data1=bbint, Data2=rec_2pt_2.Rectangle)
trim_5 = TrimTree(Tree=merge_4, Depth=2)
pshift = ShiftPaths(Data=trim_5, Offset=1)

# ---- group: Display / Ground
blocks_ground_mesh = Mesh(flatten(blocks_ground))
blocks_ground_color_2 = Colour(blocks_ground_color)
streets_color_2 = Colour(streets_color)
street_mesh_2 = Mesh(street_mesh)

# ---- group: Display / Trees
blocks_boundary_3 = Curve(blocks)
offset_3 = OffsetCurve(Curve=blocks_boundary_3, Distance=4.5, Corners=1)  # -> flatten(Curve)
merge_5 = Merge(Data1=trees_leaves, Data2=trees_trunk)  # -> graft(Result)
merge_6 = Merge(Data1=col, Data2=col_2)
divide_2 = DivideCurve(Curve=offset_3, Count=28, Kinks=False, UseTasks=False)  # -> Points, Tangents, Parameters
move_3 = Move(Motion=divide_2.Points)  # -> Geometry, flatten(Transform)
attachtransform = AttachTransformations(Geometry=merge_5, Transform=move_3.Transform)
trees = GlTF20Display(Geometry=attachtransform, Material=merge_6)

# ---- group: Display / Ground
blockground = GlTF20Display(Geometry=blocks_ground_mesh, Material=blocks_ground_color_2)
street = GlTF20Display(Geometry=street_mesh_2, Material=streets_color_2)

# ---- group: Base Boundary / Buildings Boundary
buildings_boundary = ListLength(List=pshift)
buildings_boundary_2 = Curve(pshift)

# ---- group: Base Data / Merging Custom Parameters Values with Default Values (continued)
buildings_boundary_quantity = Integer(flatten(buildings_boundary))

# ---- group: Base Data / Custom Parameters Base (continued)
buildings_boundary_quantity_2 = Integer(flatten(buildings_boundary))

# ---- group: Base Data / Merging Custom Parameters Values with Default Values (continued)
listdexs = ListIndices(List=buildings_boundary_quantity)
random = Random(Range=Domain(0, 15), Number=buildings_boundary_quantity, Seed=listdexs, Integers=True)
pshift_2 = ShiftPaths(Data=random, Offset=1)

# ---- group: Base Data / Custom Parameters Base (continued)
item_5 = ListItem(List=buildings_boundary_quantity_2, Index=selected_block_4, Wrap=True)
merge_7 = Merge(Data1=item_5, Data2=concat_4)  # -> graft(Result)
custom_select = ConstructJSON(Object=parsejson, Data=merge_7, AddressString=panel_9)  # -> flatten(Object)
merge_8 = Merge(Data2=panel_8, Data3=panel_3, Data4=panel_4, Data5=panel_5, Data6=panel_6, Data7=custom_select, Data8=panel_7)
custom_parameters_base = Text(merge_8)

# ---- group: Base Data / Merging Custom Parameters Values with Default Values (continued)
buildings_floors_quantity = BuildingsFloorsQuantity(
    gloval_value=pshift_2,
    instructions_values=instructions_values_2,
    instructions_keys=instructions_keys_3,
    attribute="floorsQuantity")

# ---- group: Make sure selected buildings height is also changed (continued)
buildings_floors_quantity_2 = Integer(buildings_floors_quantity)

split_3 = SplitTree(Data=buildings_floors_quantity_2, Masks=path)  # -> Positive, Negative
item_6 = ListItem(List=split_3.Positive, Index=item_3, Wrap=True)
replace = ReplaceItems(List=split_3.Positive, Item=item_6, Indices=selected_building_3, Wrap=False)
trim_6 = TrimTree(Tree=replace, Depth=1)
empty_2 = EmptyObjectToEmptyBranch(DataIn=item_6)
merge_9 = Merge(Data1=trim_6, Data2=split_3.Negative)
nulls_in_empty = NullsInEmptyBranches(DataWithEmptyBranches=empty_2)

selected_floor_quantities = Integer(nulls_in_empty)
buildings_floors_quantity_3 = Integer(merge_9)

# ---- group: Buildings Attributes / Buildings Material
buildings_color_selected_2 = Colour(buildings_color_selected)
buildings_floors_quantity_4 = Integer(buildings_floors_quantity_3)
transparent_material = TransparentMaterial()
buildings_color_2 = Colour(buildings_color)
selected_block_5 = Integer(selected_block)
selected_building_4 = Integer(selected_building)

# ---- group: App Builder / Get Custom Parameters Values
instructions_values_4 = Number(instructions_values)
instructions_keys_4 = Text(instructions_keys)
blocksize_final_2 = Number(blocksize)
courtyardsize_final_2 = Number(courtyardsize)
blockcorner_final_2 = Number(blockcorner)
maxbuildinglength_final_2 = Number(maxbuildinglength)
selected_block_6 = Integer(selected_block)
selected_floor_quantities_2 = Integer(selected_floor_quantities)

# ---- group: Constructing Meshes / Buildings Mesh
buildings_floors_height = Number(3.5)
buildings_boundary_3 = Curve(graft(buildings_boundary_2))
buildings_floors_quantity_5 = Integer(buildings_floors_quantity_3)

# ---- group: App Builder / Data for Charts
courtyard_rectangle_3 = Rectangle(courtyard_rectangle)
buildings_boundary_4 = Curve(buildings_boundary_2)
buildings_floors_quantity_6 = Integer(buildings_floors_quantity_3)

area = Area(Geometry=courtyard_rectangle_3, UseTasks=False)  # -> graft(Area), Centroid
area_2 = Area(Geometry=buildings_boundary_4, UseTasks=False)  # -> Area, Centroid
pshift_3 = ShiftPaths(Data=area.Area, Offset=1)
ma = MassAddition(Input=area_2.Area)  # -> Result, PartialResults
multiplication_2 = Multiplication(A=area_2.Area, B=buildings_floors_quantity_6)
merge_10 = Merge(Data1=pshift_3, Data2=ma.Result)
roundd = RoundToDecimalPlace(NumberX=merge_10, DecimalPlace=2, RoundType=0)  # -> Rounded, Difference
roundd_2 = RoundToDecimalPlace(NumberX=multiplication_2, DecimalPlace=2, RoundType=0)  # -> Rounded, Difference

# ---- group: Constructing Meshes / Buildings Mesh
multiplication_3 = Multiplication(A=graft(buildings_floors_quantity_5), B=buildings_floors_height)
num = Number(0.1)
max_2 = Maximum(A=num, B=multiplication_3)
Z = UnitZ(Factor=max_2)
move_4 = Move(Geometry=buildings_boundary_3, Motion=Z)  # -> Geometry, Transform
merge_11 = Merge(Data1=buildings_boundary_3, Data2=move_4.Geometry)
clean = CleanTree(RemoveNulls=True, RemoveInvalid=True, RemoveEmpty=False, Tree=merge_11)
loftmesh_2 = LoftMesh(Polylines=clean, ComputeUV=False, IsometricUV=False, UVSize=1)
unweld = UnweldMesh(Mesh=loftmesh_2, Angle=0)
pline2msh_2 = PolylineToMesh(Polyline=move_4.Geometry, Quadrangulate=True)
merge_12 = Merge(Data1=unweld, Data2=pline2msh_2)
mjoin = MeshJoin(Meshes=merge_12)
trim_7 = TrimTree(Tree=mjoin, Depth=1)
buildings_mesh = Mesh(trim_7)

# ---- group: App Builder / Get Custom Parameters Values
constructjson = ConstructJSON(Data=graft(instructions_values_4), AddressString=instructions_keys_4)  # -> flatten(Object)
entwine = Entwine(
    Branch00=blocksize_final_2,
    Branch01=courtyardsize_final_2,
    Branch02=blockcorner_final_2,
    Branch03=maxbuildinglength_final_2,
    FlattenInputs=True)
empty_3 = EmptyObjectToEmptyBranch(DataIn=constructjson)
item_7 = ListItem(List=entwine, Index=selected_block_6, Wrap=True)
nulls_in_empty_2 = NullsInEmptyBranches(DataWithEmptyBranches=empty_3)
nullrep_2 = ReplaceNulls(Items=nulls_in_empty_2, Replacements="{}")  # -> Items, Count
merge_13 = Merge(Data1=nullrep_2.Items, Data2=flatten(item_7), Data3=selected_block_6, Data4=flatten(selected_floor_quantities_2))
custom_parameters_values = Text(merge_13)

# ---- group: App Builder / Data for Charts
buildings_open_builtarea = Number(roundd.Rounded)
buildings_floorsarea = Number(roundd_2.Rounded)

# ---- group: App Builder / Construct Custom Parameters
panel_10 = Panel("""blockSize
courtyardSize
blockCorner
maxBuildingLength""")
panel_11 = Panel("appBuilderState")
custom_parameters_values_2 = Text(custom_parameters_values)
custom_parameters_base_2 = Text(custom_parameters_base)
selected_block_7 = Integer(selected_block)
selected_building_5 = Integer(selected_building)

join_2 = TextJoin(Text=selected_building_5, Join=",")
concat_5 = Concatenate(FragmentA=panel_10, FragmentB=selected_block_7, JoinSeparator="_")
concat_6 = Concatenate(FragmentA="floorsQuantity", FragmentC=selected_block_7, FragmentB=join_2, JoinSeparator="_")
merge_14 = Merge(Data1=panel_11, Data2=concat_5, Data3="selectBuilding", Data4=concat_6)
change_object = Panel("""true
true
true
true
true
false
true""")
buildings_tab = Panel("""false
false
false
false
false
true
true""")
clean_2 = CleanTree(
    RemoveNulls=True,
    RemoveInvalid=True,
    RemoveEmpty=False,
    Tree=custom_parameters_values_2,
    SynchronousTree1=custom_parameters_base_2,
    SynchronousTree2=merge_14,
    SynchronousTree3=change_object,
    SynchronousTree4=buildings_tab)  # -> graft(Tree), graft(SynchronousTree1), SynchronousTree2, graft(SynchronousTree3), SynchronousTree4
dispatch = Dispatch(List=clean_2.SynchronousTree1, DispatchPattern=clean_2.SynchronousTree3)  # -> ListA, ListB
clean_3 = CleanTree(
    RemoveNulls=True,
    RemoveInvalid=True,
    RemoveEmpty=True,
    Tree=dispatch.ListA,
    SynchronousTree1=clean_2.Tree,
    SynchronousTree2=graft(clean_2.SynchronousTree2))  # -> Tree, SynchronousTree1, SynchronousTree2
rejson = SerializeJson(
    Id=clean_3.SynchronousTree2,
    Value=clean_3.SynchronousTree1,
    Data3=clean_3.SynchronousTree1,
    IncludeNullAndEmptyProperties=True)
custom_parameters = MergeJson(SourceJson=clean_3.Tree, OverrideJson=rejson)
merge_15 = Merge(Data1=custom_parameters, Data2=dispatch.ListB)
cull_i = CullIndex(List=clean_2.SynchronousTree2, Indices=0, Wrap=True)  # -> flatten(List)
cull_i_2 = CullIndex(List=clean_2.SynchronousTree4, Indices=0, Wrap=True)  # -> flatten(List)
trim_8 = TrimTree(Tree=merge_15, Depth=1)

# ---- group: App Builder / Right Container Charts
gross_floor_area_plot_settings = AppBuilderPlotSettings(gross_floor_area)
buildings_floors_grossarea = Number(buildings_floorsarea)
charts_buildings_area_color_2 = Colour(charts_buildings_area_color)
charts_open_area_color_2 = Colour(charts_open_area_color)
buildings_open_builtarea_2 = Number(buildings_open_builtarea)

# ---- group: App Builder / Construct Custom Parameters
custom_parameters_object = Data(trim_8)
custom_parameters_ids = Text(cull_i)
custom_parameter_is_building_tab = Boolean(cull_i_2)

# ---- group: App Builder / Left Container Parameters
panel_12 = Panel("default_appbuilder")
custom_parameters_ids_2 = Text(custom_parameters_ids)
custom_parameter_is_building_tab_2 = Boolean(custom_parameter_is_building_tab)

rejson_2 = SerializeJson(SessionId=panel_12, Name=custom_parameters_ids_2, IncludeNullAndEmptyProperties=True)
lng_2 = ListLength(List=custom_parameters_ids_2)
bool_3 = Boolean(lng_2)
txt = Text(rejson_2)
filter = StreamFilter(Gate=bool_3, Stream1=txt)
dispatch_2 = Dispatch(List=filter, DispatchPattern=custom_parameter_is_building_tab_2)  # -> ListA, ListB
panel_13 = Panel("""Blocks Quantity X
Blocks Quantity Y
Default Block Size
Default Courtyard Size
Default Block Corner
Default Max Building Length""")
merge_16 = Merge(Data1="Select Block", Data2=dispatch_2.ListB)
panel_14 = Panel("""General
Edit Blocks
Edit Buildings""")
entwine_2 = Entwine(Branch00=panel_13, Branch01=merge_16, Branch02=dispatch_2.ListA, FlattenInputs=True)
clean_4 = CleanTree(RemoveNulls=True, RemoveInvalid=True, RemoveEmpty=True, Tree=entwine_2, SynchronousTree1=graft(panel_14))  # -> Tree, SynchronousTree1
paramwidget = ParameterWidget(ParametersAndExports=clean_4.Tree, PreserveOrdering=True)
tab = Tab(Name=clean_4.SynchronousTree1, Widgets=paramwidget)  # -> flatten(Tab)
parameters = Container(Name="left", Tabs=tab)

# ---- group: Buildings Attributes / Buildings Material
blocks_color_selected_2 = Colour(blocks_color_selected)
presetmaterial = PresetMaterial(Color=buildings_color_2, MaterialIndex=1)
presetmaterial_2 = PresetMaterial(Color=blocks_color_selected_2, MaterialIndex=1)
presetmaterial_3 = PresetMaterial(Color=buildings_color_selected_2, MaterialIndex=1)
bool_4 = Boolean(graft(buildings_floors_quantity_4))
p_n_c_3 = PickNChoose(Pattern=bool_4, Stream0=transparent_material, Stream1=presetmaterial)
trim_9 = TrimTree(Tree=p_n_c_3, Depth=1)
path_2 = DataPath(selected_block_5)
split_4 = SplitTree(Data=trim_9, Masks=path_2)  # -> Positive, Negative
listdexs_2 = ListIndices(List=split_4.Positive)
equals_2 = Equality(FirstNumber=graft(listdexs_2), SecondNumber=selected_building_4)  # -> Equality, Inequality
ma_2 = MassAddition(Input=equals_2.Equality)  # -> Result, PartialResults
bool_5 = Boolean(ma_2.Result)

# ----
nullrep_3 = ReplaceNulls(Items=bool_5, Replacements=bool_2)  # -> Items, Count

# ---- group: Buildings Attributes / Buildings Material (continued)
p_n_c_4 = PickNChoose(Pattern=nullrep_3.Items, Stream0=presetmaterial_2, Stream1=presetmaterial_3)
trim_10 = TrimTree(Tree=p_n_c_4, Depth=1)
merge_17 = Merge(Data1=split_4.Negative, Data2=trim_10)
buildings_materials = Material(merge_17)

# ---- group: Buildings Attributes / Buildings Name
buildings_materials_2 = Material(buildings_materials)
item_8 = ListItem(List=buildings_materials_2, Index=0, Wrap=True)  # -> flatten(Item)
listdexs_3 = ListIndices(List=item_8)  # -> graft(Indices)
pshift_4 = ShiftPaths(Data=listdexs_3, Offset=1)
listdexs_4 = ListIndices(List=buildings_materials_2)
concat_7 = Concatenate(FragmentA=pshift_4, FragmentB=listdexs_4, JoinSeparator=".")
panel_15 = Panel("""name
material""")
merge_18 = Merge(Data1=graft(concat_7), Data2=graft(buildings_materials_2))
buildings = ConstructAttributes(Keys=panel_15, Values=merge_18)

# ---- group: Display / Buildings
buildings_attributes = Data(buildings)
buildings_mesh_2 = Mesh(buildings_mesh)

injectattr = InjectAttributes(Object=flatten(buildings_mesh_2), Attributes=flatten(buildings_attributes))
buildings_2 = GlTF20Display(Geometry=injectattr)

# ---- group: App Builder / Right Container Charts
selected_block_8 = Integer(selected_block)
flip = FlipMatrix(Data=buildings_open_builtarea_2)
ma_3 = MassAddition(Input=buildings_floors_grossarea)  # -> Result, PartialResults
branch = TreeBranch(Tree=buildings_floors_grossarea, Path=selected_block_8, MaintainPaths=True)
branch_2 = TreeBranch(Tree=buildings_open_builtarea_2, Path=selected_block_8, MaintainPaths=True)
entwine_3 = Entwine(Branch00=ma_3.Result, Branch01=branch, FlattenInputs=True)  # -> simplify(Result)
ma_4 = MassAddition(Input=flip)  # -> Result, PartialResults
panel_16 = Panel("""Open Area
Built Area""")
entwine_4 = Entwine(Branch00=ma_4.Result, Branch01=branch_2, FlattenInputs=True)  # -> simplify(Result)
clean_5 = CleanTree(RemoveNulls=True, RemoveInvalid=True, RemoveEmpty=True, Tree=entwine_3)
merge_19 = Merge(Data1=charts_open_area_color_2, Data2=charts_buildings_area_color_2)
clean_6 = CleanTree(RemoveNulls=True, RemoveInvalid=True, RemoveEmpty=True, Tree=entwine_4)
listdexs_5 = ListIndices(List=clean_5)
x_plus_one_3 = XPlusOne(NumberX=listdexs_5)
int_2 = Integer(0)
branch_3 = TreeBranch(Tree=x_plus_one_3, Path=int_2, MaintainPaths=True)
plotsettings = PlotSettings(XAxis=True, XLabel="Block", YAxis=True, YLabel="Area", Grid="x", Dots=True, Legend=True, N=False)
x_plus_one_4 = XPlusOne(NumberX=selected_block_8)
concat_8 = Concatenate(FragmentA="Block ", FragmentB=x_plus_one_4, FragmentC=" Stats")
merge_20 = Merge(Data1="General Stats", Data2=concat_8)

# ---- group: App Builder / Right Container Charts / Data Series
chartdataseries = ChartDataSeries(Name="Gross Floor Area", Color=charts_buildings_area_color_2, Values=clean_5)
chartdataseries_2 = ChartDataSeries(Name=graft(panel_16), Color=graft(merge_19), Values=flip)  # -> flatten(DataSeries)
roundchartdata = RoundChartData(Name=panel_16, Color=merge_19, Value=clean_6)

# ---- group: App Builder / Right Container Charts / Data Sets
chartdataset = ChartDataSet(Keys=x_plus_one_3, Series=chartdataseries)
chartdataset_2 = ChartDataSet(Keys=branch_3, Series=chartdataseries_2)

# ---- group: App Builder / Right Container Charts (continued)
filter_unmatched = FilterUnmatched(Data0=gross_floor_area_plot_settings, Data1=chartdataset)  # -> Data0, Data1

# ---- group: App Builder / Right Container Charts / Create Widget
roundchartwidget = RoundChartWidget(Name="Total Built Area vs Open Area", Style="donut", Labels=True, Legend=True, Data=roundchartdata, N=False)  # -> flatten(Widget)
barchartwidget = BarChartWidget(Name="Gross Floor Area", Type="default", PlotSettings=filter_unmatched.Data0, DataSet=filter_unmatched.Data1, N=False)  # -> flatten(Widget)
barchartwidget_2 = BarChartWidget(Name="Built vs Open Area", Type="stacked", PlotSettings=plotsettings, DataSet=chartdataset_2, N=False)

# ---- group: App Builder / Right Container Charts (continued)
item_9 = ListItem(List=barchartwidget, Index=0, Wrap=False)  # -> Item, Item1
item_10 = ListItem(List=roundchartwidget, Index=0, Wrap=False)  # -> Item, Item1
merge_21 = Merge(Data1=item_9.Item1, Data2=item_10.Item1)
merge_22 = Merge(Data1=item_9.Item, Data2=barchartwidget_2, Data3=item_10.Item)
entwine_5 = Entwine(Branch00=merge_22, Branch01=merge_21, FlattenInputs=True)  # -> simplify(Result)
clean_7 = CleanTree(RemoveNulls=True, RemoveInvalid=True, RemoveEmpty=True, Tree=entwine_5, SynchronousTree1=simplify(graft(merge_20)))  # -> Tree, SynchronousTree1
tab_2 = Tab(Name=clean_7.SynchronousTree1, Widgets=clean_7.Tree)  # -> flatten(Tab)
charts = Container(Name="right", Tabs=tab_2)

# ---- group: App Builder / Output App Builder
charts_container = AppBuilderContainer(charts)
custom_parameters_object_2 = Data(custom_parameters_object)
custom_select_object = Data()
parameters_container = AppBuilderContainer(parameters)

merge_23 = Merge(Data1=parameters_container, Data2=charts_container)
merge_24 = Merge(Data1=custom_parameters_object_2, Data2=custom_select_object)
app = App(Containers=merge_23, Parameters=merge_24)

# ==== cluster BuildingsFloorsQuantity
gloval_value = ClusterInput()
quantity = ClusterInput()
instructions_values = ClusterInput()
instructions_keys = ClusterInput()
attribute = ClusterInput()
tmatch = MatchText(Text=instructions_keys, RegEx=attribute, Case=False)
cull_multiple = CullMultiple(L0=instructions_values, L1=instructions_keys, P=tmatch)  # -> L0, L1
split = TextSplit(Text=cull_multiple.L1, Separators="_")
clean = CleanTree(RemoveNulls=True, RemoveInvalid=True, RemoveEmpty=True, Tree=split)
item = ListItem(List=clean, Index=1, Wrap=False)  # -> Item, Item1
nullrep = ReplaceNulls(Items=item.Item1, Replacements=item.Item)  # -> Items, Count
split_2 = TextSplit(Text=nullrep.Items, Separators=",")
long = LongestList(ListA=item.Item, ListB=graft(cull_multiple.L0), ListC=split_2, PaddingMode=2)  # -> flatten(ListA), flatten(ListB), flatten(ListC)
listdexs = ListIndices(List=long.ListA)
addition = Addition(A=listdexs, B=long.ListA)
sort = SortList(Keys=addition, ValuesB=long.ListA, ValuesC=long.ListB, ValuesA=long.ListC)  # -> Keys, ValuesB, ValuesC, ValuesA
cset = CreateSet(List=sort.ValuesB)  # -> Set, Map
mindex = MemberIndex(Set=sort.ValuesB, Member=cset.Set)  # -> Index, Count
empty = EmptyObjectToEmptyBranch(DataIn=cset.Set)
null = NullItem(Item=quantity)  # -> NullFlags, InvalidFlags, Description
filter = StreamFilter(Gate=null.NullFlags, Stream0=flatten(mindex.Index), Stream1=mindex.Index)
filter_2 = StreamFilter(Gate=null.NullFlags, Stream1=empty)
repeat = RepeatData(Data=gloval_value, Length=quantity)
path = DataPath(filter_2)
split_3 = SplitTree(Data=gloval_value, Masks=path)  # -> Positive, Negative
trim = TrimTree(Tree=repeat, Depth=1)
item_2 = ListItem(List=sort.ValuesC, Index=filter, Wrap=True)
item_3 = ListItem(List=sort.ValuesA, Index=filter, Wrap=True)
merge = Merge(Data1=trim, Data2=split_3.Positive)
lng = ListLength(List=merge)
smaller = SmallerThan(FirstNumber=item_3, SecondNumber=lng)  # -> SmallerThan, OrEqualTo
cull_multiple_2 = CullMultiple(L0=item_2, L1=item_3, P=smaller.SmallerThan)  # -> L0, L1
cset_2 = CreateSet(List=cull_multiple_2.L1)  # -> Set, Map
mindex_2 = MemberIndex(Set=cull_multiple_2.L1, Member=cset_2.Set)  # -> Index, Count
trim_2 = TrimTree(Tree=mindex_2.Index, Depth=1)
item_4 = ListItem(List=cull_multiple_2.L0, Index=trim_2, Wrap=True)
unflatten = UnflattenTree(Tree=item_4, Guide=mindex_2.Index)
item_5 = ListItem(List=unflatten, Index=0, Wrap=True)
trim_3 = TrimTree(Tree=item_5, Depth=1)
replace = ReplaceItems(List=merge, Item=trim_3, Indices=cset_2.Set, Wrap=False)
trim_4 = TrimTree(Tree=replace, Depth=1)
merge_2 = Merge(Data1=trim_4, Data2=split_3.Negative)
final_values = ClusterOutput(merge_2)

# ==== cluster TransparentMaterial
gltf2material = GlTF20Material(
    BaseColorFactor=RGBA(255, 255, 255, 0),
    MetallicFactor=0,
    RoughnessFactor=1,
    EmissiveFactor=RGB(0, 0, 0),
    AlphaMode="BLEND",
    AlphaCutoff=0.5,
    DoubleSided=True)
M = ClusterOutput(gltf2material)
