# Grasshopper definition 2605-Webinar_NewAppBuilderFeatures.ghx (Grasshopper 1.0.7)
# plug-ins: ShapeDiverForGrasshopper, GrasshopperHyperGooComponents, jSwan

txt = Text("FloorPlan")
crv = Curve(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)
num = Number([1, 0, 0])
num_2 = Number([0, 1, 0])

# ----
# Global inputs
floor_height = Slider(3.83, range=2..5)
floor_count = Slider(10, range=0..30)
division = Division(A=floor_height, B=2)
col = Colour(ColourSwatch(SwatchColor=RGB(86, 166, 79)))
col_2 = Colour(ColourSwatch(SwatchColor=RGB(68, 164, 166)))
col_3 = Colour(ColourSwatch(SwatchColor=RGB(255, 89, 93)))
col_4 = Colour(ColourSwatch(SwatchColor=RGB(255, 172, 0)))
num_3 = Number(division)
int = Integer(floor_count)
col_5 = Colour(ColourSwatch(SwatchColor=RGB(152, 197, 109)))

# ----
# Beta Rectangle Transform
panel = Panel("{\"names\":[\"FloorPlan\"],\"transformations\":[[1.5657942295074463,0,0,0,0,1,0,0,0,0,1,0,-2.8289709091186523,0,0,1]]}")
appbuilder = DirectTextInput(maxlength=10000, text="Default")
rejson = SerializeJson(Color="#3aa864", IncludeNullAndEmptyProperties=False)
rejson_2 = SerializeJson(Type="plane", Vector_u=num, Vector_v=num_2, IncludeNullAndEmptyProperties=False)
rejson_3 = SerializeJson(Points=rejson, Lines=rejson, IncludeNullAndEmptyProperties=False)
visualization = SerializeJson(Visualization=rejson_3, IncludeNullAndEmptyProperties=False)
rejson_4 = SerializeJson(InactiveTitle="Adjust twister tower base", IncludeNullAndEmptyProperties=False)
panel_2 = Panel("""{
  "name": "RectangleTransform",
  "id": "RectangleTransform",
  "type": "Interaction",
  "value": "",
  "defval": "",
  "settings": {
    "type": "rectangleTransform",
    "props": {}
  }
}""")
rejson_5 = SerializeJson(NameFilter="FloorPlan", Plane=rejson_2, Prompt=rejson_4, Scaling=visualization, IncludeNullAndEmptyProperties=False)
rejson_6 = SerializeJson(Type="rectangleTransform", Props=rejson_5, IncludeNullAndEmptyProperties=False)
txt_2 = Text(txt)
matrix = ConstructMatrix(Rows=4, Columns=4)

parsejson = ParseJSON(JSON=appbuilder)
accessjson = AccessJSON(Object=parsejson, AddressString="FloorPlan")  # -> flatten(Property)
txt_3 = Text("FloorPlan")

parsejson_2 = ParseJSON(JSON=accessjson)
access_json = AccessJSON(Object=parsejson_2, AddressString="names")
access_json_2 = AccessJSON(Object=parsejson_2, AddressString="transformations")
txt_4 = Text(parsejson_2)
matrix_2 = ConstructMatrix(Rows=4, Columns=4, Values=access_json_2)
transpose = TransposeMatrix(Matrix=matrix_2)
rejson_7 = SerializeJson(Name=txt_2, Id=txt_2, Type="Interaction", Value=txt_4, Settings=rejson_6, IncludeNullAndEmptyProperties=False)
mindex = MemberIndex(Set=access_json, Member=txt_3)  # -> Index, Count
transform = Transform(flatten(transpose))
data = Data(rejson_7)
item = ListItem(List=transform, Index=mindex.Index, Wrap=True)  # -> flatten(Item)
null = NullItem(Item=mindex.Index)  # -> NullFlags, InvalidFlags, Description
item_2 = ListItem(List=[item, matrix], Index=null.NullFlags, Wrap=True)
attachtransform = AttachTransformations(Geometry=crv, Transform=item_2)
transform_2 = Transform(Geometry=crv, Transform=item_2)
crv_2 = Curve(transform_2)
floorplan = GlTF20Display(Geometry=attachtransform)

# ----
# Generating the towers
rotation_angle = Slider(41.76, range=0..45)
taper = Slider(0.42, range=0..0.5)
int_2 = Integer(int)
num_4 = Number(num_3)
int_3 = Integer(int)
crv_3 = Curve(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)
num_5 = Number(num_3)
crv_4 = Curve(crv_2)
cluster = Cluster(curve=crv_4, num=rotation_angle, num_2=num_4, int=int_3)  # -> mesh_3, edges, floorvolume, totalheight
cluster_2 = Cluster_2(G=crv_3, num=num_5, A=taper, int=int_2)
merge = Merge(Data1=cluster.mesh_3, Data2=cluster_2)
mesh = Mesh(merge)
mesh_2 = Mesh(cluster.mesh_3)
mesh_3 = Mesh(cluster_2)

# ----
# App Builder
width_containers = Slider(300, range=100..1000)
int_4 = Integer(width_containers)
num_6 = Number([2.4, 3.1, 3.9])
col_6 = Colour(col_5)
col_7 = Colour(col)
col_8 = Colour(col_2)
col_9 = Colour(col_3)
col_10 = Colour(col_4)
mesh_4 = Mesh(mesh_2)
mesh_5 = Mesh(mesh_3)
volume = Volume(Geometry=mesh_4)  # -> Volume, Centroid
volume_2 = Volume(Geometry=mesh_5)  # -> Volume, Centroid
concat = Concatenate(FragmentA=num_6, FragmentB="m")
panel_3 = Panel("PlanarRegionsAsPolygons")
ma = MassAddition(Input=volume.Volume)  # -> Result, PartialResults
ma_2 = MassAddition(Input=volume_2.Volume)  # -> Result, PartialResults
slidermark = SliderMarkItemData(Value=num_6, Label=concat)
slidersettings = SliderSettings(AppBuilderSliderMarks=slidermark, RestrictToMarks=True)
commercial = Number(349.94)
mixed_use = Number(177.89)
educational = Number(86.03)
offices = Number(ma.Result)
residential = Number(ma_2.Result)
merge_2 = Merge(Data1="SaveAsType")
merge_3 = Merge(Data1="Commercial", Data2="Mixed Use", Data3="Educational", Data4="Offices", Data5="Residential")  # -> flatten(Result)
merge_4 = Merge(Data1=col_6, Data2=col_7, Data3=col_8, Data4=col_9, Data5=col_10)  # -> flatten(Result)
merge_5 = Merge(Data1=commercial, Data2=mixed_use, Data3=educational, Data4=offices, Data5=residential)  # -> flatten(Result)
paramctrl = ParameterControl(Name="Floor Height", Settings=slidersettings)
paramctrl_2 = ParameterControl(Name="Floor Count")
paramctrl_3 = ParameterControl(Name="FloorPlan", DisplayName=" ", SessionId="default_appbuilder")
paramctrl_4 = ParameterControl(Name="RhinoVersion")
exportctrl = ExportControl(Name="3dmExport")
paramctrl_5 = ParameterControl(Name=merge_2)
exportctrl_2 = ExportControl(Name="SkpExport")
merge_6 = Merge(Data1=paramctrl_4, Data2=exportctrl)
merge_7 = Merge(Data1=paramctrl_5, Data2=exportctrl_2)
roundchartdata = RoundChartData(Name=merge_3, Color=merge_4, Value=merge_5)
int_5 = Integer(int_4)
concat_2 = Concatenate(FragmentA=int_5, FragmentB="px")
controlswidget = ControlsWidget(Controls=merge_6)
controlswidget_2 = ControlsWidget(Controls=merge_7)
tab = Tab(Name="3dm export", Widgets=controlswidget)
tab_2 = Tab(Name="skp export", Widgets=controlswidget_2)
panel_4 = Panel("""## :span[Massing study]{color="#3aa864"}

Update floor heights according to local regulation.

Twist and taper the towers as desired.

Live usage feedback.""")
roundchartwidget = RoundChartWidget(Name="Usage breakdown", Style="donut", Labels=True, Legend=True, Data=roundchartdata, N=False)
merge_8 = Merge(Data1=paramctrl, Data2=paramctrl_2, Data3=paramctrl_3)
merge_9 = Merge(Data1=tab, Data2=tab_2)
int_6 = Integer(int_4)
int_7 = Integer(int_4)
cp = ContainerProperties(Width=concat_2, Justification="top_right", UseContainer=False)
cp_2 = ContainerProperties(Width=concat_2, Justification="bottom_right", UseContainer=False)
cp_3 = ContainerProperties(Width=int_7, Justification="top_left")
cp_4 = ContainerProperties(Width=int_6, Justification="bottom_left")
textwidget = TextWidget(Text=panel_4)
controlswidget_3 = ControlsWidget(Controls=merge_8)
paramctrl_6 = ParameterControl(Name="Rotation Angle")
paramctrl_7 = ParameterControl(Name="Taper")
sp = ScreenPoint(XPosition="calc(100%-30px)", YPosition="30px")
sp_2 = ScreenPoint(XPosition="calc(100%-30px)", YPosition="calc(100%-30px)")
sp_3 = ScreenPoint(XPosition="30px", YPosition="30px")
sp_4 = ScreenPoint(XPosition="30px", YPosition="calc(100%-30px)")
controlswidget_4 = ControlsWidget(Controls=paramctrl_6)
cp_5 = ContainerProperties(PreviewIcon="spiral")
controlswidget_5 = ControlsWidget(Controls=paramctrl_7)
cp_6 = ContainerProperties(PreviewIcon="skew-y")
fcontainer = FloatingContainer(Location=sp, AppBuilderContainerProperties=cp, AppBuilderWidgets=controlswidget_3)  # -> AppBuilderContainer, Location, AppBuilderContainerProperties, AppBuilderTabs, AppBuilderWidgets
fcontainer_2 = FloatingContainer(Location=sp_2, AppBuilderContainerProperties=cp_2, AppBuilderWidgets=roundchartwidget)  # -> AppBuilderContainer, Location, AppBuilderContainerProperties, AppBuilderTabs, AppBuilderWidgets
fcontainer_3 = FloatingContainer(Location=sp_3, AppBuilderContainerProperties=cp_3, AppBuilderWidgets=textwidget)
fcontainer_4 = FloatingContainer(Location=sp_4, AppBuilderContainerProperties=cp_4, AppBuilderTabs=merge_9)
fcontainer_5 = FloatingContainer(
    Location=Point(-10.40955515, -1.462963581, 5.978870547),
    AppBuilderContainerProperties=cp_5,
    AppBuilderWidgets=controlswidget_4)
fcontainer_6 = FloatingContainer(
    Location=Point(9.947890282, -1.462963581, 6.024625711),
    AppBuilderContainerProperties=cp_6,
    AppBuilderWidgets=controlswidget_5)
merge_10 = Merge(
    Data1=fcontainer.AppBuilderContainer,
    Data2=fcontainer_2.AppBuilderContainer,
    Data3=fcontainer_3,
    Data4=fcontainer_4,
    Data5=fcontainer_5,
    Data6=fcontainer_6)
data_2 = Data(data)
app = App(Containers=merge_10, Parameters=data_2)

# ----
# Display
mesh_6 = Mesh([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])
mesh_7 = Mesh(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)
mesh_8 = Mesh(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)
mesh_9 = Mesh(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)  # disabled
col_11 = Colour(col_5)
col_12 = Colour(col)
mesh_10 = Mesh(mesh)
col_13 = Colour(col_2)
medges = MeshEdges(Mesh=mesh_10)  # -> NakedEdges, InteriorEdges, NonManifoldEdges
entwine = Entwine(Branch00=mesh_6, Branch01=mesh_7, Branch02=mesh_8, Branch03=mesh_9, FlattenInputs=True)
entwine_2 = Entwine(Branch00=col_11, Branch01=col_12, Branch02=col_13, FlattenInputs=True)
crv_5 = Curve(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)
crv_6 = Curve([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])
merge_11 = Merge(Data1=crv_6, Data2=flatten(medges.InteriorEdges))
constructattr = ConstructAttributes(Keys="material", Values=entwine_2)
join = JoinCurves(Curves=merge_11, Preserve=False)
injectattr = InjectAttributes(Object=entwine, Attributes=constructattr)
mesh_11 = Mesh(mesh_2)
col_14 = Colour(col_3)
mesh_12 = Mesh(mesh_3)
col_15 = Colour(col_4)
gltfdisplay = GlTF20Display(Geometry=injectattr)
gltfdisplay_2 = GlTF20Display(Geometry=join, Material=ColourSwatch(SwatchColor=RGB(0, 0, 0)))
twistedtower = GlTF20Display(Geometry=mesh_11, Material=col_14)
tapertower = GlTF20Display(Geometry=mesh_12, Material=col_15)

# ----
# Exports
saveastype = ValueList({"Sketchup2021", "Sketchup2020", "Sketchup2019", "Sketchup2018", "Sketchup2017", "Sketchup2016", "Sketchup2015", "Sketchup2014", "Sketchup2013", "Sketchup8", "Sketchup7", "Sketchup6", "Sketchup5", "Sketchup4", "Sketchup3"}, selected="Sketchup2021")
planarregionsaspolygons = BooleanToggle(False)
rhinoversion = ValueList({"6", "7", "8"}, selected="8")
mesh_13 = Mesh(flatten(mesh))
exportskp = SketchupExportOptions(
    SaveAsType=saveastype,
    ExportPlanarRegionsAsPolygons=planarregionsaspolygons,
    CullUnnecessaryVertices=True,
    MinimumFaceCount=2,
    N=False)
export3dm = _3dmExportOptions(Version=rhinoversion)
_3dmexport = DownloadExport(Data=mesh_13, Options=export3dm, Name="3dm_export")
skpexport = DownloadExport(Data=mesh_13, Options=exportskp, Name="skp_export")

# ==== cluster Cluster
curve = ClusterInput()
num = ClusterInput()
num_2 = ClusterInput()
int = ClusterInput()
curve_2 = Curve(curve)
num_3 = Number(num)
num_4 = Number(num_2)
int_2 = Integer(int)
subtraction = Subtraction(A=int_2, B=1)
series = Series(Start=0, Step=num_4, Count=int_2)
division = Division(A=num_3, B=subtraction)
series_2 = Series(Start=0, Step=division, Count=int_2)
vec = VectorXYZ(XComponent=0, YComponent=0, ZComponent=series)  # -> Vector, Length
rad = Radians(Degrees=series_2)
area = Area(Geometry=curve_2)  # -> Area, Centroid
move = Move(Geometry=curve_2, Motion=vec.Vector)  # -> Geometry, Transform
rotate = Rotate(Geometry=move.Geometry, Angle=rad, Plane=area.Centroid)  # -> Geometry, Transform
vec_2 = VectorXYZ(XComponent=0, YComponent=0, ZComponent=num_4)  # -> Vector, Length
extr = Extrude(Base=rotate.Geometry, Direction=vec_2.Vector)
cap = CapHoles(Brep=extr)
jagged = SettingsSpeed()
mesh = MeshBrep(Brep=cap, Settings=jagged)
multiplication = Multiplication(A=num_4, B=int_2)
item = ListItem(List=mesh, Index=0, Wrap=True)
volume = Volume(Geometry=item)  # -> Volume, Centroid
num_5 = Number(multiplication)
mesh_2 = Mesh(mesh)
num_6 = Number(volume.Volume)
totalheight = ClusterOutput(num_5)
mesh_3 = ClusterOutput(mesh_2)
edges = ClusterOutput(rotate.Geometry)
floorvolume = ClusterOutput(num_6)

# ==== cluster Cluster_2
int = ClusterInput()
num = ClusterInput()
int_2 = Integer(int)
num_2 = Number(num)
subtraction = Subtraction(A=int_2, B=1)
A = ClusterInput()
series = Series(Start=0, Step=num_2, Count=int_2)
division = Division(A=A, B=subtraction)
vec = VectorXYZ(XComponent=0, YComponent=0, ZComponent=series)  # -> Vector, Length
series_2 = Series(Start=1, Step=expr("-x", division), Count=int_2)
G = ClusterInput()
move = Move(Geometry=G, Motion=vec.Vector)  # -> Geometry, Transform
vec_2 = VectorXYZ(XComponent=0, YComponent=0, ZComponent=num_2)  # -> Vector, Length
scale_nu = ScaleNU(
    Geometry=move.Geometry,
    Plane=PlaneXY(2.447890131, -1.462963586, 4.505208333),
    ScaleX=series_2,
    ScaleY=series_2,
    ScaleZ=1)  # -> Geometry, Transform
extr = Extrude(Base=scale_nu.Geometry, Direction=vec_2.Vector)
cap = CapHoles(Brep=extr)
jagged = SettingsSpeed()
mesh = MeshBrep(Brep=cap, Settings=jagged)
M = ClusterOutput(mesh)
