# Grasshopper definition Webinar_2503_A_SpecklePavillion.ghx (Grasshopper 1.0.8)
# plug-ins: Speckle 2, Pufferfish, GrasshopperHyperGooComponents, ShapeDiverForGrasshopper, Mesh Pipe

planaritystrength = Slider(1, range=1..100)
max_curvature = Slider(0.05, range=0.01..0.1)
lengthfactor = Slider(1, range=0..1)
segments = Slider(8, range=4..10)
optimize = BooleanToggle(True)
render = BooleanToggle(True)
boundaryend = PointsInput(
    GridUnit=5,
    Mode="1",
    PlaneConstraint_plane=Plane(origin=(395, 90, 0), x=(0, 0, 1), y=(1, 0, 0)),
    DefaultValue_EdgeIndex=-1,
    DefaultValue_ON_Version=5)
boundarystart = PointsInput(
    GridUnit=5,
    Mode="1",
    PlaneConstraint_plane=Plane(origin=(395, 25, 0), x=(0, 0, 1), y=(1, 0, 0)),
    DefaultValue_EdgeIndex=-1,
    DefaultValue_ON_Version=5)
sddp = ShapeDiverDocumentPayload({AbsoluteTolerance=0, AngleTolerance=0, DistanceDisplayPrecision=0, GltfVersion="Gltf2", GrasshopperVersion="1.0.0008", InputGroups="{}", OutputGroups="{}", RelativeTolerance=0, RhinoVersion="8.20.25133.14001", UnitSystem=0, VersionCreated="1.23.0.0", VersionSaved="1.26.0.0"})
num = Number(max_curvature)
crv = Curve(boundarystart)
crv_2 = Curve(boundaryend)
int = Integer(segments)
num_2 = Number(lengthfactor)
bool = Boolean(optimize)
bool_2 = Boolean(render)
int_2 = Integer(planaritystrength)

crv_3 = Curve(crv)
crv_4 = Curve(crv_2)
int_3 = Integer(int)
cp = ControlPoints(Curve=crv_4)  # -> Points, Weights, Knots
cp_2 = ControlPoints(Curve=crv_3)  # -> Points, Weights, Knots
nurbs = NurbsCurve(Vertices=cp_2.Points, Degree=2, Periodic=False)  # -> Curve, Length, Domain
nurbs_2 = NurbsCurve(Vertices=cp.Points, Degree=2, Periodic=False)  # -> Curve, Length, Domain
multiplication = Multiplication(A=int_3, B=2)
reb = RebuildCurve(Curve=nurbs.Curve, Degree=1, Count=multiplication, Tangents=False)
reb_2 = RebuildCurve(Curve=nurbs_2.Curve, Degree=1, Count=multiplication, Tangents=False)
cp_3 = ControlPoints(Curve=reb_2)  # -> Points, Weights, Knots
cp_4 = ControlPoints(Curve=reb)  # -> Points, Weights, Knots
entwine = Entwine(Branch00=cp_4.Points, Branch01=cp_3.Points, FlattenInputs=True)
flip = FlipMatrix(Data=entwine)
item = ListItem(List=flip, Index=0, Wrap=True)
item_2 = ListItem(List=flip, Index=1, Wrap=True)
ln = Line(StartPoint=item, EndPoint=item_2)  # -> flatten(Line)
reb_3 = RebuildCurve(Curve=ln, Count=int_3, Tangents=False)
loftmesh = LoftMesh(Polylines=reb_3, ComputeUV=False, IsometricUV=False, UVSize=1)
mesh = Mesh(loftmesh)

mesh_2 = Mesh(mesh)
nv = NakedVertices(Mesh=mesh_2)  # -> ClothedIndex, NakedIndex, ClothedPts, NakedPts
devec = DeconstructVector(Vector=nv.NakedPts)  # -> XComponent, YComponent, ZComponent
devec_2 = DeconstructVector(Vector=nv.NakedPts)  # -> XComponent, YComponent, ZComponent
devec_3 = DeconstructVector(Vector=nv.NakedPts)  # -> XComponent, YComponent, ZComponent
equalst = EqualityWithinTolerance(FirstNumber=devec_3.ZComponent, SecondNumber="0", Tolerance=0.001)  # -> Equality, Inequality
equalst_2 = EqualityWithinTolerance(FirstNumber=devec_2.YComponent, SecondNumber="25", Tolerance=0.001)  # -> Equality, Inequality
equalst_3 = EqualityWithinTolerance(FirstNumber=devec.YComponent, SecondNumber="90", Tolerance=0.001)  # -> Equality, Inequality
p_n_c = PickNChoose(Pattern=equalst.Equality, Stream1=nv.NakedPts)
p_n_c_2 = PickNChoose(Pattern=equalst_2.Equality, Stream1=nv.NakedPts)
p_n_c_3 = PickNChoose(Pattern=equalst_3.Equality, Stream1=nv.NakedPts)
merge = Merge(Data1=p_n_c_2, Data2=p_n_c_3)
pt = Point(p_n_c)
pt_2 = Point(merge)

mesh_3 = Mesh(mesh)
pt_3 = Point(pt_2)
num_3 = Number(num_2)
int_4 = Integer(int_2)
pt_4 = Point(pt)
bool_3 = Boolean(bool)
edgelengths = EdgeLengths(Mesh=mesh_3, LengthFactor=num_3, Strength=1)
anchor = Anchor(Point=pt_3, Strength=10000)
planarize = Planarize(M=mesh_3, Strength=int_4)
onplane = OnPlane(Points=pt_4, Plane=PlaneXY(0, 0, 0), Strength=10000)
show = Show(G=mesh_3)
filter = StreamFilter(Gate=bool_3, Stream0="1", Stream1="50000")
merge_2 = Merge(Data1=show, Data2=planarize, Data3=anchor, Data4=edgelengths, Data5=onplane)
zombiesolver = ZombieSolver(GoalObjects=flatten(merge_2), Threshold=1e-10, Tolerance=0.0001, MaxIterations=filter)  # -> I, V, O
split = SplitList(List=zombiesolver.O, Index=1)  # -> ListA, ListB
lng = ListLength(List=planarize)
split_2 = SplitList(List=split.ListB, Index=lng)  # -> ListA, ListB
mesh_4 = Mesh(split.ListA)
num_4 = Number(split_2.ListA)

send = BooleanToggle(False)
speckle_stream = DirectTextInput(maxlength=10000)
num_5 = Number(num)

mesh_5 = Mesh(mesh_4)
num_6 = Number(num_4)
demesh = DeconstructMesh(Mesh=mesh_5)  # -> Vertices, Faces, Colours, Normals
medges = MeshEdges(Mesh=mesh_5)  # -> NakedEdges, InteriorEdges, NonManifoldEdges
gradient = Gradient(LowerLimit=0, UpperLimit=num_5, Parameter=num_6, stops=[0: RGB(0, 128, 0), 0.5: RGB(255, 255, 0), 1: RGB(255, 0, 0)])
deface = DeconstructFace(Face=graft(demesh.Faces))  # -> CornerA, CornerB, CornerC, CornerD
mpipe = MeshPipe(
    Curve=[medges.NakedEdges, medges.InteriorEdges, medges.NonManifoldEdges],
    Radius=0.5,
    Accuracy=0.2,
    Rotation=0,
    Segments=10,
    Caps=2)
item_3 = ListItem(List=demesh.Vertices, Index=simplify([deface.CornerA, deface.CornerB, deface.CornerC, deface.CornerD]), Wrap=True)
mjoin = MeshJoin(Meshes=mpipe)
col = Colour(simplify(graft(gradient)))
dup = DuplicateData(Data=col, Number=4, Order=True)  # -> simplify(Data)
conmesh = ConstructMesh(Vertices=item_3, Faces={A=0, B=1, C=2, D=3}, Colours=dup)  # -> flatten(Mesh)
mesh_6 = Mesh(mjoin)
mesh_7 = Mesh(conmesh)

secretinput = SecretInput()
createmodelstate = CreateModelStateAction()
buildings = ColourSwatch(SwatchColor=RGB(243, 191, 255))
roads = ColourSwatch(SwatchColor=RGB(255, 251, 133))
actionswidget = ActionsWidget(Actions=createmodelstate)

gltf2material = GlTF20Material(
    BaseColorFactor=buildings,
    MetallicFactor=0,
    RoughnessFactor=1,
    EmissiveFactor=RGB(0, 0, 0),
    AlphaMode="OPAQUE",
    AlphaCutoff=0.5,
    DoubleSided=True)
gltf2material_2 = GlTF20Material(
    BaseColorFactor=roads,
    MetallicFactor=0,
    RoughnessFactor=1,
    EmissiveFactor=RGB(0, 0, 0),
    AlphaMode="OPAQUE",
    AlphaCutoff=0.5,
    DoubleSided=True)
constructattr = ConstructAttributes(Keys="material", Values=gltf2material)
constructattr_2 = ConstructAttributes(Keys="material", Values=gltf2material_2)
mesh_8 = Mesh([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])
mesh_9 = Mesh([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])
injectattr = InjectAttributes(Object=mesh_9, Attributes=constructattr_2)
injectattr_2 = InjectAttributes(Object=mesh_8, Attributes=constructattr)
merge_3 = Merge(Data1=injectattr_2, Data2=injectattr)

num_7 = Number(num_4)
int_5 = Integer(int)
num_8 = Number(num)
py3 = Python3Script(pts=num_7, n=int_5, maxc=num_8)  # -> out, a; inputs pts: list of Double, n: Int32, maxc: Double
# ---------- py3: Python ----------
import plotly.express as px
import plotly.io as pio
import plotly.graph_objects as go
import numpy as np

# Convert nested list to a NumPy 2D array
array_2d = np.array(pts).reshape(2*n-1,n-1)

# Create heatmap with gaps
fig = go.Figure(data=go.Heatmap(
    z=array_2d,
    colorscale='RdYlGn_r',
    zmin=0, zmax=maxc,
    xgap=1,  # Horizontal spacing between tiles
    ygap=1,  # Vertical spacing between tiles
    showscale=True,  # Keep the color legend,
    colorbar_x=0.6  # Move colorbar closer (default is 1.02)
))

# Hide axis for a clean look
fig.update_layout(
    xaxis=dict(showgrid=False, zeroline=False, showticklabels=False, scaleanchor="y", domain=[0.0, 0.6]),
    yaxis=dict(showgrid=False, zeroline=False, showticklabels=False),
    margin=dict(l=5, r=5, t=5, b=5),  # Reduce extra white space
    paper_bgcolor='rgba(0,0,0,0)',  # Transparent background
    plot_bgcolor='rgba(0,0,0,0)'  # Transparent plot background
)

# Export the figure as SVG (returns a byte string)
svg_bytes = pio.to_image(fig, format='svg', width=250, height=320)

# Convert the byte string to a regular string (if needed)
svg_string = svg_bytes.decode('utf-8')

a=svg_string
# ---------- end py3 ----------
exportstream = StreamExportOptions(ContentType="svg,image/svg+xml", N=False)

# ---- group: Display
metal = ColourSwatch(SwatchColor=RGB(130, 130, 130))
bool_4 = Boolean(bool_2)
mesh_10 = Mesh(mesh_7)
mesh_11 = Mesh(mesh_4)
mesh_12 = Mesh(mesh_6)
presetmaterial = PresetMaterial(Color=RGB(255, 255, 255), MaterialIndex="400")
presetmaterial_2 = PresetMaterial(Color=metal, MaterialIndex="300")
filter_2 = StreamFilter(Gate=bool_4, Stream0=mesh_10)
filter_3 = StreamFilter(Gate=bool_4, Stream1=mesh_11)
filter_4 = StreamFilter(Gate=bool_4, Stream1=mesh_12)

# ----
# Send geometry to Speckle Stream
mesh_13 = Mesh(mesh_12)
len = TextLength(Text=speckle_stream)
larger = LargerThan(FirstNumber=len, SecondNumber=0)  # -> LargerThan, OrEqualTo
bool_5 = Boolean(larger.LargerThan)
filter_5 = StreamFilter(Gate=larger.LargerThan, Stream1=speckle_stream)
sgetwt = StreamGetWithToken(Stream=filter_5, AuthToken=secretinput)
filter_6 = StreamFilter(Gate=send, Stream1=sgetwt)
panel = Panel(""":span[**Successful export!**]{color="green"}

> Find it at the following """)
ss = SynchronousSender(
    Data=mesh_13,
    Stream=filter_6,
    OutputWrappers="https://app.speckle.systems\t7204dbd706\t25f8825759",
    UseDefaultCache=True,
    selectedKitName="Objects")
concat = Concatenate(FragmentA="**[version url](", FragmentB=ss, FragmentC=")**.")
concat_2 = Concatenate(FragmentA=panel, FragmentB=concat)
filter_7 = StreamFilter(Gate=send, Stream0="Data not sent", Stream1=concat_2)
txt = Text(filter_7)
result = DirectDataOutput(Data=txt)

bool_6 = Boolean(bool_5)
sddp_2 = ShapeDiverDocumentPayload({AbsoluteTolerance=0, AngleTolerance=0, DistanceDisplayPrecision=0, GltfVersion="Gltf2", GrasshopperVersion="1.0.0008", InputGroups="{}", OutputGroups="{}", RelativeTolerance=0, RhinoVersion="8.20.25133.14001", UnitSystem=0, VersionCreated="1.22.0.0", VersionSaved="1.26.0.0"})
mesh_14 = Mesh(filter_2)
environment = GlTF20Display(Geometry=merge_3)
gltfdisplay = GlTF20Display(Geometry=filter_3, Material=presetmaterial)
gltfdisplay_2 = GlTF20Display(Geometry=filter_4, Material=presetmaterial_2)
heatmap = DownloadExport(Data=py3.a, Options=exportstream, Name="test")

bool_7 = Boolean(bool)
txt_2 = Text(txt)
merge_4 = Merge(Data1="LengthFactor", Data2="PlanarityStrength")
panel_2 = Panel("""## Send your design to Speckle

Enter the url of your stream below and press send to synchronize your data.""")
filter_8 = StreamFilter(Gate=bool_7, Stream1=merge_4)
merge_5 = Merge(Data1="BoundaryStart", Data2="BoundaryEnd", Data3="Optimize", Data4=filter_8)
imagewidget = ImageWidget(ExportName="Heatmap")
paramwidget = ParameterWidget(ParametersAndExports="Max Curvature", PreserveOrdering=True)
textwidget = TextWidget(Text="## Curvature Heatmap")
textwidget_2 = TextWidget(Text=panel_2)
textwidget_3 = TextWidget(Text=txt_2)  # -> flatten(Widget)
paramwidget_2 = ParameterWidget(ParametersAndExports=merge_5, PreserveOrdering=True)
merge_6 = Merge(Data1=textwidget, Data2=imagewidget, Data3=paramwidget)

filter_9 = StreamFilter(Gate=bool_6, Stream1="Send")
merge_7 = Merge(Data1="Speckle Stream", Data2=filter_9)  # -> flatten(Result)
merge_8 = Merge(Data1=paramwidget_2, Data2=actionswidget)
tab = Tab(Name="Analysis", Widgets=merge_6)

paramwidget_3 = ParameterWidget(ParametersAndExports=merge_7, PreserveOrdering=True)
merge_9 = Merge(Data1=textwidget_2, Data2=paramwidget_3, Data3=textwidget_3)  # -> flatten(Result)
tab_2 = Tab(Name="Speckle", Widgets=merge_9)
tab_3 = Tab(Name="Design parameters", Widgets=merge_8)
container = Container(Name="left", Tabs=tab_3)

merge_10 = Merge(Data1=tab, Data2=tab_2)

container_2 = Container(Name="right", Tabs=merge_10)
merge_11 = Merge(Data1=container, Data2=container_2)

app = App(Containers=merge_11)
