# Grasshopper definition Webinar_2503_B_ShopifyWorkflow.ghx (Grasshopper 1.0.8)
# plug-ins: jSwan, Heteroptera, MeshEdit Components, treesloth01, Pufferfish, ClipperComponents, MetaHopper, GrasshopperHyperGooComponents, ShapeDiverForGrasshopper, Wombat

# ----
# LEGEND
# All sliders, value lists, colors, ShapeDiver inputs (e.g. "SDTextInput"), etc. that will be available in
# the ShapeDiver platform as parameters or have the potential of becoming available (e.g. Panels
# with hardcoded data that can not be access directly in ShapeDiver).
# Parameters
# Basic Groups
# The Grasshopper definition should be built in small groups, "Basic Groups", with very specific tasks.
# Each "Basic Group" should have "Inputs", "Outputs", a title and an optional description if necessary.
# Inputs
# All data that goes inside a "Basic Group".
# NO DATA should go inside a "Basic Group" from any other area but the "Inputs".
# Outputs
# All data that goes outside a "Basic Group".
# NO DATA should go outside a "Basic Group" from any other area but the "Outputs".
# Exports /
# Data Outputs
# Contains the data that will be available via the ShapeDiver platform or API.
# Data is sent via the ShapeDiver outputs components (e.g. "SDExportDownload").
# This may also contain basic exports pre processing (e.g. "SDPropertiesExport").
# Contains the "SDDisplayGeometry" components or any geometry that has preview on.
# This is the geometry that will be visible in the ShapeDiver viewer.
# This may also contain simple material creation.
# Display
# Contains any components that are used just for local testing but need to be
# removed before uploading to ShapeDiver (e.g. Components that bake geometry in Rhino,
# C# scripts that affect the Rhino document or store data in the local machine,
# unsupported ShapeDiver plugins, etc.).
# Local Testing
# Ready to
# Organize
# Add all definition sections that are finsihed but still need to be organized.
# In Progress /
# To Implement /
# To Improve
# Add all definition groups that are still not ready.
# These sections need to be implemented, are still being tested or not finished.
# They also involve potential improvements.
data = Data()
data_2 = Data()
data_3 = Data()
data_4 = Data()
data_5 = Data()
data_6 = Data()
data_7 = Data()
data_8 = Data()
data_9 = Data()

# ---- group: Head
elevate_gallery_rail = Slider(1, range=0..1.5)
head_stone_shape = ValueList({"Round": 0, "Emerald": 1, "Heart": 2}, selected="Round")
prongs_style = ValueList({"No Prongs": 0, "Straight": 1, "Crossed": 2}, selected="Crossed")
head_stone_size = Slider(3, range=2..5)
gallery_rail = Mesh(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)
diamond_shape = Integer(head_stone_shape)
larger_than = LargerThan(FirstNumber=elevate_gallery_rail, SecondNumber=0.5)  # -> LargerThan, OrEqualTo
equals = Equality(FirstNumber=prongs_style, SecondNumber=2)  # -> Equality, Inequality
scale = Scale(Geometry=gallery_rail, Center=Point(0, 0, 0), Factor=head_stone_size)  # -> Geometry, Transform
cross_prongs = GateAnd(A=larger_than.OrEqualTo, B=equals.Equality)
gallery_rail_2 = BoundingRectangle(Geometry=scale.Geometry, Plane=PlaneXZ(0, 0, 0), Axis=0, Slide=0, Union=True)  # -> Bounding, flatten(DimensionX), flatten(DimensionY)

# ---- group: Materials
center_shank_metal = ValueList({"14k Yellow Gold", "18k Yellow Gold", "14k White Gold", "18k White Gold", "14k Rose Gold", "18k Rose Gold", "Platinum"}, selected="14k Yellow Gold")
side_shank_metal = ValueList({"14k Yellow Gold", "18k Yellow Gold", "14k White Gold", "18k White Gold", "14k Rose Gold", "18k Rose Gold", "Platinum"}, selected="14k Yellow Gold")
accent_stones = ValueList({"Diamond", "Blue Sapphire", "Emerald", "Ruby"}, selected="Diamond")
head_stone = ValueList({"Diamond", "Blue Sapphire", "Emerald", "Ruby"}, selected="Diamond")
materials_database_url = DirectTextInput(maxlength=10000, text="https://sdr8euc1externalgeometry.s3.eu-central-1.amazonaws.com/cdpeacock/materials_database.json")
materials_sections_names = Panel("""headstone
shankcenter
shankside
sidestones""")
merge = Merge(Data1=head_stone, Data2=center_shank_metal, Data3=side_shank_metal, Data4=accent_stones)
material_database = ImportText(
    URI=materials_database_url,
    maximum_file_size=52428800,
    selected_file_formats="application/json,application/xml,application/x-step,text/csv,text/plain")  # -> Text, Filename
selected_materials = Text(merge)

# ---- group: Shank
base_section_segments = Slider(30, range=0..100)
shank_diameter = Slider(10, range=10..20)
center_shank_thickness = Slider(1, range=0.5..1.5)
side_shank_thickness = Slider(0.5, range=0.5..1.5)
price_per_gram = Slider(65, range=0..100)
add_accent_stones = BooleanToggle(True)
division = Division(A=shank_diameter, B=2)
base_section = Polygon(Plane=PlaneXY(0, 0, 0), Radius=0.5, Segments=base_section_segments, FilletRadius=0)  # -> Polygon, Length
shank_radius = Number(division)

# ---- group: Exports
watertight_mesh_edge_length = Slider(0.01, range=0.01..1)
watertight_mesh_file_format = ValueList({"3DM": 0, "STL": 1, "OBJ": 2}, selected="STL")
process_watertight_mesh = BooleanToggle(False)
admin_mode = BooleanToggle(False)
receiver_email_of_watertight_mesh = DirectTextInput(maxlength=10000)

# ---- group: Rails and Head / Create Center Shank Rail
shank_radius_2 = Number(shank_radius)
gallery_rail_width = Number(gallery_rail_2.DimensionX)
side_shank_thickness_2 = Number(side_shank_thickness)
extend_main_diamond_base = Number(elevate_gallery_rail)

# ---- group: Rails and Head / Create Side Shank Rail
center_shank_thickness_2 = Number(center_shank_thickness)
cross_prongs_2 = Boolean(cross_prongs)
gallery_rail_width_2 = Number(gallery_rail_2.DimensionX)
side_shank_thickness_3 = Number(side_shank_thickness)
shank_radius_3 = Number(shank_radius)

# ---- group: Create Ring Description
connected = GetConnectedObjects(Objects=[head_stone_shape, prongs_style])
shank_diameter_2 = Number(shank_diameter)

# ---- group: Output WebGi Materials
material_database_text = Text(material_database.Text)
selected_materials_2 = Text(selected_materials)
materials_sections_names_2 = Text(materials_sections_names)

# ---- group: Rails and Head / Create Center Shank Rail
division_2 = Division(A=gallery_rail_width, B=-2)
division_3 = Division(A=side_shank_thickness_2, B=-2)
subtraction = Subtraction(A=division_2, B=division_3)
X = UnitX(Factor=subtraction)
arc = Arc(Plane=Plane(origin=(0, 0, 0), x=(0, 0, 1), y=(-1, 0, 0)), Radius=shank_radius_2, Angle=Domain(0, 3.141592654))  # -> Arc, Length
line = LineSDL(Start=X, Direction=Vector(0, 0, 1), Length=1)
clx = CurveLine(Curve=arc.Arc, Line=line, LimitFirst=True)  # -> Points, Params, Count
Z = UnitZ(Factor=extend_main_diamond_base)
move = Move(Geometry=clx.Points, Motion=Z)  # -> Geometry, Transform
ptstrimcrv = PointsTrimCurve(Curve=arc.Arc, Parameters=clx.Params, Flip=True)  # -> flatten(Trimmed), SubDomains, Intersected
rebcrv = RebuildCurve(Curve=ptstrimcrv.Trimmed, Degree=8, EndTangents=False)
center_shank = RelocateCurveEnds(Curve=reparameterize(rebcrv), Start=move.Geometry)

# ---- group: Rails and Head / Set Up Head
diamond_shape_2 = Integer(diamond_shape)
round_diamond = Mesh(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)
emerald_diamond = Mesh(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)
gallery_rail_3 = Mesh(scale.Geometry)
heart_diamond = Mesh(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)
stone_size = Number(head_stone_size)
center_shank_rail = Curve(center_shank)

curvepoint = PointOnCurve(center_shank_rail, parameter=0)
filter = StreamFilter(Gate=diamond_shape_2, Stream0=round_diamond, Stream1=emerald_diamond, Stream2=heart_diamond)
pt2num = PointsToNumbers(Points=curvepoint, Mask=11)  # -> flatten(Numbers)
scale_2 = Scale(Geometry=filter, Center=Point(0, 0, 0), Factor=stone_size)  # -> Geometry, Transform
merge_2 = Merge(Data1=scale_2.Geometry, Data2=gallery_rail_3)
Z_2 = UnitZ(Factor=pt2num)
move_2 = Move(Geometry=merge_2, Motion=Z_2)  # -> Geometry, Transform
head_mesh = Mesh(move_2.Geometry)

# ---- group: Rails and Head / Create Prongs Rail
head_mesh_2 = Mesh(graft(head_mesh))
prongs_style_2 = Integer(prongs_style)
side_shank_thickness_4 = Number(side_shank_thickness)
cross_prongs_3 = Boolean(cross_prongs)

bool = Boolean(prongs_style_2)
filter_2 = StreamFilter(Gate=bool, Stream1=head_mesh_2)
division_4 = Division(A=side_shank_thickness_4, B=3)
division_5 = Division(A=side_shank_thickness_4, B=-2)
panel = Panel("""0.75
0.5""")
brec = BoundingRectangle(Geometry=filter_2, Plane=PlaneXY(0, 0, 0), Axis=0, Slide=graft(panel), Union=True)  # -> Bounding, DimensionX, DimensionY
sec = MeshPlane(Mesh=filter_2, Plane=brec.Bounding)
eval = EvaluateCurve(Curve=brec.Bounding, Parameter=cross_prongs_3)  # -> Point, Tangent, Angle
item = ListItem(List=sec, Index=0, Wrap=True)
division_6 = Division(A=eval.Angle, B=2)
vrot = Rotate(Vector=eval.Tangent, Axis=Vector(0, 0, 1), Angle=division_6)
polyoffset = PolylineOffset(Polylines=item, Distance=division_4, Plane=brec.Bounding, Tolerance=0.001, ClosedFillet=1, OpenFillet=1, Miter=2)  # -> Contour, Holes
line_2 = LineSDL(Start=eval.Point, Direction=vrot, Length=1)
clx_2 = CurveLine(Curve=polyoffset.Contour, Line=line_2, LimitFirst=False)  # -> Points, Params, Count
dist = Distance(PointA=clx_2.Points, PointB=eval.Point)
sort = SortList(Keys=dist, ValuesA=clx_2.Points)  # -> Keys, ValuesA
item_2 = ListItem(List=sort.ValuesA, Index=0, Wrap=True)
item_3 = ListItem(List=flatten(item_2), Index=0, Wrap=True)  # -> Item, Item1
brec_2 = BoundingRectangle(Geometry=flatten(filter_2), Plane=PlaneXY(0, 0, 0), Axis=0, Slide=1, Union=True)  # -> Bounding, DimensionX, DimensionY
vec2pt = Vector2Pt(PointA=item_3.Item, PointB=item_3.Item1, Unitize=True)  # -> Vector, Length
projecta = ProjectAlong(Geometry=item_3.Item, Plane=brec_2.Bounding, Direction=vec2pt.Vector)  # -> Geometry, Transform
ln = Line(StartPoint=projecta.Geometry, EndPoint=item_3.Item1)
prongs = ExtendCurve(Curve=ln, Type=0, Start=division_5, End=0)

# ---- group: Rails and Head / Create Side Shank Rail
division_7 = Division(A=center_shank_thickness_2, B=-2)
x_plus_one = XPlusOne(NumberX=cross_prongs_2)
addition = Addition(A=shank_radius_3, B=division_7)
division_8 = Division(A=gallery_rail_width_2, B=-1.5)
division_9 = Division(A=side_shank_thickness_3, B=-2)
arc_2 = Arc(Plane=Plane(origin=(0, 0, 0), x=(0, 0, 1), y=(-1, 0, 0)), Radius=addition, Angle=Domain(0, 3.141592654))  # -> Arc, Length
multiplication = Multiplication(A=division_9, B=x_plus_one)
Y = UnitY(Factor=division_7)
move_3 = Move(Geometry=arc_2.Arc, Motion=Y)  # -> Geometry, Transform
filter_3 = StreamFilter(Gate=cross_prongs_2, Stream0=division_8, Stream1=division_9)
rebcrv_2 = RebuildCurve(Curve=move_3.Geometry, Count=6, EndTangents=False)
merge_3 = Merge(Data1=division_9, Data2=multiplication)
ext = ExtendCurve(Curve=rebcrv_2, Type=0, Start=filter_3, End=0)
sddp = ShapeDiverDocumentPayload({AbsoluteTolerance=0, AngleTolerance=0, DistanceDisplayPrecision=0, GltfVersion="Gltf2", GrasshopperVersion="1.0.0008", InputGroups="{}", OutputGroups="{}", RelativeTolerance=0, RhinoVersion="8.20.25133.14001", UnitSystem=0, VersionCreated="1.21.0.0", VersionSaved="1.26.0.0"})
curvepoint_2 = PointOnCurve(ext, parameter=0)
Y_2 = UnitY(Factor=merge_3)
addition_2 = Addition(A=curvepoint_2, B=Y_2)
changecurveends = CSharpScript(crv=ext, pntStart=addition_2)  # -> out, A; inputs crv: Curve
# ---------- changecurveends: C# ----------
    //if nothing was provided, return the original curve
    if(pntStart == null && vecStart == null && pntEnd == null && vecEnd == null){
      A = crv;
      return;
    }

    //convert curve into nurbs curve to be able to edit the ends
    NurbsCurve crvNurbs = (NurbsCurve) crv;

    //check if we need to change anything in the start of the curve
    if(pntStart != null || vecStart != null){

      //check which data was provided. If data is not provided, use the original data from curve
      Point3d _pntStart = pntStart == null ? crv.PointAtStart : (Point3d) pntStart;
      Vector3d _vecStart = vecStart == null ? crv.TangentAtStart : (Vector3d) vecStart;
      _vecStart.Unitize();

      //change start of curve
      crvNurbs.SetEndCondition(false, NurbsCurve.NurbsCurveEndConditionType.Tangency, _pntStart, _vecStart);
    }

    //check if we need to change anything in the end of the curve
    if(pntEnd != null || vecEnd != null){

      //check which data was provided. If data is not provided, use the original data from curve
      Point3d _pntEnd = pntEnd == null ? crv.PointAtEnd : (Point3d) pntEnd;
      Vector3d _vecEnd = vecEnd == null ? crv.TangentAtEnd : (Vector3d) vecEnd;
      _vecEnd.Unitize();

      //change end of curve
      crvNurbs.SetEndCondition(true, NurbsCurve.NurbsCurveEndConditionType.Tangency, _pntEnd, _vecEnd);
    }

    A = crvNurbs;
# ---------- end changecurveends ----------
shank_side_rail = Curve(changecurveends.A)

# ---- group: Output WebGi Materials
dejsonkv = DeserializeKeysAndValues(JSON=material_database_text)  # -> Key, Value
standarize_text = StandarizeText(T=dejsonkv.Key)
standarize_text_2 = StandarizeText(T=selected_materials_2)
mindex = MemberIndex(Set=standarize_text, Member=standarize_text_2)  # -> Index, Count
item_4 = ListItem(List=dejsonkv.Value, Index=mindex.Index, Wrap=True)
nulls_in_empty = NullsInEmptyBranches(DataWithEmptyBranches=item_4)
clean = CleanTree(
    RemoveNulls=True,
    RemoveInvalid=True,
    RemoveEmpty=False,
    Tree=flatten(nulls_in_empty),
    SynchronousTree1=materials_sections_names_2)  # -> Tree, SynchronousTree1
rejsonkv = SerializeKeysAndValues(Key=clean.SynchronousTree1, Value=clean.Tree)
materials = ParseJSON(JSON=rejsonkv)
materialdatabase = DirectDataOutput(Data=materials)

# ---- group: Create Ring Description
listdata = GetListData(ObjectToSet=connected)  # -> NickName, Keys, Values, SelectedIndex
item_5 = ListItem(List=listdata.Keys, Index=listdata.SelectedIndex, Wrap=True)  # -> flatten(Item)
item_6 = ListItem(List=item_5, Index=0, Wrap=True)  # -> Item, Item1
ring = Concatenate(
    FragmentE=shank_diameter_2,
    FragmentF="mm ⌀ ",
    FragmentA=item_6.Item,
    FragmentB=" Head Stone ",
    FragmentC=item_6.Item1,
    FragmentD=" Prongs Custom Ring")

# ---- group: Meshes / Create Center Shank Mesh
center_shank_rail_2 = Curve(center_shank)
base_section_polygon = Curve(base_section.Polygon)
side_shank_thickness_5 = Number(side_shank_thickness)
center_shank_thickness_3 = Number(center_shank_thickness)

# ---- group: Meshes / Create Side Shank Mesh
base_section_polygon_2 = Curve(base_section.Polygon)
side_shank_thickness_6 = Number(side_shank_thickness)
prongs_curve = Curve(prongs)
shank_side_rail_2 = Curve(shank_side_rail)
base_section_segments_2 = Integer(base_section_segments)

long = LongestList(ListA=prongs_curve, ListB=graft(shank_side_rail_2), PaddingMode=2)  # -> ListA, ListB
division_10 = Division(A=side_shank_thickness_6, B=2)
merge_4 = Merge(Data1=long.ListA, Data2=long.ListB)
msphere = MeshSphere(Base=PlaneXY(0, 0, 0), Radius=division_10, UCount=10, VCount=base_section_segments_2)
connect = ConnectCurves(Curves=merge_4, Continuity=2, Close=False, Bulge=0.5)  # -> flatten(Curve)
item_7 = ListItem(List=connect, Index=0, Wrap=True)  # -> Item, Item1
mirror = Mirror(Geometry=item_7.Item1, Plane=PlaneYZ(0, 0, 0))  # -> Geometry, Transform
merge_5 = Merge(Data1=item_7.Item, Data2=mirror.Geometry)
join = JoinCurves(Curves=merge_5, Preserve=False)
cluster = CenterShank(section=base_section_polygon_2, start_thickness=side_shank_thickness_6, end_thickness=side_shank_thickness_6, rail=join)  # -> wireframe, M, sections_size, pl_2
item_8 = ListItem(List=cluster.pl_2, Index=0, Wrap=True)  # -> Item1, Item
pflip = FlipPlane(Plane=item_8.Item1, ReverseX=False, ReverseY=True, SwapAxes=False)
plntrimmsh = PlaneTrimMesh(Mesh=msphere, Plane=PlaneXY(0, 0, 0), Flip=False, TrimType=1)  # -> Trimmed, Intersected
merge_6 = Merge(Data1=pflip, Data2=item_8.Item)
orient = Orient(Geometry=plntrimmsh.Trimmed, Source=PlaneXY(0, 0, 0), Target=merge_6)  # -> Geometry, Transform
merge_7 = Merge(Data1=cluster.M, Data2=orient.Geometry)
mjoin = MeshJoin(Meshes=merge_7)
alignvert = AlignVertices(Mesh=mjoin, Tolerance=0.01)  # -> Result, Count
mirror_2 = Mirror(Plane=PlaneXZ(0, 0, 0))  # -> Geometry, Transform
zerotran = ZeroedTransform()
weld = WeldMesh(Mesh=alignvert.Result, Angle=3.141592654)
merge_8 = Merge(Data1=zerotran, Data2=mirror_2.Transform)
attachtransform = AttachTransformations(Geometry=weld, Transform=merge_8)
side_shank = Mesh(attachtransform)

# ---- group: Meshes / Create Center Shank Mesh
center_shank_2 = CenterShank(
    section=base_section_polygon,
    start_thickness=side_shank_thickness_5,
    end_thickness=center_shank_thickness_3,
    rail=center_shank_rail_2)  # -> wireframe, M, sections_size, pl_2
item_9 = ListItem(List=center_shank_2.wireframe, Index=0, Wrap=True)
pline2msh = PolylineToMesh(Polyline=item_9, Quadrangulate=True)
merge_9 = Merge(Data1=pline2msh, Data2=center_shank_2.M)
mirror_3 = Mirror(Geometry=merge_9, Plane=PlaneYZ(0, 0, 0))  # -> Geometry, Transform
merge_10 = Merge(Data1=merge_9, Data2=mirror_3.Geometry)
mjoin_2 = MeshJoin(Meshes=merge_10)
alignvert_2 = AlignVertices(Mesh=mjoin_2, Tolerance=0.01)  # -> Result, Count

center_shank_3 = WeldMesh(Mesh=alignvert_2.Result, Angle=3.141592654)
center_shank_section_sizes = Number(center_shank_2.sections_size)
center_shank_planes = Plane(center_shank_2.pl_2)

# ---- group: Accent Stones / Calculate accent stones base
shank_side_rail_3 = Curve(shank_side_rail)
center_shank_sz = Number(center_shank_section_sizes)
side_shank_thickness_7 = Number(side_shank_thickness)
add_accent_stones_2 = Boolean(add_accent_stones)
center_shank_pl = Plane(center_shank_planes)

# ---- group: Calculate metal price
price_per_gram_2 = Number(price_per_gram)

# ---- group: UI
panel_2 = Panel("""Shank Diameter
Center Shank Thickness
Side Shank Thickness
Add Accent Stones
Head Stone Size
Head Stone Shape
Elevate Gallery Rail
Prongs Style
Center Shank Metal
Side Shank Metal
Head Stone""")
agent_context = Panel("The app allows to configure a diamond ring. The head stone has three options, Round = 0, Emerald = 1, Heart   = 2")
panel_3 = Panel("""Watertight Mesh File Format
Receiver Email of Watertight Mesh""")
panel_4 = Panel("""Process Watertight Mesh
Watertight Mesh Edge Length""")
panel_5 = Panel("""Download Watertight Mesh
Email Watertight Mesh""")
panel_6 = Panel("Accent Stones")
add_accent_stones_3 = Boolean(add_accent_stones)
ring_description = Text(ring)
process_watertight_mesh_2 = Boolean(process_watertight_mesh)
admin_mode_2 = Boolean(admin_mode)

filter_4 = StreamFilter(Gate=add_accent_stones_3, Stream1=panel_6)
and = GateAnd(A=admin_mode_2, B=process_watertight_mesh_2)
rejson = SerializeJson(Context=agent_context, IncludeNullAndEmptyProperties=False)
merge_11 = Merge(Data1=panel_2, Data2=filter_4)
filter_5 = StreamFilter(Gate=and, Stream1=panel_3)
filter_6 = StreamFilter(Gate=and, Stream1=panel_5)
merge_12 = Merge(Data1=panel_4, Data2=filter_5)
rejson_2 = SerializeJson(Type="agent", Props=rejson, IncludeNullAndEmptyProperties=False)
createmodelstate = CreateModelStateAction(Label="Share link")
paramwidget = ParameterWidget(ParametersAndExports=merge_11, PreserveOrdering=True)
filter_7 = StreamFilter(Gate=admin_mode_2, Stream1=merge_12)
paramref = ParameterReference(Name=filter_7, GroupName="Exports")
exportref = ExportReference(Name=filter_6, GroupName="Exports")
merge_13 = Merge(Data1=paramref, Data2=exportref)
paramwidget_2 = ParameterWidget(ParametersAndExports=merge_13, PreserveOrdering=True)
filter_8 = StreamFilter(Gate=admin_mode_2, Stream1=paramwidget_2)

# ---- group: Accent Stones / Calculate accent stones base
filter_9 = StreamFilter(Gate=add_accent_stones_2, Stream1=shank_side_rail_3)
filter_10 = StreamFilter(Gate=add_accent_stones_2, Stream1=center_shank_pl)
filter_11 = StreamFilter(Gate=add_accent_stones_2, Stream1=center_shank_sz)
division_11 = Division(A=side_shank_thickness_7, B=2)
deplane = DeconstructPlane(Plane=filter_10)  # -> Origin, XAxis, YAxis, ZAxis
division_12 = Division(A=filter_11, B=3)
division_13 = Division(A=filter_11, B=-2)
ext_2 = ExtendCurve(Curve=filter_9, Type=0, Start=division_11, End=0)
amp = Amplitude(Vector=deplane.YAxis, Amplitude=division_12)
Y_3 = UnitY(Factor=division_13)
addition_3 = Addition(A=deplane.Origin, B=amp, C=Y_3)
neg = Negative(Value=division_11)
offset_l = OffsetCurveLoose(Curve=ext_2, Distance=division_11, Plane=PlaneXZ(0, 0, 0))
Y_4 = UnitY(Factor=neg)
move_4 = Move(Geometry=offset_l, Motion=Y_4)  # -> Geometry, Transform
intcrv = Interpolate(Vertices=addition_3, Degree=3, Periodic=False, KnotStyle=1)  # -> Curve, Length, Domain
neg_2 = Negative(Value=side_shank_thickness_7)
ext_3 = ExtendCurve(Curve=intcrv.Curve, Type=0, Start=neg_2, End=0)
plntrimcrv = PlaneTrimCurve(Curve=move_4.Geometry, Plane=PlaneXY(0, 0, 0), Flip=False)  # -> Trimmed, Parameters, Intersected
plntrimcrv_2 = PlaneTrimCurve(Curve=ext_3, Plane=PlaneXY(0, 0, 0), Flip=False)  # -> Trimmed, Parameters, Intersected
curvepoint_3 = PointOnCurve(plntrimcrv_2.Trimmed, parameter=0)
curvepoint_4 = PointOnCurve(plntrimcrv.Trimmed, parameter=0)
crv_cp = CurveClosestPoint(Point=curvepoint_3, Curve=plntrimcrv.Trimmed)  # -> Point, Parameter, Distance
crv_cp_2 = CurveClosestPoint(Point=curvepoint_4, Curve=plntrimcrv_2.Trimmed)  # -> Point, Parameter, Distance
ptstrimcrv_2 = PointsTrimCurve(Curve=plntrimcrv.Trimmed, Parameters=crv_cp.Parameter, Flip=True)  # -> flatten(Trimmed), SubDomains, Intersected
ptstrimcrv_3 = PointsTrimCurve(Curve=plntrimcrv_2.Trimmed, Parameters=crv_cp_2.Parameter, Flip=True)  # -> flatten(Trimmed), SubDomains, Intersected
gap_between_stones = Number(0.1)
ext_4 = ExtendCurve(Curve=ptstrimcrv_2.Trimmed, Type=2, Start=gap_between_stones, End=0)
ext_5 = ExtendCurve(Curve=ptstrimcrv_3.Trimmed, Type=2, Start=gap_between_stones, End=0)
packcirclesalongtwopaths = PackCirclesAlongTwoPaths(crva=ext_4, crvb=ext_5, gap=gap_between_stones, distribute=True, tolerance=0.01)

# ---- group: Accent Stones / Calculate accent stones base / Circles have to be at least 1mm for the basket and stone
darc = DeconstructArc(Arc=packcirclesalongtwopaths)  # -> BasePlane, Radius, Angle
roundd = RoundToDecimalPlace(NumberX=darc.Radius, DecimalPlace=1, RoundType=0)  # -> Rounded, Difference
larger = LargerThan(FirstNumber=roundd.Rounded, SecondNumber=0.4)  # -> LargerThan, OrEqualTo
bool_2 = Boolean(True)
mindex_2 = MemberIndex(Set=larger.OrEqualTo, Member=bool_2)  # -> flatten(Index), Count
extremums = MinMax(Number=mindex_2.Index)  # -> Minimum, Maximum
x_plus_one_2 = XPlusOne(NumberX=extremums.Maximum)
split = SplitList(List=packcirclesalongtwopaths, Index=x_plus_one_2)  # -> ListA, ListB

# ---- group: Accent Stones / Calculate accent stones base (continued)
accent_stones_base = Circle(split.ListA)

# ---- group: Accent Stones / Get Accent Stones Transformations
accent_stones_base_2 = Circle(accent_stones_base)
darc_2 = DeconstructArc(Arc=accent_stones_base_2)  # -> BasePlane, Radius, Angle
mirror_4 = Mirror(Plane=PlaneYZ(0, 0, 0))  # -> Geometry, Transform
multiplication_2 = Multiplication(A=darc_2.Radius, B=2)
zerotran_2 = ZeroedTransform()
merge_14 = Merge(Data1=zerotran_2, Data2=mirror_4.Transform)  # -> graft(Result)
orient_2 = Orient(Source=PlaneXY(0, 0, 0), Target=darc_2.BasePlane)  # -> Geometry, Transform
scale_3 = Scale(Center=Point(0, 0, 0), Factor=multiplication_2)  # -> Geometry, Transform
empty = EmptyObjectToEmptyBranch(DataIn=flatten(orient_2.Transform))
long_2 = LongestList(ListA=scale_3.Transform, ListD=orient_2.Transform, ListB=merge_14, PaddingMode=2)  # -> ListA, ListD, ListB
lng = ListLength(List=empty)
merge_15 = Merge(Data1=graft(long_2.ListA), Data2=graft(long_2.ListD), Data3=graft(long_2.ListB))
bool_3 = Boolean(lng)
mirror_5 = Mirror(Plane=PlaneXZ(0, 0, 0))  # -> Geometry, Transform
comp = Compound(Transforms=merge_15)
long_3 = LongestList(ListA=comp, ListB=mirror_5.Transform, PaddingMode=2)  # -> ListA, ListB
merge_16 = Merge(Data1=long_3.ListA, Data2=long_3.ListB)
comp_2 = Compound(Transforms=merge_16)
merge_17 = Merge(Data1=comp, Data2=comp_2)
filter_12 = StreamFilter(Gate=bool_3, Stream1=flatten(merge_17))
accent_stones_transformations = Transform(filter_12)

# ---- group: Display Ring
head_mesh_3 = Mesh(head_mesh)
center_shank_4 = Mesh(center_shank_3)
side_shank_2 = Mesh(side_shank)
base_basket_geometry = Mesh(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)
base_accent_stone_geometry = Mesh(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)
accent_stones_transformations_2 = Transform(accent_stones_transformations)
materials_sections_names_3 = Text(materials_sections_names)

item_10 = ListItem(List=head_mesh_3, Index=0, Wrap=True)  # -> Item, Item1
attachtransform_2 = AttachTransformations(Geometry=base_basket_geometry, Transform=accent_stones_transformations_2)
merge_18 = Merge(Data1=item_10.Item1, Data2=center_shank_4)
merge_19 = Merge(Data1=side_shank_2, Data2=attachtransform_2)
attachtransform_3 = AttachTransformations(Geometry=base_accent_stone_geometry, Transform=accent_stones_transformations_2)
entwine = Entwine(Branch00=item_10.Item, Branch01=merge_18, Branch02=merge_19, Branch03=attachtransform_3, FlattenInputs=True)  # -> simplify(Result)
create_material_only_with_name = CreateMaterialOnlyWithName(N=materials_sections_names_3)
ring_all_meshes = Mesh(entwine)
ring_2 = GlTF20Display(Geometry=entwine, Material=create_material_only_with_name)

# ---- group: Calculate metal price (continued)
ring_all_meshes_2 = Mesh(ring_all_meshes)

split_2 = SplitTree(Data=ring_all_meshes_2, Masks="{0}")  # -> Positive, graft(Negative)
volume = MeshVolume(Mesh=split_2.Negative)  # -> Volume, Centroid
abs = Absolute(Value=volume.Volume)

# ---- group: Calculate metal price / Get how much the geometry was scaled
accesskey = AccessKey(Object=split_2.Negative, Key="transform")
clean_2 = CleanTree(RemoveNulls=True, RemoveInvalid=False, RemoveEmpty=True, Tree=accesskey)
explodestransformlist = ExplodeTransformList(TransformList=clean_2)
dematrix = DeconstructMatrix(Matrix=explodestransformlist)  # -> Rows, Columns, Values
item_11 = ListItem(List=dematrix.Values, Index=0, Wrap=True)  # -> Item, Item1, Item2
vec = VectorXYZ(XComponent=item_11.Item, YComponent=item_11.Item1, ZComponent=item_11.Item2)  # -> Vector, Length
trim = TrimTree(Tree=vec.Length, Depth=2)

# ---- group: Calculate metal price (continued)
add_unmatched = AddUnmatched(Data0=abs, Data1=trim, nullPath=False)  # -> Data0, Data1
multiplication_3 = Multiplication(A=add_unmatched.Data0, B=add_unmatched.Data1)
flatten = FlattenTree(Tree=multiplication_3, Path="{0}")
ma = MassAddition(Input=flatten)  # -> Result, PartialResults
multiplication_4 = Multiplication(A=price_per_gram_2, B=ma.Result)
ring_price = RoundToDecimalPlace(NumberX=multiplication_4, DecimalPlace=2, RoundType=0)  # -> Rounded, Difference

# ---- group: UI (continued)
ring_price_2 = Number(ring_price.Rounded)

concat = Concatenate(FragmentA="**Price: $", FragmentB=ring_price_2, FragmentC="**")
addtocart = AddToCartAction(Price=ring_price_2, Description=ring_description)
textwidget = TextWidget(Text=concat)
merge_20 = Merge(Data1=addtocart, Data2=createmodelstate, Data3=paramwidget, Data4=textwidget, Data5=rejson_2, Data6=filter_8)
container = Container(Name="right", Widgets=merge_20)
app = App(Containers=container)

# ---- group: Download Watertight Mesh
ring_all_meshes_3 = Mesh(ring_all_meshes)
watertight_mesh_file_format_2 = Integer(watertight_mesh_file_format)
process_watertight_mesh_3 = Boolean(process_watertight_mesh)
watertight_mesh_edge_length_2 = Number(watertight_mesh_edge_length)
receiver_email_of_watertight_mesh_2 = Text(receiver_email_of_watertight_mesh)
ring_description_2 = Text(ring)
ring_price_3 = Number(ring_price.Rounded)

filter_13 = StreamFilter(Gate=process_watertight_mesh_3, Stream1=ring_all_meshes_3)
concat_2 = Concatenate(FragmentD=ring_description_2, FragmentA=" $", FragmentB=ring_price_3)
panel_7 = Panel("""1
2""")
zerotran_3 = ZeroedTransform()
exportobj = ObjExportOptions(
    EndOfLine="CRLF",
    YUp=True,
    WrapLongLines=False,
    WritePrecision=17,
    ExportRhinoObjectNames="DoNotExportObjectNames",
    N=False)
export3dm = _3dmExportOptions(Version=8)
exportstl = StlExportOptions(FileFormat="Binary", N=False)
filter_14 = StreamFilter(Gate=watertight_mesh_file_format_2, Stream0=export3dm, Stream1=exportstl, Stream2=exportobj)

# ----
branch = TreeBranch(Tree=filter_13, Path=panel_7, MaintainPaths=True)

# ---- group: Download Watertight Mesh (continued)
accesskey_2 = AccessKey(Object=branch, Key="transform")
explodestransformlist_2 = ExplodeTransformList(TransformList=accesskey_2)
nulls_in_empty_2 = NullsInEmptyBranches(DataWithEmptyBranches=explodestransformlist_2)
nullrep = ReplaceNulls(Items=nulls_in_empty_2, Replacements=zerotran_3)  # -> Items, Count
transform = Transform(Geometry=graft(branch), Transform=nullrep.Items)  # -> flatten(Geometry)
wrap = ShrinkWrap(Geometry=transform, EdgeLength=watertight_mesh_edge_length_2, Offset=0, Smoothing=0, Optimization=100, FillHoles=True)
email_watertight_mesh = EmailExport(
    Data=wrap,
    Options=filter_14,
    Name=concat_2,
    To=receiver_email_of_watertight_mesh_2,
    Subject=concat_2,
    Body="__PARAMS__",
    AttachExport=True,
    AttachJSON=False)
download_watertight_mesh = DownloadExport(Data=wrap, Options=filter_14, Name=concat_2)

# ==== cluster CenterShank
start_thickness = ClusterInput()
end_thickness = ClusterInput()
section = ClusterInput()
rail = ClusterInput()
dom = ConstructDomain(StartThickness=start_thickness, EndThickness=end_thickness)
topoly = CurveToPolyline(Curve=rail, ToleranceDistance=0.005, ToleranceAngle=0)  # -> Polyline, Segments
disc = Discontinuity(Curve=topoly.Polyline, Level=1)  # -> Points, Parameters
trim = TrimTree(Tree=disc.Parameters, Depth=1)
eval = EvaluateCurve(Curve=rail, Parameter=trim)  # -> Point, Tangent, Angle
graph = GraphMapper(
    trim,
    x0=0,
    x1=1,
    y0=0,
    y1=1,
    container_name="Bezier",
    cpx=[0, 0.0007412675768, 0.6550748348, 1],
    cpy=[0, 0.5333207846, 1, 1])
slideindom = SlideWithinDomain(Domain=dom, Factor=graph)
xprod = CrossProduct(VectorA=Vector(0, 1, 0), VectorB=eval.Tangent, Unitize=False)  # -> Vector, Length
sections_size = ClusterOutput(slideindom)
pl = ConstructPlane(Origin=eval.Point, XAxis=Vector(0, 1, 0), YAxis=xprod.Vector)
scale = Scale(Geometry=section, Center=Point(0, 0, 0), Factor=slideindom)  # -> Geometry, Transform
orient = Orient(Geometry=scale.Geometry, Source=PlaneXY(0, 0, 0), Target=pl)  # -> Geometry, Transform
loftmesh = LoftMesh(Polylines=orient.Geometry, ComputeUV=False, IsometricUV=False, UVSize=1)
crv = Curve(orient.Geometry)
wireframe = ClusterOutput(crv)
M = ClusterOutput(loftmesh)
pl_2 = ClusterOutput(pl)

# ==== cluster StandarizeText
T = ClusterInput()
split = TextSplit(Text=T, Separators=" ")
trim = TextTrim(Text=split, Start=True, End=True)
join = TextJoin(Text=trim)
case = TextCase(Text=join, Culture=127)  # -> UpperCase, LowerCase
trim_2 = TrimTree(Tree=case.LowerCase, Depth=1)
T_2 = ClusterOutput(trim_2)

# ==== cluster CreateMaterialOnlyWithName
N = ClusterInput()
gltf2material = GlTF20Material(
    Name=N,
    BaseColorFactor=RGB(255, 255, 255),
    MetallicFactor=1,
    RoughnessFactor=0.5,
    EmissiveFactor=RGB(0, 0, 0),
    AlphaMode="OPAQUE",
    AlphaCutoff=0.5,
    DoubleSided=True)
M = ClusterOutput(gltf2material)

# ==== cluster PackCirclesAlongTwoPaths
distribute = ClusterInput()
tolerance = ClusterInput()
crva = ClusterInput()
crvb = ClusterInput()
gap = ClusterInput()
sizes = ClusterInput()
crva_2 = Curve(crva)
crvb_2 = Curve(crvb)
gap_2 = Number(gap)
sizes_2 = Number(sizes)
distribute_2 = Boolean(distribute)
tolerance_2 = Number(tolerance)
c_script = CSharpScript(CrvA=crva_2, CrvB=crvb_2, Gap=gap_2, Sizes=sizes_2, Distribute=distribute_2, Tolerance=tolerance_2)  # -> out, Circles; inputs CrvA: Curve, CrvB: Curve, Gap: Double, Sizes: list of Double, Distribute: Boolean, Tolerance: Double
# ---------- c_script: C# usings ----------
using System.Linq;
# ---------- c_script: C# ----------
    double totalRemainingSpace;
    var nurbsA = CrvA.ToNurbsCurve();
    nurbsA = nurbsA.Rebuild(nurbsA.Points.Count * 10, nurbsA.Degree, true);
    var nurbsB = CrvB.ToNurbsCurve();
    nurbsB = nurbsB.Rebuild(nurbsB.Points.Count * 10, nurbsB.Degree, true);
    var newDomain = new Interval(0, Math.Max(CrvA.GetLength(), CrvB.GetLength()));
    nurbsA.Domain = newDomain;
    nurbsB.Domain = newDomain;
    string errors = "";
    var circles = FitCirclesInCurves(nurbsA, nurbsB, 0, Gap, -1, -1, Tolerance, Sizes, out totalRemainingSpace, out errors);
    Print(errors);
    //Print(totalRemainingSpace.ToString());
    if(Distribute && circles.Count>0)
    {
      double finalGap = totalRemainingSpace / circles.Count;
      Print(circles.Count.ToString());
      //finalGap * 0.5
      //circles = FitCirclesInCurves(nurbsA, nurbsB, 0, 0, totalRemainingSpace, circles.Count, Sizes, out totalRemainingSpace);
      circles = FitCirclesInCurves(nurbsA, nurbsB, finalGap * 0.5, finalGap, totalRemainingSpace, circles.Count, Tolerance * 10, Sizes, out totalRemainingSpace, out errors);
    Print(errors);
    }

    Circles = circles;
# ---------- c_script: C# additional code ----------
  public static List<Circle> FitCirclesInCurves(NurbsCurve CrvA, NurbsCurve CrvB, double start, double gap, double potentialRemainingSpace, double aimAmount, double tolerance, List<double> sizes, out double totalRemainingSpace, out string errors)
  {
    errors = "";
    List<Circle> circles = new List<Circle>();
    totalRemainingSpace = 0;

    double lengthA = CrvA.GetLength();
    double lengthB = CrvB.GetLength();
    bool isALongest = lengthA > lengthB;
    double length = isALongest ? lengthA : lengthB;
    double previousParamAEnd = -1;
    double previousParamBEnd = -1;
    double previousParamX = -1;
    Point3d previousPnt = Point3d.Unset;

    Curve previousCircle = null;

    int counter = 0;
    while (true)
    {
      counter++;
      Circle circle;
      //if(aimAmount > 0)gap = (potentialRemainingSpace - totalRemainingSpace) / (aimAmount - circles.Count + (circles.Count == 0 ? 0 : 1));
      if (previousCircle == null)
      {
        Point3d pntA = CrvA.PointAtStart;
        Point3d pntB = CrvB.PointAtStart;
        Vector3d vectorX = new Vector3d(pntA.X - pntB.X, pntA.Y - pntB.Y, pntA.Z - pntB.Z);

        //double startt = aimAmount > 0 ? gap / 2 : 0;
        double startRadius = (vectorX.Length * 0.5) + start;
        //totalRemainingSpace += startt;
        
        circle = Circle.TryFitCircleTT(CrvA, CrvB, startRadius, startRadius);

        if (!circle.IsValid)break;

        Plane circlePlane = circle.Plane;

        double tA,tB;
        CrvA.ClosestPoint(circlePlane.Origin, out tA);
        CrvB.ClosestPoint(circlePlane.Origin, out tB);
        double alignAngle = Vector3d.VectorAngle(circlePlane.YAxis, (CrvA.TangentAt(tA) + CrvB.TangentAt(tB)) / 2, circlePlane);

        if(alignAngle != 0)
        {
          if(circlePlane.Rotate(alignAngle, circlePlane.Normal))circle.Plane = circlePlane;
        }
      }
      else
      {
        Point3d pntA = CrvA.PointAt(previousParamAEnd);
        Point3d pntB = CrvB.PointAt(previousParamBEnd);

        Point3d origin = (pntA + pntB) * 0.5;

        Vector3d vectorX = new Vector3d(pntA.X - pntB.X, pntA.Y - pntB.Y, pntA.Z - pntB.Z);
        Vector3d vectorY = (CrvA.TangentAt(previousParamAEnd) + CrvB.TangentAt(previousParamBEnd)) * 0.5;

        double paramAEnd = previousParamAEnd;
        double paramBEnd = previousParamBEnd;

        if(gap > 0)
        {
          Plane startPln = new Plane(origin, vectorX, vectorY);

          paramAEnd += gap;
          paramBEnd += gap;
          pntA = CrvA.PointAt(paramAEnd);
          pntB = CrvB.PointAt(paramBEnd);

          origin = (pntA + pntB) * 0.5;

          vectorX = new Vector3d(pntA.X - pntB.X, pntA.Y - pntB.Y, pntA.Z - pntB.Z);
          vectorY = (CrvA.TangentAt(paramAEnd) + CrvB.TangentAt(paramBEnd)) * 0.5;

          Plane endPln = new Plane(origin, vectorX, vectorY);

          previousCircle.Transform(Transform.PlaneToPlane(startPln, endPln));
        }

        double potentialDiameter = FindClosestBelow(sizes, vectorX.Length);
        if(potentialDiameter == -1)potentialDiameter = vectorX.Length;
        double potentialRadius = vectorX.Length * 0.5;

        double testLength = (isALongest ? paramAEnd : paramBEnd) + potentialDiameter - (potentialDiameter * tolerance);
        if(aimAmount <= 0 && (testLength < (isALongest ? previousParamAEnd : previousParamBEnd) || testLength >= length))
          break;
        else
        {
          paramAEnd += potentialRadius;
          paramBEnd += potentialRadius;
        }
/*
        double testLengthB = paramBEnd + potentialDiameter - (potentialDiameter * tolerance);
        if(aimAmount <= 0 && (testLengthB < previousParamBEnd || testLengthB >= lengthB))
          break;
        else
          paramBEnd += potentialRadius;
*/
          circle = Circle.TryFitCircleTT(CrvA, CrvB, paramAEnd, paramBEnd);
        //circle = Circle.TryFitCircleTTT(CrvA, CrvB, previousCircle, paramAEnd, paramBEnd, previousParamX);

        if(tolerance > 0 && !circle.IsValid)
        {
          Curve extendCrvA = CrvA.DuplicateCurve().Extend(CurveEnd.End, potentialRadius, CurveExtensionStyle.Smooth);
          Curve extendCrvB = CrvB.DuplicateCurve().Extend(CurveEnd.End, potentialRadius, CurveExtensionStyle.Smooth);
          //circle = Circle.TryFitCircleTTT(extendCrvA, extendCrvB, previousCircle, paramAEnd, paramBEnd, previousParamX);
          circle = Circle.TryFitCircleTT(extendCrvA, extendCrvB, paramAEnd, paramBEnd);
        }
        if(!circle.IsValid)break;

        Plane circlePlane = circle.Plane;
        double tA,tB;
        CrvA.ClosestPoint(circlePlane.Origin, out tA);
        CrvB.ClosestPoint(circlePlane.Origin, out tB);
        double alignAngle = Vector3d.VectorAngle(circlePlane.YAxis, (CrvA.TangentAt(tA) + CrvB.TangentAt(tB)) / 2, circlePlane);

        if(alignAngle != 0)
        {
          //if(circlePlane.Rotate(alignAngle, circlePlane.Normal) && circlePlane.Transform(Transform.Mirror(circlePlane.Origin, circlePlane.YAxis)))circle.Plane = circlePlane;
          if(circlePlane.Rotate(alignAngle, circlePlane.Normal))circle.Plane = circlePlane;
        }
      }

      if(sizes.Count > 0)
      {
        double originalDiameter = circle.Diameter;
        double newDiameter = FindClosestBelow(sizes, originalDiameter);
        if(newDiameter != -1)
        {
          double paramA,paramB,param;
          var curve = circle.ToNurbsCurve();
          curve.LengthParameter(curve.GetLength() * 0.75, out param);
          Point3d pt = curve.PointAt(param);

          CrvA.ClosestPoint(pt, out paramA);
          CrvB.ClosestPoint(pt, out paramB);

          Point3d pntA = CrvA.PointAt(paramA);
          Point3d pntB = CrvB.PointAt(paramB);

          Point3d origin = (pntA + pntB) * 0.5;

          Vector3d vectorX = new Vector3d(pntA.X - pntB.X, pntA.Y - pntB.Y, pntA.Z - pntB.Z);
          Vector3d vectorY = (CrvA.TangentAt(paramA) + CrvB.TangentAt(paramB)) * 0.5;

          Plane endPln = new Plane(origin, vectorX, vectorY);

          circle.Diameter = newDiameter;
          curve = circle.ToNurbsCurve();
          curve.LengthParameter(curve.GetLength() * 0.75, out param);
          pt = curve.PointAt(param);

          CrvA.ClosestPoint(pt, out paramA);
          CrvB.ClosestPoint(pt, out paramB);

          pntA = CrvA.PointAt(paramA);
          pntB = CrvB.PointAt(paramB);

          origin = (pntA + pntB) * 0.5;

          vectorX = new Vector3d(pntA.X - pntB.X, pntA.Y - pntB.Y, pntA.Z - pntB.Z);
          vectorY = (CrvA.TangentAt(paramA) + CrvB.TangentAt(paramB)) * 0.5;

          Plane startPln = new Plane(origin, vectorX, vectorY);

          circle.Transform(Transform.PlaneToPlane(startPln, endPln));
        }
      }

      if(previousCircle != null)
      {
        double currentParam;
        var currentCircle = circle.ToNurbsCurve();
        currentCircle.LengthParameter(currentCircle.GetLength() * 0.75, out currentParam);
        Point3d currentPnt = currentCircle.PointAt(currentParam);

        Vector3d correctionVec = new Vector3d(previousPnt.X - currentPnt.X, previousPnt.Y - currentPnt.Y, previousPnt.Z - currentPnt.Z);
        double correctionDistance = correctionVec.Length - gap;
        if(Math.Abs(correctionDistance) > 0.01)
        {
          correctionVec.Unitize();
          circle.Translate(correctionVec * correctionDistance);
        }
      }
      else
      {

      }

      {
        if(previousCircle != null)
        {
          double currentParam;
          var currentCircle = circle.ToNurbsCurve();
          currentCircle.LengthParameter(currentCircle.GetLength() * 0.75, out currentParam);
          Point3d currentPnt = currentCircle.PointAt(currentParam);

          totalRemainingSpace += currentPnt.DistanceTo(previousPnt);
        }

        previousCircle = circle.ToNurbsCurve();
        previousCircle.LengthParameter(previousCircle.GetLength() * 0.25, out previousParamX);
        previousPnt = previousCircle.PointAt(previousParamX);

        CrvA.ClosestPoint(previousPnt, out previousParamAEnd);
        CrvB.ClosestPoint(previousPnt, out previousParamBEnd);
      }

      circles.Add(circle);
      if((aimAmount > 0 && circles.Count == aimAmount) || counter > 100)break;
    }

    //totalRemainingSpace = previousParamAEnd;
    totalRemainingSpace += (CrvA.GetLength(new Interval(previousParamAEnd, CrvA.Domain.Max)) + CrvB.GetLength(new Interval(previousParamBEnd, CrvB.Domain.Max))) * 0.5;

    return circles;
  }

  public static double FindClosestBelow(List<double> numbers, double threshold)
  {
    if(numbers.Count == 0)return -1;

    // Filter numbers below the threshold
    var belowThreshold = numbers.Where(n => n < threshold);

    // Return false if no numbers found below threshold
    if (!belowThreshold.Any())return -1;

    // Find the number closest to the threshold
    return belowThreshold.Aggregate((current, next) => Math.Abs(next - threshold) < Math.Abs(current - threshold) ? next : current);
  }
# ---------- end c_script ----------
circle = Circle(c_script.Circles)
circle_2 = ClusterOutput(circle)
